vi "Function.gvi"   [G Web Development Software 22.3.0]
inputs:
  "string in": string
  "Error Cluster Constant": error
outputs:
  "Output": string[]
  "Output_error": error
uses:
  NI::G Core::Strings::Search and Replace Pattern.gvi
  NI::G Core::Strings::Trim Whitespace.gvi
diagram:
  s1 = ""  # shift register
  s2 = string[] []  # shift register
  while (iteration -> i1) {
    case (i1) {
      frame 0 {
        w1 = $"string in"
      }
      frame 1, Default {
        w1 = s1
      }
    }
    Match Pattern(regular expression="Start", string=w1) -> (after substring=w2)
    call "Search and Replace Pattern.gvi"(string=w2, pattern="]", replace string="") -> (result string=w3)
    call "Trim Whitespace.gvi"(string=w3) -> (trimmed string=w4)
    Match Pattern(regular expression="End", string=w4) -> (after substring=w5, before substring=w6, match substring=w7)
    Search Or Split String(search string/char="[", string=w6) -> (substring before match=w8)
    call "Trim Whitespace.gvi"(string=w8) -> (trimmed string=w9)
    Insert Into Array(inArray=s2, new=w9) -> w10
    Is Empty String Or Path(string/path=w7) -> w11
    next s1 = w5
    next s2 = w10
    stop if w11
  }
  $Output <- s2
  $Output_error <- $"Error Cluster Constant"
