vi "Add_BMK_to_Comment_iVario.gviweb"   [G Web Development Software 22.3.0]
inputs:
  "BMKs": string[]
  "Input": error
  "Parameter name": string
outputs:
  "Output": error
  "Changed Component": string
uses:
  NI::G Core::Strings::Trim Whitespace.gvi
  NI::G Core::Strings::Search and Replace Pattern.gvi
diagram:
  w1 = "may have been replaced:\nFurther details can be found in the component \nreplacement history (page 2)."
  call "Trim Whitespace.gvi"(string=$"Parameter name") -> (trimmed string=w2)
  # board may have been replaced:
  # Automatic detection of a change in the serial number).
  # Further details can be found in the
  # component replacement history (page 3).
  # has been replaced.
  # For further details, please refer to the component
  # replacement history (Page 3).
  for {
    w3 = each element of $BMKs
    case (w3) {
      frame "False", Default {
        w4 = ""
        w5 = FALSE
      }
      frame "A10" {
        case (w2) {
          frame "False", Default {
            w4 = ""
            w5 = FALSE
          }
          frame "IO-Board Serial number" {
            Concatenate Strings("⚠️ Automatic detection of changes to the serial \nnumber.", " ", w2, " ", w1) -> w6
            call "Search and Replace Pattern.gvi"(string=w6, pattern="Serial number") -> (result string=w4)
            w5 = TRUE
          }
        }
      }
      frame "A11" {
        case (w2) {
          frame "False", Default {
            w4 = ""
            w5 = FALSE
          }
          frame "CPU-Board Serial number" {
            Concatenate Strings("⚠️ Automatic detection of changes to the serial \nnumber.", " ", w2, " ", w1) -> w7
            call "Search and Replace Pattern.gvi"(string=w7, pattern="Serial number") -> (result string=w4)
            w5 = TRUE
          }
        }
      }
    }
    stop if w5
  }
  $"Changed Component" <- w4
  $Output <- $Input
