vi "Change_Parameter_Solenoid_Valve.gviweb"   [G Web Development Software 22.3.0]
inputs:
  "Error input": error
  "Comment in": string
  "Parameter Name": string
  "Value": string
outputs:
  "Output": error
  "Comment out": string
diagram:
  case ($"Parameter Name") {
    frame "False", Default {
      case ($Value) {
        frame Default {
          w2 = $"Error input"
          w1 = $"Comment in"
        }
        frame "true" {
          Concatenate Strings("✅ \"false\" --> ", $"Parameter Name", " closed ", "| \"true\" --> ", $"Parameter Name", " open") -> w1
          w2 = $"Error input"
        }
        frame "false" {
          Concatenate Strings("✅ \"false\" --> ", $"Parameter Name", " closed ", "| \"true\" --> ", $"Parameter Name", " open") -> w1
          w2 = $"Error input"
        }
      }
    }
    frame "Level Electrode S2" {
      case ($Value) {
        frame Default {
          w2 = $"Error input"
          w1 = $"Comment in"
        }
        frame "true" {
          w2 = $"Error input"
          w1 = "✅ \"true\" --> water in contact with level electrode."
        }
        frame "false" {
          w2 = $"Error input"
          w1 = "✅ \"false\" --> no water in contact with level electrode."
        }
      }
    }
  }
  $Output <- w2
  $"Comment out" <- w1
