vi "Delete_Duplikate_from_Array.gviweb"   [G Web Development Software 22.3.0]
inputs:
  "BMKs": string[]
  "Error Cluster input": error
outputs:
  "output": error
  "Output BMK": string[]
diagram:
  Array Index(array=$BMKs) -> (out0[_]=w1)
  Initialize Array(element=w1, size=0) -> w2
  s1 = w2  # shift register
  for {
    w3 = each element of $BMKs
    Search 1D Array(1D array=s1, element=w3) -> (index of element=w4)
    case (w4) {
      frame -1 {
        Build Array(s1, w3) -> w5
      }
      frame Default {
        w5 = s1
      }
    }
    next s1 = w5
  }
  $"Output BMK" <- s1
  $output <- $"Error Cluster input"
