vi "Diagnostic_Service_History.gviweb"   [G Web Development Software 22.3.0]
inputs:
  "Diagnostic Service History Entrys": string[]
  "Error Cluster input": error
  "Device Type": string = "Device"
outputs:
  "Error Output": error
  "Diagnostic Service History Output": T1[]
types:
  T1 = cluster{"Parameter Name": string, "First Time": string, "Last Time": string, "Quantity": string, "Comment": string}
uses:
  NI::G Core::Strings::Trim Whitespace.gvi
  NI::G Core::Strings::Search and Replace Pattern.gvi
  WebApp::Change_to_validate_Date.gvi
  WebApp::Find_Service_Error_Name.gviweb
diagram:
  for {
    w1 = each element of $"Diagnostic Service History Entrys"
    Match Pattern(regular expression="First_Time=", string=w1) -> (after substring=w3, before substring=w4)
    call "Trim Whitespace.gvi"(string=w4) -> (trimmed string=w5)
    Match Pattern(regular expression=" Last_Time=", string=w3) -> (after substring=w6, before substring=w7)
    call "Search and Replace Pattern.gvi"(String=w7, Muster="\"", Alle ersetzen=TRUE) -> (Ergebnis-String=w8)
    call "Trim Whitespace.gvi"(string=w8) -> (trimmed string=w9)
    call "Change_to_validate_Date.gvi"(Date_Time_String input=w9, Error Cluster input=$"Error Cluster input") -> (Validate date and time=w10, Error Cluster output=w11)
    Match Pattern(regular expression="Quantity=", string=w6) -> (after substring=w12, before substring=w13)
    call "Search and Replace Pattern.gvi"(String=w13, Muster="\"", Alle ersetzen=TRUE) -> (Ergebnis-String=w14)
    call "Trim Whitespace.gvi"(string=w14) -> (trimmed string=w15)
    call "Change_to_validate_Date.gvi"(Date_Time_String input=w15, Error Cluster input=w11) -> (Validate date and time=w16, Error Cluster output=w17)
    call "Search and Replace Pattern.gvi"(String=w12, Muster="\"", Alle ersetzen=TRUE) -> (Ergebnis-String=w18)
    call "Trim Whitespace.gvi"(string=w18) -> (trimmed string=w19)
    Property Node(instance in=T1 {all zero or empty}, "Parameter Name"=w5, "First Time"=w10, "Last Time"=w16, "Quantity"=w19) -> (instance out=w20)
    append w20 to w2
  }
  s1 = T1[] []  # shift register
  for {
    w21 = each element of w2
    Property Node(instance in=w21) -> ("Quantity"=w22)
    call "Search and Replace Pattern.gvi"(string=w22, pattern="\"", replace all=TRUE) -> (result string=w23)
    String Length(string=w23) -> (length=w24)
    Is Greater Than 0(x=w24) -> w25
    case (w25) {
      frame False {
        w26 = s1
      }
      frame True {
        Insert Into Array(inArray=s1, new=w21) -> w26
      }
    }
    next s1 = w26
  }
  for {
    w27 = each element of s1
    Property Node(instance in=w27) -> ("Quantity"=w29, "Comment"=w30, "Parameter Name"=w31)
    Floating Point String To Number(default (0 DBL)=0, string=w29, use system decimal point (T)=TRUE) -> (number=w32)
    Is Greater Or Equal(x=w32, y=10) -> w33
    case (w33) {
      frame False, Default {
        Is Equal To 0(x=w32) -> w37
        case (w37) {
          frame False, Default {
            w35 = w30
          }
          frame True {
            Property Node(instance in=w27, "Comment"="⚠️ The service error has been reset.") -> ("Comment"=w35)
          }
        }
        w34 = w27
        w36 = w17
      }
      frame True {
        Is Greater Or Equal(x=w32, y=25) -> w38
        case (w38) {
          frame False, Default {
            w39 = "❌"  # String {0}
            Concatenate Strings(w39, " ", "The quantity exceeds 10!") -> w40
            Property Node(instance in=w27, "Comment"=w40) -> ("Comment"=w35)
          }
          frame True {
            w41 = "❌"  # String {0}
            Concatenate Strings(w41, " ", "The quantity exceeds 25!") -> w42
            Property Node(instance in=w27, "Comment"=w42) -> ("Comment"=w35)
          }
        }
        w34 = w27
        w36 = w17
      }
    }
    call "Find_Service_Error_Name.gviweb"(Service Error ID=w31, Output_2=w36) -> (Service name=w43, Output=w44)
    Concatenate Strings(w35, "\r\n", w43) -> w45
    call "Trim Whitespace.gvi"(string=w45) -> (trimmed string=w46)
    Property Node(instance in=w34, "Comment"=w46) -> (instance out=w47)
    append w47 to w28
  }
  $"Diagnostic Service History Output" <- w28
  $"Error Output" <- w44
