vi "Display_Information_In_Tabular_Form.gviweb"   [G Web Development Software 22.3.0]
inputs:
  "All infos": string[]
  "Error in": error
outputs:
  "Error out": error
  "Output infos": T1[]
  "General infos": cluster{"Entry": string, "Information": string}[]
panel controls:
  "Get all charge": string[]
types:
  T1 = cluster{"eventId": string, "eventType": string, "identifier": string, "muid": string, "time": string}
uses:
  NI::G Core::Strings::Search and Replace Pattern.gvi
  NI::G Core::Strings::Trim Whitespace.gvi
diagram:
  s1 = string[] []  # shift register
  s2 = string[] []  # shift register
  for (iteration -> i1) {
    w1 = each element of $"All infos"
    case (i1) {
      frame 0 {
        Insert Into Array(inArray=s1, new=w1) -> w2
        w3 = s2
      }
      frame 1, Default {
        Insert Into Array(inArray=s2, new=w1) -> w3
        w2 = s1
      }
    }
    next s1 = w2
    next s2 = w3
  }
  for {
    w4 = each element of s1
    Match Pattern(regular expression="swVersion", string=w4) -> (after substring=w5)
    Match Pattern(regular expression="serialNumber", string=w5) -> (before substring=w6)
    call "Search and Replace Pattern.gvi"(string=w6, pattern="\"", replace all=TRUE) -> (result string=w7)
    call "Search and Replace Pattern.gvi"(string=w7, pattern=":", replace all=TRUE) -> (result string=w8)
    call "Search and Replace Pattern.gvi"(string=w8, pattern=",", replace all=TRUE) -> (result string=w9)
    call "Trim Whitespace.gvi"(string=w9) -> (trimmed string=w10)
    Match Pattern(regular expression="serialNumber", string=w4) -> (after substring=w11)
    Match Pattern(regular expression="timezone", string=w11) -> (before substring=w12)
    call "Search and Replace Pattern.gvi"(string=w12, pattern="\"", replace all=TRUE) -> (result string=w13)
    call "Search and Replace Pattern.gvi"(string=w13, pattern=":", replace all=TRUE) -> (result string=w14)
    call "Search and Replace Pattern.gvi"(string=w14, pattern=",", replace all=TRUE) -> (result string=w15)
    call "Trim Whitespace.gvi"(string=w15) -> (trimmed string=w16)
    Match Pattern(regular expression="timezone", string=w4) -> (after substring=w17)
    Match Pattern(regular expression="createdAt", string=w17) -> (before substring=w18)
    call "Search and Replace Pattern.gvi"(string=w18, pattern="\"", replace all=TRUE) -> (result string=w19)
    call "Search and Replace Pattern.gvi"(string=w19, pattern=":", replace all=TRUE) -> (result string=w20)
    call "Search and Replace Pattern.gvi"(string=w20, pattern=",", replace all=TRUE) -> (result string=w21)
    call "Trim Whitespace.gvi"(string=w21) -> (trimmed string=w22)
    Match Pattern(regular expression="createdAt", string=w4) -> (after substring=w23)
    Match Pattern(regular expression="events", string=w23) -> (before substring=w24)
    call "Search and Replace Pattern.gvi"(string=w24, pattern="\"", replace all=TRUE) -> (result string=w25)
    call "Search and Replace Pattern.gvi"(string=w25, pattern=":", replace all=TRUE) -> (result string=w26)
    call "Search and Replace Pattern.gvi"(string=w26, pattern=",", replace all=TRUE) -> (result string=w27)
    call "Trim Whitespace.gvi"(string=w27) -> (trimmed string=w28)
  }
  Insert Into Array(inArray=string[] [], new=w10, new=w16, new=w22, new=w28) -> w29
  w30 = ["Software version", "Serial number", "Timezone", "Timeline"]
  for {
    w31 = each element of w30
    w32 = each element of w29
    w34 = cluster{"Entry": string, "Information": string} {all zero or empty}
    Property Node(instance in=w34, "Entry"=w31, "Information"=w32) -> (instance out=w35)
    append w35 to w33
  }
  $"General infos" <- w33
  # "eventId":2,"eventType":"start","identifier":"S_52_1","muid":4,"time":1751434091},
  for {
    w36 = each element of s2
    Match Pattern(regular expression="eventId\":", string=w36) -> (after substring=w38)
    Match Pattern(regular expression=",\"eventType", string=w38) -> (before substring=w39)
    call "Search and Replace Pattern.gvi"(string=w39, pattern=",\"", replace all=TRUE) -> (result string=w40)
    call "Trim Whitespace.gvi"(string=w40) -> (trimmed string=w41)
    Match Pattern(regular expression=",\"eventType", string=w36) -> (after substring=w42)
    Match Pattern(regular expression=",\"identifier", string=w42) -> (before substring=w43)
    call "Search and Replace Pattern.gvi"(string=w43, pattern="\"", replace all=TRUE) -> (result string=w44)
    call "Search and Replace Pattern.gvi"(string=w44, pattern=":", replace all=TRUE) -> (result string=w45)
    call "Trim Whitespace.gvi"(string=w45) -> (trimmed string=w46)
    Match Pattern(regular expression=",\"identifier", string=w36) -> (after substring=w47)
    Match Pattern(regular expression=",\"muid", string=w47) -> (before substring=w48)
    call "Search and Replace Pattern.gvi"(string=w48, pattern="\"", replace all=TRUE) -> (result string=w49)
    call "Search and Replace Pattern.gvi"(string=w49, pattern=":", replace all=TRUE) -> (result string=w50)
    call "Trim Whitespace.gvi"(string=w50) -> (trimmed string=w51)
    Match Pattern(regular expression=",\"muid", string=w36) -> (after substring=w52)
    Match Pattern(regular expression=",\"time", string=w52) -> (after substring=w53, before substring=w54)
    call "Search and Replace Pattern.gvi"(string=w54, pattern="\"", replace all=TRUE) -> (result string=w55)
    call "Search and Replace Pattern.gvi"(string=w55, pattern=":", replace all=TRUE) -> (result string=w56)
    call "Trim Whitespace.gvi"(string=w56) -> (trimmed string=w57)
    Match Pattern(regular expression="}", string=w53) -> (before substring=w58)
    call "Search and Replace Pattern.gvi"(string=w58, pattern="\"", replace all=TRUE) -> (result string=w59)
    call "Search and Replace Pattern.gvi"(string=w59, pattern=":", replace all=TRUE) -> (result string=w60)
    call "Trim Whitespace.gvi"(string=w60) -> (trimmed string=w61)
    Property Node(instance in=T1 {all zero or empty}, "eventId"=w41, "eventType"=w46, "identifier"=w51, "muid"=w57, "time"=w61) -> (instance out=w62)
    append w62 to w37
  }
  $"Error out" <- $"Error in"
  $"Output infos" <- w37
