vi "Display_Service_MSG_History_In_Part.gviweb"   [G Web Development Software 22.3.0]
inputs:
  "File content": string
  "Error input": error
outputs:
  "Get all charge": string[]
  "Error Output": error
panel controls:
  "Happ_file": string
diagram:
  s1 = ""  # shift register
  s2 = uninitialised  # shift register
  while (iteration -> i1) {
    case (i1) {
      frame 1, Default {
        Match Pattern(regular expression="{", string=s1) -> (after substring=w1, before substring=w4)
        Is Empty String Or Path(string/path=w4) -> w3
        case (w3) {
          frame True {
            w2 = s2
          }
          frame False {
            Insert Into Array(inArray=s2, new=w4) -> w2
          }
        }
      }
      frame 0 {
        Match Pattern(regular expression="{", string=$"File content") -> (after substring=w5)
        Match Pattern(regular expression="{", string=w5) -> (after substring=w1, before substring=w6)
        Insert Into Array(inArray=s2, new=w6) -> w2
        Is Empty String Or Path(string/path=w1) -> w3
      }
    }
    next s1 = w1
    next s2 = w2
    stop if w3
  }
  $"Error Output" <- $"Error input"
  $"Get all charge" <- s2
