vi "Display_Service_MSG_History_Json.gviweb"   [G Web Development Software 22.3.0]
panel controls:
  "Analyse": bool  # Press the button “Analyse” and select a service report xml file.
panel indicators:
  "output": error
  "URL-Grafik": string
  "file content": string
  "Service-History": T1[]
  "Specifications:": T2[]
types:
  T1 = cluster{"Event Id": string, "Event Type": string, "Identifier": string, "muid": string, "Time": string}
  T2 = cluster{"Information": string, "Details": string}
uses:
  FileTasks::Read File Text.gvi
  WebApp::Display_Service_MSG_History_In_Part.gviweb
  WebApp::Display_Information_In_Tabular_Form.gviweb
diagram:
  # "eventId":2,"eventType":"start","identifier":"S_52_1","muid":4,"time":1751434091},
  s1 = "Init"  # shift register
  while {
    case (s1) {
      frame "Init", Default {
        $"URL-Grafik" <- "Rational_Logo.png"
        w1 = no error
        w2 = "Wait for interaction"
      }
      frame "Read File" {
        call "Read File Text.gvi"(allowed file types=[".json"], error in=no error) -> (file content=w3, error out=w4)
        $"file content" <- w3
        call "Display_Service_MSG_History_In_Part.gviweb"(File content=w3, Error input=w4) -> (Get all charge=w5, Error Output=w6)
        call "Display_Information_In_Tabular_Form.gviweb"(All infos=w5, Error in=w6) -> (Output infos=w7, General infos=w8, Error out=w1)
        $"Service-History" <- w7
        $"Specifications:" <- w8
        w2 = "Wait for interaction"
      }
      frame "Wait for interaction" {
        event {
          on "Analyse" Value changed {
            w1 = no error
            w2 = "Read File"
          }
          on "Timeout" {
            w1 = default
            w2 = "Init"
          }
        }
      }
    }
    next s1 = w2
    stop if FALSE
  }
  $output <- w1
