vi "Exclude_Entry.gviweb"   [G Web Development Software 22.3.0]
inputs:
  "Input XML array": string[]
  "Excluded Entry": string = "WA"
  "Error in": error
outputs:
  "Output Error": error
  "Without_Excluded_Entrys": string[]
diagram:
  s1 = string[] []  # shift register
  for {
    w1 = each element of $"Input XML array"
    String Length(string=$"Excluded Entry") -> (length=w2)
    String Subset(length (rest)=w2, string=w1) -> w3
    Is Equal(x=w3, y=$"Excluded Entry") -> w4
    case (w4) {
      frame False, Default {
        Insert Into Array(inArray=s1, new=w1) -> w5
      }
      frame True {
        w5 = s1
      }
    }
    next s1 = w5
  }
  $Without_Excluded_Entrys <- s1
  $"Output Error" <- $"Error in"
