vi "Exlude_WA_Entrys.gviweb"   [G Web Development Software 22.3.0]
inputs:
  "Input XML array": string[]
  "Error in": error
outputs:
  "Without_WA_Entrys": string[]
  "Output Error": error
diagram:
  s1 = string[] []  # shift register
  for {
    w1 = each element of $"Input XML array"
    String Subset(length (rest)=2, string=w1) -> w2
    Is Equal(x=w2, y="WA") -> w3
    case (w3) {
      frame False, Default {
        Insert Into Array(inArray=s1, new=w1) -> w4
      }
      frame True {
        w4 = s1
      }
    }
    next s1 = w4
  }
  $Without_WA_Entrys <- s1
  $"Output Error" <- $"Error in"
