vi "Function.gviweb"   [G Web Development Software 22.3.0]
panel controls:
  "Device:": string = "No_Picture.jpg"
  "Board Information:": cluster{"Board": string, "Information": string}[]
  "Diagnostic RT Calibration": T1[]
  "Checkbox": bool
  "Diagnostic_Water_iCS_Switch": T2[]
  "Diagnostic-Service-History": T3[]
  "Sort table iCombi": bool
  "Engine Link": string = "https://portal.rational-online.com/fs4p/media/service/3_dokumentationen/icombi_pro___icombi_classik/tm_icombi_pro___icombi_classic/en_gb/80.51.321_ET_en-GB.pdf"
  "Diagnostic Running Times Comp": T4[]
  "Total Running Time :": T4[]
  "Software-Service-History_iCP": T5[]
  "Input XML": string
  "Error in": error
panel indicators:
  "Page 1": i32
  "Output XML array": string[]
  "Error out": error
types:
  T1 = cluster{"Parameter Name": string, "Combi": string, "Dry": string, "Wet": string, "Dimension": string, "Comment": string}
  T2 = cluster{"Parameter Name": string, "Status": string, "Dimension": string, "Comment": string}
  T3 = cluster{"Parameter Name": string, "First Time": string, "Last Time": string, "Quantity": string, "Comment": string}
  T4 = cluster{"Parameter Name": string, "Count": string, "Duration": string, "Dimension": string, "Comment": string}
  T5 = cluster{"Parameter Name": string, "Update Date": string, "Version Name": string}
uses:
  NI::G Core::Strings::Trim Whitespace.gvi
diagram:
  w1 = $"Error in"
  s1 = string[] []  # shift register
  s2 = $"Input XML"  # shift register
  while {
    call "Trim Whitespace.gvi"(String=s2) -> (Gekürzter String=w2)
    Match Pattern(regular expression="\r\n", string=w2) -> (after substring=w3, before substring=w4)
    Is Empty String Or Path(string/path=w3) -> w5
    case (w5) {
      frame False, Default {
        Insert Into Array(inArray=s1, new=w4) -> w6
        w7 = w3
        w8 = w5
      }
      frame True {
        w6 = s1
        w7 = w3
        w8 = w5
      }
    }
    next s1 = w6
    next s2 = w7
    stop if w8
  }
  $"Error out" <- w1
  $"Output XML array" <- s1
