vi "Function_2.gviweb"   [G Web Development Software 22.3.0]
panel controls:
  "All A BMK": string[]
  "All SN comp": string[]
panel indicators:
  "SN A13": string[]
diagram:
  s1 = string[] []  # shift register
  for {
    w1 = each element of $"All A BMK"
    w2 = each element of $"All SN comp"
    case (w1) {
      frame "False", Default {
        w3 = s1
      }
      frame "A13" {
        Insert Into Array(inArray=s1, new=w2) -> w3
      }
    }
    next s1 = w3
  }
  s2 = ""  # shift register
  for (iteration -> i1) {
    w4 = each element of s1
    case (i1) {
      frame 0 {
        Replace Substring(length (len. of substring)=15, offset=4, string=w4) -> (result string=w5)
      }
      frame 1, Default {
        Replace Substring(length (len. of substring)=15, offset=4, string=w4) -> (result string=w6)
        Is Equal(x=s2, y=w6)
        w5 = _
      }
    }
    next s2 = w5
  }
  $"SN A13" <- s1
