vi "Get_Config_ini_Part.gviweb"   [G Web Development Software 22.3.0]
inputs:
  "Ini Array": string[]
  "ini Part from Array": i32
  "Error in": error
outputs:
  "Ini Part as Array": string[]
  "Output Error": error
uses:
  NI::G Core::Strings::Trim Whitespace.gvi
diagram:
  Array Index(array=$"Ini Array") -> (out0[$"ini Part from Array"]=w1)
  s1 = string[] []  # shift register
  s2 = ""  # shift register
  while (iteration -> i1) {
    case (i1) {
      frame 0 {
        w2 = w1
      }
      frame 1, Default {
        w2 = s2
      }
    }
    call "Trim Whitespace.gvi"(String=w2) -> (Gekürzter String=w3)
    Match Pattern(regular expression="\r\n", string=w3) -> (after substring=w4, before substring=w5)
    Is Empty String Or Path(string/path=w5) -> w6
    case (w6) {
      frame False, Default {
        Insert Into Array(inArray=s1, new=w5) -> w7
        w8 = w4
        w9 = w6
      }
      frame True {
        w7 = s1
        w8 = ""
        w9 = w6
      }
    }
    next s1 = w7
    next s2 = w8
    stop if w9
  }
  $"Output Error" <- $"Error in"
  $"Ini Part as Array" <- s1
