vi "How to use it.gviweb"   [G Web Development Software 22.3.0]
panel controls:
  "Engine Link": string = "index.html"
panel indicators:
  "banner": string
  "error out": error
uses:
  WebApp::Library.jsli::AddIframe
  WebApp::Library.jsli::InsertURL
diagram:
  Obtain JavaScript Reference(reference in=reference to "HTML Container") -> (javascript reference out=w1)
  call "AddIframe"(container=w1) -> (error out=w2)
  call "InsertURL"(url="How to use the Service File Visualizer.pdf", error in=w2) -> (error out=w3)
  $"error out" <- w3
