vi "Interpret_Basic_Settings.gviweb"   [G Web Development Software 22.3.0]
inputs:
  "Error input": error
  "Device Type": string = "Device"
  "Config File infos": string[]
  "Basic Settings Entrys": string[]
outputs:
  "Output Error": error
  "Basic Informations": T1[]
types:
  T1 = cluster{"Parameter Name": string, "Value": string, "Dimension": string, "Comment": string}
uses:
  NI::G Core::Strings::Search and Replace Pattern.gvi
  NI::G Core::Strings::Trim Whitespace.gvi
  WebApp::Set_Eco_State.gviweb
  WebApp::Change_Parameter_Value.gviweb
diagram:
  # ⚠️ NaOH (Natriumhydroxid) free tabs is enabled !
  # ⚠️ Foam reduction iCareSystem is deactivated !
  # Forced shutdown deactivated
  # Forced shutdown is deactivated !
  # Profile selection Heavy Duty
  s1 = ""  # shift register
  s2 = ""  # shift register
  for {
    w1 = each element of $"Basic Settings Entrys"
    Match Pattern(regular expression="dim", string=w1) -> (after substring=w3, before substring=w4)
    call "Search and Replace Pattern.gvi"(String=w4, Muster="_", Ersetzungs-String=" ", Alle ersetzen=TRUE) -> (Ergebnis-String=w5)
    call "Trim Whitespace.gvi"(string=w5) -> (trimmed string=w6)
    Match Pattern(regular expression="val", string=w3) -> (after substring=w7, before substring=w8)
    call "Search and Replace Pattern.gvi"(String=w8, Muster="=\"", Alle ersetzen=TRUE) -> (Ergebnis-String=w9)
    # w6: Param. Name
    # s2: Gas Type
    # s1: Control Mode
    call "Search and Replace Pattern.gvi"(String=w9, Muster="\"") -> (Ergebnis-String=w10)
    # w11: Dimension
    call "Trim Whitespace.gvi"(string=w10) -> (trimmed string=w11)
    call "Search and Replace Pattern.gvi"(String=w7, Muster="=\"", Alle ersetzen=TRUE) -> (Ergebnis-String=w12)
    # $"Device Type": Device type
    call "Search and Replace Pattern.gvi"(String=w12, Muster="\"") -> (Ergebnis-String=w13)
    # w14: value
    call "Trim Whitespace.gvi"(string=w13) -> (trimmed string=w14)
    case ($"Device Type") {
      frame "False", Default {
        w19 = "Unit_Type is missing/incorrect: Evaluation of the service report is not possible"
        w15 = w19
        w16 = w14
        w17 = s1
        w18 = s2
      }
      frame "623", "E523", "E623" {
        case (w6) {
          frame "False", Default {
            w15 = "✅"
            w16 = w14
            w17 = s1
          }
          frame "Drain Valve time0" {
            Decimal String To Number(default (0 I32)=0, string=w14) -> (number=w20)
            Decimal String To Number(default (0 I32)=0, string="7") -> (number=w21)
            Decimal String To Number(default (0 I32)=0, string="5") -> (number=w22)
            In Range And Coerce(lower limit=w22, upper limit=w21, x=w20) -> (In Range?=w23)
            case (w23) {
              frame False, Default {
                w24 = "❌"  # String {0}
                Concatenate Strings(w24, " ", w6, " ", "is out of range") -> w15
              }
              frame True {
                w15 = "✅"
              }
            }
            w16 = w14
            w17 = s1
          }
          frame "Drain Valve time1" {
            Decimal String To Number(default (0 I32)=0, string=w14) -> (number=w25)
            Decimal String To Number(default (0 I32)=0, string="20") -> (number=w26)
            Decimal String To Number(default (0 I32)=0, string="16") -> (number=w27)
            In Range And Coerce(lower limit=w27, upper limit=w26, x=w25) -> (In Range?=w28)
            case (w28) {
              frame False, Default {
                w29 = "❌"  # String {0}
                Concatenate Strings(w29, " ", w6, " ", "is out of range") -> w15
              }
              frame True {
                w15 = "✅"
              }
            }
            w16 = w14
            w17 = s1
          }
          frame "CDS-Sensor XS" {
            Decimal String To Number(string=w14) -> (number=w30)
            Is Equal(x=w30, y=1000) -> w31
            case (w31) {
              frame False, Default {
                w32 = "❌"  # String {0}
                Concatenate Strings(w32, "Incorrect calibration of the CDS sensor XS") -> w15
              }
              frame True {
                w15 = "✅"
              }
            }
            w16 = w14
            w17 = s1
          }
          frame "Installation voltage" {
            Is Not Equal(x=w14, y="") -> w33
            case (w33) {
              frame False, Default {
                w34 = "❌"  # String {0}
                Concatenate Strings(w34, " ", w6, " ", "is missing") -> w15
              }
              frame True {
                w15 = "✅"
              }
            }
            w16 = w14
            w17 = s1
          }
          frame "ShowMode" {
            Is Equal(x=w14, y="false") -> w35
            case (w35) {
              frame False, Default {
                Concatenate Strings("⚠️", " ShowMode is activated") -> w15
              }
              frame True {
                w15 = "✅"
              }
            }
            w16 = w14
            w17 = s1
          }
          frame "Forced shutdown deactivated" {
            Is Equal(x=w14, y="false") -> w36
            case (w36) {
              frame False, Default {
                Concatenate Strings("⚠️", "Forced shutdown is deactivated !") -> w15
              }
              frame True {
                w15 = "✅"
              }
            }
            w16 = w14
            w17 = s1
          }
          frame "Control Temperature Dry Heat" {
            Decimal String To Number(default (0 I32)=0, string=w14) -> (number=w37)
            Decimal String To Number(default (0 I32)=0, string="45") -> (number=w38)
            Is Less Or Equal(x=w37, y=w38) -> w39
            case (w39) {
              frame True {
                w40 = "Temperature limit is too low, it could cause high water consumption"
                Concatenate Strings("⚠️", w40) -> w15
              }
              frame False {
                w15 = "✅"
              }
            }
            w16 = w14
            w17 = s1
          }
          frame "Control Temperature Moist Heat" {
            Decimal String To Number(default (0 I32)=0, string=w14) -> (number=w41)
            Decimal String To Number(default (0 I32)=0, string="40") -> (number=w42)
            Is Less Or Equal(x=w41, y=w42) -> w43
            case (w43) {
              frame True {
                w44 = "Temperature limit is too low, it could cause high water consumption"
                Concatenate Strings("⚠️", w44) -> w15
              }
              frame False {
                w15 = "✅"
              }
            }
            w16 = w14
            w17 = s1
          }
          frame "Control Temperature Off" {
            Decimal String To Number(default (0 I32)=0, string=w14) -> (number=w45)
            Decimal String To Number(default (0 I32)=0, string="60") -> (number=w46)
            Is Less Or Equal(x=w45, y=w46) -> w47
            case (w47) {
              frame True {
                w48 = "Temperature limit is too low, it could cause high water consumption"
                Concatenate Strings("⚠️", w48) -> w15
              }
              frame False {
                w15 = "✅"
              }
            }
            w16 = w14
            w17 = s1
          }
          frame "Control Mode" {
            Decimal String To Number(default (0 I32)=0, string=w14) -> (number=w49)
            case (w49) {
              frame 1, Default {
                w15 = "✅: No control temperatures are used."
                w16 = "OFF"
              }
              frame 2 {
                w15 = "✅: The unit defined control temperatures are used."
                w16 = "Eco"
              }
              frame 3 {
                w15 = "✅: The temperature controls are in use."
                w16 = "ON"
              }
              frame 0 {
                w15 = "✅"
                w16 = "Undefined"
              }
            }
            w17 = w16
          }
          frame "Profile selection Heavy Duty" {
            Decimal String To Number(default (0 I32)=0, string=w14) -> (number=w50)
            case (w50) {
              frame 1 {
                w15 = "✅"
                w16 = "Light User"
              }
              frame 2 {
                w15 = "✅"
                w16 = "Medium User"
              }
              frame 3 {
                w15 = "✅"
                w16 = "Heavy User"
              }
              frame 0, Default {
                w15 = "✅"
                w16 = "Default"
              }
            }
            w17 = w16
          }
          frame "NaOH free tabs enable" {
            Decimal String To Number(default (0 I32)=0, string=w14) -> (number=w51)
            case (w51) {
              frame 1, Default {
                w15 = "⚠️ NaOH (Natriumhydroxid) free tabs is enabled !"
                w16 = "YES"
              }
              frame 0 {
                w15 = "✅"
                w16 = "NO"
              }
            }
            w17 = w16
          }
          frame "Plate a la carte weight" {
            Decimal String To Number(default (0 I32)=0, string=w14) -> (number=w52)
            case (w52) {
              frame 1, Default {
                w15 = "✅"
                w16 = "< 899g"
              }
              frame 2 {
                w15 = "✅"
                w16 = "1099 g"
              }
              frame 3 {
                w15 = "✅"
                w16 = "1100g"
              }
              frame 0 {
                w15 = "✅"
                w16 = "< 700g"
              }
            }
            w17 = w16
          }
          frame "Foam reduction iCareSystem" {
            Decimal String To Number(default (0 I32)=0, string=w14) -> (number=w53)
            case (w53) {
              frame 1 {
                w15 = "✅"
                w16 = "ON"
              }
              frame 0, Default {
                w15 = "⚠️ Foam reduction iCareSystem is deactivated !"
                w16 = "OFF"
              }
            }
            w17 = s1
          }
          frame "Altitude boiling point" {
            Decimal String To Number(default (0 I32)=0, string=w14) -> (number=w54)
            Is Equal(x=w54, y=0) -> w55
            case (w55) {
              frame True {
                w56 = "❌"  # String {0}
                Concatenate Strings(w56, " Device is not calibrated!") -> w15
              }
              frame False {
                w15 = "✅"
              }
            }
            w16 = w14
            w17 = s1
          }
          frame "Altitude pressure sensor", "CDS-Sensor", "Gas blower speed Hot Air bottom Max RPM", "Gas blower speed Hot Air bottom Max Ultravent RPM", "Gas blower speed Hot Air bottom Min RPM", "Gas blower speed Hot Air bottom Min Ultravent RPM", "Gas blower speed Hot Air bottom Start RPM", "Gas blower speed Hot Air bottom Start Ultravent RPM", "Gas blower speed Hot Air top Max RPM", "Gas blower speed Hot Air top Max Ultravent RPM", "Gas blower speed Hot Air top Min RPM", "Gas blower speed Hot Air top Min UltraVent RPM", "Gas blower speed Hot Air top Start RPM", "Gas blower speed Hot Air top Start UltraVent RPM", "Gas blower speed Steam Max RPM", "Gas blower speed Steam Max Ultravent RPM", "Gas blower speed Steam Min RPM", "Gas blower speed Steam Min UltraVent RPM", "Gas blower speed Steam Start RPM", "Gas blower speed Steam Start UltraVent RPM", "Gas type", "Magnetron Safety Chain bottom" {
            w57 = " Information not required for this device type"  # String {0}
            Concatenate Strings("[ℹ]", w57) -> w15
            w16 = w14
            w17 = s1
          }
          frame "Chefline phone setting", "Ethernet eth0 active", "Ethernet eth0 dhcp", "Ethernet eth0 dns", "Ethernet eth0 gateway", "Ethernet eth0 ip", "Ethernet eth0 mac", "Ethernet eth0 netmask", "Service phone setting", "Wifi wlan0 dhcp", "Wifi wlan0 dns", "Wifi wlan0 gateway", "Wifi wlan0 ip", "Wifi wlan0 mac", "Wifi wlan0 netmask" {
            call "Trim Whitespace.gvi"(string=w14) -> (trimmed string=w58)
            Is Empty String Or Path(string/path=w58) -> w59
            case (w59) {
              frame False, Default {
                w15 = "✅"
              }
              frame True {
                w60 = " Information is missing for this device type"  # String {0}
                Concatenate Strings("[ℹ]", w60) -> w15
              }
            }
            w16 = w14
            w17 = s1
          }
        }
        w18 = s2
      }
      frame "E101", "E102", "E201", "E202", "E61", "E62" {
        case (w6) {
          frame "False", Default {
            w15 = "✅"
            w16 = w14
            w17 = s1
          }
          frame "CDS-Sensor" {
            Decimal String To Number(string=w14) -> (number=w61)
            Is Equal(x=w61, y=1350) -> w62
            case (w62) {
              frame False, Default {
                w63 = "❌"  # String {0}
                Concatenate Strings(w63, "Incorrect calibration of the CDS sensor") -> w15
              }
              frame True {
                w15 = "✅"
              }
            }
            w16 = w14
            w17 = s1
          }
          frame "Installation voltage" {
            Is Not Equal(x=w14, y="") -> w64
            case (w64) {
              frame False, Default {
                w65 = "❌"  # String {0}
                Concatenate Strings(w65, " ", w6, " ", "is missing") -> w15
              }
              frame True {
                w15 = "✅"
              }
            }
            w16 = w14
            w17 = s1
          }
          frame "ShowMode" {
            Is Equal(x=w14, y="false") -> w66
            case (w66) {
              frame False, Default {
                Concatenate Strings("⚠️", " ShowMode is activated") -> w15
              }
              frame True {
                w15 = "✅"
              }
            }
            w16 = w14
            w17 = s1
          }
          frame "Forced shutdown deactivated" {
            Is Equal(x=w14, y="false") -> w67
            case (w67) {
              frame False, Default {
                Concatenate Strings("⚠️", "Forced shutdown is deactivated !") -> w15
              }
              frame True {
                w15 = "✅"
              }
            }
            w16 = w14
            w17 = s1
          }
          frame "Control Temperature Dry Heat" {
            Decimal String To Number(default (0 I32)=0, string=w14) -> (number=w68)
            Decimal String To Number(default (0 I32)=0, string="45") -> (number=w69)
            Is Less Or Equal(x=w68, y=w69) -> w70
            case (w70) {
              frame True {
                w71 = "Temperature limit is too low, it could cause high water consumption"
                Concatenate Strings("⚠️", w71) -> w15
              }
              frame False {
                w15 = "✅"
              }
            }
            w16 = w14
            w17 = s1
          }
          frame "Control Temperature Moist Heat" {
            Decimal String To Number(default (0 I32)=0, string=w14) -> (number=w72)
            Decimal String To Number(default (0 I32)=0, string="40") -> (number=w73)
            Is Less Or Equal(x=w72, y=w73) -> w74
            case (w74) {
              frame True {
                w75 = "Temperature limit is too low, it could cause high water consumption"
                Concatenate Strings("⚠️", w75) -> w15
              }
              frame False {
                w15 = "✅"
              }
            }
            w16 = w14
            w17 = s1
          }
          frame "Control Temperature Off" {
            Decimal String To Number(default (0 I32)=0, string=w14) -> (number=w76)
            Decimal String To Number(default (0 I32)=0, string="60") -> (number=w77)
            Is Less Or Equal(x=w76, y=w77) -> w78
            case (w78) {
              frame True {
                w79 = "Temperature limit is too low, it could cause high water consumption"
                Concatenate Strings("⚠️", w79) -> w15
              }
              frame False {
                w15 = "✅"
              }
            }
            w16 = w14
            w17 = s1
          }
          frame "Control Mode" {
            Decimal String To Number(default (0 I32)=0, string=w14) -> (number=w80)
            case (w80) {
              frame 1, Default {
                w15 = "✅: No control temperatures are used."
                w16 = "OFF"
              }
              frame 2 {
                w15 = "✅: The unit defined control temperatures are used."
                w16 = "Eco"
              }
              frame 3 {
                w15 = "✅: The temperature controls are in use."
                w16 = "ON"
              }
              frame 0 {
                w15 = "✅"
                w16 = "Undefined"
              }
            }
            w17 = w16
          }
          frame "Profile selection Heavy Duty" {
            Decimal String To Number(default (0 I32)=0, string=w14) -> (number=w81)
            case (w81) {
              frame 1 {
                w15 = "✅"
                w16 = "Light User"
              }
              frame 2 {
                w15 = "✅"
                w16 = "Medium User"
              }
              frame 3 {
                w15 = "✅"
                w16 = "Heavy User"
              }
              frame 0, Default {
                w15 = "✅"
                w16 = "Default"
              }
            }
            w17 = w16
          }
          frame "NaOH free tabs enable" {
            Decimal String To Number(default (0 I32)=0, string=w14) -> (number=w82)
            case (w82) {
              frame 1, Default {
                w15 = "⚠️ NaOH (Natriumhydroxid) free tabs is enabled !"
                w16 = "YES"
              }
              frame 0 {
                w15 = "✅"
                w16 = "NO"
              }
            }
            w17 = w16
          }
          frame "Plate a la carte weight" {
            Decimal String To Number(default (0 I32)=0, string=w14) -> (number=w83)
            case (w83) {
              frame 1, Default {
                w15 = "✅"
                w16 = "< 899g"
              }
              frame 2 {
                w15 = "✅"
                w16 = "1099 g"
              }
              frame 3 {
                w15 = "✅"
                w16 = "1100g"
              }
              frame 0 {
                w15 = "✅"
                w16 = "< 700g"
              }
            }
            w17 = w16
          }
          frame "Foam reduction iCareSystem" {
            Decimal String To Number(default (0 I32)=0, string=w14) -> (number=w84)
            case (w84) {
              frame 1 {
                w15 = "✅"
                w16 = "ON"
              }
              frame 0, Default {
                w15 = "⚠️ Foam reduction iCareSystem is deactivated !"
                w16 = "OFF"
              }
            }
            w17 = s1
          }
          frame "Altitude boiling point" {
            Decimal String To Number(string=w14) -> (number=w85)
            Is Equal(x=w85, y=0) -> w86
            case (w86) {
              frame True {
                w87 = "❌"  # String {0}
                Concatenate Strings(w87, " Device is not calibrated!") -> w15
              }
              frame False {
                w15 = "✅"
              }
            }
            w16 = w14
            w17 = s1
          }
          frame "Altitude pressure sensor", "CDS-Sensor XS", "Drain Valve time0", "Drain Valve time1", "Gas blower speed Hot Air bottom Max RPM", "Gas blower speed Hot Air bottom Max Ultravent RPM", "Gas blower speed Hot Air bottom Min RPM", "Gas blower speed Hot Air bottom Min Ultravent RPM", "Gas blower speed Hot Air bottom Start RPM", "Gas blower speed Hot Air bottom Start Ultravent RPM", "Gas blower speed Hot Air top Max RPM", "Gas blower speed Hot Air top Max Ultravent RPM", "Gas blower speed Hot Air top Min RPM", "Gas blower speed Hot Air top Min UltraVent RPM", "Gas blower speed Hot Air top Start RPM", "Gas blower speed Hot Air top Start UltraVent RPM", "Gas blower speed Steam Max RPM", "Gas blower speed Steam Max Ultravent RPM", "Gas blower speed Steam Min RPM", "Gas blower speed Steam Min UltraVent RPM", "Gas blower speed Steam Start RPM", "Gas blower speed Steam Start UltraVent RPM", "Gas type" {
            w88 = " Information not required for this device type"  # String {0}
            Concatenate Strings("[ℹ]", w88) -> w15
            w16 = w14
            w17 = s1
          }
          frame "Chefline phone setting", "Ethernet eth0 active", "Ethernet eth0 dhcp", "Ethernet eth0 dns", "Ethernet eth0 gateway", "Ethernet eth0 ip", "Ethernet eth0 mac", "Ethernet eth0 netmask", "Service phone setting", "Wifi wlan0 dhcp", "Wifi wlan0 dns", "Wifi wlan0 gateway", "Wifi wlan0 ip", "Wifi wlan0 mac", "Wifi wlan0 netmask" {
            call "Trim Whitespace.gvi"(string=w14) -> (trimmed string=w89)
            Is Empty String Or Path(string/path=w89) -> w90
            case (w90) {
              frame False, Default {
                w15 = "✅"
              }
              frame True {
                w91 = " Information is missing for this device type"  # String {0}
                Concatenate Strings("[ℹ]", w91) -> w15
              }
            }
            w16 = w14
            w17 = s1
          }
        }
        w18 = s2
      }
      frame "E61T" {
        case (w6) {
          frame "False", Default {
            w15 = "✅"
            w16 = w14
            w17 = s1
          }
          frame "CDS-Sensor" {
            Decimal String To Number(string=w14) -> (number=w92)
            Is Equal(x=w92, y=1350) -> w93
            case (w93) {
              frame False, Default {
                w94 = "❌"  # String {0}
                Concatenate Strings(w94, "Incorrect calibration of the CDS sensor") -> w15
              }
              frame True {
                w15 = "✅"
              }
            }
            w16 = w14
            w17 = s1
          }
          frame "ShowMode" {
            Is Equal(x=w14, y="false") -> w95
            case (w95) {
              frame False, Default {
                Concatenate Strings("⚠️", " ShowMode is activated") -> w15
              }
              frame True {
                w15 = "✅"
              }
            }
            w16 = w14
            w17 = s1
          }
          frame "Forced shutdown deactivated" {
            Is Equal(x=w14, y="false") -> w96
            case (w96) {
              frame False, Default {
                Concatenate Strings("⚠️", "Forced shutdown is deactivated !") -> w15
              }
              frame True {
                w15 = "✅"
              }
            }
            w16 = w14
            w17 = s1
          }
          frame "Control Temperature Dry Heat" {
            Decimal String To Number(default (0 I32)=0, string=w14) -> (number=w97)
            Decimal String To Number(default (0 I32)=0, string="45") -> (number=w98)
            Is Less Or Equal(x=w97, y=w98) -> w99
            case (w99) {
              frame True {
                w100 = "Temperature limit is too low, it could cause high water consumption"
                Concatenate Strings("⚠️", w100) -> w15
              }
              frame False {
                w15 = "✅"
              }
            }
            w16 = w14
            w17 = s1
          }
          frame "Control Temperature Moist Heat" {
            Decimal String To Number(default (0 I32)=0, string=w14) -> (number=w101)
            Decimal String To Number(default (0 I32)=0, string="40") -> (number=w102)
            Is Less Or Equal(x=w101, y=w102) -> w103
            case (w103) {
              frame True {
                w104 = "Temperature limit is too low, it could cause high water consumption"
                Concatenate Strings("⚠️", w104) -> w15
              }
              frame False {
                w15 = "✅"
              }
            }
            w16 = w14
            w17 = s1
          }
          frame "Control Temperature Off" {
            Decimal String To Number(default (0 I32)=0, string=w14) -> (number=w105)
            Decimal String To Number(default (0 I32)=0, string="60") -> (number=w106)
            Is Less Or Equal(x=w105, y=w106) -> w107
            case (w107) {
              frame True {
                w108 = "Temperature limit is too low, it could cause high water consumption"
                Concatenate Strings("⚠️", w108) -> w15
              }
              frame False {
                w15 = "✅"
              }
            }
            w16 = w14
            w17 = s1
          }
          frame "Control Mode" {
            Decimal String To Number(default (0 I32)=0, string=w14) -> (number=w109)
            case (w109) {
              frame 1, Default {
                w15 = "✅: No control temperatures are used."
                w16 = "OFF"
              }
              frame 2 {
                w15 = "✅: The unit defined control temperatures are used."
                w16 = "Eco"
              }
              frame 3 {
                w15 = "✅: The temperature controls are in use."
                w16 = "ON"
              }
              frame 0 {
                w15 = "✅"
                w16 = "Undefined"
              }
            }
            w17 = w16
          }
          frame "Profile selection Heavy Duty" {
            Decimal String To Number(default (0 I32)=0, string=w14) -> (number=w110)
            case (w110) {
              frame 1 {
                w15 = "✅"
                w16 = "Light User"
              }
              frame 2 {
                w15 = "✅"
                w16 = "Medium User"
              }
              frame 3 {
                w15 = "✅"
                w16 = "Heavy User"
              }
              frame 0, Default {
                w15 = "✅"
                w16 = "Default"
              }
            }
            w17 = w16
          }
          frame "NaOH free tabs enable" {
            Decimal String To Number(default (0 I32)=0, string=w14) -> (number=w111)
            case (w111) {
              frame 1, Default {
                w15 = "⚠️ NaOH (Natriumhydroxid) free tabs is enabled !"
                w16 = "YES"
              }
              frame 0 {
                w15 = "✅"
                w16 = "NO"
              }
            }
            w17 = w16
          }
          frame "Plate a la carte weight" {
            Decimal String To Number(default (0 I32)=0, string=w14) -> (number=w112)
            case (w112) {
              frame 1, Default {
                w15 = "✅"
                w16 = "< 899g"
              }
              frame 2 {
                w15 = "✅"
                w16 = "1099 g"
              }
              frame 3 {
                w15 = "✅"
                w16 = "1100g"
              }
              frame 0 {
                w15 = "✅"
                w16 = "< 700g"
              }
            }
            w17 = w16
          }
          frame "Foam reduction iCareSystem" {
            Decimal String To Number(default (0 I32)=0, string=w14) -> (number=w113)
            case (w113) {
              frame 1 {
                w15 = "✅"
                w16 = "ON"
              }
              frame 0, Default {
                w15 = "⚠️ Foam reduction iCareSystem is deactivated !"
                w16 = "OFF"
              }
            }
            w17 = s1
          }
          frame "Altitude boiling point" {
            Decimal String To Number(string=w14) -> (number=w114)
            Is Equal(x=w114, y=0) -> w115
            case (w115) {
              frame True {
                w116 = "❌"  # String {0}
                Concatenate Strings(w116, " Device is not calibrated!") -> w15
              }
              frame False {
                w15 = "✅"
              }
            }
            w16 = w14
            w17 = s1
          }
          frame "Altitude pressure sensor", "CDS-Sensor XS", "Drain Valve time0", "Drain Valve time1", "Gas blower speed Hot Air bottom Max RPM", "Gas blower speed Hot Air bottom Max Ultravent RPM", "Gas blower speed Hot Air bottom Min RPM", "Gas blower speed Hot Air bottom Min Ultravent RPM", "Gas blower speed Hot Air bottom Start RPM", "Gas blower speed Hot Air bottom Start Ultravent RPM", "Gas blower speed Hot Air top Max RPM", "Gas blower speed Hot Air top Max Ultravent RPM", "Gas blower speed Hot Air top Min RPM", "Gas blower speed Hot Air top Min UltraVent RPM", "Gas blower speed Hot Air top Start RPM", "Gas blower speed Hot Air top Start UltraVent RPM", "Gas blower speed Steam Max RPM", "Gas blower speed Steam Max Ultravent RPM", "Gas blower speed Steam Min RPM", "Gas blower speed Steam Min UltraVent RPM", "Gas blower speed Steam Start RPM", "Gas blower speed Steam Start UltraVent RPM", "Gas type", "Installation voltage" {
            w117 = " Information not required for this device type"  # String {0}
            Concatenate Strings("[ℹ]", w117) -> w15
            w16 = w14
            w17 = s1
          }
          frame "Chefline phone setting", "Ethernet eth0 active", "Ethernet eth0 dhcp", "Ethernet eth0 dns", "Ethernet eth0 gateway", "Ethernet eth0 ip", "Ethernet eth0 mac", "Ethernet eth0 netmask", "Service phone setting", "Wifi wlan0 dhcp", "Wifi wlan0 dns", "Wifi wlan0 gateway", "Wifi wlan0 ip", "Wifi wlan0 mac", "Wifi wlan0 netmask" {
            call "Trim Whitespace.gvi"(string=w14) -> (trimmed string=w118)
            Is Empty String Or Path(string/path=w118) -> w119
            case (w119) {
              frame False, Default {
                w15 = "✅"
              }
              frame True {
                w120 = " Information is missing for this device type"  # String {0}
                Concatenate Strings("[ℹ]", w120) -> w15
              }
            }
            w16 = w14
            w17 = s1
          }
        }
        w18 = s2
      }
      frame "G101", "G102", "G61", "G62" {
        case (w6) {
          frame "False", Default {
            w15 = "✅"
            w16 = w14
            w17 = s1
            w18 = s2
          }
          frame "CDS-Sensor" {
            Decimal String To Number(string=w14) -> (number=w121)
            Is Equal(x=w121, y=1350) -> w122
            case (w122) {
              frame False, Default {
                w123 = "❌"  # String {0}
                Concatenate Strings(w123, "Incorrect calibration of the CDS sensor") -> w15
              }
              frame True {
                w15 = "✅"
              }
            }
            w16 = w14
            w17 = s1
            w18 = s2
          }
          frame "Altitude pressure sensor" {
            Is Not Equal(x=w14, y="") -> w124
            case (w124) {
              frame False, Default {
                w125 = "❌"  # String {0}
                Concatenate Strings(w125, " ", w6, " ", "is missing") -> w15
              }
              frame True {
                w15 = "✅"
              }
            }
            w16 = w14
            w17 = s1
            w18 = s2
          }
          frame "Gas blower speed Hot Air top Max RPM", "Gas blower speed Hot Air top Min RPM", "Gas blower speed Hot Air top Start RPM", "Gas blower speed Steam Max RPM", "Gas blower speed Steam Min RPM", "Gas blower speed Steam Start RPM" {
            Decimal String To Number(default (0 I32)=0, string=w14) -> (number=w126)
            Is Not Equal To 0(x=w126) -> w127
            case (w127) {
              frame False, Default {
                w128 = "❌"  # String {0}
                Concatenate Strings(w128, " ", $"Device Type", " ", "is out of range!") -> w15
              }
              frame True {
                w15 = "✅"
              }
            }
            w16 = w14
            w17 = s1
            w18 = s2
          }
          frame "ShowMode" {
            Is Equal(x=w14, y="false") -> w129
            case (w129) {
              frame False, Default {
                Concatenate Strings("⚠️", " ShowMode is activated") -> w15
              }
              frame True {
                w15 = "✅"
              }
            }
            w16 = w14
            w17 = s1
            w18 = s2
          }
          frame "Forced shutdown deactivated" {
            Is Equal(x=w14, y="false") -> w130
            case (w130) {
              frame False, Default {
                Concatenate Strings("⚠️", "Forced shutdown is deactivated !") -> w15
              }
              frame True {
                w15 = "✅"
              }
            }
            w16 = w14
            w17 = s1
            w18 = s2
          }
          frame "Control Temperature Dry Heat" {
            Decimal String To Number(default (0 I32)=0, string=w14) -> (number=w131)
            Decimal String To Number(default (0 I32)=0, string="45") -> (number=w132)
            Is Less Or Equal(x=w131, y=w132) -> w133
            case (w133) {
              frame True {
                w134 = "Temperature limit is too low, it could cause high water consumption"
                Concatenate Strings("⚠️", w134) -> w15
              }
              frame False {
                w15 = "✅"
              }
            }
            w16 = w14
            w17 = s1
            w18 = s2
          }
          frame "Control Temperature Moist Heat" {
            Decimal String To Number(default (0 I32)=0, string=w14) -> (number=w135)
            Decimal String To Number(default (0 I32)=0, string="40") -> (number=w136)
            Is Less Or Equal(x=w135, y=w136) -> w137
            case (w137) {
              frame True {
                w138 = "Temperature limit is too low, it could cause high water consumption"
                Concatenate Strings("⚠️", w138) -> w15
              }
              frame False {
                w15 = "✅"
              }
            }
            w16 = w14
            w17 = s1
            w18 = s2
          }
          frame "Control Temperature Off" {
            Decimal String To Number(default (0 I32)=0, string=w14) -> (number=w139)
            Decimal String To Number(default (0 I32)=0, string="60") -> (number=w140)
            Is Less Or Equal(x=w139, y=w140) -> w141
            case (w141) {
              frame True {
                w142 = "Temperature limit is too low, it could cause high water consumption"
                Concatenate Strings("⚠️", w142) -> w15
              }
              frame False {
                w15 = "✅"
              }
            }
            w16 = w14
            w17 = s1
            w18 = s2
          }
          frame "Control Mode" {
            Decimal String To Number(default (0 I32)=0, string=w14) -> (number=w143)
            case (w143) {
              frame 1, Default {
                w15 = "✅: No control temperatures are used."
                w16 = "OFF"
              }
              frame 2 {
                w15 = "✅: The unit defined control temperatures are used."
                w16 = "Eco"
              }
              frame 3 {
                w15 = "✅: The temperature controls are in use."
                w16 = "ON"
              }
              frame 0 {
                w15 = "✅"
                w16 = "Undefined"
              }
            }
            w17 = w16
            w18 = s2
          }
          frame "Profile selection Heavy Duty" {
            Decimal String To Number(default (0 I32)=0, string=w14) -> (number=w144)
            case (w144) {
              frame 1 {
                w15 = "✅"
                w16 = "Light User"
              }
              frame 2 {
                w15 = "✅"
                w16 = "Medium User"
              }
              frame 3 {
                w15 = "✅"
                w16 = "Heavy User"
              }
              frame 0, Default {
                w15 = "✅"
                w16 = "Default"
              }
            }
            w17 = w16
            w18 = s2
          }
          frame "NaOH free tabs enable" {
            Decimal String To Number(default (0 I32)=0, string=w14) -> (number=w145)
            case (w145) {
              frame 1, Default {
                w15 = "⚠️ NaOH (Natriumhydroxid) free tabs is enabled !"
                w16 = "YES"
              }
              frame 0 {
                w15 = "✅"
                w16 = "NO"
              }
            }
            w17 = w16
            w18 = s2
          }
          frame "Plate a la carte weight" {
            Decimal String To Number(default (0 I32)=0, string=w14) -> (number=w146)
            case (w146) {
              frame 1, Default {
                w15 = "✅"
                w16 = "< 899g"
              }
              frame 2 {
                w15 = "✅"
                w16 = "1099 g"
              }
              frame 3 {
                w15 = "✅"
                w16 = "1100g"
              }
              frame 0 {
                w15 = "✅"
                w16 = "< 700g"
              }
            }
            w17 = w16
            w18 = s2
          }
          frame "Gas type" {
            w15 = "✅"
            w16 = w14
            w17 = s1
            w18 = w14
          }
          frame "Foam reduction iCareSystem" {
            Decimal String To Number(default (0 I32)=0, string=w14) -> (number=w147)
            case (w147) {
              frame 1 {
                w15 = "✅"
                w16 = "ON"
              }
              frame 0, Default {
                w15 = "⚠️ Foam reduction iCareSystem is deactivated !"
                w16 = "OFF"
              }
            }
            w17 = s1
            w18 = s2
          }
          frame "Altitude boiling point" {
            Decimal String To Number(default (0 I32)=0, string=w14) -> (number=w148)
            Is Equal(x=w148, y=0) -> w149
            case (w149) {
              frame True {
                w150 = "❌"  # String {0}
                Concatenate Strings(w150, " Device is not calibrated!") -> w15
              }
              frame False {
                w15 = "✅"
              }
            }
            w16 = w14
            w17 = s1
            w18 = s2
          }
          frame "CDS-Sensor XS", "Drain Valve time0", "Drain Valve time1", "Gas blower speed Hot Air bottom Max RPM", "Gas blower speed Hot Air bottom Max Ultravent RPM", "Gas blower speed Hot Air bottom Min RPM", "Gas blower speed Hot Air bottom Min Ultravent RPM", "Gas blower speed Hot Air bottom Start RPM", "Gas blower speed Hot Air bottom Start Ultravent RPM", "Installation voltage" {
            w151 = " Information not required for this device type"  # String {0}
            Concatenate Strings("[ℹ]", w151) -> w15
            w16 = w14
            w17 = s1
            w18 = s2
          }
          frame "Chefline phone setting", "Ethernet eth0 active", "Ethernet eth0 dhcp", "Ethernet eth0 dns", "Ethernet eth0 gateway", "Ethernet eth0 ip", "Ethernet eth0 mac", "Ethernet eth0 netmask", "Service phone setting", "Wifi wlan0 dhcp", "Wifi wlan0 dns", "Wifi wlan0 gateway", "Wifi wlan0 ip", "Wifi wlan0 mac", "Wifi wlan0 netmask" {
            call "Trim Whitespace.gvi"(string=w14) -> (trimmed string=w152)
            Is Empty String Or Path(string/path=w152) -> w153
            case (w153) {
              frame False, Default {
                w15 = "✅"
              }
              frame True {
                w154 = " Information is missing for this device type"  # String {0}
                Concatenate Strings("[ℹ]", w154) -> w15
              }
            }
            w16 = w14
            w17 = s1
            w18 = s2
          }
        }
      }
      frame "G201", "G202" {
        case (w6) {
          frame "False", Default {
            w15 = "✅"
            w16 = w14
            w17 = s1
            w18 = s2
          }
          frame "CDS-Sensor" {
            Decimal String To Number(string=w14) -> (number=w155)
            Is Equal(x=w155, y=1350) -> w156
            case (w156) {
              frame False, Default {
                w157 = "❌"  # String {0}
                Concatenate Strings(w157, "Incorrect calibration of the CDS sensor") -> w15
              }
              frame True {
                w15 = "✅"
              }
            }
            w16 = w14
            w17 = s1
            w18 = s2
          }
          frame "Altitude pressure sensor" {
            Is Not Equal(x=w14, y="") -> w158
            case (w158) {
              frame False, Default {
                w159 = "❌"  # String {0}
                Concatenate Strings(w159, " ", w6, " ", "is missing") -> w15
              }
              frame True {
                w15 = "✅"
              }
            }
            w16 = w14
            w17 = s1
            w18 = s2
          }
          frame "Gas blower speed Hot Air bottom Max RPM", "Gas blower speed Hot Air bottom Min RPM", "Gas blower speed Hot Air bottom Start RPM", "Gas blower speed Hot Air top Max RPM", "Gas blower speed Hot Air top Min RPM", "Gas blower speed Hot Air top Start RPM", "Gas blower speed Steam Max RPM", "Gas blower speed Steam Min RPM", "Gas blower speed Steam Start RPM" {
            Decimal String To Number(default (0 I32)=0, string=w14) -> (number=w160)
            Is Not Equal To 0(x=w160) -> w161
            case (w161) {
              frame False, Default {
                w162 = "❌"  # String {0}
                Concatenate Strings(w162, " ", w6, " ", "is out of range!") -> w15
              }
              frame True {
                w15 = "✅"
              }
            }
            w16 = w14
            w17 = s1
            w18 = s2
          }
          frame "ShowMode" {
            Is Equal(x=w14, y="false") -> w163
            case (w163) {
              frame False, Default {
                Concatenate Strings("⚠️", " ShowMode is activated") -> w15
              }
              frame True {
                w15 = "✅"
              }
            }
            w16 = w14
            w17 = s1
            w18 = s2
          }
          frame "Forced shutdown deactivated" {
            Is Equal(x=w14, y="false") -> w164
            case (w164) {
              frame False, Default {
                Concatenate Strings("⚠️", "Forced shutdown is deactivated !") -> w15
              }
              frame True {
                w15 = "✅"
              }
            }
            w16 = w14
            w17 = s1
            w18 = s2
          }
          frame "Control Temperature Dry Heat" {
            Decimal String To Number(default (0 I32)=0, string=w14) -> (number=w165)
            Decimal String To Number(default (0 I32)=0, string="45") -> (number=w166)
            Is Less Or Equal(x=w165, y=w166) -> w167
            case (w167) {
              frame True {
                w168 = "Temperature limit is too low, it could cause high water consumption"
                Concatenate Strings("⚠️", w168) -> w15
              }
              frame False {
                w15 = "✅"
              }
            }
            w16 = w14
            w17 = s1
            w18 = s2
          }
          frame "Control Temperature Moist Heat" {
            Decimal String To Number(default (0 I32)=0, string=w14) -> (number=w169)
            Decimal String To Number(default (0 I32)=0, string="40") -> (number=w170)
            Is Less Or Equal(x=w169, y=w170) -> w171
            case (w171) {
              frame True {
                w172 = "Temperature limit is too low, it could cause high water consumption"
                Concatenate Strings("⚠️", w172) -> w15
              }
              frame False {
                w15 = "✅"
              }
            }
            w16 = w14
            w17 = s1
            w18 = s2
          }
          frame "Control Temperature Off" {
            Decimal String To Number(default (0 I32)=0, string=w14) -> (number=w173)
            Decimal String To Number(default (0 I32)=0, string="60") -> (number=w174)
            Is Less Or Equal(x=w173, y=w174) -> w175
            case (w175) {
              frame True {
                w176 = "Temperature limit is too low, it could cause high water consumption"
                Concatenate Strings("⚠️", w176) -> w15
              }
              frame False {
                w15 = "✅"
              }
            }
            w16 = w14
            w17 = s1
            w18 = s2
          }
          frame "Control Mode" {
            Decimal String To Number(default (0 I32)=0, string=w14) -> (number=w177)
            case (w177) {
              frame 1, Default {
                w15 = "✅ No control temperatures are used."
                w16 = "OFF"
              }
              frame 2 {
                w15 = "✅: The unit defined control temperatures are used."
                w16 = "Eco"
              }
              frame 3 {
                w15 = "✅: The temperature controls are in use."
                w16 = "ON"
              }
              frame 0 {
                w15 = "✅"
                w16 = "Undefined"
              }
            }
            w17 = w16
            w18 = s2
          }
          frame "Profile selection Heavy Duty" {
            Decimal String To Number(default (0 I32)=0, string=w14) -> (number=w178)
            case (w178) {
              frame 1 {
                w15 = "✅"
                w16 = "Light User"
              }
              frame 2 {
                w15 = "✅"
                w16 = "Medium User"
              }
              frame 3 {
                w15 = "✅"
                w16 = "Heavy User"
              }
              frame 0, Default {
                w15 = "✅"
                w16 = "Default"
              }
            }
            w17 = w16
            w18 = s2
          }
          frame "NaOH free tabs enable" {
            Decimal String To Number(default (0 I32)=0, string=w14) -> (number=w179)
            case (w179) {
              frame 1, Default {
                w15 = "⚠️ NaOH (Natriumhydroxid) free tabs is enabled !"
                w16 = "YES"
              }
              frame 0 {
                w15 = "✅"
                w16 = "NO"
              }
            }
            w17 = w16
            w18 = s2
          }
          frame "Plate a la carte weight" {
            Decimal String To Number(default (0 I32)=0, string=w14) -> (number=w180)
            case (w180) {
              frame 1, Default {
                w15 = "✅"
                w16 = "< 899g"
              }
              frame 2 {
                w15 = "✅"
                w16 = "1099 g"
              }
              frame 3 {
                w15 = "✅"
                w16 = "1100g"
              }
              frame 0 {
                w15 = "✅"
                w16 = "< 700g"
              }
            }
            w17 = w16
            w18 = s2
          }
          frame "Gas type" {
            w15 = "✅"
            w16 = w14
            w17 = s1
            w18 = w14
          }
          frame "Foam reduction iCareSystem" {
            Decimal String To Number(default (0 I32)=0, string=w14) -> (number=w181)
            case (w181) {
              frame 1 {
                w15 = "✅"
                w16 = "ON"
              }
              frame 0, Default {
                w15 = "⚠️ Foam reduction iCareSystem is deactivated !"
                w16 = "OFF"
              }
            }
            w17 = s1
            w18 = s2
          }
          frame "Altitude boiling point" {
            Decimal String To Number(default (0 I32)=0, string=w14) -> (number=w182)
            Is Equal(x=w182, y=0) -> w183
            case (w183) {
              frame True {
                w184 = "❌"  # String {0}
                Concatenate Strings(w184, " Device is not calibrated!") -> w15
              }
              frame False {
                w15 = "✅"
              }
            }
            w16 = w14
            w17 = s1
            w18 = s2
          }
          frame "CDS-Sensor XS", "Drain Valve time0", "Drain Valve time1", "Installation voltage" {
            w185 = " Information not required for this device type"  # String {0}
            Concatenate Strings("[ℹ]", w185) -> w15
            w16 = w14
            w17 = s1
            w18 = s2
          }
          frame "Chefline phone setting", "Ethernet eth0 active", "Ethernet eth0 dhcp", "Ethernet eth0 dns", "Ethernet eth0 gateway", "Ethernet eth0 ip", "Ethernet eth0 mac", "Ethernet eth0 netmask", "Service phone setting", "Wifi wlan0 dhcp", "Wifi wlan0 dns", "Wifi wlan0 gateway", "Wifi wlan0 ip", "Wifi wlan0 mac", "Wifi wlan0 netmask" {
            call "Trim Whitespace.gvi"(string=w14) -> (trimmed string=w186)
            Is Empty String Or Path(string/path=w186) -> w187
            case (w187) {
              frame False, Default {
                w15 = "✅"
              }
              frame True {
                w188 = " Information is missing for this device type"  # String {0}
                Concatenate Strings("[ℹ]", w188) -> w15
              }
            }
            w16 = w14
            w17 = s1
            w18 = s2
          }
        }
      }
    }
    Property Node(instance in=T1 {all zero or empty}, "Parameter Name"=w6, "Value"=w16, "Dimension"=w11, "Comment"=w15) -> (instance out=w189)
    append w189 to w2
    next s1 = w17
    next s2 = w18
  }
  for {
    w190 = each element of w2
    Property Node(instance in=w190) -> ("Parameter Name"=w192, "Value"=w193, "Dimension"=w194, "Comment"=w195)
    call "Set_Eco_State.gviweb"(Control Mode=s1, Parameter Name=w192, Comment in=w195, Error input=$"Error input") -> (Comment out=w196, Output=w197)
    call "Change_Parameter_Value.gviweb"(Value=w193, Comment in=w196, Error input=w197) -> (Comment out=w198, Output=w199)
    Property Node(instance in=T1 {all zero or empty}, "Parameter Name"=w192, "Value"=w193, "Dimension"=w194, "Comment"=w198) -> (instance out=w200)
    append w200 to w191
  }
  $"Basic Informations" <- w191
  $"Output Error" <- w199
