vi "Interpret_Common_Information.gviweb"   [G Web Development Software 22.3.0]
inputs:
  "Common Information Entrys": string[]
  "Error Cluster Constant": error
  "Language Entrys": string[]
  "BMKs": string[]
outputs:
  "Output Error": error
  "Boards Informations:": T1[]
  "Device:": string
  "common": T2[]
  "Unit-type": string
  "Ultravent": string
  "Startup Date and Time": string
  "Auto Dose": string
panel controls:
  "Without_WA_Entrys": string[]
types:
  T1 = cluster{"Boards": string, "Informations": string}
  T2 = cluster{"Parameter Name": string, "Value": string, "Comment": string}
uses:
  WebApp::Get_Config_ini_Part.gviweb
  NI::G Core::Strings::Search and Replace Pattern.gvi
  NI::G Core::Strings::Trim Whitespace.gvi
  WebApp::Change_to_validate_Date.gvi
  WebApp::Add_BMK_to_Comment.gviweb
diagram:
  call "Get_Config_ini_Part.gviweb"(Ini Array=$"Language Entrys", ini Part from Array=0, Error in=$"Error Cluster Constant") -> (Ini Part as Array=w1, Output Error=w2)
  call "Get_Config_ini_Part.gviweb"(Ini Array=$"Language Entrys", ini Part from Array=1, Error in=w2) -> (Ini Part as Array=w3, Output Error=w4)
  call "Get_Config_ini_Part.gviweb"(Ini Array=$"Language Entrys", ini Part from Array=2, Error in=w4) -> (Ini Part as Array=w5, Output Error=w6)
  # ⚠️
  s1 = "Device"  # shift register
  s2 = "Ultravent_not_available"  # shift register
  s3 = ""  # shift register
  s4 = ""  # shift register
  for {
    w7 = each element of $"Common Information Entrys"
    Match Pattern(regular expression="=", string=w7) -> (after substring=w9, before substring=w10)
    call "Search and Replace Pattern.gvi"(String=w10, Muster="val", Alle ersetzen=TRUE) -> (Ergebnis-String=w11)
    # parm.value
    call "Search and Replace Pattern.gvi"(String=w11, Muster="_", Ersetzungs-String=" ", Alle ersetzen=TRUE) -> (Ergebnis-String=w12)
    call "Trim Whitespace.gvi"(String=w12) -> (Gekürzter String=w13)
    call "Search and Replace Pattern.gvi"(String=w9, Muster="\"", Alle ersetzen=TRUE) -> (Ergebnis-String=w14)
    case (w13) {
      frame "False", Default {
        w15 = s1
        w16 = s2
        w17 = FALSE
        w18 = s4
      }
      frame "Chemical Controller Revision" {
        Is Equal(x=w14, y="0") -> w19
        case (w19) {
          frame False, Default {
            w18 = "AutoDose_available"
          }
          frame True {
            w18 = "AutoDose_not_available"
          }
        }
        w15 = s1
        w16 = s2
        w17 = FALSE
      }
      frame "Status UltraVent" {
        case (w14) {
          frame "false", Default {
            w16 = "Ultravent_not_available"
          }
          frame "true" {
            w16 = "Ultravent_available"
          }
        }
        w15 = s1
        w17 = FALSE
        w18 = s4
      }
      frame "Unit Type" {
        case (w14) {
          frame "False", Default {
            w20 = "No_Analyse.png"
            w15 = w14
            w17 = TRUE
          }
          frame "623", "E523" {
            call "Search and Replace Pattern.gvi"(string=s1, pattern="Device", replace string=w14) -> (result string=w15)
            w20 = "E523.jpg"
            w17 = FALSE
          }
          frame "E61", "E61T" {
            call "Search and Replace Pattern.gvi"(string=s1, pattern="Device", replace string=w14) -> (result string=w15)
            w20 = "E61.jpg"
            w17 = FALSE
          }
          frame "G61" {
            call "Search and Replace Pattern.gvi"(string=s1, pattern="Device", replace string=w14) -> (result string=w15)
            w20 = "G61.jpg"
            w17 = FALSE
          }
          frame "G62" {
            call "Search and Replace Pattern.gvi"(string=s1, pattern="Device", replace string=w14) -> (result string=w15)
            w20 = "G62.jpg"
            w17 = FALSE
          }
          frame "E62" {
            call "Search and Replace Pattern.gvi"(string=s1, pattern="Device", replace string=w14) -> (result string=w15)
            w20 = "E62.jpg"
            w17 = FALSE
          }
          frame "E101", "G101" {
            call "Search and Replace Pattern.gvi"(string=s1, pattern="Device", replace string=w14) -> (result string=w15)
            w20 = "E101.jpg"
            w17 = FALSE
          }
          frame "E102", "G102" {
            call "Search and Replace Pattern.gvi"(string=s1, pattern="Device", replace string=w14) -> (result string=w15)
            w20 = "E102.jpg"
            w17 = FALSE
          }
          frame "E201", "G201" {
            call "Search and Replace Pattern.gvi"(string=s1, pattern="Device", replace string=w14) -> (result string=w15)
            w20 = "E102.jpg"
            w17 = FALSE
          }
          frame "E202", "G202" {
            call "Search and Replace Pattern.gvi"(string=s1, pattern="Device", replace string=w14) -> (result string=w15)
            w20 = "E202.jpg"
            w17 = FALSE
          }
        }
        $"Device:" <- w20
        w16 = s2
        w18 = s4
      }
    }
    Is Empty String Or Path(string/path=w14) -> w21
    # w16: UV
    case (w21) {
      frame False {
        # w14: param_values
        # w13: param_name
        # w15: Device type
        # w16: Ultravent state
        # w5: ini_Ultravent_infos
        case (w13) {
          frame "False", Default {
            w22 = "✅"
            w23 = w14
            w27 = w16
            w24 = w6
            w25 = s3
            w26 = w18
          }
          frame "Date and Time" {
            call "Change_to_validate_Date.gvi"(Date_Time_String input=w14, Error Cluster input=w6) -> (Validate date and time=w23, Error Cluster output=w24)
            Decimal String To Number(string=w14) -> (offset past number=w28)
            Is Equal(x=w28, y=14) -> w29
            case (w29) {
              frame False, Default {
                w30 = "❌"  # String {0}
                Concatenate Strings(w30, " ", w13, " ", "is incorrect") -> w22
              }
              frame True {
                w22 = "✅"
              }
            }
            w27 = w16
            w25 = s3
            w26 = w18
          }
          frame "Startup Date and Time" {
            call "Change_to_validate_Date.gvi"(Date_Time_String input=w14, Error Cluster input=w6) -> (Validate date and time=w23, Error Cluster output=w24)
            Decimal String To Number(string=w14) -> (offset past number=w31)
            Is Equal(x=w31, y=14) -> w32
            case (w32) {
              frame False, Default {
                w33 = "⚠️"  # String {0}
                Concatenate Strings(w33, " ", w13, " ", "will automatically ", "\r", "change after about 10 hours of operation.") -> w22
              }
              frame True {
                w22 = "✅"
              }
            }
            w27 = w16
            w25 = w14
            w26 = w18
          }
          frame "Unit Serial number" {
            String Length(string=w14) -> (length=w34)
            Is Equal(x=w34, y=16) -> w35
            case (w35) {
              frame False, Default {
                w36 = "❌"  # String {0}
                Concatenate Strings(w36, " ", w13, " ", "is incorrect") -> w22
              }
              frame True {
                w22 = "✅"
              }
            }
            w23 = w14
            w27 = w16
            w24 = w6
            w25 = s3
            w26 = w18
          }
          frame "Script version" {
            String Length(string=w14) -> (length=w37)
            Is Equal(x=w37, y=0) -> w38
            case (w38) {
              frame False, Default {
                w39 = "⚠️"  # String {0}
                Concatenate Strings(w39, " ", w13, " ", "is available!") -> w22
              }
              frame True {
                w22 = "✅"
              }
            }
            w23 = w14
            w27 = w16
            w24 = w6
            w25 = s3
            w26 = w18
          }
          frame "Language" {
            Decimal String To Number(string=w14) -> (number=w40)
            Is Greater Or Equal(x=w40, y=1) -> w41
            Is Less Or Equal(x=w40, y=65) -> w42
            Logical And(w41, w42) -> w43
            case (w43) {
              frame False, Default {
                w44 = "❌"  # String {0}
                Concatenate Strings(w44, " ", w13, " ", "is missing") -> w22
                w24 = w6
                w23 = w14
              }
              frame True {
                case (w40) {
                  frame 0, Default {
                    w24 = w6
                    w23 = w14
                  }
                  frame 1 {
                    w24 = w6
                    w23 = "catalan"
                  }
                  frame 2 {
                    w24 = w6
                    w23 = "czech"
                  }
                  frame 3 {
                    w24 = w6
                    w23 = "cymraeg"
                  }
                  frame 4 {
                    w24 = w6
                    w23 = "danish"
                  }
                  frame 5 {
                    w24 = w6
                    w23 = "german"
                  }
                  frame 6 {
                    w24 = w6
                    w23 = "german (Austria)"
                  }
                  frame 7 {
                    w24 = w6
                    w23 = "german (Swiss)"
                  }
                  frame 8 {
                    w24 = w6
                    w23 = "estonian"
                  }
                  frame 9 {
                    w24 = w6
                    w23 = "english (Australia)"
                  }
                  frame 10 {
                    w24 = w6
                    w23 = "english (Canada)"
                  }
                  frame 11 {
                    w24 = w6
                    w23 = "english (UK)"
                  }
                  frame 12 {
                    w24 = w6
                    w23 = "english (USA)"
                  }
                  frame 13 {
                    w24 = w6
                    w23 = "english (others)"
                  }
                  frame 14 {
                    w24 = w6
                    w23 = "spanish"
                  }
                  frame 15 {
                    w24 = w6
                    w23 = "spanish (Chile)"
                  }
                  frame 16 {
                    w24 = w6
                    w23 = "spanish (Peru)"
                  }
                  frame 17 {
                    w24 = w6
                    w23 = "spanish (USA)"
                  }
                  frame 18 {
                    w24 = w6
                    w23 = "spanish (Mexiko)"
                  }
                  frame 19 {
                    w24 = w6
                    w23 = "basque"
                  }
                  frame 20 {
                    w24 = w6
                    w23 = "french"
                  }
                  frame 21 {
                    w24 = w6
                    w23 = "french (Swiss)"
                  }
                  frame 22 {
                    w24 = w6
                    w23 = "french (Canada)"
                  }
                  frame 23 {
                    w24 = w6
                    w23 = "gaelic"
                  }
                  frame 24 {
                    w24 = w6
                    w23 = "croatian"
                  }
                  frame 25 {
                    w24 = w6
                    w23 = "icelandic"
                  }
                  frame 26 {
                    w24 = w6
                    w23 = "italian"
                  }
                  frame 27 {
                    w24 = w6
                    w23 = "italian (Swiss)"
                  }
                  frame 28 {
                    w24 = w6
                    w23 = "latvian"
                  }
                  frame 29 {
                    w24 = w6
                    w23 = "lithuanian"
                  }
                  frame 30 {
                    w24 = w6
                    w23 = "hungarian"
                  }
                  frame 31 {
                    w24 = w6
                    w23 = "malay"
                  }
                  frame 32 {
                    w24 = w6
                    w23 = "dutch"
                  }
                  frame 33 {
                    w24 = w6
                    w23 = "norgwgian"
                  }
                  frame 34 {
                    w24 = w6
                    w23 = "polish"
                  }
                  frame 35 {
                    w24 = w6
                    w23 = "portugese"
                  }
                  frame 36 {
                    w24 = w6
                    w23 = "portugese (Brasil)"
                  }
                  frame 37 {
                    w24 = w6
                    w23 = "romanian"
                  }
                  frame 38 {
                    w24 = w6
                    w23 = "slovensky"
                  }
                  frame 39 {
                    w24 = w6
                    w23 = "slovene"
                  }
                  frame 40 {
                    w24 = w6
                    w23 = "serbian"
                  }
                  frame 41 {
                    w24 = w6
                    w23 = "serbian (cyrill)"
                  }
                  frame 42 {
                    w24 = w6
                    w23 = "finnish"
                  }
                  frame 43 {
                    w24 = w6
                    w23 = "swedish"
                  }
                  frame 44 {
                    w24 = w6
                    w23 = "turkish"
                  }
                  frame 45 {
                    w24 = w6
                    w23 = "greek"
                  }
                  frame 46 {
                    w24 = w6
                    w23 = "bulgarian"
                  }
                  frame 47 {
                    w24 = w6
                    w23 = "russian"
                  }
                  frame 48 {
                    w24 = w6
                    w23 = "ukrainian"
                  }
                  frame 49 {
                    w24 = w6
                    w23 = "hebrew"
                  }
                  frame 50 {
                    w24 = w6
                    w23 = "arabic"
                  }
                  frame 51 {
                    w24 = w6
                    w23 = "hindi"
                  }
                  frame 52 {
                    w24 = w6
                    w23 = "thai"
                  }
                  frame 53 {
                    w24 = w6
                    w23 = "korean"
                  }
                  frame 54 {
                    w24 = w6
                    w23 = "japanese"
                  }
                  frame 55 {
                    w24 = w6
                    w23 = "chinese (new)"
                  }
                  frame 56 {
                    w24 = w6
                    w23 = "chinese (old)"
                  }
                  frame 57 {
                    w24 = w6
                    w23 = "philippine"
                  }
                  frame 58 {
                    w24 = w6
                    w23 = "english (India)"
                  }
                  frame 59 {
                    w24 = w6
                    w23 = "indonesian"
                  }
                  frame 60 {
                    w24 = w6
                    w23 = "persian"
                  }
                  frame 61 {
                    w24 = w6
                    w23 = "chinese (traditional & others)"
                  }
                  frame 62 {
                    w24 = w6
                    w23 = "spanish (Argentina)"
                  }
                  frame 63 {
                    w24 = w6
                    w23 = "spanish (Colombia)"
                  }
                  frame 64 {
                    w24 = w6
                    w23 = "azerbaijan"
                  }
                  frame 65 {
                    w24 = w6
                    w23 = "vietnamese"
                  }
                }
                w22 = "✅"
              }
            }
            w27 = w16
            w25 = s3
            w26 = w18
          }
          frame "Unit Type" {
            case (w14) {
              frame "False", Default {
                w45 = "Unit type is incorrect, analysis of the service report XML file is not possible"
                One Button Dialog(button name ("OK")="OK", message=w45)
                w46 = "❌"  # String {0}
                Concatenate Strings(w46, " ", w13, " ", "is incorrect") -> w22
              }
              frame "623", "E101", "E102", "E201", "E202", "E523", "E61", "E61T", "E62", "E623", "G101", "G102", "G201", "G202", "G61", "G62" {
                w22 = "✅"
              }
            }
            w23 = w14
            w27 = w16
            w24 = w6
            w25 = s3
            w26 = w18
          }
          frame "UltraVent Board Serial number", "UltraVent Serial number" {
            case (w16) {
              frame "False", Default {
                w47 = "  UltraVent is not implemented for this device !"  # String {0}
                Concatenate Strings("[ℹ]", w47) -> w22
              }
              frame "Ultravent_available" {
                call "Trim Whitespace.gvi"(String=w14) -> (Gekürzter String=w48)
                Is Not Equal(x=w48, y="") -> w49
                case (w49) {
                  frame False, Default {
                    case (w15) {
                      frame "False", Default {
                        w50 = "⚠️"  # String {0}
                        Concatenate Strings(w50, " ", w13, " ", "is missing") -> w22
                      }
                      frame "623", "E523" {
                        w51 = "⚠️"  # String {0}
                        Concatenate Strings(w51, " ", w13, " ", "is missing") -> w22
                      }
                    }
                  }
                  frame True {
                    case (w48) {
                      frame "False", Default {
                        w22 = "✅"
                      }
                      frame "0" {
                        w52 = "❌"  # String {0}
                        Concatenate Strings(w52, " ", w13, " ", "is incorrect") -> w22
                      }
                      frame "" {
                        w53 = "❌"  # String {0}
                        Concatenate Strings(w53, " ", w13, " ", "is missing") -> w22
                      }
                    }
                  }
                }
              }
            }
            w23 = w14
            w27 = w16
            w24 = w6
            w25 = s3
            w26 = w18
          }
          frame "UltraVent Plus" {
            case (w16) {
              frame "False", Default {
                w54 = "  UltraVent is not implemented for this device !"  # String {0}
                Concatenate Strings("[ℹ]", w54) -> w22
              }
              frame "Ultravent_available" {
                Is Not Equal(x=w14, y="") -> w55
                case (w55) {
                  frame False, Default {
                    w56 = "❌"  # String {0}
                    Concatenate Strings(w56, " ", w13, " ", "is missing") -> w22
                  }
                  frame True {
                    case (w15) {
                      frame "False", Default {
                        case (w14) {
                          frame "true", Default {
                            w22 = "✅"
                          }
                        }
                      }
                      frame "623", "E523" {
                        case (w14) {
                          frame "false", Default {
                            w22 = "✅"
                          }
                          frame "true" {
                            w57 = "❌"  # String {0}
                            Concatenate Strings(w57, " ", w13, " ", "is incorrect: should be false") -> w22
                          }
                        }
                      }
                    }
                  }
                }
              }
            }
            w23 = w14
            w27 = w16
            w24 = w6
            w25 = s3
            w26 = w18
          }
          frame "UltraVent SW-version" {
            case (w16) {
              frame "False", Default {
                w58 = "  UltraVent is not implemented for this device !"  # String {0}
                Concatenate Strings("[ℹ]", w58) -> w22
              }
              frame "Ultravent_available" {
                Is Not Equal(x=w14, y="") -> w59
                case (w59) {
                  frame False, Default {
                    w60 = "❌"  # String {0}
                    Concatenate Strings(w60, " ", w13, " ", "is missing") -> w22
                  }
                  frame True {
                    case (w15) {
                      frame "False", Default {
                        case (w14) {
                          frame "False", Default {
                            w22 = "✅"
                          }
                          frame "0.0.0" {
                            w61 = "❌"  # String {0}
                            Concatenate Strings(w61, " ", w13, " ", "is incorrect") -> w22
                          }
                        }
                      }
                      frame "623", "E523" {
                        case (w14) {
                          frame "False", Default {
                            w22 = "✅"
                          }
                          frame "0" {
                            w62 = "❌"  # String {0}
                            Concatenate Strings(w62, " ", w13, " ", "is incorrect") -> w22
                          }
                        }
                      }
                    }
                  }
                }
              }
            }
            w23 = w14
            w27 = w16
            w24 = w6
            w25 = s3
            w26 = w18
          }
          frame "Software version" {
            Match Pattern(regular expression="LM100", string=w14) -> (match substring=w63)
            Is Equal(x=w63, y="LM100") -> w64
            case (w64) {
              frame False, Default {
                w65 = "❌"  # String {0}
                Concatenate Strings(w65, " ", w13, " ", "is incorrect") -> w22
              }
              frame True {
                w22 = "✅"
              }
            }
            w23 = w14
            w27 = w16
            w24 = w6
            w25 = s3
            w26 = w18
          }
          frame "Chemical Controller Revision", "Chemical Controller SW-version", "Chemical Controller Serial number", "Conductivity Sensor Revision", "Conductivity Sensor SW-version", "Conductivity Sensor Serial number" {
            case (w18) {
              frame "False", Default {
                w66 = " Information not required for this device type"  # String {0}
                Concatenate Strings("[ℹ]", w66) -> w22
              }
              frame "AutoDose_available" {
                Is Empty String Or Path(string/path=w14) -> w67
                Is Equal(x=w14, y="0") -> w68
                Is Equal(x=w14, y="0.0.0") -> w69
                Logical Or(w68, w69, w67) -> w70
                case (w70) {
                  frame True {
                    w71 = "❌"  # String {0}
                    Concatenate Strings(w71, " ", w13, " ", "is incorrect") -> w22
                  }
                  frame False {
                    w22 = "✅"
                  }
                }
              }
            }
            w23 = w14
            w27 = w14
            w24 = w6
            w25 = s3
            w26 = w18
          }
          frame "SDcard inserted", "microSD card inserted" {
            Match Pattern(regular expression="OK", string=w14) -> (match substring=w72)
            Is Equal(x=w14, y=w72) -> w73
            case (w73) {
              frame False, Default {
                w74 = "❌"  # String {0}
                Concatenate Strings(w74, " ", "Check the inserted SDcard !", " ") -> w22
              }
              frame True {
                w22 = "✅"
              }
            }
            w23 = w14
            w27 = w16
            w24 = w6
            w25 = s3
            w26 = w18
          }
          frame "microSD card file system" {
            Match Pattern(regular expression="EXT4", string=w14) -> (match substring=w75)
            Is Equal(x=w14, y=w75) -> w76
            case (w76) {
              frame False, Default {
                w77 = "❌"  # String {0}
                Concatenate Strings(w77, " ", "The file system for microSD cards \nshould be EXT4.", " ") -> w22
              }
              frame True {
                w22 = "✅"
              }
            }
            w23 = w14
            w27 = w16
            w24 = w6
            w25 = s3
            w26 = w18
          }
          frame "microSD card free MB" {
            Decimal String To Number(default (0 I32)=0, string=w14) -> (number=w78)
            Is Greater Or Equal(x=w78, y=10) -> w79
            case (w79) {
              frame False, Default {
                w80 = "The free space on the microSD \ncard should be more than 10 MB."
                w81 = "❌"  # String {0}
                Concatenate Strings(w81, " ", w80, " ") -> w22
              }
              frame True {
                w22 = "✅"
              }
            }
            w23 = w14
            w27 = w16
            w24 = w6
            w25 = s3
            w26 = w18
          }
          frame "microSD card total MB" {
            Decimal String To Number(default (0 I32)=0, string=w14) -> (number=w82)
            Is Greater Or Equal(x=w82, y=5000) -> w83
            case (w83) {
              frame False, Default {
                w84 = "The total space on the microSD \ncard should be more than 5000 MB."
                w85 = "❌"  # String {0}
                Concatenate Strings(w85, " ", w84, " ") -> w22
              }
              frame True {
                w22 = "✅"
              }
            }
            w23 = w14
            w27 = w16
            w24 = w6
            w25 = s3
            w26 = w18
          }
        }
      }
      frame True {
        case (w15) {
          frame "False", Default {
            case (w13) {
              frame "False", Default {
                w86 = "❌"  # String {0}
                Concatenate Strings(w86, " ", w13, " ", "is missing") -> w22
              }
              frame "Unit Type" {
                w87 = "Unit type is missing, analysis of the service report XML file is not possible"
                One Button Dialog(button name ("OK")="OK", message=w87)
                w88 = "❌"  # String {0}
                Concatenate Strings(w88, " ", w13, " ", "is missing") -> w22
              }
            }
          }
          frame "623", "E523" {
            # w13: par.name
            # w16: UV State
            call "Trim Whitespace.gvi"(string=w13) -> (trimmed string=w89)
            case (w89) {
              frame "Burner Control Manufactoring date", "Burner Control Revision", "Burner Control SW-version", "Burner Control Serial number", "Chemical Controller Revision", "Chemical Controller SW-version", "Chemical Controller Serial number", "Conductivity Sensor Revision", "Conductivity Sensor SW-version", "Conductivity Sensor Serial number", "Fan M16 Revision", "Fan M16 SW-version", "Fan M16 Serial number", "Fan M22 Revision", "Fan M22 SW-version", "Fan M22 Serial number", "Magnetron Power Supply Temperature bottom", "Magnetron Power Supply Temperature top", "Magnetron Temperature bottom", "Magnetron Temperature top", "Magnetron bottom Revision", "Magnetron bottom SW-version", "Magnetron bottom Serial number", "Magnetron top Revision", "Magnetron top SW-version", "Magnetron top Serial number", "Microwave power supply bottom Revision", "Microwave power supply bottom SW-version", "Microwave power supply bottom Serial number", "Microwave power supply top Revision", "Microwave power supply top SW-version", "Microwave power supply top Serial number", "Pump-Board Manufacturing date", "Pump-Board Revision", "Pump-Board SW-version", "Pump-Board Serial number" {
                w90 = " Information not required for this device type"  # String {0}
                Concatenate Strings("[ℹ]", w90) -> w22
              }
              frame "Energy optimisation", "Script version" {
                w91 = " Information is not implemented for this device"  # String {0}
                Concatenate Strings("[ℹ]", w91) -> w22
              }
              frame "UltraVent SW-version" {
                case (w16) {
                  frame "False", Default {
                    w92 = "   UltraVent is not implemented for this device !"  # String {0}
                    Concatenate Strings("[ℹ]", w92) -> w22
                  }
                  frame "Ultravent_available" {
                    Is Not Equal(x=w14, y="") -> w93
                    case (w93) {
                      frame False, Default {
                        w94 = "❌"  # String {0}
                        Concatenate Strings(w94, " ", w89, " ", "is missing") -> w22
                      }
                      frame True {
                        case (w14) {
                          frame "False", Default {
                            w22 = "✅"
                          }
                          frame " " {
                            w95 = "❌"  # String {0}
                            Concatenate Strings(w95, " ", w89, " ", "is incorrect") -> w22
                          }
                        }
                      }
                    }
                  }
                }
              }
              frame "UltraVent Plus" {
                case (w16) {
                  frame "False", Default {
                    w96 = "   UltraVent is not implemented for this device !"  # String {0}
                    Concatenate Strings("[ℹ]", w96) -> w22
                  }
                  frame "Ultravent_available" {
                    Is Not Equal(x=w14, y="") -> w97
                    case (w97) {
                      frame False, Default {
                        w98 = "⚠️"  # String {0}
                        Concatenate Strings(w98, " ", w89, " ", "value is missing") -> w22
                      }
                      frame True {
                        case (w14) {
                          frame "False", Default {
                            w22 = "✅"
                          }
                          frame "" {
                            w99 = "❌"  # String {0}
                            Concatenate Strings(w99, " ", w89, " ", "is incorrect") -> w22
                          }
                        }
                      }
                    }
                  }
                }
              }
              frame "UltraVent Board Serial number", "UltraVent Serial number" {
                case (w16) {
                  frame "False", Default {
                    w100 = "   UltraVent is not implemented for this device !"  # String {0}
                    Concatenate Strings("[ℹ]", w100) -> w22
                  }
                  frame "Ultravent_available" {
                    Is Not Equal(x=w14, y="") -> w101
                    case (w101) {
                      frame False, Default {
                        w102 = "⚠️"  # String {0}
                        Concatenate Strings(w102, " ", w89, " ", "is missing") -> w22
                      }
                      frame True {
                        case (w14) {
                          frame "False", Default {
                            w22 = "✅"
                          }
                          frame "0" {
                            w103 = "❌"  # String {0}
                            Concatenate Strings(w103, " ", w89, " ", "is incorrect") -> w22
                          }
                        }
                      }
                    }
                  }
                }
              }
              frame "True", Default {
                w104 = "❌"  # String {0}
                Concatenate Strings(w104, " ", w13, " ", "is missing") -> w22
              }
            }
          }
          frame "E61", "E62" {
            case (w13) {
              frame "Burner Control Manufactoring date", "Burner Control Revision", "Burner Control SW-version", "Burner Control Serial number", "Chemical Controller Revision", "Chemical Controller SW-version", "Chemical Controller Serial number", "Conductivity Sensor Revision", "Conductivity Sensor SW-version", "Fan M16 Revision", "Fan M16 SW-version", "Fan M16 Serial number", "Fan M22 Revision", "Fan M22 SW-version", "Fan M22 Serial number", "Magnetron bottom Revision", "Magnetron bottom SW-version", "Magnetron bottom Serial number", "Magnetron top Revision", "Magnetron top SW-version", "Magnetron top Serial number", "Microwave power supply bottom Revision", "Microwave power supply bottom SW-version", "Microwave power supply bottom Serial number", "Microwave power supply top Revision", "Microwave power supply top SW-version", "Microwave power supply top Serial number", "SW-Version", "XS Additional PCB", "XS Additional PCB Revision", "XS Additional PCB SW-Version", "XS Additional PCB Serial Number" {
                w105 = " Information is not required for this device"  # String {0}
                Concatenate Strings("[ℹ]", w105) -> w22
              }
              frame "Script version" {
                w106 = " Information is not implemented for this device"  # String {0}
                Concatenate Strings("[ℹ]", w106) -> w22
              }
              frame "UltraVent SW-version" {
                case (w16) {
                  frame "False", Default {
                    w107 = "   UltraVent is not implemented for this device !"  # String {0}
                    Concatenate Strings("[ℹ]", w107) -> w22
                  }
                  frame "Ultravent_available" {
                    Is Not Equal(x=w14, y="") -> w108
                    case (w108) {
                      frame False, Default {
                        w109 = "❌"  # String {0}
                        Concatenate Strings(w109, " ", w13, " ", "is missing") -> w22
                      }
                      frame True {
                        case (w14) {
                          frame "False", Default {
                            w22 = "✅"
                          }
                          frame "0.0.0" {
                            w110 = "❌"  # String {0}
                            Concatenate Strings(w110, " ", w13, " ", "is incorrect") -> w22
                          }
                        }
                      }
                    }
                  }
                }
              }
              frame "UltraVent Plus" {
                case (w16) {
                  frame "False", Default {
                    w111 = "   UltraVent is not implemented for this device !"  # String {0}
                    Concatenate Strings("[ℹ]", w111) -> w22
                  }
                  frame "Ultravent_available" {
                    Is Not Equal(x=w14, y="") -> w112
                    case (w112) {
                      frame False, Default {
                        w113 = "⚠️"  # String {0}
                        Concatenate Strings(w113, " ", w13, " ", "value is missing") -> w22
                      }
                      frame True {
                        case (w14) {
                          frame "False", Default {
                            w22 = "✅"
                          }
                          frame "" {
                            w114 = "❌"  # String {0}
                            Concatenate Strings(w114, " ", w13, " ", "is incorrect") -> w22
                          }
                        }
                      }
                    }
                  }
                }
              }
              frame "Conductivity Sensor Serial number" {
                case (w18) {
                  frame "False", Default {
                    w115 = " Information is not implemented for this device"  # String {0}
                    Concatenate Strings("[ℹ]", w115) -> w22
                  }
                  frame "AutoDose_available" {
                    Is Not Equal(x=w14, y="") -> w116
                    case (w116) {
                      frame False, Default {
                        w117 = "❌"  # String {0}
                        Concatenate Strings(w117, " ", w13, " ", "is missing") -> w22
                      }
                      frame True {
                        case (w14) {
                          frame "False", Default {
                            w22 = "✅"
                          }
                          frame "0", "0.0.0" {
                            w118 = "❌"  # String {0}
                            Concatenate Strings(w118, " ", w13, " ", "is incorrect") -> w22
                          }
                        }
                      }
                    }
                  }
                }
              }
              frame "UltraVent Board Serial number", "UltraVent Serial number" {
                case (w16) {
                  frame "False", Default {
                    w119 = "   UltraVent is not implemented for this device !"  # String {0}
                    Concatenate Strings("[ℹ]", w119) -> w22
                  }
                  frame "Ultravent_available" {
                    Is Not Equal(x=w14, y="") -> w120
                    case (w120) {
                      frame False, Default {
                        w121 = "❌"  # String {0}
                        Concatenate Strings(w121, " ", w13, " ", "is missing") -> w22
                      }
                      frame True {
                        case (w14) {
                          frame "False", Default {
                            w22 = "✅"
                          }
                          frame "0.0.0" {
                            w122 = "❌"  # String {0}
                            Concatenate Strings(w122, " ", w13, " ", "is incorrect") -> w22
                          }
                        }
                      }
                    }
                  }
                }
              }
              frame "True", Default {
                w123 = "❌"  # String {0}
                Concatenate Strings(w123, " ", w13, " ", "is missing") -> w22
              }
            }
          }
          frame "E61T", "E62T" {
            case (w13) {
              frame "Burner Control Manufactoring date", "Burner Control Revision", "Burner Control SW-version", "Burner Control Serial number", "Fan M16 Revision", "Fan M16 SW-version", "Fan M16 Serial number", "Fan M22 Revision", "Fan M22 SW-version", "Fan M22 Serial number", "SW-Version", "XS Additional PCB", "XS Additional PCB Revision", "XS Additional PCB SW-Version", "XS Additional PCB Serial Number" {
                w124 = " Information not required for this device type"  # String {0}
                Concatenate Strings("[ℹ]", w124) -> w22
              }
              frame "Energy optimisation", "Script version" {
                w125 = " Information is not implemented for this device"  # String {0}
                Concatenate Strings("[ℹ]", w125) -> w22
              }
              frame "UltraVent SW-version" {
                case (w16) {
                  frame "False", Default {
                    w126 = "   UltraVent is not implemented for this device !"  # String {0}
                    Concatenate Strings("[ℹ]", w126) -> w22
                  }
                  frame "Ultravent_available" {
                    Is Not Equal(x=w14, y="") -> w127
                    case (w127) {
                      frame False, Default {
                        w128 = "❌"  # String {0}
                        Concatenate Strings(w128, " ", w13, " ", "is missing") -> w22
                      }
                      frame True {
                        case (w14) {
                          frame "False", Default {
                            w22 = "✅"
                          }
                          frame "0.0.0" {
                            w129 = "❌"  # String {0}
                            Concatenate Strings(w129, " ", w13, " ", "is incorrect") -> w22
                          }
                        }
                      }
                    }
                  }
                }
              }
              frame "UltraVent Plus" {
                case (w16) {
                  frame "False", Default {
                    w130 = "   UltraVent is not implemented for this device !"  # String {0}
                    Concatenate Strings("[ℹ]", w130) -> w22
                  }
                  frame "Ultravent_available" {
                    Is Not Equal(x=w14, y="") -> w131
                    case (w131) {
                      frame False, Default {
                        w132 = "⚠️"  # String {0}
                        Concatenate Strings(w132, " ", w13, " ", "value is missing") -> w22
                      }
                      frame True {
                        case (w14) {
                          frame "False", Default {
                            w22 = "✅"
                          }
                          frame "" {
                            w133 = "❌"  # String {0}
                            Concatenate Strings(w133, " ", w13, " ", "is incorrect") -> w22
                          }
                        }
                      }
                    }
                  }
                }
              }
              frame "Conductivity Sensor Serial number" {
                case (w18) {
                  frame "False", Default {
                    w134 = " Information is not implemented for this device"  # String {0}
                    Concatenate Strings("[ℹ]", w134) -> w22
                  }
                  frame "AutoDose_available" {
                    Is Not Equal(x=w14, y="") -> w135
                    case (w135) {
                      frame False, Default {
                        w136 = "❌"  # String {0}
                        Concatenate Strings(w136, " ", w13, " ", "is missing") -> w22
                      }
                      frame True {
                        case (w14) {
                          frame "False", Default {
                            w22 = "✅"
                          }
                          frame "0.0.0" {
                            w137 = "❌"  # String {0}
                            Concatenate Strings(w137, " ", w13, " ", "is incorrect") -> w22
                          }
                        }
                      }
                    }
                  }
                }
              }
              frame "UltraVent Board Serial number", "UltraVent Serial number" {
                case (w18) {
                  frame "False", Default {
                    w138 = "   UltraVent is not implemented for this device !"  # String {0}
                    Concatenate Strings("[ℹ]", w138) -> w22
                  }
                  frame "Ultravent_available" {
                    Is Not Equal(x=w14, y="") -> w139
                    case (w139) {
                      frame False, Default {
                        w140 = "❌"  # String {0}
                        Concatenate Strings(w140, " ", w13, " ", "is missing") -> w22
                      }
                      frame True {
                        case (w14) {
                          frame "False", Default {
                            w22 = "✅"
                          }
                          frame "0" {
                            w141 = "❌"  # String {0}
                            Concatenate Strings(w141, " ", w13, " ", "is incorrect") -> w22
                          }
                        }
                      }
                    }
                  }
                }
              }
              frame "True", Default {
                w142 = "❌"  # String {0}
                Concatenate Strings(w142, " ", w13, " ", "is missing") -> w22
              }
            }
          }
          frame "E101", "E102" {
            case (w13) {
              frame "Burner Control Manufactoring date", "Burner Control Revision", "Burner Control SW-version", "Burner Control Serial number", "Chemical Controller SW-version", "Chemical Controller Serial number", "Conductivity Sensor Revision", "Conductivity Sensor SW-version", "Conductivity Sensor Serial number", "Fan M22 Revision", "Fan M22 SW-version", "Fan M22 Serial number", "Magnetron bottom Revision", "Magnetron bottom SW-version", "Magnetron bottom Serial number", "Magnetron top Revision", "Magnetron top SW-version", "Magnetron top Serial number", "Microwave power supply bottom Revision", "Microwave power supply bottom SW-version", "Microwave power supply bottom Serial number", "Microwave power supply top Revision", "Microwave power supply top SW-version", "Microwave power supply top Serial number", "SW-Version", "XS Additional PCB", "XS Additional PCB Revision", "XS Additional PCB SW-Version", "XS Additional PCB Serial Number" {
                w143 = " Information not required for this device type"  # String {0}
                Concatenate Strings("[ℹ]", w143) -> w22
              }
              frame "Energy optimisation", "Script version" {
                w144 = "  Information is not implemented for this device"  # String {0}
                Concatenate Strings("[ℹ]", w144) -> w22
              }
              frame "UltraVent SW-version" {
                case (w16) {
                  frame "False", Default {
                    w145 = "  UltraVent is not implemented for this device !"  # String {0}
                    Concatenate Strings("[ℹ]", w145) -> w22
                  }
                  frame "Ultravent_available" {
                    Is Not Equal(x=w14, y="") -> w146
                    case (w146) {
                      frame False, Default {
                        w147 = "❌"  # String {0}
                        Concatenate Strings(w147, " ", w13, " ", "is missing") -> w22
                      }
                      frame True {
                        case (w14) {
                          frame "False", Default {
                            w22 = "✅"
                          }
                          frame "0.0.0" {
                            w148 = "❌"  # String {0}
                            Concatenate Strings(w148, " ", w13, " ", "is incorrect") -> w22
                          }
                        }
                      }
                    }
                  }
                }
              }
              frame "UltraVent Plus" {
                case (w16) {
                  frame "False", Default {
                    w149 = "  UltraVent is not implemented for this device !"  # String {0}
                    Concatenate Strings("[ℹ]", w149) -> w22
                  }
                  frame "Ultravent_available" {
                    Is Not Equal(x=w14, y="") -> w150
                    case (w150) {
                      frame False, Default {
                        w151 = "⚠️"  # String {0}
                        Concatenate Strings(w151, " ", w13, " ", "value is missing") -> w22
                      }
                      frame True {
                        case (w14) {
                          frame "False", Default {
                            w22 = "✅"
                          }
                          frame "" {
                            w152 = "❌"  # String {0}
                            Concatenate Strings(w152, " ", w13, " ", "is incorrect") -> w22
                          }
                        }
                      }
                    }
                  }
                }
              }
              frame "Chemical Controller Revision" {
                case (w18) {
                  frame "False", Default {
                    w153 = " Information is not implemented for this device"  # String {0}
                    Concatenate Strings("[ℹ]", w153) -> w22
                  }
                  frame "AutoDose_available" {
                    Is Not Equal(x=w14, y="") -> w154
                    case (w154) {
                      frame False, Default {
                        w155 = "❌"  # String {0}
                        Concatenate Strings(w155, " ", w13, " ", "is missing") -> w22
                      }
                      frame True {
                        case (w14) {
                          frame "False", Default {
                            w22 = "✅"
                          }
                          frame "0.0.0" {
                            w156 = "❌"  # String {0}
                            Concatenate Strings(w156, " ", w13, " ", "is incorrect") -> w22
                          }
                        }
                      }
                    }
                  }
                }
              }
              frame "UltraVent Board Serial number", "UltraVent Serial number" {
                case (w16) {
                  frame "False", Default {
                    w157 = "   UltraVent is not implemented for this device !"  # String {0}
                    Concatenate Strings("[ℹ]", w157) -> w22
                  }
                  frame "Ultravent_available" {
                    Is Not Equal(x=w14, y="") -> w158
                    case (w158) {
                      frame False, Default {
                        w159 = "❌"  # String {0}
                        Concatenate Strings(w159, " ", w13, " ", "is missing") -> w22
                      }
                      frame True {
                        case (w14) {
                          frame "False", Default {
                            w22 = "✅"
                          }
                          frame "0" {
                            w160 = "❌"  # String {0}
                            Concatenate Strings(w160, " ", w13, " ", "is incorrect") -> w22
                          }
                        }
                      }
                    }
                  }
                }
              }
              frame "True", Default {
                w161 = "❌"  # String {0}
                Concatenate Strings(w161, " ", w13, " ", "is missing") -> w22
              }
            }
          }
          frame "G101", "G102" {
            case (w13) {
              frame "Chemical Controller SW-version", "Chemical Controller Serial number", "Conductivity Sensor Revision", "Conductivity Sensor SW-version", "Conductivity Sensor Serial number", "Fan M22 Revision", "Fan M22 SW-version", "Fan M22 Serial number", "Magnetron bottom Revision", "Magnetron bottom SW-version", "Magnetron bottom Serial number", "Magnetron top Revision", "Magnetron top SW-version", "Magnetron top Serial number", "Microwave power supply bottom Revision", "Microwave power supply bottom SW-version", "Microwave power supply bottom Serial number", "Microwave power supply top Revision", "Microwave power supply top SW-version", "Microwave power supply top Serial number", "XS Additional PCB", "XS Additional PCB Revision", "XS Additional PCB SW-Version", "XS Additional PCB Serial Number" {
                w162 = " Information not required for this device type"  # String {0}
                Concatenate Strings("[ℹ]", w162) -> w22
              }
              frame "Energy optimisation", "Script version" {
                w163 = " Information is not implemented for this device"  # String {0}
                Concatenate Strings("[ℹ]", w163) -> w22
              }
              frame "UltraVent SW-version" {
                case (w16) {
                  frame "False", Default {
                    w164 = "   UltraVent is not implemented for this device !"  # String {0}
                    Concatenate Strings("[ℹ]", w164) -> w22
                  }
                  frame "Ultravent_available" {
                    Is Not Equal(x=w14, y="") -> w165
                    case (w165) {
                      frame False, Default {
                        w166 = "❌"  # String {0}
                        Concatenate Strings(w166, " ", w13, " ", "is missing") -> w22
                      }
                      frame True {
                        case (w14) {
                          frame "False", Default {
                            w22 = "✅"
                          }
                          frame "0.0.0" {
                            w167 = "❌"  # String {0}
                            Concatenate Strings(w167, " ", w13, " ", "is incorrect") -> w22
                          }
                        }
                      }
                    }
                  }
                }
              }
              frame "UltraVent Plus" {
                case (w16) {
                  frame "False", Default {
                    w168 = "   UltraVent is not implemented for this device !"  # String {0}
                    Concatenate Strings("[ℹ]", w168) -> w22
                  }
                  frame "Ultravent_available" {
                    Is Not Equal(x=w14, y="") -> w169
                    case (w169) {
                      frame False, Default {
                        w170 = "⚠️"  # String {0}
                        Concatenate Strings(w170, " ", w13, " ", "value is missing") -> w22
                      }
                      frame True {
                        case (w14) {
                          frame "False", Default {
                            w22 = "✅"
                          }
                          frame "" {
                            w171 = "❌"  # String {0}
                            Concatenate Strings(w171, " ", w13, " ", "is incorrect") -> w22
                          }
                        }
                      }
                    }
                  }
                }
              }
              frame "Chemical Controller Revision" {
                case (w18) {
                  frame "False", Default {
                    w172 = "   UltraVent is not implemented for this device !"  # String {0}
                    Concatenate Strings("[ℹ]", w172) -> w22
                  }
                  frame "AutoDose_available" {
                    Is Not Equal(x=w14, y="") -> w173
                    case (w173) {
                      frame False, Default {
                        w174 = "❌"  # String {0}
                        Concatenate Strings(w174, " ", w13, " ", "is missing") -> w22
                      }
                      frame True {
                        case (w14) {
                          frame "False", Default {
                            w22 = "✅"
                          }
                          frame "0.0.0" {
                            w175 = "❌"  # String {0}
                            Concatenate Strings(w175, " ", w13, " ", "is incorrect") -> w22
                          }
                        }
                      }
                    }
                  }
                }
              }
              frame "UltraVent Board Serial number", "UltraVent Serial number" {
                case (w16) {
                  frame "False", Default {
                    w176 = "   UltraVent is not implemented for this device !"  # String {0}
                    Concatenate Strings("[ℹ]", w176) -> w22
                  }
                  frame "Ultravent_available" {
                    Is Not Equal(x=w14, y="") -> w177
                    case (w177) {
                      frame False, Default {
                        w178 = "❌"  # String {0}
                        Concatenate Strings(w178, " ", w13, " ", "is missing") -> w22
                      }
                      frame True {
                        case (w14) {
                          frame "False", Default {
                            w22 = "✅"
                          }
                          frame "0" {
                            w179 = "❌"  # String {0}
                            Concatenate Strings(w179, " ", w13, " ", "is incorrect") -> w22
                          }
                        }
                      }
                    }
                  }
                }
              }
              frame "True", Default {
                w180 = "❌"  # String {0}
                Concatenate Strings(w180, " ", w13, " ", "is missing") -> w22
              }
            }
          }
          frame "E201", "E202" {
            case (w13) {
              frame "Burner Control Manufactoring date", "Burner Control Revision", "Burner Control SW-version", "Burner Control Serial number", "Chemical Controller Revision", "Chemical Controller SW-version", "Chemical Controller Serial number", "Conductivity Sensor Revision", "Conductivity Sensor SW-version", "Conductivity Sensor Serial number", "Magnetron bottom Revision", "Magnetron bottom SW-version", "Magnetron bottom Serial number", "Magnetron top Revision", "Magnetron top SW-version", "Magnetron top Serial number", "Microwave power supply bottom Revision", "Microwave power supply bottom SW-version", "Microwave power supply bottom Serial number", "Microwave power supply top Revision", "Microwave power supply top SW-version", "Microwave power supply top Serial number", "SW-Version", "XS Additional PCB", "XS Additional PCB Revision", "XS Additional PCB SW-Version", "XS Additional PCB Serial Number" {
                w181 = " Information not required for this device type"  # String {0}
                Concatenate Strings("[ℹ]", w181) -> w22
              }
              frame "Energy optimisation", "Script version" {
                w182 = " Information is not implemented for this device"  # String {0}
                Concatenate Strings("[ℹ]", w182) -> w22
              }
              frame "UltraVent SW-version" {
                case (w16) {
                  frame "False", Default {
                    w183 = "   UltraVent is not implemented for this device !"  # String {0}
                    Concatenate Strings("[ℹ]", w183) -> w22
                  }
                  frame "Ultravent_available" {
                    Is Not Equal(x=w14, y="") -> w184
                    case (w184) {
                      frame False, Default {
                        w185 = "❌"  # String {0}
                        Concatenate Strings(w185, " ", w13, " ", "is missing") -> w22
                      }
                      frame True {
                        case (w14) {
                          frame "False", Default {
                            w22 = "✅"
                          }
                          frame "0.0.0" {
                            w186 = "❌"  # String {0}
                            Concatenate Strings(w186, " ", w13, " ", "is incorrect") -> w22
                          }
                        }
                      }
                    }
                  }
                }
              }
              frame "UltraVent Plus" {
                case (w16) {
                  frame "False", Default {
                    w187 = "   UltraVent is not implemented for this device !"  # String {0}
                    Concatenate Strings("[ℹ]", w187) -> w22
                  }
                  frame "Ultravent_available" {
                    Is Not Equal(x=w14, y="") -> w188
                    case (w188) {
                      frame False, Default {
                        w189 = "⚠️"  # String {0}
                        Concatenate Strings(w189, " ", w13, " ", "is missing") -> w22
                      }
                      frame True {
                        case (w14) {
                          frame "False", Default {
                            w22 = "✅"
                          }
                          frame "" {
                            w190 = "❌"  # String {0}
                            Concatenate Strings(w190, " ", w13, " ", "is incorrect") -> w22
                          }
                        }
                      }
                    }
                  }
                }
              }
              frame "UltraVent Board Serial number", "UltraVent Serial number" {
                case (w16) {
                  frame "False", Default {
                    w191 = "   UltraVent is not implemented for this device !"  # String {0}
                    Concatenate Strings("[ℹ]", w191) -> w22
                  }
                  frame "Ultravent_available" {
                    Is Not Equal(x=w14, y="") -> w192
                    case (w192) {
                      frame False, Default {
                        w193 = "❌"  # String {0}
                        Concatenate Strings(w193, " ", w13, " ", "is missing") -> w22
                      }
                      frame True {
                        case (w14) {
                          frame "False", Default {
                            w22 = "✅"
                          }
                          frame "0" {
                            w194 = "❌"  # String {0}
                            Concatenate Strings(w194, " ", w13, " ", "is incorrect") -> w22
                          }
                        }
                      }
                    }
                  }
                }
              }
              frame "True", Default {
                w195 = "❌"  # String {0}
                Concatenate Strings(w195, " ", w13, " ", "is missing") -> w22
              }
            }
          }
          frame "G201", "G202" {
            case (w13) {
              frame "Chemical Controller SW-version", "Chemical Controller Serial number", "Conductivity Sensor Revision", "Conductivity Sensor SW-version", "Conductivity Sensor Serial number", "Magnetron bottom Revision", "Magnetron bottom SW-version", "Magnetron bottom Serial number", "Magnetron top Revision", "Magnetron top SW-version", "Magnetron top Serial number", "Microwave power supply bottom Revision", "Microwave power supply bottom SW-version", "Microwave power supply bottom Serial number", "Microwave power supply top Revision", "Microwave power supply top SW-version", "Microwave power supply top Serial number", "XS Additional PCB", "XS Additional PCB Revision", "XS Additional PCB SW-Version", "XS Additional PCB Serial Number" {
                w196 = " Information not required for this device type"  # String {0}
                Concatenate Strings("[ℹ]", w196) -> w22
              }
              frame "Energy optimisation", "Script version" {
                w197 = " Information is not implemented for this device"  # String {0}
                Concatenate Strings("[ℹ]", w197) -> w22
              }
              frame "UltraVent SW-version" {
                case (w16) {
                  frame "False", Default {
                    w198 = "   UltraVent is not implemented for this device !"  # String {0}
                    Concatenate Strings("[ℹ]", w198) -> w22
                  }
                  frame "Ultravent_available" {
                    Is Not Equal(x=w14, y="") -> w199
                    case (w199) {
                      frame False, Default {
                        w200 = "❌"  # String {0}
                        Concatenate Strings(w200, " ", w13, " ", "is missing") -> w22
                      }
                      frame True {
                        case (w14) {
                          frame "False", Default {
                            w22 = "✅"
                          }
                          frame "0.0.0" {
                            w201 = "❌"  # String {0}
                            Concatenate Strings(w201, " ", w13, " ", "is incorrect") -> w22
                          }
                        }
                      }
                    }
                  }
                }
              }
              frame "UltraVent Plus" {
                case (w16) {
                  frame "False", Default {
                    w202 = "   UltraVent is not implemented for this device !"  # String {0}
                    Concatenate Strings("[ℹ]", w202) -> w22
                  }
                  frame "Ultravent_available" {
                    Is Not Equal(x=w14, y="") -> w203
                    case (w203) {
                      frame False, Default {
                        w204 = "⚠️"  # String {0}
                        Concatenate Strings(w204, " ", w13, " ", "value is missing") -> w22
                      }
                      frame True {
                        case (w14) {
                          frame "False", Default {
                            w22 = "✅"
                          }
                          frame "0.0.0" {
                            w205 = "❌"  # String {0}
                            Concatenate Strings(w205, " ", w13, " ", "is incorrect") -> w22
                          }
                        }
                      }
                    }
                  }
                }
              }
              frame "Chemical Controller Revision" {
                case (w18) {
                  frame "False", Default {
                    w206 = " Information is not implemented for this device"  # String {0}
                    Concatenate Strings("[ℹ]", w206) -> w22
                  }
                  frame "AutoDose_available" {
                    Is Not Equal(x=w14, y="") -> w207
                    case (w207) {
                      frame False, Default {
                        w208 = "❌"  # String {0}
                        Concatenate Strings(w208, " ", w13, " ", "is missing") -> w22
                      }
                      frame True {
                        case (w14) {
                          frame "False", Default {
                            w22 = "✅"
                          }
                          frame "0.0.0" {
                            w209 = "❌"  # String {0}
                            Concatenate Strings(w209, " ", w13, " ", "is incorrect") -> w22
                          }
                        }
                      }
                    }
                  }
                }
              }
              frame "UltraVent Board Serial number", "UltraVent Serial number" {
                case (w16) {
                  frame "False", Default {
                    w210 = "   UltraVent is not implemented for this device !"  # String {0}
                    Concatenate Strings("[ℹ]", w210) -> w22
                  }
                  frame "Ultravent_available" {
                    Is Not Equal(x=w14, y="") -> w211
                    case (w211) {
                      frame False, Default {
                        w212 = "❌"  # String {0}
                        Concatenate Strings(w212, " ", w13, " ", "is missing") -> w22
                      }
                      frame True {
                        case (w14) {
                          frame "False", Default {
                            w22 = "✅"
                          }
                          frame "0" {
                            w213 = "❌"  # String {0}
                            Concatenate Strings(w213, " ", w13, " ", "is incorrect") -> w22
                          }
                        }
                      }
                    }
                  }
                }
              }
              frame "True", Default {
                w214 = "❌"  # String {0}
                Concatenate Strings(w214, " ", w13, " ", "is missing") -> w22
              }
            }
          }
          frame "G61", "G62" {
            case (w13) {
              frame "Chemical Controller Revision", "Chemical Controller SW-version", "Chemical Controller Serial number", "Conductivity Sensor Revision", "Conductivity Sensor SW-version", "Conductivity Sensor Serial number", "Fan M16 Revision", "Fan M16 SW-version", "Fan M16 Serial number", "Fan M22 Revision", "Fan M22 SW-version", "Fan M22 Serial number", "Magnetron bottom Revision", "Magnetron bottom SW-version", "Magnetron bottom Serial number", "Magnetron top Revision", "Magnetron top SW-version", "Magnetron top Serial number", "Microwave power supply bottom Revision", "Microwave power supply bottom SW-version", "Microwave power supply bottom Serial number", "Microwave power supply top Revision", "Microwave power supply top SW-version", "Microwave power supply top Serial number", "XS Additional PCB", "XS Additional PCB Revision", "XS Additional PCB SW-Version", "XS Additional PCB Serial Number" {
                w215 = " Information not required for this device type"  # String {0}
                Concatenate Strings("[ℹ]", w215) -> w22
              }
              frame "Energy optimisation", "Script version" {
                w216 = " Information is not implemented for this device"  # String {0}
                Concatenate Strings("[ℹ]", w216) -> w22
              }
              frame "UltraVent SW-version" {
                case (w16) {
                  frame "False", Default {
                    w217 = "   UltraVent is not implemented for this device !"  # String {0}
                    Concatenate Strings("[ℹ]", w217) -> w22
                  }
                  frame "Ultravent_available" {
                    Is Not Equal(x=w14, y="") -> w218
                    case (w218) {
                      frame False, Default {
                        w219 = "❌"  # String {0}
                        Concatenate Strings(w219, " ", w13, " ", "is missing") -> w22
                      }
                      frame True {
                        case (w14) {
                          frame "False", Default {
                            w22 = "✅"
                          }
                          frame "0.0.0" {
                            w220 = "❌"  # String {0}
                            Concatenate Strings(w220, " ", w13, " ", "is incorrect") -> w22
                          }
                        }
                      }
                    }
                  }
                }
              }
              frame "UltraVent Plus" {
                case (w16) {
                  frame "False", Default {
                    w221 = "   UltraVent is not implemented for this device !"  # String {0}
                    Concatenate Strings("[ℹ]", w221) -> w22
                  }
                  frame "Ultravent_available" {
                    Is Not Equal(x=w14, y="") -> w222
                    case (w222) {
                      frame False, Default {
                        w223 = "⚠️"  # String {0}
                        Concatenate Strings(w223, " ", w13, " ", "value is missing") -> w22
                      }
                      frame True {
                        case (w14) {
                          frame "False", Default {
                            w22 = "✅"
                          }
                          frame "" {
                            w224 = "❌"  # String {0}
                            Concatenate Strings(w224, " ", w13, " ", "is incorrect") -> w22
                          }
                        }
                      }
                    }
                  }
                }
              }
              frame "UltraVent Board Serial number", "UltraVent Serial number" {
                case (w16) {
                  frame "False", Default {
                    w225 = "   UltraVent is not implemented for this device !"  # String {0}
                    Concatenate Strings("[ℹ]", w225) -> w22
                  }
                  frame "Ultravent_available" {
                    Is Not Equal(x=w14, y="") -> w226
                    case (w226) {
                      frame False, Default {
                        w227 = "❌"  # String {0}
                        Concatenate Strings(w227, " ", w13, " ", "is missing") -> w22
                      }
                      frame True {
                        case (w14) {
                          frame "False", Default {
                            w22 = "✅"
                          }
                          frame "0" {
                            w228 = "❌"  # String {0}
                            Concatenate Strings(w228, " ", w13, " ", "is incorrect") -> w22
                          }
                        }
                      }
                    }
                  }
                }
              }
              frame "True", Default {
                w229 = "❌"  # String {0}
                Concatenate Strings(w229, " ", w13, " ", "is missing") -> w22
              }
            }
          }
        }
        w23 = w14
        w24 = w6
        w25 = s3
        w26 = w18
      }
    }
    case (w13) {
      frame "False", Default {
        call "Trim Whitespace.gvi"(string="") -> (trimmed string=w231)
        w230 = w24
      }
      frame "IO-Board Serial number" {
        call "Add_BMK_to_Comment.gviweb"(BMKs=$BMKs, Parameter name=w13, Input=w24) -> (Changed Component=w231, Output=w230)
      }
      frame "Pump-Board Serial number" {
        call "Add_BMK_to_Comment.gviweb"(BMKs=$BMKs, Parameter name=w13, Input=w24) -> (Changed Component=w231, Output=w230)
      }
      frame "CPU-Board Serial number" {
        call "Add_BMK_to_Comment.gviweb"(BMKs=$BMKs, Parameter name=w13, Input=w24) -> (Changed Component=w231, Output=w230)
      }
      frame "Fan M1 Serial number" {
        call "Add_BMK_to_Comment.gviweb"(BMKs=$BMKs, Parameter name=w13, Input=w24) -> (Changed Component=w231, Output=w230)
      }
      frame "Fan M16 Serial number" {
        call "Add_BMK_to_Comment.gviweb"(BMKs=$BMKs, Parameter name=w13, Input=w24) -> (Changed Component=w231, Output=w230)
      }
      frame "Fan M22 Serial number" {
        call "Add_BMK_to_Comment.gviweb"(BMKs=$BMKs, Parameter name=w13, Input=w24) -> (Changed Component=w231, Output=w230)
      }
      frame "Burner Control Serial number" {
        call "Add_BMK_to_Comment.gviweb"(BMKs=$BMKs, Parameter name=w13, Input=w24) -> (Changed Component=w231, Output=w230)
      }
      frame "Chemical Controller Serial number" {
        call "Add_BMK_to_Comment.gviweb"(BMKs=$BMKs, Parameter name=w13, Input=w24) -> (Changed Component=w231, Output=w230)
      }
    }
    Is Empty String Or Path(string/path=w231) -> w232
    case (w232) {
      frame True {
        w233 = w22
      }
      frame False {
        call "Search and Replace Pattern.gvi"(string=w22, pattern="✅") -> (result string=w234)
        Concatenate Strings(w234, "\r\n", w231) -> w235
        call "Trim Whitespace.gvi"(string=w235, location="both"(0)) -> (trimmed string=w233)
      }
    }
    Property Node(instance in=T2 {all zero or empty}, "Parameter Name"=w13, "Value"=w23, "Comment"=w233) -> (instance out=w236)
    append w236 to w8
    next s1 = w15
    next s2 = w16
    next s3 = w25
    next s4 = w26
    stop if w17
  }
  $common <- w8
  $"Startup Date and Time" <- s3
  s5 = string[] []  # shift register
  s6 = string[] []  # shift register
  for {
    w237 = each element of w8
    Property Node(instance in=w237) -> ("Parameter Name"=w238, "Value"=w239)
    case (w238) {
      frame "False", Default {
        w240 = s5
        w241 = s6
      }
      frame "Touchcontroller type" {
        Insert Into Array(inArray=s6, new=w238) -> w241
        case (w239) {
          frame "False", Default {
            w242 = "------"
          }
          frame "T1" {
            w242 = "Atmel Chip"
          }
          frame "T2" {
            w242 = "ILITEK"
          }
        }
        Insert Into Array(inArray=s5, new=w242) -> w240
      }
      frame "CPU-Board Revision" {
        Insert Into Array(inArray=s6, new=w238) -> w241
        case (w239) {
          frame "False", Default {
            w243 = "Benchmark Board"
          }
          frame "A0" {
            w243 = "Avnet Board"
          }
        }
        Insert Into Array(inArray=s5, new=w243) -> w240
      }
      frame "IO-Board Serial number" {
        Insert Into Array(inArray=s6, new=w238) -> w241
        String Subset(length (rest)=1, string=w239) -> w244
        case (w244) {
          frame "False", Default {
            w245 = "IO"
          }
          frame "C" {
            w245 = "IO LO"
          }
        }
        Insert Into Array(inArray=s5, new=w245) -> w240
      }
      frame "Pump-Board Serial number" {
        Insert Into Array(inArray=s6, new="Pump-Board μC-Type") -> w241
        String Subset(length (rest)=3, string=w239) -> w246
        case (w246) {
          frame "False", Default {
            w247 = "IO"
          }
          frame "PC6" {
            w247 = "G4"
          }
          frame "PC3" {
            w247 = "F1"
          }
        }
        Insert Into Array(inArray=s5, new=w247) -> w240
      }
    }
    next s5 = w240
    next s6 = w241
  }
  for {
    w248 = each element of s6
    w249 = each element of s5
    Property Node(instance in=T1 {all zero or empty}, "Boards"=w248, "Informations"=w249) -> (instance out=w251)
    append w251 to w250
  }
  $"Boards Informations:" <- w250
  $"Unit-type" <- s1
  $Ultravent <- s2
  $"Output Error" <- w230
  $"Auto Dose" <- s4
