vi "Interpret_Common_Information_iVario.gviweb"   [G Web Development Software 22.3.0]
inputs:
  "Common Information Entrys": string[]
  "Error Cluster Constant": error
  "Language Entrys": string[]
  "BMKs": string[]
outputs:
  "common": T2[]
  "Boards Informations:": T1[]
  "Output Error": error
  "Device:": string
  "Unit-type": string
panel indicators:
  "Ultravent": string
  "Startup Date and Time": string
types:
  T1 = cluster{"Boards": string, "Informations": string}
  T2 = cluster{"Parameter Name": string, "Value": string, "Comment": string}
uses:
  WebApp::Get_Config_ini_Part.gviweb
  NI::G Core::Strings::Search and Replace Pattern.gvi
  NI::G Core::Strings::Trim Whitespace.gvi
  WebApp::Change_to_validate_Date.gvi
  WebApp::Add_BMK_to_Comment.gviweb
  WebApp::Add_BMK_to_Comment_iVario.gviweb
diagram:
  call "Get_Config_ini_Part.gviweb"(Ini Array=$"Language Entrys", ini Part from Array=0, Error in=$"Error Cluster Constant") -> (Ini Part as Array=w1, Output Error=w2)
  call "Get_Config_ini_Part.gviweb"(Ini Array=$"Language Entrys", ini Part from Array=1, Error in=w2) -> (Ini Part as Array=w3, Output Error=w4)
  call "Get_Config_ini_Part.gviweb"(Ini Array=$"Language Entrys", ini Part from Array=2, Error in=w4) -> (Ini Part as Array=w5, Output Error=w6)
  s1 = "Device"  # shift register
  s2 = ""  # shift register
  s3 = ""  # shift register
  for {
    w7 = each element of $"Common Information Entrys"
    Match Pattern(regular expression="dim=", string=w7) -> (after substring=w9, before substring=w10)
    call "Search and Replace Pattern.gvi"(String=w10, Muster="_", Ersetzungs-String=" ", Alle ersetzen=TRUE) -> (Ergebnis-String=w11)
    call "Trim Whitespace.gvi"(string=w11) -> (trimmed string=w12)
    Match Pattern(regular expression="val=", string=w9) -> (after substring=w13)
    call "Search and Replace Pattern.gvi"(String=w13, Muster="\"", Alle ersetzen=TRUE) -> (Ergebnis-String=w14)
    call "Trim Whitespace.gvi"(String=w14) -> (Gekürzter String=w15)
    Is Empty String Or Path(string/path=w15) -> w16
    case (w12) {
      frame "False", Default {
        w17 = s1
        w18 = s2
        w19 = FALSE
        w20 = s3
      }
      frame "IO-Board A13 active" {
        Match Pattern(regular expression="true", string=w15) -> (match substring=w21)
        case (w21) {
          frame "false", Default {
            w20 = "IO-Board A13 not available"
          }
          frame "true" {
            w20 = "IO-Board A13 available"
          }
        }
        w17 = s1
        w18 = s2
        w19 = FALSE
      }
      frame "H-Bridge active" {
        Match Pattern(regular expression="true", string=w15) -> (match substring=w22)
        case (w22) {
          frame "false", Default {
            w18 = "H-Bridge not available"
          }
          frame "true" {
            w18 = "H-Bridge available"
          }
        }
        w17 = s1
        w19 = FALSE
        w20 = s3
      }
      frame "Unit Type" {
        case (w15) {
          frame "False", Default {
            w23 = "No_Analyse.png"
            w17 = "Unit type is incorrect"
            w19 = TRUE
          }
          frame "2-XS" {
            call "Search and Replace Pattern.gvi"(string=s1, pattern="Device", replace string=w15) -> (result string=w17)
            w23 = "2-XS.jpg"
            w19 = FALSE
          }
          frame "2-XS P" {
            call "Search and Replace Pattern.gvi"(string=s1, pattern="Device", replace string=w15) -> (result string=w17)
            w23 = "2-S.jpg"
            w19 = TRUE
          }
          frame "2-S" {
            call "Search and Replace Pattern.gvi"(string=s1, pattern="Device", replace string=w15) -> (result string=w17)
            w23 = "2-S.jpg"
            w19 = FALSE
          }
          frame "2-S P" {
            call "Search and Replace Pattern.gvi"(string=s1, pattern="Device", replace string=w15) -> (result string=w17)
            w23 = "2-S.jpg"
            w19 = FALSE
          }
          frame "L" {
            call "Search and Replace Pattern.gvi"(string=s1, pattern="Device", replace string=w15) -> (result string=w17)
            w23 = "L.jpg"
            w19 = FALSE
          }
          frame "L P" {
            call "Search and Replace Pattern.gvi"(string=s1, pattern="Device", replace string=w15) -> (result string=w17)
            w23 = "L.jpg"
            w19 = FALSE
          }
          frame "XL" {
            call "Search and Replace Pattern.gvi"(string=s1, pattern="Device", replace string=w15) -> (result string=w17)
            w23 = "XL.jpg"
            w19 = FALSE
          }
          frame "XL P" {
            call "Search and Replace Pattern.gvi"(string=s1, pattern="Device", replace string=w15) -> (result string=w17)
            w23 = "XL.jpg"
            w19 = FALSE
          }
        }
        $"Device:" <- w23
        w18 = s2
        w20 = s3
      }
    }
    case (w16) {
      frame False, Default {
        # w12: param_name
        # w15: param_values
        # w17: Device type
        # w5: ini_Ultravent_infos
        # w18: H Bridge
        # w20: IO-Board A13
        # w1: ini_Languages
        # w3: ini Comm_infos
        case (w12) {
          frame "False", Default {
            w24 = "✅"
            w25 = w15
            w26 = w18
            w27 = w6
            w28 = w20
          }
          frame "Date and Time" {
            Decimal String To Number(string=w15) -> (offset past number=w29)
            Is Equal(x=w29, y=14) -> w30
            case (w30) {
              frame False, Default {
                w31 = "❌"  # String {0}
                Concatenate Strings(w31, " ", w12, " ", "is incorrect") -> w24
              }
              frame True {
                w24 = "✅"
              }
            }
            call "Change_to_validate_Date.gvi"(Date_Time_String input=w15, Error Cluster input=w6) -> (Validate date and time=w25, Error Cluster output=w27)
            w26 = w18
            w28 = w20
          }
          frame "First Startup Date and Time", "Startup Date and Time" {
            Decimal String To Number(string=w15) -> (offset past number=w32)
            Is Equal(x=w32, y=14) -> w33
            case (w33) {
              frame False, Default {
                w34 = "⚠️"  # String {0}
                Concatenate Strings(w34, " ", w12, " ", "will automatically ", "\r", "change after about 10 hours of operation.") -> w24
              }
              frame True {
                w24 = "✅"
              }
            }
            call "Change_to_validate_Date.gvi"(Date_Time_String input=w15, Error Cluster input=w6) -> (Validate date and time=w25, Error Cluster output=w27)
            w26 = w18
            w28 = w20
          }
          frame "Unit Serial number" {
            String Length(string=w15) -> (length=w35)
            Is Equal(x=w35, y=16) -> w36
            case (w36) {
              frame False, Default {
                w37 = "❌"  # String {0}
                Concatenate Strings(w37, " ", w12, " ", "is incorrect") -> w24
              }
              frame True {
                String Subset(length (rest)=4, string=w15) -> w38
                case (w38) {
                  frame "False", Default {
                    w39 = "❌"  # String {0}
                    Concatenate Strings(w39, " serial number is not correct!") -> w24
                  }
                  frame "E07V" {
                    case (w17) {
                      frame "False", Default {
                        w40 = "❌"  # String {0}
                        Concatenate Strings(w40, " serial number doesn't match the stored unit type") -> w24
                      }
                      frame "2-XS" {
                        w24 = "✅"
                      }
                    }
                  }
                  frame "E07P" {
                    case (w17) {
                      frame "False", Default {
                        w41 = "❌"  # String {0}
                        Concatenate Strings(w41, " serial number doesn't match the stored unit type") -> w24
                      }
                      frame "2-XS P" {
                        w24 = "✅"
                      }
                    }
                  }
                  frame "E11V" {
                    case (w17) {
                      frame "False", Default {
                        w42 = "❌"  # String {0}
                        Concatenate Strings(w42, " serial number doesn't match the stored unit type") -> w24
                      }
                      frame "2-S" {
                        w24 = "✅"
                      }
                    }
                  }
                  frame "E11P" {
                    case (w17) {
                      frame "False", Default {
                        w43 = "❌"  # String {0}
                        Concatenate Strings(w43, " serial number doesn't match the stored unit type") -> w24
                      }
                      frame "2-S P" {
                        w24 = "✅"
                      }
                    }
                  }
                  frame "E21V" {
                    case (w17) {
                      frame "False", Default {
                        w44 = "❌"  # String {0}
                        Concatenate Strings(w44, " serial number doesn't match the stored unit type") -> w24
                      }
                      frame "L" {
                        w24 = "✅"
                      }
                    }
                  }
                  frame "E21P" {
                    case (w17) {
                      frame "False", Default {
                        w45 = "❌"  # String {0}
                        Concatenate Strings(w45, " serial number doesn't match the stored unit type") -> w24
                      }
                      frame "L P" {
                        w24 = "✅"
                      }
                    }
                  }
                  frame "E31V" {
                    case (w17) {
                      frame "False", Default {
                        w46 = "❌"  # String {0}
                        Concatenate Strings(w46, " serial number doesn't match the stored unit type") -> w24
                      }
                      frame "XL" {
                        w24 = "✅"
                      }
                    }
                  }
                  frame "E31P" {
                    case (w17) {
                      frame "False", Default {
                        w47 = "❌"  # String {0}
                        Concatenate Strings(w47, " serial number doesn't match the stored unit type") -> w24
                      }
                      frame "XL P" {
                        w24 = "✅"
                      }
                    }
                  }
                }
              }
            }
            w25 = w15
            w26 = w18
            w27 = w6
            w28 = w20
          }
          frame "Language" {
            Decimal String To Number(string=w15) -> (number=w48)
            Is Greater Or Equal(x=w48, y=1) -> w49
            Is Less Or Equal(x=w48, y=65) -> w50
            Logical And(w49, w50) -> w51
            case (w51) {
              frame False, Default {
                w52 = "❌"  # String {0}
                Concatenate Strings(w52, " ", w12, " ", "is missing") -> w24
                w27 = w6
                w25 = w15
              }
              frame True {
                case (w48) {
                  frame 0, Default {
                    w27 = w6
                    w25 = w15
                  }
                  frame 1 {
                    w27 = w6
                    w25 = "catalan"
                  }
                  frame 2 {
                    w27 = w6
                    w25 = "czech"
                  }
                  frame 3 {
                    w27 = w6
                    w25 = "cymraeg"
                  }
                  frame 4 {
                    w27 = w6
                    w25 = "danish"
                  }
                  frame 5 {
                    w27 = w6
                    w25 = "german"
                  }
                  frame 6 {
                    w27 = w6
                    w25 = "german (Austria)"
                  }
                  frame 7 {
                    w27 = w6
                    w25 = "german (Swiss)"
                  }
                  frame 8 {
                    w27 = w6
                    w25 = "estonian"
                  }
                  frame 9 {
                    w27 = w6
                    w25 = "english (Australia)"
                  }
                  frame 10 {
                    w27 = w6
                    w25 = "english (Canada)"
                  }
                  frame 11 {
                    w27 = w6
                    w25 = "english (UK)"
                  }
                  frame 12 {
                    w27 = w6
                    w25 = "english (USA)"
                  }
                  frame 13 {
                    w27 = w6
                    w25 = "english (others)"
                  }
                  frame 14 {
                    w27 = w6
                    w25 = "spanish"
                  }
                  frame 15 {
                    w27 = w6
                    w25 = "spanish (Chile)"
                  }
                  frame 16 {
                    w27 = w6
                    w25 = "spanish (Peru)"
                  }
                  frame 17 {
                    w27 = w6
                    w25 = "spanish (USA)"
                  }
                  frame 18 {
                    w27 = w6
                    w25 = "spanish (Mexiko)"
                  }
                  frame 19 {
                    w27 = w6
                    w25 = "basque"
                  }
                  frame 20 {
                    w27 = w6
                    w25 = "french"
                  }
                  frame 21 {
                    w27 = w6
                    w25 = "french (Swiss)"
                  }
                  frame 22 {
                    w27 = w6
                    w25 = "french (Canada)"
                  }
                  frame 23 {
                    w27 = w6
                    w25 = "gaelic"
                  }
                  frame 24 {
                    w27 = w6
                    w25 = "croatian"
                  }
                  frame 25 {
                    w27 = w6
                    w25 = "icelandic"
                  }
                  frame 26 {
                    w27 = w6
                    w25 = "italian"
                  }
                  frame 27 {
                    w27 = w6
                    w25 = "italian (Swiss)"
                  }
                  frame 28 {
                    w27 = w6
                    w25 = "latvian"
                  }
                  frame 29 {
                    w27 = w6
                    w25 = "lithuanian"
                  }
                  frame 30 {
                    w27 = w6
                    w25 = "hungarian"
                  }
                  frame 31 {
                    w27 = w6
                    w25 = "malay"
                  }
                  frame 32 {
                    w27 = w6
                    w25 = "dutch"
                  }
                  frame 33 {
                    w27 = w6
                    w25 = "norgwgian"
                  }
                  frame 34 {
                    w27 = w6
                    w25 = "polish"
                  }
                  frame 35 {
                    w27 = w6
                    w25 = "portugese"
                  }
                  frame 36 {
                    w27 = w6
                    w25 = "portugese (Brasil)"
                  }
                  frame 37 {
                    w27 = w6
                    w25 = "romanian"
                  }
                  frame 38 {
                    w27 = w6
                    w25 = "slovensky"
                  }
                  frame 39 {
                    w27 = w6
                    w25 = "slovene"
                  }
                  frame 40 {
                    w27 = w6
                    w25 = "serbian"
                  }
                  frame 41 {
                    w27 = w6
                    w25 = "serbian (cyrill)"
                  }
                  frame 42 {
                    w27 = w6
                    w25 = "finnish"
                  }
                  frame 43 {
                    w27 = w6
                    w25 = "swedish"
                  }
                  frame 44 {
                    w27 = w6
                    w25 = "turkish"
                  }
                  frame 45 {
                    w27 = w6
                    w25 = "greek"
                  }
                  frame 46 {
                    w27 = w6
                    w25 = "bulgarian"
                  }
                  frame 47 {
                    w27 = w6
                    w25 = "russian"
                  }
                  frame 48 {
                    w27 = w6
                    w25 = "ukrainian"
                  }
                  frame 49 {
                    w27 = w6
                    w25 = "hebrew"
                  }
                  frame 50 {
                    w27 = w6
                    w25 = "arabic"
                  }
                  frame 51 {
                    w27 = w6
                    w25 = "hindi"
                  }
                  frame 52 {
                    w27 = w6
                    w25 = "thai"
                  }
                  frame 53 {
                    w27 = w6
                    w25 = "korean"
                  }
                  frame 54 {
                    w27 = w6
                    w25 = "japanese"
                  }
                  frame 55 {
                    w27 = w6
                    w25 = "chinese (new)"
                  }
                  frame 56 {
                    w27 = w6
                    w25 = "chinese (old)"
                  }
                  frame 57 {
                    w27 = w6
                    w25 = "philippine"
                  }
                  frame 58 {
                    w27 = w6
                    w25 = "english (India)"
                  }
                  frame 59 {
                    w27 = w6
                    w25 = "indonesian"
                  }
                  frame 60 {
                    w27 = w6
                    w25 = "persian"
                  }
                  frame 61 {
                    w27 = w6
                    w25 = "chinese (traditional & others)"
                  }
                  frame 62 {
                    w27 = w6
                    w25 = "spanish (Argentina)"
                  }
                  frame 63 {
                    w27 = w6
                    w25 = "spanish (Colombia)"
                  }
                  frame 64 {
                    w27 = w6
                    w25 = "azerbaijan"
                  }
                  frame 65 {
                    w27 = w6
                    w25 = "vietnamese"
                  }
                }
                w24 = "✅"
              }
            }
            w26 = w18
            w28 = w20
          }
          frame "Unit Type" {
            case (w15) {
              frame "False", Default {
                w53 = "Unit type is incorrect, analysis of the service report XML file is not possible"
                One Button Dialog(button name ("OK")="OK", message=w53)
                w54 = "❌"  # String {0}
                Concatenate Strings(w54, " ", w12, " ", "is incorrect") -> w24
              }
              frame "2-S", "2-S P", "2-XS", "2-XS P", "L", "L P", "XL", "XL P" {
                w24 = "✅"
              }
            }
            w25 = w15
            w26 = w18
            w27 = w6
            w28 = w20
          }
          frame "H-Bridge Revision", "H-Bridge SW-version", "H-Bridge Serial number", "H-Bridge active" {
            case (w18) {
              frame "False", Default {
                w55 = " H-Bridge is not implemented "  # String {0}
                Concatenate Strings("[ℹ]", w55) -> w24
              }
              frame "H-Bridge available" {
                call "Trim Whitespace.gvi"(String=w15) -> (Gekürzter String=w56)
                Is Not Equal(x=w56, y="") -> w57
                case (w57) {
                  frame False, Default {
                    w58 = "❌"  # String {0}
                    Concatenate Strings(w58, " ", w12, " ", "is missing") -> w24
                  }
                  frame True {
                    case (w56) {
                      frame "False", Default {
                        w24 = "✅"
                      }
                      frame "0" {
                        w59 = "❌"  # String {0}
                        Concatenate Strings(w59, " ", w12, " ", "is incorrect") -> w24
                      }
                      frame "" {
                        w60 = "❌"  # String {0}
                        Concatenate Strings(w60, " ", w12, " ", "is missing") -> w24
                      }
                    }
                  }
                }
              }
            }
            w25 = w15
            w26 = w18
            w27 = w6
            w28 = w20
          }
          frame "IO-Board A13 Revision", "IO-Board A13 SW-version", "IO-Board A13 Serial number", "IO-Board A13 active" {
            case (w20) {
              frame "False", Default {
                w61 = " IO-Board A13 is not implemented "  # String {0}
                Concatenate Strings("[ℹ]", w61) -> w24
              }
              frame "IO-Board A13 available" {
                call "Trim Whitespace.gvi"(String=w15) -> (Gekürzter String=w62)
                Is Not Equal(x=w62, y="") -> w63
                case (w63) {
                  frame False, Default {
                    w64 = "❌"  # String {0}
                    Concatenate Strings(w64, " ", w12, " ", "is missing") -> w24
                  }
                  frame True {
                    case (w62) {
                      frame "False", Default {
                        w24 = "✅"
                      }
                      frame "0" {
                        w65 = "❌"  # String {0}
                        Concatenate Strings(w65, " ", w12, " ", "is incorrect") -> w24
                      }
                      frame "" {
                        w66 = "❌"  # String {0}
                        Concatenate Strings(w66, " ", w12, " ", "is missing") -> w24
                      }
                    }
                  }
                }
              }
            }
            w25 = w15
            w26 = w18
            w27 = w6
            w28 = w20
          }
          frame "Software version" {
            Match Pattern(regular expression="LMX", string=w15) -> (match substring=w67)
            Is Equal(x=w67, y="LMX") -> w68
            case (w68) {
              frame False, Default {
                w69 = "❌"  # String {0}
                Concatenate Strings(w69, " ", w12, " ", "is incorrect") -> w24
              }
              frame True {
                w24 = "✅"
              }
            }
            w25 = w15
            w26 = w18
            w27 = w6
            w28 = w20
          }
          frame "Sdcard inserted", "microSD card inserted" {
            Match Pattern(regular expression="OK", string=w15) -> (match substring=w70)
            Is Equal(x=w15, y=w70) -> w71
            case (w71) {
              frame False, Default {
                w72 = "❌"  # String {0}
                Concatenate Strings(w72, " ", "Check the inserted microSD card !", " ") -> w24
              }
              frame True {
                w24 = "✅"
              }
            }
            w25 = w15
            w26 = w18
            w27 = w6
            w28 = w20
          }
          frame "microSD card file system" {
            Match Pattern(regular expression="EXT4", string=w15) -> (match substring=w73)
            Is Equal(x=w15, y=w73) -> w74
            case (w74) {
              frame False, Default {
                w75 = "❌"  # String {0}
                Concatenate Strings(w75, " ", "The file system for microSD cards \nshould be EXT4.", " ") -> w24
              }
              frame True {
                w24 = "✅"
              }
            }
            w25 = w15
            w26 = w18
            w27 = w6
            w28 = w20
          }
          frame "microSD card free MB" {
            Decimal String To Number(default (0 I32)=0, string=w15) -> (number=w76)
            Is Greater Or Equal(x=w76, y=10) -> w77
            case (w77) {
              frame False, Default {
                w78 = "❌"  # String {0}
                Concatenate Strings(w78, " ", "The file system for microSD cards \nshould be EXT4.", " ") -> w24
              }
              frame True {
                w24 = "✅"
              }
            }
            w25 = w15
            w26 = w18
            w27 = w6
            w28 = w20
          }
          frame "microSD card total MB" {
            Decimal String To Number(default (0 I32)=0, string=w15) -> (number=w79)
            Is Greater Or Equal(x=w79, y=5000) -> w80
            case (w80) {
              frame False, Default {
                w81 = "The total space on the microSD \ncard should be more than 5000 MB."
                w82 = "❌"  # String {0}
                Concatenate Strings(w82, " ", w81, " ") -> w24
              }
              frame True {
                w24 = "✅"
              }
            }
            w25 = w15
            w26 = w18
            w27 = w6
            w28 = w20
          }
        }
      }
      frame True {
        case (w18) {
          frame "False", Default {
            w84 = "❌"  # String {0}
            Concatenate Strings(w84, " ", w12, " ", "is missing") -> w83
          }
          frame "H-Bridge available" {
            case (w12) {
              frame "False", Default {
                w83 = "✅"
              }
              frame "H-Bridge Revision", "H-Bridge SW-version", "H-Bridge Serial number", "H-Bridge active" {
                w85 = "❌"  # String {0}
                Concatenate Strings(w85, " ", w12, " ", "is missing") -> w83
              }
            }
          }
          frame "H-Bridge not available" {
            case (w12) {
              frame "False", Default {
                w83 = "✅"
              }
              frame "H-Bridge Revision", "H-Bridge SW-version", "H-Bridge Serial number", "H-Bridge active" {
                w86 = " H-Bridge is not implemented  !"  # String {0}
                Concatenate Strings("[ℹ]", w86) -> w83
              }
            }
          }
        }
        case (w20) {
          frame "False", Default {
            w24 = w83
          }
          frame "IO-Board A13 available" {
            case (w12) {
              frame "False", Default {
                w24 = "✅"
              }
              frame "IO-Board A13 Revision", "IO-Board A13 SW-version", "IO-Board A13 Serial number", "IO-Board A13 active" {
                w87 = "❌"  # String {0}
                Concatenate Strings(w87, " ", w12, " ", "is missing") -> w24
              }
            }
          }
          frame "IO-Board A13 not available" {
            case (w12) {
              frame "False", Default {
                w24 = "✅"
              }
              frame "IO-Board A13 Revision", "IO-Board A13 SW-version", "IO-Board A13 Serial number", "IO-Board A13 active" {
                w88 = " IO-Board A13 is not implemented"  # String {0}
                Concatenate Strings("[ℹ]", w88) -> w24
              }
            }
          }
        }
        w25 = w15
        w26 = w18
        w27 = w6
        w28 = w20
      }
    }
    case (w12) {
      frame "False", Default {
        call "Trim Whitespace.gvi"(string="") -> (trimmed string=w90)
        w89 = w27
      }
      frame "IO-Board Serial number" {
        call "Add_BMK_to_Comment.gviweb"(BMKs=$BMKs, Parameter name=w12, Input=w27) -> (Changed Component=w90, Output=w89)
      }
      frame "CPU-Board Serial number" {
        call "Add_BMK_to_Comment_iVario.gviweb"(BMKs=$BMKs, Parameter name=w12, Input=w27) -> (Changed Component=w90, Output=w89)
      }
    }
    Is Empty String Or Path(string/path=w90) -> w91
    case (w91) {
      frame True {
        w92 = w24
      }
      frame False {
        call "Search and Replace Pattern.gvi"(string=w24, pattern="✅") -> (result string=w93)
        Concatenate Strings(w93, "\r\n", w90) -> w94
        call "Trim Whitespace.gvi"(string=w94, location="both"(0)) -> (trimmed string=w92)
      }
    }
    Property Node(instance in=T2 {all zero or empty}, "Parameter Name"=w12, "Value"=w25, "Comment"=w92) -> (instance out=w95)
    append w95 to w8
    next s1 = w17
    next s2 = w26
    next s3 = w28
    stop if w19
  }
  $common <- w8
  s4 = string[] []  # shift register
  s5 = string[] []  # shift register
  for {
    w96 = each element of w8
    Property Node(instance in=w96) -> ("Parameter Name"=w97, "Value"=w98)
    case (w97) {
      frame "False", Default {
        w99 = s4
        w100 = s5
      }
      frame "Touchcontroller" {
        Insert Into Array(inArray=s5, new=w97) -> w100
        case (w98) {
          frame "False", Default {
            w101 = "------"
          }
          frame "T1" {
            w101 = "Atmel Chip"
          }
          frame "T2" {
            w101 = "ILITEK"
          }
        }
        Insert Into Array(inArray=s4, new=w101) -> w99
      }
      frame "CPU-Board Revision" {
        Insert Into Array(inArray=s5, new=w97) -> w100
        case (w98) {
          frame "False", Default {
            w102 = "Benchmark Board"
          }
          frame "A0" {
            w102 = "Avnet Board"
          }
        }
        Insert Into Array(inArray=s4, new=w102) -> w99
      }
      frame "IO-Board A10 Serial number", "IO-Board Serial number" {
        Insert Into Array(inArray=s5, new=w97) -> w100
        String Subset(length (rest)=1, string=w98) -> w103
        case (w103) {
          frame "False", Default {
            w104 = "IO"
          }
          frame "C" {
            w104 = "IO LO"
          }
        }
        Insert Into Array(inArray=s4, new=w104) -> w99
      }
    }
    next s4 = w99
    next s5 = w100
  }
  for {
    w105 = each element of s5
    w106 = each element of s4
    Property Node(instance in=T1 {all zero or empty}, "Boards"=w105, "Informations"=w106) -> (instance out=w108)
    append w108 to w107
  }
  $"Boards Informations:" <- w107
  $Ultravent <- s2
  $"Unit-type" <- s1
  $"Output Error" <- w89
  $"Startup Date and Time" <- s3
