vi "Interpret_Component_Replacement_History.gviweb"   [G Web Development Software 22.3.0]
inputs:
  "Component Replacement History Entrys": string[]
  "Device Type": string = "Device"
  "Error Cluster input": error
outputs:
  "Component Replacement History": T1[]
  "Error Output": error
  "Changed Component": string[]
  "All BMK": string[]
  "All compo": string[]
types:
  T1 = cluster{"Parameter Name": string, "BMK": string, "Component Name": string, "Replace Time": string, "Serial number": string, "Service Note": string, "Type": string}
uses:
  NI::G Core::Strings::Search and Replace Pattern.gvi
  NI::G Core::Strings::Trim Whitespace.gvi
  WebApp::Change_to_validate_Date.gvi
  WebApp::Update_Type_Component_History.gviweb
  WebApp::Delete_Duplikate_from_Array.gviweb
diagram:
  s1 = string[] []  # shift register
  for {
    w1 = each element of $"Component Replacement History Entrys"
    Match Pattern(regular expression="BMK=", string=w1) -> (after substring=w5, before substring=w6)
    Match Pattern(regular expression="Component_Name=", string=w5) -> (after substring=w7, before substring=w8)
    call "Search and Replace Pattern.gvi"(String=w8, Muster="\"", Alle ersetzen=TRUE) -> (Ergebnis-String=w9)
    call "Trim Whitespace.gvi"(string=w9) -> (trimmed string=w10)
    Match Pattern(regular expression="Replace_Time=", string=w7) -> (after substring=w11, before substring=w12)
    Match Pattern(regular expression="SN=", string=w11) -> (after substring=w13, before substring=w14)
    Match Pattern(regular expression="Service_Note=", string=w13) -> (after substring=w15, before substring=w16)
    Match Pattern(regular expression="Type=", string=w15) -> (after substring=w17, before substring=w18)
    call "Search and Replace Pattern.gvi"(String=w17, Muster="\"", Alle ersetzen=TRUE) -> (Ergebnis-String=w19)
    call "Trim Whitespace.gvi"(string=w19) -> (trimmed string=w20)
    case (w20) {
      frame "False", Default {
        w21 = s1
      }
      frame "A" {
        Insert Into Array(inArray=s1, new=w10) -> w21
      }
    }
    call "Search and Replace Pattern.gvi"(String=w14, Muster="\"", Alle ersetzen=TRUE) -> (Ergebnis-String=w22)
    call "Trim Whitespace.gvi"(string=w22) -> (trimmed string=w23)
    call "Change_to_validate_Date.gvi"(Date_Time_String input=w23, Error Cluster input=$"Error Cluster input") -> (Validate date and time=w24, Error Cluster output=w25)
    call "Search and Replace Pattern.gvi"(String=w6, Muster="\"", Alle ersetzen=TRUE) -> (Ergebnis-String=w26)
    call "Trim Whitespace.gvi"(string=w26) -> (trimmed string=w27)
    call "Search and Replace Pattern.gvi"(String=w18, Muster="\"", Alle ersetzen=TRUE) -> (Ergebnis-String=w28)
    call "Trim Whitespace.gvi"(string=w28) -> (trimmed string=w29)
    call "Search and Replace Pattern.gvi"(String=w16, Muster="\"", Alle ersetzen=TRUE) -> (Ergebnis-String=w30)
    call "Trim Whitespace.gvi"(string=w30) -> (trimmed string=w31)
    call "Update_Type_Component_History.gviweb"(Type input=w20, Error Cluster input=w25) -> (Type Output=w32, Error Cluster output=w33)
    call "Search and Replace Pattern.gvi"(String=w12, Muster="\"", Alle ersetzen=TRUE) -> (Ergebnis-String=w34)
    call "Trim Whitespace.gvi"(string=w34) -> (trimmed string=w35)
    Property Node(instance in=T1 {all zero or empty}, "Parameter Name"=w27, "BMK"=w10, "Component Name"=w35, "Replace Time"=w24, "Serial number"=w31, "Service Note"=w29, "Type"=w32) -> (instance out=w36)
    append w36 to w2
    append w10 to w3
    append w31 to w4
    next s1 = w21
  }
  $"All BMK" <- w3
  $"All compo" <- w4
  call "Delete_Duplikate_from_Array.gviweb"(BMKs=s1, Error Cluster input=w33) -> (Output BMK=w37, output=w38)
  $"Changed Component" <- w37
  $"Error Output" <- w38
  $"Component Replacement History" <- w2
