vi "Interpret_Diagnostic_RT_Data_Sensors.gviweb"   [G Web Development Software 22.3.0]
inputs:
  "Diagnostic Settings Entrys": string[]
  "Config File infos": string[]
  "Device Type": string = "Device"
  "Error input": error
  "Auto Dose": string
outputs:
  "Output Error": error
  "Diagnostic_RT_Data_Sensors": T1[]
types:
  T1 = cluster{"Parameter Name": string, "Actual": string, "Dimension": string, "Limit": string, "maximum": string, "Time_stamp": string, "Comment": string}
  T2 = cluster{"Parameter Name": string, "Actual": string, "Dimension": string, "Limit": string, "maximum": string, "time_stamp": string, "comment": string}
uses:
  WebApp::Get_Config_ini_Part.gviweb
  NI::G Core::Strings::Search and Replace Pattern.gvi
  NI::G Core::Strings::Trim Whitespace.gvi
diagram:
  call "Get_Config_ini_Part.gviweb"(Ini Array=$"Config File infos", ini Part from Array=6, Error in=$"Error input") -> (Ini Part as Array=w1, Output Error=w2)
  for (after w1) {
    w3 = each element of $"Diagnostic Settings Entrys"
    Match Pattern(regular expression="actual", string=w3) -> (after substring=w5, before substring=w6)
    call "Search and Replace Pattern.gvi"(String=w6, Muster="_", Ersetzungs-String=" ", Alle ersetzen=TRUE) -> (Ergebnis-String=w7)
    call "Trim Whitespace.gvi"(string=w7) -> (trimmed string=w8)
    Match Pattern(regular expression="dim", string=w5) -> (after substring=w9, before substring=w10)
    call "Search and Replace Pattern.gvi"(String=w10, Muster="=\"", Alle ersetzen=TRUE) -> (Ergebnis-String=w11)
    call "Search and Replace Pattern.gvi"(String=w11, Muster="\"", Alle ersetzen=TRUE) -> (Ergebnis-String=w12)
    call "Trim Whitespace.gvi"(string=w12) -> (trimmed string=w13)
    call "Search and Replace Pattern.gvi"(String=w9, Muster="=\"", Alle ersetzen=TRUE) -> (Ergebnis-String=w14)
    Match Pattern(regular expression="lim", string=w14) -> (after substring=w15, before substring=w16)
    Match Pattern(regular expression="maximum", string=w15) -> (after substring=w17, before substring=w18)
    Match Pattern(regular expression="time_stamp", string=w17) -> (after substring=w19, before substring=w20)
    # w8: parm name
    # w13: actual
    # timestamp
    case ($"Device Type") {
      frame "False", Default {
        w21 = "✅"
      }
      frame "623", "E523", "E623" {
        # w8: parm name
        # w13: actual
        # w19: timestamp
        case (w8) {
          frame "False", Default {
            Decimal String To Number(string=w19) -> (offset past number=w22)
            Is Greater(x=w22, y=10) -> w23
            case (w23) {
              frame False, Default {
                Decimal String To Number(default (0 I32)=0, string=w13) -> (number=w24)
                In Range And Coerce(lower limit=1, upper limit=614, x=w24) -> (In Range?=w25)
                case (w25) {
                  frame False, Default {
                    w21 = "❌ Temperature not plausible, please check the sensor"
                  }
                  frame True {
                    w21 = "✅"
                  }
                }
              }
              frame True {
                call "Search and Replace Pattern.gvi"(String=w8, Muster="Temperature ", Alle ersetzen=TRUE) -> (Ergebnis-String=w26)
                w27 = "❌"  # String {0}
                Concatenate Strings(w27, "maximum temperatur of", " ", w26, "\r\n", "was reached") -> w21
              }
            }
          }
          frame "Cabinet B9", "Chemical Controller Temperature NTC", "HotAir Bottom Average HeatReq Last3Month", "HotAir Bottom Average HeatReq Lifetime Burner", "HotAir Bottom Average HeatReq Lifetime Device", "HotAir Top Average HeatReq Lifetime Burner", "HotAir Top Average HeatReq Lifetime Device", "Magnetron Power Supply Temperature bottom", "Magnetron Power Supply Temperature top", "Magnetron Temperature bottom", "Magnetron Temperature top", "Microwave Power Supply Temperature bottom", "Microwave Power Supply Temperature top", "Steam Average HeatReq Lifetime Burner", "Steam Average HeatReq Lifetime Device", "Temperature Fan Bottom", "Temperature Fan Middle", "Temperature LED handle side", "Temperature LED hinge side", "Temperature Pump Board" {
            w28 = " Information not required for this device type"  # String {0}
            Concatenate Strings("[ℹ]", w28) -> w21
          }
        }
      }
      frame "E61", "E62" {
        case (w8) {
          frame "False", Default {
            Decimal String To Number(string=w19) -> (offset past number=w29)
            Is Greater(x=w29, y=10) -> w30
            case (w30) {
              frame False, Default {
                Decimal String To Number(default (0 I32)=0, string=w13) -> (number=w31)
                In Range And Coerce(lower limit=1, upper limit=614, x=w31) -> (In Range?=w32)
                case (w32) {
                  frame False, Default {
                    w21 = "❌ Temperature not plausible, please check the sensor"
                  }
                  frame True {
                    w21 = "✅"
                  }
                }
              }
              frame True {
                call "Search and Replace Pattern.gvi"(String=w8, Muster="Temperature ", Alle ersetzen=TRUE) -> (Ergebnis-String=w33)
                w34 = "❌"  # String {0}
                Concatenate Strings(w34, "maximum temperatur of", " ", w33, "\r\n", "was reached") -> w21
              }
            }
          }
          frame "Cabinet B9", "Electrical Compartment B10", "HotAir Bottom Average HeatReq Last3Month", "HotAir Bottom Average HeatReq Lifetime Burner", "HotAir Bottom Average HeatReq Lifetime Device", "HotAir Top Average HeatReq Lifetime Burner", "HotAir Top Average HeatReq Lifetime Device", "Magnetron Power Supply Temperature bottom", "Magnetron Power Supply Temperature top", "Magnetron Temperature bottom", "Magnetron Temperature top", "Microwave Power Supply Temperature bottom", "Microwave Power Supply Temperature top", "Steam Average HeatReq Lifetime Burner", "Steam Average HeatReq Lifetime Device", "Temperature Fan Bottom", "Temperature Fan Middle" {
            w35 = " Information not required for this device type"  # String {0}
            Concatenate Strings("[ℹ]", w35) -> w21
          }
          frame "Chemical Controller Temperature NTC" {
            case ($"Auto Dose") {
              frame "AutoDose_available" {
                Floating Point String To Number(string=w13, use system decimal point (T)=TRUE) -> (number=w36)
                Is Equal To 0(x=w36) -> w37
                case (w37) {
                  frame True {
                    w21 = "❌ Temperature not plausible, please check the sensor"
                  }
                  frame False {
                    Decimal String To Number(string=w19) -> (offset past number=w38)
                    Is Greater(x=w38, y=10) -> w39
                    case (w39) {
                      frame True {
                        call "Search and Replace Pattern.gvi"(String=w8, Muster="Temperature ", Alle ersetzen=TRUE) -> (Ergebnis-String=w40)
                        w41 = "❌"  # String {0}
                        Concatenate Strings(w41, "maximum temperatur of", " ", w40, "\r\n", "was reached") -> w21
                      }
                      frame False {
                        w21 = "✅"
                      }
                    }
                  }
                }
              }
              frame "False", Default {
                w42 = " Information not required for this device type"  # String {0}
                Concatenate Strings("[ℹ]", w42) -> w21
              }
            }
          }
        }
      }
      frame "E61T", "E62T" {
        case (w8) {
          frame "False", Default {
            Decimal String To Number(string=w19) -> (offset past number=w43)
            Is Greater(x=w43, y=10) -> w44
            case (w44) {
              frame False, Default {
                Decimal String To Number(default (0 I32)=0, string=w13) -> (number=w45)
                In Range And Coerce(lower limit=1, upper limit=614, x=w45) -> (In Range?=w46)
                case (w46) {
                  frame False, Default {
                    w21 = "❌ Temperature not plausible, please check the sensor"
                  }
                  frame True {
                    w21 = "✅"
                  }
                }
              }
              frame True {
                call "Search and Replace Pattern.gvi"(String=w8, Muster="Temperature ", Alle ersetzen=TRUE) -> (Ergebnis-String=w47)
                w48 = "❌"  # String {0}
                Concatenate Strings(w48, "maximum temperatur of", " ", w47, "\r\n", "was reached") -> w21
              }
            }
          }
          frame "Cabinet B9", "Electrical Compartment B10", "HotAir Bottom Average HeatReq Last3Month", "HotAir Bottom Average HeatReq Lifetime Burner", "HotAir Bottom Average HeatReq Lifetime Device", "HotAir Top Average HeatReq Lifetime Burner", "HotAir Top Average HeatReq Lifetime Device", "Steam Average HeatReq Lifetime Burner", "Steam Average HeatReq Lifetime Device", "Temperature Fan Bottom", "Temperature Fan Middle" {
            w49 = " Information not required for this device type"  # String {0}
            Concatenate Strings("[ℹ]", w49) -> w21
          }
          frame "Chemical Controller Temperature NTC" {
            case ($"Auto Dose") {
              frame "AutoDose_available" {
                Floating Point String To Number(string=w13, use system decimal point (T)=TRUE) -> (number=w50)
                Is Equal To 0(x=w50) -> w51
                case (w51) {
                  frame True {
                    w21 = "❌ Temperature not plausible, please check the sensor"
                  }
                  frame False {
                    Decimal String To Number(string=w19) -> (offset past number=w52)
                    Is Greater(x=w52, y=10) -> w53
                    case (w53) {
                      frame True {
                        call "Search and Replace Pattern.gvi"(String=w8, Muster="Temperature ", Alle ersetzen=TRUE) -> (Ergebnis-String=w54)
                        w55 = "❌"  # String {0}
                        Concatenate Strings(w55, "maximum temperatur of", " ", w54, "\r\n", "was reached") -> w21
                      }
                      frame False {
                        w21 = "✅"
                      }
                    }
                  }
                }
              }
              frame "False", Default {
                w56 = " Information not required for this device type"  # String {0}
                Concatenate Strings("[ℹ]", w56) -> w21
              }
            }
          }
        }
      }
      frame "G61", "G62" {
        # w13: actual
        case (w8) {
          frame "False", Default {
            Decimal String To Number(string=w19) -> (offset past number=w57)
            Is Greater(x=w57, y=10) -> w58
            case (w58) {
              frame False, Default {
                Decimal String To Number(default (0 I32)=0, string=w13) -> (number=w59)
                In Range And Coerce(lower limit=1, upper limit=614, x=w59) -> (In Range?=w60)
                case (w60) {
                  frame False, Default {
                    w21 = "❌ Value is not plausible, please check the sensor"
                  }
                  frame True {
                    w21 = "✅"
                  }
                }
              }
              frame True {
                call "Search and Replace Pattern.gvi"(String=w8, Muster="Temperature ", Alle ersetzen=TRUE) -> (Ergebnis-String=w61)
                w62 = "❌"  # String {0}
                Concatenate Strings(w62, "maximum temperatur of", " ", w61, "\r\n", "was reached") -> w21
              }
            }
          }
          frame "Cabinet B9", "Electrical Compartment B10", "HotAir Bottom Average HeatReq Last3Month", "HotAir Bottom Average HeatReq Lifetime Burner", "HotAir Bottom Average HeatReq Lifetime Device", "Magnetron Power Supply Temperature bottom", "Magnetron Power Supply Temperature top", "Magnetron Temperature bottom", "Magnetron Temperature top", "Microwave Power Supply Temperature bottom", "Microwave Power Supply Temperature top", "Temperature Fan Bottom", "Temperature Fan Middle" {
            w63 = " Information not required for this device type"  # String {0}
            Concatenate Strings("[ℹ]", w63) -> w21
          }
          frame "Chemical Controller Temperature NTC" {
            case ($"Auto Dose") {
              frame "AutoDose_available" {
                Floating Point String To Number(string=w13, use system decimal point (T)=TRUE) -> (number=w64)
                Is Equal To 0(x=w64) -> w65
                case (w65) {
                  frame True {
                    w21 = "❌ Temperature not plausible, please check the sensor"
                  }
                  frame False {
                    Decimal String To Number(string=w19) -> (offset past number=w66)
                    Is Greater(x=w66, y=10) -> w67
                    case (w67) {
                      frame True {
                        call "Search and Replace Pattern.gvi"(String=w8, Muster="Temperature ", Alle ersetzen=TRUE) -> (Ergebnis-String=w68)
                        w69 = "❌"  # String {0}
                        Concatenate Strings(w69, "maximum temperatur of", " ", w68, "\r\n", "was reached") -> w21
                      }
                      frame False {
                        w21 = "✅"
                      }
                    }
                  }
                }
              }
              frame "False", Default {
                w70 = " Information not required for this device type"  # String {0}
                Concatenate Strings("[ℹ]", w70) -> w21
              }
            }
          }
        }
      }
      frame "E101", "E102" {
        case (w8) {
          frame "False", Default {
            Decimal String To Number(string=w19) -> (offset past number=w71)
            Is Greater(x=w71, y=10) -> w72
            case (w72) {
              frame False, Default {
                Decimal String To Number(default (0 I32)=0, string=w13) -> (number=w73)
                In Range And Coerce(lower limit=1, upper limit=614, x=w73) -> (In Range?=w74)
                case (w74) {
                  frame False, Default {
                    w21 = "❌ Temperature not plausible, please check the sensor"
                  }
                  frame True {
                    w21 = "✅"
                  }
                }
              }
              frame True {
                call "Search and Replace Pattern.gvi"(String=w8, Muster="Temperature ", Alle ersetzen=TRUE) -> (Ergebnis-String=w75)
                w76 = "❌"  # String {0}
                Concatenate Strings(w76, "maximum temperatur of", " ", w75, "\r\n", "was reached") -> w21
              }
            }
          }
          frame "Cabinet B9", "Electrical Compartment B10", "HotAir Bottom Average HeatReq Last3Month", "HotAir Bottom Average HeatReq Lifetime Burner", "HotAir Bottom Average HeatReq Lifetime Device", "HotAir Top Average HeatReq Lifetime Burner", "HotAir Top Average HeatReq Lifetime Device", "Magnetron Power Supply Temperature bottom", "Magnetron Power Supply Temperature top", "Magnetron Temperature bottom", "Magnetron Temperature top", "Microwave Power Supply Temperature bottom", "Microwave Power Supply Temperature top", "Steam Average HeatReq Lifetime Burner", "Steam Average HeatReq Lifetime Device", "Temperature Fan Bottom" {
            w77 = " Information not required for this device type"  # String {0}
            Concatenate Strings("[ℹ]", w77) -> w21
          }
          frame "Chemical Controller Temperature NTC" {
            case ($"Auto Dose") {
              frame "AutoDose_available" {
                Floating Point String To Number(string=w13, use system decimal point (T)=TRUE) -> (number=w78)
                Is Equal To 0(x=w78) -> w79
                case (w79) {
                  frame True {
                    w21 = "❌ Temperature not plausible, please check the sensor"
                  }
                  frame False {
                    Decimal String To Number(string=w19) -> (offset past number=w80)
                    Is Greater(x=w80, y=10) -> w81
                    case (w81) {
                      frame True {
                        call "Search and Replace Pattern.gvi"(String=w8, Muster="Temperature ", Alle ersetzen=TRUE) -> (Ergebnis-String=w82)
                        w83 = "❌"  # String {0}
                        Concatenate Strings(w83, "maximum temperatur of", " ", w82, "\r\n", "was reached") -> w21
                      }
                      frame False {
                        w21 = "✅"
                      }
                    }
                  }
                }
              }
              frame "False", Default {
                w84 = " Information not required for this device type"  # String {0}
                Concatenate Strings("[ℹ]", w84) -> w21
              }
            }
          }
        }
      }
      frame "E201", "E202" {
        case (w8) {
          frame "False", Default {
            Decimal String To Number(string=w19) -> (offset past number=w85)
            Is Greater(x=w85, y=10) -> w86
            case (w86) {
              frame False, Default {
                Decimal String To Number(default (0 I32)=0, string=w13) -> (number=w87)
                In Range And Coerce(lower limit=1, upper limit=614, x=w87) -> (In Range?=w88)
                case (w88) {
                  frame False, Default {
                    w21 = "❌ Temperature not plausible, please check the sensor"
                  }
                  frame True {
                    w21 = "✅"
                  }
                }
              }
              frame True {
                call "Search and Replace Pattern.gvi"(String=w8, Muster="Temperature ", Alle ersetzen=TRUE) -> (Ergebnis-String=w89)
                w90 = "❌"  # String {0}
                Concatenate Strings(w90, "maximum temperatur of", " ", w89, "\r\n", "was reached") -> w21
              }
            }
          }
          frame "Chemical Controller Temperature NTC", "Electrical Compartment B10", "HotAir Bottom Average HeatReq Last3Month", "HotAir Bottom Average HeatReq Lifetime Burner", "HotAir Bottom Average HeatReq Lifetime Device", "HotAir Top Average HeatReq Lifetime Burner", "HotAir Top Average HeatReq Lifetime Device", "Magnetron Power Supply Temperature bottom", "Magnetron Power Supply Temperature top", "Magnetron Temperature bottom", "Magnetron Temperature top", "Microwave Power Supply Temperature bottom", "Microwave Power Supply Temperature top", "Steam Average HeatReq Lifetime Burner", "Steam Average HeatReq Lifetime Device", "Temperature LED handle side", "Temperature LED hinge side" {
            w91 = " Information not required for this device type"  # String {0}
            Concatenate Strings("[ℹ]", w91) -> w21
          }
        }
      }
      frame "G101", "G102" {
        case (w8) {
          frame "False", Default {
            Decimal String To Number(string=w19) -> (offset past number=w92)
            Is Greater(x=w92, y=10) -> w93
            case (w93) {
              frame False, Default {
                Decimal String To Number(default (0 I32)=0, string=w13) -> (number=w94)
                In Range And Coerce(lower limit=1, upper limit=614, x=w94) -> (In Range?=w95)
                case (w95) {
                  frame False, Default {
                    w21 = "❌ Temperature not plausible, please check the sensor"
                  }
                  frame True {
                    w21 = "✅"
                  }
                }
              }
              frame True {
                call "Search and Replace Pattern.gvi"(String=w8, Muster="Temperature ", Alle ersetzen=TRUE) -> (Ergebnis-String=w96)
                w97 = "❌"  # String {0}
                Concatenate Strings(w97, "maximum temperatur of", " ", w96, "\r\n", "was reached") -> w21
              }
            }
          }
          frame "Cabinet B9", "Electrical Compartment B10", "HotAir Bottom Average HeatReq Last3Month", "HotAir Bottom Average HeatReq Lifetime Burner", "HotAir Bottom Average HeatReq Lifetime Device", "Magnetron Power Supply Temperature bottom", "Magnetron Power Supply Temperature top", "Magnetron Temperature bottom", "Magnetron Temperature top", "Microwave Power Supply Temperature bottom", "Microwave Power Supply Temperature top", "Temperature Fan Bottom" {
            w98 = " Information not required for this device type"  # String {0}
            Concatenate Strings("[ℹ]", w98) -> w21
          }
          frame "Chemical Controller Temperature NTC" {
            case ($"Auto Dose") {
              frame "AutoDose_available" {
                Floating Point String To Number(string=w13, use system decimal point (T)=TRUE) -> (number=w99)
                Is Equal To 0(x=w99) -> w100
                case (w100) {
                  frame True {
                    w21 = "❌ Temperature not plausible, please check the sensor"
                  }
                  frame False {
                    Decimal String To Number(string=w19) -> (offset past number=w101)
                    Is Greater(x=w101, y=10) -> w102
                    case (w102) {
                      frame True {
                        call "Search and Replace Pattern.gvi"(String=w8, Muster="Temperature ", Alle ersetzen=TRUE) -> (Ergebnis-String=w103)
                        w104 = "❌"  # String {0}
                        Concatenate Strings(w104, "maximum temperatur of", " ", w103, "\r\n", "was reached") -> w21
                      }
                      frame False {
                        w21 = "✅"
                      }
                    }
                  }
                }
              }
              frame "False", Default {
                w105 = " Information not required for this device type"  # String {0}
                Concatenate Strings("[ℹ]", w105) -> w21
              }
            }
          }
        }
      }
      frame "G201", "G202" {
        case (w8) {
          frame "False", Default {
            Decimal String To Number(string=w19) -> (offset past number=w106)
            Is Greater(x=w106, y=10) -> w107
            case (w107) {
              frame False, Default {
                Decimal String To Number(default (0 I32)=0, string=w13) -> (number=w108)
                In Range And Coerce(lower limit=1, upper limit=614, x=w108) -> (In Range?=w109)
                case (w109) {
                  frame False, Default {
                    w21 = "❌ Temperature not plausible, please check the sensor"
                  }
                  frame True {
                    w21 = "✅"
                  }
                }
              }
              frame True {
                call "Search and Replace Pattern.gvi"(String=w8, Muster="Temperature ", Alle ersetzen=TRUE) -> (Ergebnis-String=w110)
                w111 = "❌"  # String {0}
                Concatenate Strings(w111, "maximum temperatur of", " ", w110, "\r\n", "was reached") -> w21
              }
            }
          }
          frame "Chemical Controller Temperature NTC", "Electrical Compartment B10", "Magnetron Power Supply Temperature bottom", "Magnetron Power Supply Temperature top", "Magnetron Temperature bottom", "Magnetron Temperature top", "Microwave Power Supply Temperature bottom", "Microwave Power Supply Temperature top", "Temperature LED handle side", "Temperature LED hinge side" {
            w112 = " Information not required for this device type"  # String {0}
            Concatenate Strings("[ℹ]", w112) -> w21
          }
        }
      }
    }
    call "Search and Replace Pattern.gvi"(String=w16, Muster="\"", Alle ersetzen=TRUE) -> (Ergebnis-String=w113)
    call "Trim Whitespace.gvi"(string=w113) -> (trimmed string=w114)
    call "Search and Replace Pattern.gvi"(String=w19, Muster="\"", Alle ersetzen=TRUE) -> (Ergebnis-String=w115)
    call "Trim Whitespace.gvi"(string=w115) -> (trimmed string=w116)
    String Length(string=w116) -> (length=w117)
    Is Greater(x=w117, y=10) -> w118
    case (w118) {
      frame False, Default {
        w119 = w116
      }
      frame True {
        String Subset(length (rest)=4, string=w116) -> w120
        String Subset(length (rest)=2, offset (0)=4, string=w116) -> w121
        String Subset(length (rest)=2, offset (0)=6, string=w116) -> w122
        String Subset(length (rest)=2, offset (0)=8, string=w116) -> w123
        String Subset(length (rest)=2, offset (0)=10, string=w116) -> w124
        String Subset(offset (0)=12, string=w116) -> w125
        Concatenate Strings(w120, ".", w121, ".", w122, " ", w123, ":", w124, ":", w125) -> w119
      }
    }
    call "Search and Replace Pattern.gvi"(String=w18, Muster="=\"", Alle ersetzen=TRUE) -> (Ergebnis-String=w126)
    call "Search and Replace Pattern.gvi"(String=w126, Muster="\"", Alle ersetzen=TRUE) -> (Ergebnis-String=w127)
    call "Trim Whitespace.gvi"(string=w127) -> (trimmed string=w128)
    call "Search and Replace Pattern.gvi"(String=w20, Muster="=\"", Alle ersetzen=TRUE) -> (Ergebnis-String=w129)
    call "Search and Replace Pattern.gvi"(String=w129, Muster="\"", Alle ersetzen=TRUE) -> (Ergebnis-String=w130)
    call "Trim Whitespace.gvi"(string=w130) -> (trimmed string=w131)
    Property Node(instance in=T2 {all zero or empty}, "Parameter Name"=w8, "Actual"=w13, "Dimension"=w114, "Limit"=w128, "maximum"=w131, "time_stamp"=w119, "comment"=w21) -> (instance out=w132)
    append w132 to w4
  }
  $Diagnostic_RT_Data_Sensors <- w4
  $"Output Error" <- w2
