vi "Interpret_Diagnostic_RT_Data_Sensors_Heating.gviweb"   [G Web Development Software 22.3.0]
inputs:
  "Diagnostic Settings Entrys": string[]
  "Error input": error
  "Device Type": string = "Device"
outputs:
  "Output Error": error
  "Output": T1[]
  "rechts": f64
  "links": f64
panel indicators:
  "Output_2": f64
  "Output_3": f64
  "Left Probe": f64
types:
  T1 = cluster{"Parameter Name": string, "Actual": string, "Dimension": string, "comment": string}
uses:
  NI::G Core::Strings::Search and Replace Pattern.gvi
  NI::G Core::Strings::Trim Whitespace.gvi
diagram:
  # 0: 2XS: B105..B108/2S B105..B112
  # 0: 2XS: B101..B104/2S B101..B106
  s1 = 0  # shift register
  s2 = 0  # shift register
  s3 = 0  # shift register
  s4 = 0  # shift register
  s5 = 0  # shift register
  s6 = 0  # shift register
  s7 = 0  # shift register
  s8 = 0  # shift register
  for {
    w1 = each element of $"Diagnostic Settings Entrys"
    Match Pattern(regular expression="actual=", string=w1) -> (after substring=w3, before substring=w4)
    Match Pattern(regular expression="dim=", string=w3) -> (after substring=w5, before substring=w6)
    call "Search and Replace Pattern.gvi"(String=w6, Muster="=\"", Alle ersetzen=TRUE) -> (Ergebnis-String=w7)
    call "Search and Replace Pattern.gvi"(String=w7, Muster="\"", Alle ersetzen=TRUE) -> (Ergebnis-String=w8)
    call "Trim Whitespace.gvi"(string=w8) -> (trimmed string=w9)
    call "Search and Replace Pattern.gvi"(String=w4, Muster="_", Ersetzungs-String=" ", Alle ersetzen=TRUE) -> (Ergebnis-String=w10)
    call "Trim Whitespace.gvi"(string=w10) -> (trimmed string=w11)
    Match Pattern(regular expression="heat_request=", string=w5) -> (before substring=w12, match substring=w13)
    case (w13) {
      frame "False", Default {
        Match Pattern(regular expression="maximum=", string=w5) -> (before substring=w14)
      }
      frame "heat_request=" {
        w14 = w12
      }
    }
    # w9: actual
    call "Search and Replace Pattern.gvi"(String=w14, Muster="\"", Alle ersetzen=TRUE) -> (Ergebnis-String=w15)
    call "Trim Whitespace.gvi"(string=w15) -> (trimmed string=w16)
    Property Node(instance in=T1 {all zero or empty}, "Parameter Name"=w11, "Actual"=w9, "Dimension"=w16) -> (instance out=w17)
    case ($"Device Type") {
      frame "False", Default {
        w18 = s1
        w19 = s2
        w20 = s3
        w21 = s4
        w22 = s5
        w23 = s6
        w24 = s7
        w25 = s8
      }
      frame "2-XS", "2-XS P" {
        case (w11) {
          frame "False", Default {
            Floating Point String To Number(default (0 DBL)=0, string=w9, use system decimal point (T)=TRUE) -> (number=w26)
            In Range And Coerce(lower limit=1, upper limit=320, x=w26) -> (In Range?=w27)
            case (w27) {
              frame False, Default {
                w18 = s1
                w19 = s2
                w20 = s3
                w21 = s4
                w22 = s5
                w23 = s6
                w24 = s7
                w25 = s8
              }
              frame True {
                case (w11) {
                  frame "False", Default {
                    w18 = s1
                    w19 = s2
                    w20 = s3
                    w21 = s4
                    w22 = s5
                    w23 = s6
                    w24 = s7
                    w25 = s8
                  }
                  frame "Right Core Probe Temperature B311", "Right Core Probe Temperature B312", "Right Core Probe Temperature B313", "Right Core Probe Temperature B314", "Right Core Probe Temperature B315", "Right Core Probe Temperature B316" {
                    Add(w26, s7) -> w24
                    Increment(x=s8) -> w25
                    w18 = s1
                    w19 = s2
                    w20 = s3
                    w21 = s4
                    w22 = s5
                    w23 = s6
                  }
                  frame "Left Core Probe Temperature B301", "Left Core Probe Temperature B302", "Left Core Probe Temperature B303", "Left Core Probe Temperature B304", "Left Core Probe Temperature B305", "Left Core Probe Temperature B306" {
                    Add(w26, s5) -> w22
                    Increment(x=s6) -> w23
                    w18 = s1
                    w19 = s2
                    w20 = s3
                    w21 = s4
                    w24 = s7
                    w25 = s8
                  }
                  frame "B101", "B102", "B103", "B104" {
                    Add(w26, s1) -> w18
                    Increment(x=s3) -> w20
                    w19 = s2
                    w21 = s4
                    w22 = s5
                    w23 = s6
                    w24 = s7
                    w25 = s8
                  }
                  frame "B105", "B106", "B107", "B108" {
                    Add(w26, s2) -> w19
                    Increment(x=s4) -> w21
                    w18 = s1
                    w20 = s3
                    w22 = s5
                    w23 = s6
                    w24 = s7
                    w25 = s8
                  }
                }
              }
            }
          }
          frame "B109", "B110", "B111", "B112", "B113", "B114", "B115", "B116", "B117", "B118" {
            w18 = s1
            w19 = s2
            w20 = s3
            w21 = s4
            w22 = s5
            w23 = s6
            w24 = s7
            w25 = s8
          }
        }
      }
      frame "2-S", "2-S P" {
        # w22: left prpbe values
        case (w11) {
          frame "False", Default {
            Floating Point String To Number(default (0 DBL)=0, string=w9, use system decimal point (T)=TRUE) -> (number=w28)
            In Range And Coerce(lower limit=1, upper limit=320, x=w28) -> (In Range?=w29)
            case (w29) {
              frame False, Default {
                w18 = s1
                w19 = s2
                w20 = s3
                w21 = s4
                w22 = s5
                w23 = s6
                w24 = s7
                w25 = s8
              }
              frame True {
                case (w11) {
                  frame "False", Default {
                    w18 = s1
                    w19 = s2
                    w20 = s3
                    w21 = s4
                    w22 = s5
                    w23 = s6
                    w24 = s7
                    w25 = s8
                  }
                  frame "Right Core Probe Temperature B311", "Right Core Probe Temperature B312", "Right Core Probe Temperature B313", "Right Core Probe Temperature B314", "Right Core Probe Temperature B315", "Right Core Probe Temperature B316" {
                    Add(w28, s7) -> w24
                    Increment(x=s8) -> w25
                    w18 = s1
                    w19 = s2
                    w20 = s3
                    w21 = s4
                    w22 = s5
                    w23 = s6
                  }
                  frame "Left Core Probe Temperature B301", "Left Core Probe Temperature B302", "Left Core Probe Temperature B303", "Left Core Probe Temperature B304", "Left Core Probe Temperature B305", "Left Core Probe Temperature B306" {
                    Add(w28, s5) -> w22
                    Increment(x=s6) -> w23
                    w18 = s1
                    w19 = s2
                    w20 = s3
                    w21 = s4
                    w24 = s7
                    w25 = s8
                  }
                  frame "B101", "B102", "B103", "B104", "B105", "B106" {
                    Add(w28, s1) -> w18
                    Increment(x=s3) -> w20
                    w19 = s2
                    w21 = s4
                    w22 = s5
                    w23 = s6
                    w24 = s7
                    w25 = s8
                  }
                  frame "B107", "B108", "B109", "B110", "B111", "B112" {
                    Add(w28, s2) -> w19
                    Increment(x=s4) -> w21
                    w18 = s1
                    w20 = s3
                    w22 = s5
                    w23 = s6
                    w24 = s7
                    w25 = s8
                  }
                }
              }
            }
          }
          frame "B113", "B114", "B115", "B116", "B117", "B118" {
            w18 = s1
            w19 = s2
            w20 = s3
            w21 = s4
            w22 = s5
            w23 = s6
            w24 = s7
            w25 = s8
          }
        }
      }
      frame "L", "L P" {
        case (w11) {
          frame "False", Default {
            Floating Point String To Number(default (0 DBL)=0, string=w9, use system decimal point (T)=TRUE) -> (number=w30)
            In Range And Coerce(lower limit=1, upper limit=320, x=w30) -> (In Range?=w31)
            case (w31) {
              frame False, Default {
                w18 = s1
                w19 = s2
                w20 = s3
                w21 = s4
              }
              frame True {
                case (w11) {
                  frame "False", Default {
                    w18 = s1
                    w19 = s2
                    w20 = s3
                    w21 = s4
                  }
                  frame "B101", "B102", "B103", "B104", "B105", "B106", "B107", "B108", "B109", "B110", "B111", "B112" {
                    Add(w30, s1) -> w18
                    Increment(x=s3) -> w20
                    w19 = s2
                    w21 = s4
                  }
                  frame "Left Core Probe Temperature B301", "Left Core Probe Temperature B302", "Left Core Probe Temperature B303", "Left Core Probe Temperature B304", "Left Core Probe Temperature B305", "Left Core Probe Temperature B306" {
                    Add(w30, s2) -> w19
                    Increment(x=s4) -> w21
                    w18 = s1
                    w20 = s3
                  }
                }
              }
            }
          }
          frame "B113", "B114", "B115", "B116", "B117", "B118", "Right Core Probe Temperature B311", "Right Core Probe Temperature B312", "Right Core Probe Temperature B313", "Right Core Probe Temperature B314", "Right Core Probe Temperature B315", "Right Core Probe Temperature B316", "Right Pan Temperature B211" {
            w18 = s1
            w19 = s2
            w20 = s3
            w21 = s4
          }
        }
        w22 = s5
        w23 = s6
        w24 = s7
        w25 = s8
      }
      frame "XL", "XL P" {
        case (w11) {
          frame "False", Default {
            Floating Point String To Number(default (0 DBL)=0, string=w9, use system decimal point (T)=TRUE) -> (number=w32)
            In Range And Coerce(lower limit=1, upper limit=320, x=w32) -> (In Range?=w33)
            case (w33) {
              frame False, Default {
                w18 = s1
                w19 = s2
                w20 = s3
                w21 = s4
              }
              frame True {
                case (w11) {
                  frame "False", Default {
                    w18 = s1
                    w19 = s2
                    w20 = s3
                    w21 = s4
                  }
                  frame "B101", "B102", "B103", "B104", "B105", "B106", "B107", "B108", "B109", "B110", "B111", "B112", "B113", "B114", "B115", "B116", "B117", "B118" {
                    Add(w32, s1) -> w18
                    Increment(x=s3) -> w20
                    w19 = s2
                    w21 = s4
                  }
                  frame "Left Core Probe Temperature B301", "Left Core Probe Temperature B302", "Left Core Probe Temperature B303", "Left Core Probe Temperature B304", "Left Core Probe Temperature B305", "Left Core Probe Temperature B306" {
                    Add(w32, s2) -> w19
                    Increment(x=s4) -> w21
                    w18 = s1
                    w20 = s3
                  }
                }
              }
            }
          }
          frame "Right Core Probe Temperature B311", "Right Core Probe Temperature B312", "Right Core Probe Temperature B313", "Right Core Probe Temperature B314", "Right Core Probe Temperature B315", "Right Core Probe Temperature B316", "Right Pan Temperature B211" {
            w18 = s1
            w19 = s2
            w20 = s3
            w21 = s4
          }
        }
        w22 = s5
        w23 = s6
        w24 = s7
        w25 = s8
      }
    }
    append w17 to w2
    next s1 = w18
    next s2 = w19
    next s3 = w20
    next s4 = w21
    next s5 = w22
    next s6 = w23
    next s7 = w24
    next s8 = w25
  }
  $Output_3 <- s3
  # w34: 2XS: B101..B104/2S B101..B106/L: B101..B112
  Divide(x=s1, y=s3) -> w34
  $links <- w34
  $Output_2 <- s4
  Divide(x=s2, y=s4) -> w35
  # w35: 2XS: B105..B108/2S B105..B112
  $rechts <- w35
  Divide(x=s7, y=s8) -> w36
  Divide(x=s5, y=s6) -> w37
  # "Left Core Probe Temperature B301", "Left Core Probe Temperature B302", "Left Core Probe Temperature B303", "Left Core Probe Temperature B304", "Left Core Probe Temperature B305", "Left Core Probe Temperature B306", Default
  for {
    w38 = each element of w2
    Property Node(instance in=w38) -> ("Parameter Name"=w40, "Actual"=w41, instance out=w42)
    case ($"Device Type") {
      frame "False", Default {
        w43 = "✅"
      }
      frame "2-XS", "2-XS P" {
        case (w40) {
          frame "False", Default {
            Floating Point String To Number(default (0 DBL)=0, string=w41, use system decimal point (T)=TRUE) -> (number=w44)
            In Range And Coerce(lower limit=1, upper limit=320, x=w44) -> (In Range?=w45)
            case (w45) {
              frame False, Default {
                Is Greater(x=w44, y=614) -> w46
                Is Less(x=w44, y=1) -> w47
                Logical Or(w46, w47) -> w48
                case (w48) {
                  frame False, Default {
                    Concatenate Strings("⚠️ ", w40, " is very hot") -> w43
                  }
                  frame True {
                    w43 = "❌ Temperature not plausible, please check the sensor"
                  }
                }
              }
              frame True {
                case (w40) {
                  frame "False", Default {
                    w43 = "✅"
                  }
                  frame "B101", "B102", "B103", "B104" {
                    Add(w34, 5) -> w49
                    Subtract(x=w34, y=5) -> w50
                    In Range And Coerce(lower limit=w50, upper limit=w49, x=w44) -> (In Range?=w51)
                    case (w51) {
                      frame False, Default {
                        Number To Fractional String(number=w34, precision (6)=2) -> (F-format string=w52)
                        Concatenate Strings("⚠️  ", w40, " is outside the range of the other thermocouple (left)", " [mean value : ", w52, " /+- 5°C]") -> w43
                      }
                      frame True {
                        Number To Fractional String(number=w34, precision (6)=2, use system decimal point (T)=TRUE) -> (F-format string=w53)
                        Concatenate Strings("✅ ", w40, " is in range of the other thermocouple (left)", " [mean value : ", w53, " /+- 5°C]") -> w43
                      }
                    }
                  }
                  frame "B105", "B106", "B107", "B108" {
                    Add(w35, 5) -> w54
                    Subtract(x=w35, y=5) -> w55
                    In Range And Coerce(lower limit=w55, upper limit=w54, x=w44) -> (In Range?=w56)
                    case (w56) {
                      frame False, Default {
                        Number To Fractional String(number=w35, precision (6)=2, use system decimal point (T)=TRUE) -> (F-format string=w57)
                        Concatenate Strings("⚠️  ", w40, " is outside the range of the other thermocouple (right)", " [mean value : ", w57, " /+- 5°C]") -> w43
                      }
                      frame True {
                        Number To Fractional String(number=w35, precision (6)=2, use system decimal point (T)=TRUE) -> (F-format string=w58)
                        Concatenate Strings("✅  ", w40, " is in range of the other thermocouple (right)", " [mean value : ", w58, " /+- 5°C]") -> w43
                      }
                    }
                  }
                  frame "Left Core Probe Temperature B301", "Left Core Probe Temperature B302", "Left Core Probe Temperature B303", "Left Core Probe Temperature B304", "Left Core Probe Temperature B305", "Left Core Probe Temperature B306" {
                    Add(w37, 5) -> w59
                    Subtract(x=w37, y=5) -> w60
                    In Range And Coerce(lower limit=w60, upper limit=w59, x=w44) -> (In Range?=w61)
                    case (w61) {
                      frame False, Default {
                        Number To Fractional String(number=w37, precision (6)=2, use system decimal point (T)=TRUE) -> (F-format string=w62)
                        Concatenate Strings("⚠️  ", w40, " is outside the range of the other Core Probe", "\r", " [mean value : ", w62, " /+- 5°C]") -> w43
                      }
                      frame True {
                        Number To Fractional String(number=w37, precision (6)=2, use system decimal point (T)=TRUE) -> (F-format string=w63)
                        Concatenate Strings("✅ ", w40, " is in range of the other Core Probe", "\r", " [mean value : ", w63, " /+- 5°C]") -> w43
                      }
                    }
                  }
                  frame "Right Core Probe Temperature B311", "Right Core Probe Temperature B312", "Right Core Probe Temperature B313", "Right Core Probe Temperature B314", "Right Core Probe Temperature B315", "Right Core Probe Temperature B316" {
                    Add(w36, 5) -> w64
                    Subtract(x=w36, y=5) -> w65
                    In Range And Coerce(lower limit=w65, upper limit=w64, x=w44) -> (In Range?=w66)
                    case (w66) {
                      frame False, Default {
                        Number To Fractional String(number=w36, precision (6)=2, use system decimal point (T)=TRUE) -> (F-format string=w67)
                        Concatenate Strings("⚠️  ", w40, " is outside the range of the other Core Probe", "\r", " [mean value : ", w67, " /+- 5°C]") -> w43
                      }
                      frame True {
                        Number To Fractional String(number=w36, precision (6)=2, use system decimal point (T)=TRUE) -> (F-format string=w68)
                        Concatenate Strings("✅ ", w40, " is in range of the other Core Probe", "\r", " [mean value : ", w68, " /+- 5°C]") -> w43
                      }
                    }
                  }
                }
              }
            }
          }
          frame "B109", "B110", "B111", "B112", "B113", "B114", "B115", "B116", "B117", "B118" {
            w69 = " Information not required for this device type"  # String {0}
            Concatenate Strings("[ℹ]", w69) -> w43
          }
        }
      }
      frame "2-S", "2-S P" {
        case (w40) {
          frame "False", Default {
            Floating Point String To Number(default (0 DBL)=0, string=w41, use system decimal point (T)=TRUE) -> (number=w70)
            In Range And Coerce(lower limit=1, upper limit=320, x=w70) -> (In Range?=w71)
            case (w71) {
              frame False, Default {
                Is Greater(x=w70, y=614) -> w72
                Is Less(x=w70, y=1) -> w73
                Logical Or(w72, w73) -> w74
                case (w74) {
                  frame False, Default {
                    Concatenate Strings("⚠️ ", w40, " is very hot") -> w43
                  }
                  frame True {
                    w43 = "❌ Temperature not plausible, please check the sensor"
                  }
                }
              }
              frame True {
                case (w40) {
                  frame "False", Default {
                    w43 = "✅"
                  }
                  frame "B101", "B102", "B103", "B104", "B105", "B106" {
                    Add(w34, 5) -> w75
                    Subtract(x=w34, y=5) -> w76
                    In Range And Coerce(lower limit=w76, upper limit=w75, x=w70) -> (In Range?=w77)
                    case (w77) {
                      frame False, Default {
                        Number To Fractional String(number=w34, precision (6)=2, use system decimal point (T)=TRUE) -> (F-format string=w78)
                        Concatenate Strings("⚠️  ", w40, " is outside the range of the other thermocouple (left)", " [mean value : ", w78, " /+- 5°C]") -> w43
                      }
                      frame True {
                        Number To Fractional String(number=w34, precision (6)=2, use system decimal point (T)=TRUE) -> (F-format string=w79)
                        Concatenate Strings("✅ ", w40, " is in range of the other thermocouple (left)", " [mean value : ", w79, " /+- 5°C]") -> w43
                      }
                    }
                  }
                  frame "B107", "B108", "B109", "B110", "B111", "B112" {
                    Add(w35, 5) -> w80
                    Subtract(x=w35, y=5) -> w81
                    In Range And Coerce(lower limit=w81, upper limit=w80, x=w70) -> (In Range?=w82)
                    case (w82) {
                      frame False, Default {
                        Number To Fractional String(number=w35, precision (6)=2, use system decimal point (T)=TRUE) -> (F-format string=w83)
                        Concatenate Strings("⚠️  ", w40, " is outside the range of the other thermocouple (right)", " [mean value : ", w83, " /+- 5°C]") -> w43
                      }
                      frame True {
                        Number To Fractional String(number=w35, precision (6)=2, use system decimal point (T)=TRUE) -> (F-format string=w84)
                        Concatenate Strings("✅ ", w40, " is in range of the other thermocouple (right)", " [mean value : ", w84, " /+- 5°C]") -> w43
                      }
                    }
                  }
                  frame "Left Core Probe Temperature B301", "Left Core Probe Temperature B302", "Left Core Probe Temperature B303", "Left Core Probe Temperature B304", "Left Core Probe Temperature B305", "Left Core Probe Temperature B306" {
                    Add(w37, 5) -> w85
                    Subtract(x=w37, y=5) -> w86
                    In Range And Coerce(lower limit=w86, upper limit=w85, x=w70) -> (In Range?=w87)
                    case (w87) {
                      frame False, Default {
                        Number To Fractional String(number=w37, precision (6)=2, use system decimal point (T)=TRUE) -> (F-format string=w88)
                        Concatenate Strings("⚠️  ", w40, " is outside the range of the other Core Probe", "\r", " [mean value : ", w88, " /+- 5°C]") -> w43
                      }
                      frame True {
                        Number To Fractional String(number=w37, precision (6)=2, use system decimal point (T)=TRUE) -> (F-format string=w89)
                        Concatenate Strings("✅ ", w40, " is in range of the other Core Probe", "\r", " [mean value : ", w89, " /+- 5°C]") -> w43
                      }
                    }
                  }
                  frame "Right Core Probe Temperature B311", "Right Core Probe Temperature B312", "Right Core Probe Temperature B313", "Right Core Probe Temperature B314", "Right Core Probe Temperature B315", "Right Core Probe Temperature B316" {
                    Add(w36, 5) -> w90
                    Subtract(x=w36, y=5) -> w91
                    In Range And Coerce(lower limit=w91, upper limit=w90, x=w70) -> (In Range?=w92)
                    case (w92) {
                      frame False, Default {
                        Number To Fractional String(number=w36, precision (6)=2, use system decimal point (T)=TRUE) -> (F-format string=w93)
                        Concatenate Strings("⚠️  ", w40, " is outside the range of the other Core Probe", "\r", " [mean value : ", w93, " /+- 5°C]") -> w43
                      }
                      frame True {
                        Number To Fractional String(number=w36, precision (6)=2, use system decimal point (T)=TRUE) -> (F-format string=w94)
                        Concatenate Strings("✅ ", w40, " is in range of the other Core Probe", "\r", " [mean value : ", w94, " /+- 5°C]") -> w43
                      }
                    }
                  }
                }
              }
            }
          }
          frame "B113", "B114", "B115", "B116", "B117", "B118" {
            w95 = " Information not required for this device type"  # String {0}
            Concatenate Strings("[ℹ]", w95) -> w43
          }
        }
      }
      frame "L", "L P" {
        case (w40) {
          frame "False", Default {
            Floating Point String To Number(default (0 DBL)=0, string=w41, use system decimal point (T)=TRUE) -> (number=w96)
            In Range And Coerce(lower limit=1, upper limit=320, x=w96) -> (In Range?=w97)
            case (w97) {
              frame False, Default {
                Is Greater(x=w96, y=614) -> w98
                Is Less(x=w96, y=1) -> w99
                Logical Or(w98, w99) -> w100
                case (w100) {
                  frame False, Default {
                    Concatenate Strings("⚠️ ", w40, " is very hot") -> w43
                  }
                  frame True {
                    w43 = "❌ Temperature not plausible, please check the sensor"
                  }
                }
              }
              frame True {
                case (w40) {
                  frame "False", Default {
                    w43 = "✅"
                  }
                  frame "B101", "B102", "B103", "B104", "B105", "B106", "B107", "B108", "B109", "B110", "B111", "B112" {
                    Add(w34, 5) -> w101
                    Subtract(x=w34, y=5) -> w102
                    In Range And Coerce(lower limit=w102, upper limit=w101, x=w96) -> (In Range?=w103)
                    case (w103) {
                      frame False, Default {
                        Number To Fractional String(number=w34, precision (6)=2, use system decimal point (T)=TRUE) -> (F-format string=w104)
                        Concatenate Strings("⚠️  ", w40, " is outside the range of the other thermocouple", " [mean value : ", w104, " /+- 5°C]") -> w43
                      }
                      frame True {
                        Number To Fractional String(number=w34, precision (6)=2, use system decimal point (T)=TRUE) -> (F-format string=w105)
                        Concatenate Strings("✅ ", w40, " is in range of the other thermocouple", " [mean value : ", w105, " /+- 5°C]") -> w43
                      }
                    }
                  }
                  frame "Left Core Probe Temperature B301", "Left Core Probe Temperature B302", "Left Core Probe Temperature B303", "Left Core Probe Temperature B304", "Left Core Probe Temperature B305", "Left Core Probe Temperature B306" {
                    Add(w35, 5) -> w106
                    Subtract(x=w35, y=5) -> w107
                    In Range And Coerce(lower limit=w107, upper limit=w106, x=w96) -> (In Range?=w108)
                    case (w108) {
                      frame False, Default {
                        Number To Fractional String(number=w35, precision (6)=2, use system decimal point (T)=TRUE) -> (F-format string=w109)
                        Concatenate Strings("⚠️  ", w40, " is outside the range of the other Core Probe", "\r", " [mean value : ", w109, " /+- 5°C]") -> w43
                      }
                      frame True {
                        Number To Fractional String(number=w35, precision (6)=2, use system decimal point (T)=TRUE) -> (F-format string=w110)
                        Concatenate Strings("✅ ", w40, " is in range of the other Core Probe", "\r", " [mean value : ", w110, " /+- 5°C]") -> w43
                      }
                    }
                  }
                }
              }
            }
          }
          frame "B113", "B114", "B115", "B116", "B117", "B118", "Right Core Probe Temperature B311", "Right Core Probe Temperature B312", "Right Core Probe Temperature B313", "Right Core Probe Temperature B314", "Right Core Probe Temperature B315", "Right Core Probe Temperature B316", "Right Pan Temperature B211" {
            w111 = " Information not required for this device type"  # String {0}
            Concatenate Strings("[ℹ]", w111) -> w43
          }
        }
      }
      frame "XL", "XL P" {
        case (w40) {
          frame "False", Default {
            Floating Point String To Number(default (0 DBL)=0, string=w41, use system decimal point (T)=TRUE) -> (number=w112)
            In Range And Coerce(lower limit=1, upper limit=320, x=w112) -> (In Range?=w113)
            case (w113) {
              frame False, Default {
                Is Greater(x=w112, y=614) -> w114
                Is Less(x=w112, y=1) -> w115
                Logical Or(w114, w115) -> w116
                case (w116) {
                  frame False, Default {
                    Concatenate Strings("⚠️ ", w40, " is very hot") -> w43
                  }
                  frame True {
                    w43 = "❌ Temperature not plausible, please check the sensor"
                  }
                }
              }
              frame True {
                case (w40) {
                  frame "False", Default {
                    w43 = "✅"
                  }
                  frame "B101", "B102", "B103", "B104", "B105", "B106", "B107", "B108", "B109", "B110", "B111", "B112", "B113", "B114", "B115", "B116", "B117", "B118" {
                    Add(w34, 5) -> w117
                    Subtract(x=w34, y=5) -> w118
                    In Range And Coerce(lower limit=w118, upper limit=w117, x=w112) -> (In Range?=w119)
                    case (w119) {
                      frame False, Default {
                        Number To Fractional String(number=w34, precision (6)=2, use system decimal point (T)=TRUE) -> (F-format string=w120)
                        Concatenate Strings("⚠️  ", w40, " is outside the range of the other thermocouple", " [mean value : ", w120, " /+- 5°C]") -> w43
                      }
                      frame True {
                        Number To Fractional String(number=w34, precision (6)=2, use system decimal point (T)=TRUE) -> (F-format string=w121)
                        Concatenate Strings("✅ ", w40, " is in range of the other thermocouple", " [mean value : ", w121, " /+- 5°C]") -> w43
                      }
                    }
                  }
                  frame "Left Core Probe Temperature B301", "Left Core Probe Temperature B302", "Left Core Probe Temperature B303", "Left Core Probe Temperature B304", "Left Core Probe Temperature B305", "Left Core Probe Temperature B306" {
                    Add(w35, 5) -> w122
                    Subtract(x=w35, y=5) -> w123
                    In Range And Coerce(lower limit=w123, upper limit=w122, x=w112) -> (In Range?=w124)
                    case (w124) {
                      frame False, Default {
                        Number To Fractional String(number=w35, precision (6)=2, use system decimal point (T)=TRUE) -> (F-format string=w125)
                        Concatenate Strings("⚠️  ", w40, " is outside the range of the other Core Probe", "\r", " [mean value : ", w125, " /+- 5°C]") -> w43
                      }
                      frame True {
                        Number To Fractional String(number=w35, precision (6)=2, use system decimal point (T)=TRUE) -> (F-format string=w126)
                        Concatenate Strings("✅ ", w40, " is in range of the other Core Probe", "\r", " [mean value : ", w126, " /+- 5°C]") -> w43
                      }
                    }
                  }
                }
              }
            }
          }
          frame "Right Core Probe Temperature B311", "Right Core Probe Temperature B312", "Right Core Probe Temperature B313", "Right Core Probe Temperature B314", "Right Core Probe Temperature B315", "Right Core Probe Temperature B316", "Right Pan Temperature B211" {
            w127 = " Information not required for this device type"  # String {0}
            Concatenate Strings("[ℹ]", w127) -> w43
          }
        }
      }
    }
    Property Node(instance in=w42, "comment"=w43) -> (instance out=w128)
    append w128 to w39
  }
  $"Output Error" <- $"Error input"
  $Output <- w39
  $"Left Probe" <- w37
