vi "Interpret_Diagnostic_RT_Data_Sensors_Movement.gviweb"   [G Web Development Software 22.3.0]
inputs:
  "Diagnostic Settings mouvement Entrys": string[]
  "Device Type": string = "Device"
  "Error input": error
outputs:
  "Output Error": error
  "Output mouvement": T2[]
panel controls:
  "Config File infos": string[]
panel indicators:
  "Output": T1[]
types:
  T1 = cluster{"Parameter Name": string, "Down_Switch": string, "Status": string, "Up_Switch": string, "dim": string, "Comment": string}
  T2 = cluster{"Parameter Name": string, "Command": string, "Down_Switch": string, "Status": string, "Up_Switch": string, "dim": string, "Comment": string}
uses:
  WebApp::Get_Config_ini_Part.gviweb
  NI::G Core::Strings::Search and Replace Pattern.gvi
  NI::G Core::Strings::Trim Whitespace.gvi
diagram:
  call "Get_Config_ini_Part.gviweb"(Ini Array=$"Config File infos", ini Part from Array=6, Error in=$"Error input") -> (Ini Part as Array=w1, Output Error=w2)
  for (after $"Device Type") (after w1) {
    w3 = each element of $"Diagnostic Settings mouvement Entrys"
    Match Pattern(regular expression="Command=", string=w3) -> (after substring=w5, before substring=w6)
    Match Pattern(regular expression="Down_Switch=", string=w5) -> (after substring=w7, before substring=w8)
    Match Pattern(regular expression="Status=", string=w7) -> (after substring=w9, before substring=w10)
    call "Search and Replace Pattern.gvi"(String=w10, Muster="\"", Alle ersetzen=TRUE) -> (Ergebnis-String=w11)
    Match Pattern(regular expression="Up_Switch=", string=w9) -> (after substring=w12, before substring=w13)
    call "Search and Replace Pattern.gvi"(String=w13, Muster="\"", Alle ersetzen=TRUE) -> (Ergebnis-String=w14)
    call "Trim Whitespace.gvi"(string=w14) -> (trimmed string=w15)
    call "Search and Replace Pattern.gvi"(String=w6, Muster="_", Ersetzungs-String=" ", Alle ersetzen=TRUE) -> (Ergebnis-String=w16)
    call "Search and Replace Pattern.gvi"(String=w16, Muster="\"", Alle ersetzen=TRUE) -> (Ergebnis-String=w17)
    call "Trim Whitespace.gvi"(string=w17) -> (trimmed string=w18)
    call "Search and Replace Pattern.gvi"(String=w8, Muster="\"", Alle ersetzen=TRUE) -> (Ergebnis-String=w19)
    call "Trim Whitespace.gvi"(string=w19) -> (trimmed string=w20)
    Is Empty String Or Path(string/path=w15) -> w21
    case (w21) {
      frame True {
        w22 = "⚠️: Value is missing"
      }
      frame False {
        case (w18) {
          frame "False", Default {
            Floating Point String To Number(default (0 DBL)=0, string=w15, use system decimal point (T)=TRUE) -> (number=w23)
            In Range And Coerce(lower limit=0, upper limit=65000, x=w23) -> (In Range?=w24)
            case (w24) {
              frame True {
                w22 = "✅: Value is available"
              }
              frame False {
                w22 = "⚠️ Value is out of range or not implemented"
              }
            }
          }
          frame "Left Pan Calibration Offset", "Right Pan  Lid Calibration Offset" {
            Floating Point String To Number(default (0 DBL)=0, string=w15, use system decimal point (T)=TRUE) -> (number=w25)
            In Range And Coerce(lower limit=0, upper limit=65000, x=w25) -> (In Range?=w26)
            case (w26) {
              frame True {
                w22 = "✅: Value is available"
              }
              frame False {
                w22 = "⚠️ Value is out of range or not implemented"
              }
            }
          }
          frame "PT1 Potentiometer", "PT2 Potentiometer" {
            Floating Point String To Number(default (0 DBL)=0, string=w15, use system decimal point (T)=TRUE) -> (number=w27)
            In Range And Coerce(lower limit=0, upper limit=5000, x=w27) -> (In Range?=w28)
            case (w28) {
              frame True {
                w22 = "✅: Value is available"
              }
              frame False {
                w22 = "⚠️ Value is out of range"
              }
            }
          }
        }
      }
    }
    Match Pattern(regular expression="dim=", string=w12) -> (after substring=w29, before substring=w30)
    call "Search and Replace Pattern.gvi"(String=w30, Muster="\"", Alle ersetzen=TRUE) -> (Ergebnis-String=w31)
    call "Search and Replace Pattern.gvi"(String=w29, Muster="\"", Alle ersetzen=TRUE) -> (Ergebnis-String=w32)
    Property Node(instance in=T2 {all zero or empty}, "Parameter Name"=w18, "Command"=w20, "Down_Switch"=w11, "Status"=w15, "Up_Switch"=w31, "dim"=w32, "Comment"=w22) -> (instance out=w33)
    append w33 to w4
  }
  $"Output mouvement" <- w4
  $"Output Error" <- w2
