vi "Interpret_Diagnostic_RT_Data_Sensors_Pressure.gviweb"   [G Web Development Software 22.3.0]
inputs:
  "Pressure Entrys": string[]
  "Device Type": string = "Device"
  "Error input": error
outputs:
  "Output Pressure": T1[]
  "Output Error": error
panel controls:
  "Config File infos": string[]
types:
  T1 = cluster{"Parameter Name": string, "Status": string, "Dimension": string, "comment": string}
uses:
  WebApp::Get_Config_ini_Part.gviweb
  NI::G Core::Strings::Search and Replace Pattern.gvi
  NI::G Core::Strings::Trim Whitespace.gvi
diagram:
  call "Get_Config_ini_Part.gviweb"(Ini Array=$"Config File infos", ini Part from Array=6, Error in=$"Error input") -> (Ini Part as Array=w1, Output Error=w2)
  for (after w1) {
    w3 = each element of $"Pressure Entrys"
    Match Pattern(regular expression="Status=", string=w3) -> (after substring=w5, before substring=w6)
    call "Search and Replace Pattern.gvi"(String=w6, Muster="_", Ersetzungs-String=" ", Alle ersetzen=TRUE) -> (Ergebnis-String=w7)
    call "Trim Whitespace.gvi"(string=w7) -> (trimmed string=w8)
    Match Pattern(regular expression="dim=", string=w5) -> (after substring=w9, before substring=w10)
    call "Search and Replace Pattern.gvi"(String=w10, Muster="\"", Alle ersetzen=TRUE) -> (Ergebnis-String=w11)
    call "Search and Replace Pattern.gvi"(String=w9, Muster="\"", Alle ersetzen=TRUE) -> (Ergebnis-String=w12)
    call "Trim Whitespace.gvi"(string=w12) -> (trimmed string=w13)
    case ($"Device Type") {
      frame "2-S", "2-XS", "L", "XL", Default {
        w15 = " Information not required for this device type"  # String {0}
        Concatenate Strings("[ℹ]", w15) -> w14
      }
      frame "2-S P", "2-XS P" {
        case (w8) {
          frame "False", Default {
            w14 = "✅"
          }
          frame "Left Relative Pressure" {
            Floating Point String To Number(default (0 DBL)=0, string=w11, use system decimal point (T)=TRUE) -> (number=w16)
            In Range And Coerce(lower limit=-20, upper limit=350, x=w16) -> (In Range?=w17)
            case (w17) {
              frame True {
                w14 = "✅"
              }
              frame False {
                w14 = "❌ Pressure is out of tolerance"
              }
            }
          }
          frame "Left Absolute Pressure P1" {
            Floating Point String To Number(default (0 DBL)=0, string=w11, use system decimal point (T)=TRUE) -> (number=w18)
            In Range And Coerce(lower limit=500, upper limit=1450, x=w18) -> (In Range?=w19)
            case (w19) {
              frame True {
                w14 = "✅"
              }
              frame False {
                w14 = "❌ Pressure is out of tolerance"
              }
            }
          }
          frame "Right Relative Pressure" {
            Floating Point String To Number(default (0 DBL)=0, string=w11, use system decimal point (T)=TRUE) -> (number=w20)
            In Range And Coerce(lower limit=-20, upper limit=350, x=w20) -> (In Range?=w21)
            case (w21) {
              frame True {
                w14 = "✅"
              }
              frame False {
                w14 = "❌ Pressure is out of tolerance"
              }
            }
          }
          frame "Right Absolute Pressure P2" {
            Floating Point String To Number(default (0 DBL)=0, string=w11, use system decimal point (T)=TRUE) -> (number=w22)
            In Range And Coerce(lower limit=500, upper limit=1450, x=w22) -> (In Range?=w23)
            case (w23) {
              frame True {
                w14 = "✅"
              }
              frame False {
                w14 = "❌ Pressure is out of tolerance"
              }
            }
          }
        }
      }
      frame "L P", "XL P" {
        case (w8) {
          frame "False", Default {
            w14 = "✅"
          }
          frame "Left Relative Pressure" {
            Floating Point String To Number(default (0 DBL)=0, string=w11, use system decimal point (T)=TRUE) -> (number=w24)
            In Range And Coerce(lower limit=-20, upper limit=350, x=w24) -> (In Range?=w25)
            case (w25) {
              frame True {
                w14 = "✅"
              }
              frame False {
                w14 = "❌ Pressure is out of tolerance"
              }
            }
          }
          frame "Left Absolute Pressure P1" {
            Floating Point String To Number(default (0 DBL)=0, string=w11, use system decimal point (T)=TRUE) -> (number=w26)
            In Range And Coerce(lower limit=500, upper limit=1450, x=w26) -> (In Range?=w27)
            case (w27) {
              frame True {
                w14 = "✅"
              }
              frame False {
                w14 = "❌ Pressure is out of tolerance"
              }
            }
          }
          frame "Right Absolute Pressure P2", "Right Offset Value", "Right Relative Pressure", "Right pressure valve close duration", "Right pressure valve close switch", "Right pressure valve open duration", "Right pressure valve open switch" {
            w28 = " Information not required for this device type"  # String {0}
            Concatenate Strings("[ℹ]", w28) -> w14
          }
        }
      }
    }
    Property Node(instance in=T1 {all zero or empty}, "Parameter Name"=w8, "Status"=w11, "Dimension"=w13, "comment"=w14) -> (instance out=w29)
    append w29 to w4
  }
  $"Output Pressure" <- w4
  $"Output Error" <- w2
