vi "Interpret_Diagnostic_RunningTimes_Comp.gviweb"   [G Web Development Software 22.3.0]
inputs:
  "Diagnostic Service History Entrys": string[]
  "Error Cluster input": error
  "Total running time": string
outputs:
  "Running Time Component Output": T1[]
  "Error Cluster output": error
types:
  T1 = cluster{"Parameter Name": string, "Count": string, "Duration": string, "Dimension": string, "Comment": string}
uses:
  NI::G Core::Strings::Search and Replace Pattern.gvi
  NI::G Core::Strings::Trim Whitespace.gvi
diagram:
  for {
    w1 = each element of $"Diagnostic Service History Entrys"
    Match Pattern(regular expression="Count_abs=", string=w1) -> (after substring=w3, before substring=w4, match substring=w5)
    case (w5) {
      frame "Count_abs=" {
        call "Search and Replace Pattern.gvi"(String=w4, Muster="_", Ersetzungs-String=" ", Alle ersetzen=TRUE) -> (Ergebnis-String=w10)
        call "Trim Whitespace.gvi"(string=w10) -> (trimmed string=w7)
        Match Pattern(regular expression="Count_rel=", string=w3) -> (after substring=w11, before substring=w12)
        call "Search and Replace Pattern.gvi"(String=w12, Muster="\"", Alle ersetzen=TRUE) -> (Ergebnis-String=w6)
        Match Pattern(regular expression="Duration_rel=", string=w11) -> (after substring=w13)
        Match Pattern(regular expression="dim=", string=w13) -> (after substring=w14, before substring=w15)
        call "Search and Replace Pattern.gvi"(String=w15, Muster="\"", Alle ersetzen=TRUE) -> (Ergebnis-String=w9)
        call "Search and Replace Pattern.gvi"(String=w14, Muster="\"", Alle ersetzen=TRUE) -> (Ergebnis-String=w8)
      }
      frame "False", Default {
        Match Pattern(regular expression="Count=", string=w1) -> (after substring=w16, before substring=w17)
        call "Search and Replace Pattern.gvi"(String=w17, Muster="_", Ersetzungs-String=" ", Alle ersetzen=TRUE) -> (Ergebnis-String=w18)
        call "Trim Whitespace.gvi"(string=w18) -> (trimmed string=w7)
        Match Pattern(regular expression="Duration=", string=w16) -> (after substring=w19, before substring=w20)
        call "Search and Replace Pattern.gvi"(String=w20, Muster="\"", Alle ersetzen=TRUE) -> (Ergebnis-String=w6)
        Match Pattern(regular expression="dim=", string=w19) -> (after substring=w21, before substring=w22)
        call "Search and Replace Pattern.gvi"(String=w22, Muster="\"", Alle ersetzen=TRUE) -> (Ergebnis-String=w9)
        call "Search and Replace Pattern.gvi"(String=w21, Muster="\"", Alle ersetzen=TRUE) -> (Ergebnis-String=w8)
      }
    }
    Property Node(instance in=T1 {all zero or empty}, "Parameter Name"=w7, "Count"=w6, "Duration"=w9, "Dimension"=w8) -> (instance out=w23)
    append w23 to w2
  }
  for {
    w24 = each element of w2
    Property Node(instance in=w24) -> ("Duration"=w26, "Dimension"=w27, "Parameter Name"=w28, "Count"=w29)
    Floating Point String To Number(default (0 DBL)=0, string=$"Total running time", use system decimal point (T)=TRUE) -> (number=w30)
    case (w27) {
      frame "False", Default {
        call "Trim Whitespace.gvi"(string=w29) -> (trimmed string=w32)
        call "Trim Whitespace.gvi"(string=w26) -> (trimmed string=w33)
        Is Empty String Or Path(string/path=w33) -> w34
        Is Empty String Or Path(string/path=w32) -> w35
        Logical And(w34, w35) -> w36
        case (w36) {
          frame False {
            case (w32) {
              frame "False", Default {
                w31 = "✅"
              }
              frame "undef" {
                Concatenate Strings("[ℹ] ", " Information is not implemented !") -> w31
              }
              frame "xxxxxxxxxx" {
                Concatenate Strings("[ℹ] ", " Information is not implemented !") -> w31
              }
            }
          }
          frame True {
            w37 = " Information not required for this device type"  # String {0}
            Concatenate Strings("[ℹ]", w37) -> w31
          }
        }
      }
      frame "min" {
        Floating Point String To Number(default (0 DBL)=0, string=w26, use system decimal point (T)=TRUE) -> (number=w38)
        Divide(x=w38, y=60) -> w39
        Is Greater(x=w39, y=w30) -> w40
        case (w40) {
          frame False, Default {
            call "Trim Whitespace.gvi"(string=w29) -> (trimmed string=w41)
            call "Trim Whitespace.gvi"(string=w26) -> (trimmed string=w42)
            Is Empty String Or Path(string/path=w42) -> w43
            Is Empty String Or Path(string/path=w41) -> w44
            Logical And(w43, w44) -> w45
            case (w45) {
              frame True {
                w46 = " Information not required for this device type"  # String {0}
                Concatenate Strings("[ℹ]", w46) -> w31
              }
              frame False {
                case (w41) {
                  frame "False", Default {
                    w31 = "✅"
                  }
                  frame "undef" {
                    Concatenate Strings("[ℹ] ", " Information is not implemented !") -> w31
                  }
                  frame "xxxxxxxxxx" {
                    Concatenate Strings("[ℹ] ", " Information is not implemented !") -> w31
                  }
                }
              }
            }
          }
          frame True {
            w47 = "❌"  # String {0}
            Concatenate Strings(w47, " ", w28, " ", "exceeds the total running time !") -> w31
          }
        }
      }
      frame "h" {
        Floating Point String To Number(default (0 DBL)=0, string=w26, use system decimal point (T)=TRUE) -> (number=w48)
        Is Greater(x=w48, y=w30) -> w49
        case (w49) {
          frame False, Default {
            call "Trim Whitespace.gvi"(string=w29) -> (trimmed string=w50)
            call "Trim Whitespace.gvi"(string=w26) -> (trimmed string=w51)
            Is Empty String Or Path(string/path=w51) -> w52
            Is Empty String Or Path(string/path=w50) -> w53
            Logical And(w52, w53) -> w54
            case (w54) {
              frame True {
                case (w28) {
                  frame "Emergency Controller" {
                    w31 = "✅"
                  }
                  frame "False", Default {
                    w55 = "  Information not required for this device type"  # String {0}
                    Concatenate Strings("[ℹ]", w55) -> w31
                  }
                }
              }
              frame False {
                case (w50) {
                  frame "False", Default {
                    w31 = "✅"
                  }
                  frame "undef" {
                    Concatenate Strings("[ℹ] ", " Information is not implemented !") -> w31
                  }
                  frame "xxxxxxxxxx" {
                    Concatenate Strings("[ℹ] ", " Information is not implemented !") -> w31
                  }
                }
              }
            }
          }
          frame True {
            w56 = "❌"  # String {0}
            Concatenate Strings(w56, " ", w28, " ", "exceeds the total running time !") -> w31
          }
        }
      }
    }
    Property Node(instance in=w24, "Comment"=w31) -> (instance out=w57)
    append w57 to w25
  }
  $"Error Cluster output" <- $"Error Cluster input"
  $"Running Time Component Output" <- w25
