vi "Interpret_Diagnostic_RunningTimes_Modes.gviweb"   [G Web Development Software 22.3.0]
inputs:
  "Diagnostic Service History Entrys": string[]
  "Error Cluster input": error
outputs:
  "Error Cluster output": error
  "Diagnostic Running Time Modes Output": T1[]
  "Total running time": string
  "Total of Cleaning": f64
  "Only Total running Time:": T1[]
types:
  T1 = cluster{"Parameter Name": string, "Count": string, "Duration": string, "Dimension": string, "Comment": string}
uses:
  NI::G Core::Strings::Search and Replace Pattern.gvi
  NI::G Core::Strings::Trim Whitespace.gvi
diagram:
  s1 = ""  # shift register
  s2 = 0  # shift register
  s3 = FALSE  # shift register
  for {
    w1 = each element of $"Diagnostic Service History Entrys"
    Match Pattern(regular expression="Count_abs=", string=w1) -> (after substring=w3, before substring=w4, match substring=w5)
    case (w5) {
      frame "Count_abs=" {
        call "Search and Replace Pattern.gvi"(String=w4, Muster="_", Ersetzungs-String=" ", Alle ersetzen=TRUE) -> (Ergebnis-String=w10)
        call "Trim Whitespace.gvi"(string=w10) -> (trimmed string=w6)
        # New Version
        Match Pattern(regular expression="Duration_abs=", string=w3) -> (after substring=w11, before substring=w12)
        Match Pattern(regular expression="Count_rel=", string=w12) -> (before substring=w13)
        call "Search and Replace Pattern.gvi"(String=w13, Muster="\"", Alle ersetzen=TRUE) -> (Ergebnis-String=w7)
        Match Pattern(regular expression="Duration_rel=", string=w11) -> (after substring=w14, before substring=w15)
        Match Pattern(regular expression="dim=", string=w14) -> (after substring=w16)
        call "Search and Replace Pattern.gvi"(String=w16, Muster="\"", Alle ersetzen=TRUE) -> (Ergebnis-String=w8)
        call "Search and Replace Pattern.gvi"(String=w15, Muster="\"", Alle ersetzen=TRUE) -> (Ergebnis-String=w9)
      }
      frame "False", Default {
        Match Pattern(regular expression="Count=", string=w1) -> (after substring=w17, before substring=w18)
        call "Search and Replace Pattern.gvi"(String=w18, Muster="_", Ersetzungs-String=" ", Alle ersetzen=TRUE) -> (Ergebnis-String=w19)
        call "Trim Whitespace.gvi"(string=w19) -> (trimmed string=w6)
        # Old Version
        Match Pattern(regular expression="Duration=", string=w17) -> (after substring=w20, before substring=w21)
        call "Search and Replace Pattern.gvi"(String=w21, Muster="\"", Alle ersetzen=TRUE) -> (Ergebnis-String=w22)
        call "Trim Whitespace.gvi"(string=w22) -> (trimmed string=w7)
        Match Pattern(regular expression="dim=", string=w20) -> (after substring=w23, before substring=w24)
        call "Search and Replace Pattern.gvi"(String=w24, Muster="\"", Alle ersetzen=TRUE) -> (Ergebnis-String=w25)
        call "Trim Whitespace.gvi"(string=w25) -> (trimmed string=w9)
        call "Search and Replace Pattern.gvi"(String=w23, Muster="\"", Alle ersetzen=TRUE) -> (Ergebnis-String=w26)
        call "Trim Whitespace.gvi"(string=w26) -> (trimmed string=w8)
      }
    }
    call "Search and Replace Pattern.gvi"(String=w8, Muster="\"", Alle ersetzen=TRUE) -> (Ergebnis-String=w27)
    Property Node(instance in=T1 {all zero or empty}, "Parameter Name"=w6, "Count"=w7, "Duration"=w9, "Dimension"=w27) -> (instance out=w28)
    case (w6) {
      frame "False", Default {
        w29 = s1
        w30 = s2
        w31 = s3
      }
      frame "express", "light eco with steam generator descale", "light eco wo steam generator descale", "light with steam generator descale", "light wo steam generator descale", "medium eco with steam generator descale", "medium eco wo steam generator descale", "medium with steam generator descale", "medium wo steam generator descale", "rinse", "rinse without tabs", "strong eco with steam generator descale", "strong with steam generator descale", "strong wo steam generator descale" {
        Floating Point String To Number(string=w7, use system decimal point (T)=TRUE) -> (number=w32)
        Add(w32, s2) -> w30
        w29 = s1
        w31 = s3
      }
      frame "Clean Abort" {
        Floating Point String To Number(string=w7, use system decimal point (T)=TRUE) -> (number=w33)
        Multiply(w33, 100) -> w34
        Divide(x=w34, y=s2) -> w35
        Is Greater(x=w35, y=5) -> w31
        w29 = s1
        w30 = s2
      }
      frame "Total Running Time" {
        w29 = w9
        w30 = s2
        w31 = s3
      }
    }
    append w28 to w2
    next s1 = w29
    next s2 = w30
    next s3 = w31
  }
  for {
    w36 = each element of w2
    Property Node(instance in=w36) -> ("Duration"=w38, "Dimension"=w39, "Parameter Name"=w40, "Count"=w41)
    Floating Point String To Number(default (0 DBL)=0, string=s1, use system decimal point (T)=TRUE) -> (number=w42)
    case (w39) {
      frame "False", Default {
        call "Trim Whitespace.gvi"(string=w38) -> (trimmed string=w44)
        Is Empty String Or Path(string/path=w44) -> w45
        call "Trim Whitespace.gvi"(string=w41) -> (trimmed string=w46)
        Is Empty String Or Path(string/path=w46) -> w47
        Logical And(w45, w47) -> w48
        case (w48) {
          frame True {
            w49 = " Process was not performed"  # String {0}
            Concatenate Strings("[ℹ]", w49) -> w43
          }
          frame False {
            w43 = "✅"
          }
        }
      }
      frame "min" {
        Floating Point String To Number(default (0 DBL)=0, string=w38, use system decimal point (T)=TRUE) -> (number=w50)
        Divide(x=w50, y=60) -> w51
        Is Greater(x=w51, y=w42) -> w52
        case (w52) {
          frame False, Default {
            call "Trim Whitespace.gvi"(string=w38) -> (trimmed string=w53)
            Is Empty String Or Path(string/path=w53) -> w54
            call "Trim Whitespace.gvi"(string=w41) -> (trimmed string=w55)
            Is Empty String Or Path(string/path=w55) -> w56
            Logical And(w54, w56) -> w57
            case (w57) {
              frame True {
                w58 = " Process was not performed"  # String {0}
                Concatenate Strings("[ℹ]", w58) -> w43
              }
              frame False {
                w43 = "✅"
              }
            }
          }
          frame True {
            w59 = "❌"  # String {0}
            Concatenate Strings(w59, " ", w40, " ", "exceeds the total running time !") -> w43
          }
        }
      }
      frame "h" {
        Floating Point String To Number(default (0 DBL)=0, string=w38, use system decimal point (T)=TRUE) -> (number=w60)
        Is Greater(x=w60, y=w42) -> w61
        case (w61) {
          frame False, Default {
            call "Trim Whitespace.gvi"(string=w38) -> (trimmed string=w62)
            Is Empty String Or Path(string/path=w62) -> w63
            call "Trim Whitespace.gvi"(string=w41) -> (trimmed string=w64)
            Is Empty String Or Path(string/path=w64) -> w65
            Logical And(w63, w65) -> w66
            case (w66) {
              frame True {
                w67 = " Process was not performed"  # String {0}
                Concatenate Strings("[ℹ]", w67) -> w43
              }
              frame False {
                w43 = "✅"
              }
            }
          }
          frame True {
            w68 = "❌"  # String {0}
            Concatenate Strings(w68, " ", w40, " ", "exceeds the total running time !") -> w43
          }
        }
      }
    }
    case (w40) {
      frame "False", Default {
        w69 = w43
      }
      frame "Clean Abort" {
        case (s3) {
          frame False, Default {
            w69 = "✅"
          }
          frame True {
            w69 = "⚠️ Quantity of clean abort is high"
          }
        }
      }
    }
    Property Node(instance in=w36, "Comment"=w69) -> (instance out=w70)
    append w70 to w37
  }
  $"Error Cluster output" <- $"Error Cluster input"
  $"Diagnostic Running Time Modes Output" <- w37
  s4 = T1[] []  # shift register
  for {
    w71 = each element of w37
    Property Node(instance in=w71) -> ("Parameter Name"=w72, "Duration"=w73, instance out=w74)
    case (w72) {
      frame "False", Default {
        w75 = s4
      }
      frame "Total Running Time" {
        Property Node(instance in=w74, "Parameter Name"=w72) -> (instance out=w76)
        Quotient And Remainder(x=w42, y=8760) -> (floor(x/y)=w77, x-y*floor(x/y)=w78)
        Number To Decimal String(number=w77) -> (decimal integer string=w79)
        Quotient And Remainder(x=w78, y=730) -> (floor(x/y)=w80, x-y*floor(x/y)=w81)
        Number To Decimal String(number=w80) -> (decimal integer string=w82)
        Quotient And Remainder(x=w81, y=24) -> (floor(x/y)=w83, x-y*floor(x/y)=w84)
        Number To Decimal String(number=w83) -> (decimal integer string=w85)
        Round To Nearest(number=w84) -> w86
        Number To Decimal String(number=w86) -> (decimal integer string=w87)
        Concatenate Strings("This means:  ", w79, " years, ", w82, " months,  ", w85, " days, ", w87, " hours.") -> w88
        Property Node(instance in=w76, "Comment"=w88) -> (instance out=w89)
        Insert Into Array(inArray=s4, new=w89) -> w75
      }
    }
    next s4 = w75
  }
  $"Only Total running Time:" <- s4
  $"Total running time" <- s1
  $"Total of Cleaning" <- s2
