vi "Interpret_Diagnostic_Water_iCS_Switch.gviweb"   [G Web Development Software 22.3.0]
inputs:
  "Error Cluster input": error
  "Diagnostic Water iCS Switch Entrys": string[]
  "Device Type": string = "Device"
  "Auto Dose": string = "Device"
outputs:
  "Diagnostic Water iCS Switch Output": T1[]
  "Output_Error": error
types:
  T1 = cluster{"Parameter Name": string, "Status": string, "Dimension": string, "Comment": string}
uses:
  NI::G Core::Strings::Search and Replace Pattern.gvi
  NI::G Core::Strings::Trim Whitespace.gvi
  WebApp::Change_Parameter_Solenoid_Valve.gviweb
diagram:
  # 0: Reference Volume Steam Generator
  # 0: Fill
  # is out of range! Valid range [500, 2000]
  # ✅: Valid range [500, 2000]
  s1 = 0  # shift register
  s2 = 0  # shift register
  for {
    w1 = each element of $"Diagnostic Water iCS Switch Entrys"
    # s1: Norm
    # s2: Fill
    Match Pattern(regular expression="Status=", string=w1) -> (after substring=w3, before substring=w4)
    call "Search and Replace Pattern.gvi"(String=w4, Muster="_", Ersetzungs-String=" ", Alle ersetzen=TRUE) -> (Ergebnis-String=w5)
    call "Trim Whitespace.gvi"(string=w5) -> (trimmed string=w6)
    Match Pattern(regular expression="dim=", string=w3) -> (after substring=w7, before substring=w8)
    call "Search and Replace Pattern.gvi"(String=w8, Muster="\"", Alle ersetzen=TRUE) -> (Ergebnis-String=w9)
    call "Trim Whitespace.gvi"(string=w9) -> (trimmed string=w10)
    call "Search and Replace Pattern.gvi"(String=w7, Muster="\"", Alle ersetzen=TRUE) -> (Ergebnis-String=w11)
    call "Trim Whitespace.gvi"(string=w11) -> (trimmed string=w12)
    case ($"Device Type") {
      frame "False", Default {
        w13 = $"Error Cluster input"
        w14 = "✅"
        w15 = s1
        w16 = s2
      }
      frame "623", "E523" {
        case (w6) {
          frame "False", Default {
            w13 = $"Error Cluster input"
            w14 = "✅"
            w15 = s1
            w16 = s2
          }
          frame "Solenoid Valve Care Y4", "Solenoid Valve Control Y2", "Solenoid Valve Filling Y1", "Solenoid Valve Moistening Y3" {
            Concatenate Strings("✅: ", "Value is available.") -> w14
            w13 = $"Error Cluster input"
            w15 = s1
            w16 = s2
          }
          frame "Active Pump", "Active RPM", "Conductivity Mixbox", "Contact Cleaning Flap S25", "Gas blower Hot Air1 M8", "Gas blower Hot Air2 M10", "Gas blower Steam M9", "Gas valve Hot Air 1 Y12", "Gas valve Hot Air 2 Y13", "Gas valve Steam Y11", "Hot Air Bottom Flame Current", "Hot Air Bottom Heat Request", "Hot Air Top Flame Current", "Hot Air Top Heat Request", "Magnetron Cooling Fan bottom", "Magnetron Cooling Fan top", "Magnetron Safety Chain bottom", "Magnetron Safety Chain top", "Microwave Anode current bottom", "Microwave Anode current top", "Microwave Heating Voltage bottom", "Microwave Heating Voltage top", "Microwave High Voltage actual bottom", "Microwave High Voltage actual top", "Microwave Target bottom", "Microwave Target top", "Motor Floor M22", "Motor TableFloor M16", "Solenoid Valve Flush Y14", "Status Cartridge 1", "Status Cartridge 2", "Status Cartridge 3", "Status Cartridge 4", "Steam Flame Current", "Steam Heat Request" {
            w17 = " Information not required for this device type"  # String {0}
            Concatenate Strings("[ℹ]", w17) -> w14
            w13 = $"Error Cluster input"
            w15 = s1
            w16 = s2
          }
          frame "Reference Volume Steam Generator" {
            Floating Point String To Number(default (0 DBL)=0, string=w10, use system decimal point (T)=TRUE) -> (number=w15)
            Multiply(1.9, 1.1) -> w18
            Multiply(1.9, 0.9) -> w19
            In Range And Coerce(lower limit=w19, upper limit=w18, x=w15) -> (In Range?=w20)
            # E623_Volume_Steam_Generator_Norm = 1.9
            case (w20) {
              frame False, Default {
                Number To Fractional String(number=1.9, precision (6)=1, use system decimal point (T)=TRUE) -> (F-format string=w21)
                w22 = "❌"  # String {0}
                Concatenate Strings(w22, " ", w6, " ", "is out of range !", "\r", "Nominal volume: ", w21, " L") -> w14
              }
              frame True {
                Number To Fractional String(number=1.9, precision (6)=1, use system decimal point (T)=TRUE) -> (F-format string=w23)
                Concatenate Strings("✅", " Nominal volume: ", w23, " L") -> w14
              }
            }
            w13 = $"Error Cluster input"
            w16 = s2
          }
          frame "Actual Filling Volume Steam Generator" {
            Floating Point String To Number(default (0 DBL)=0, string=w10, use system decimal point (T)=TRUE) -> (number=w16)
            Multiply(s1, 0.2) -> w24
            Add(w24, s1) -> w25
            Subtract(x=s1, y=w24) -> w26
            In Range And Coerce(lower limit=w26, upper limit=w25, x=w16) -> (In Range?=w27)
            case (w27) {
              frame False, Default {
                w28 = "❌"  # String {0}
                Concatenate Strings(w28, " ", w6, " ", "doesn't fit to the norm level") -> w14
              }
              frame True {
                Concatenate Strings("✅ ", w6, " is OK:", "\r", "In relation to the reference volume steam generator.") -> w14
              }
            }
            w13 = $"Error Cluster input"
            w15 = s1
          }
          frame "Level Electrode S2 Threshold" {
            Floating Point String To Number(default (0 DBL)=0, string=w10, use system decimal point (T)=TRUE) -> (number=w29)
            In Range And Coerce[IncludeHighLimit=True](lower limit=500, upper limit=2000, x=w29) -> (In Range?=w30)
            case (w30) {
              frame False, Default {
                w31 = "❌"  # String {0}
                Concatenate Strings(w31, " ", w6, " ", "is out of range! Valid range [500, 2000] ") -> w14
              }
              frame True {
                w14 = "✅: Valid range [500, 2000] "
              }
            }
            w13 = $"Error Cluster input"
            w15 = s1
            w16 = s2
          }
          frame "Level Electrode S2 Current  Value" {
            Floating Point String To Number(default (0 DBL)=0, string=w10, use system decimal point (T)=TRUE) -> (number=w32)
            In Range And Coerce(lower limit=0, upper limit=3000, x=w32) -> (In Range?=w33)
            case (w33) {
              frame False, Default {
                w34 = "❌"  # String {0}
                Concatenate Strings(w34, " ", w6, " ", "is out of range!") -> w14
              }
              frame True {
                w14 = "✅ "
              }
            }
            w13 = $"Error Cluster input"
            w15 = s1
            w16 = s2
          }
          frame "CalcCheck Volume Steam Generator" {
            Floating Point String To Number(default (0 DBL)=0, string=w10, use system decimal point (T)=TRUE) -> (number=w35)
            Is Greater(x=w35, y=s2) -> w36
            Divide(x=s2, y=w35) -> w37
            Is Less(x=w37, y=1.08) -> w38
            Logical Or(w38, w36) -> w39
            case (w39) {
              frame True {
                w40 = "❌"  # String {0}
                Concatenate Strings(w40, " ", "Too much calc in the steam generator!") -> w14
              }
              frame False {
                w14 = "✅"
              }
            }
            w13 = $"Error Cluster input"
            w15 = s1
            w16 = s2
          }
        }
      }
      frame "E61" {
        case (w6) {
          frame "False", Default {
            w13 = $"Error Cluster input"
            w14 = "✅"
            w15 = s1
            w16 = s2
          }
          frame "Ball Valve Motor M7", "Care Pump XS M18", "CleanJet Pump XS M6", "Gas blower Hot Air1 M8", "Gas blower Hot Air2 M10", "Gas blower Steam M9", "Gas valve Hot Air 1 Y12", "Gas valve Hot Air 2 Y13", "Gas valve Steam Y11", "Hot Air Bottom Flame Current", "Hot Air Bottom Heat Request", "Hot Air Top Flame Current", "Hot Air Top Heat Request", "Magnetron Cooling Fan bottom", "Magnetron Cooling Fan top", "Magnetron Safety Chain bottom", "Magnetron Safety Chain top", "Microwave Anode current bottom", "Microwave Anode current top", "Microwave Heating Voltage bottom", "Microwave Heating Voltage top", "Microwave High Voltage actual bottom", "Microwave High Voltage actual top", "Microwave Target bottom", "Microwave Target top", "Motor Floor M22", "Motor TableFloor M16", "SC Pump XS M4", "Steam Flame Current", "Steam Heat Request" {
            w41 = " Information not required for this device type"  # String {0}
            Concatenate Strings("[ℹ]", w41) -> w14
            w13 = $"Error Cluster input"
            w15 = s1
            w16 = s2
          }
          frame "Conductivity Mixbox", "Contact Cleaning Flap S25", "Status Cartridge 1", "Status Cartridge 2", "Status Cartridge 3", "Status Cartridge 4" {
            case ($"Auto Dose") {
              frame "False", Default {
                w14 = "✅ "
              }
              frame "AutoDose_not_available" {
                w42 = " Information not required for this device type"  # String {0}
                Concatenate Strings("[ℹ]", w42) -> w14
              }
            }
            w13 = $"Error Cluster input"
            w15 = s1
            w16 = s2
          }
          frame "Reference Volume Steam Generator" {
            Floating Point String To Number(default (0 DBL)=0, string=w10, use system decimal point (T)=TRUE) -> (number=w15)
            Multiply(3.9, 1.1) -> w43
            Multiply(3.9, 0.9) -> w44
            In Range And Coerce(lower limit=w44, upper limit=w43, x=w15) -> (In Range?=w45)
            # E61_Volume_Steam_Generator_Norm = 3.9
            case (w45) {
              frame False, Default {
                Number To Fractional String(number=3.9, precision (6)=1, use system decimal point (T)=TRUE) -> (F-format string=w46)
                w47 = "❌"  # String {0}
                Concatenate Strings(w47, " ", w6, " ", "is out of range !", "\r", "Nominal volume: ", w46, " L") -> w14
              }
              frame True {
                Number To Fractional String(number=3.9, precision (6)=1, use system decimal point (T)=TRUE) -> (F-format string=w48)
                Concatenate Strings("✅", " Nominal volume: ", w48, "L") -> w14
              }
            }
            w13 = $"Error Cluster input"
            w16 = s2
          }
          frame "Actual Filling Volume Steam Generator" {
            Floating Point String To Number(default (0 DBL)=0, string=w10, use system decimal point (T)=TRUE) -> (number=w16)
            Multiply(s1, 0.2) -> w49
            Add(w49, s1) -> w50
            Subtract(x=s1, y=w49) -> w51
            In Range And Coerce(lower limit=w51, upper limit=w50, x=w16) -> (In Range?=w52)
            case (w52) {
              frame False, Default {
                w53 = "❌"  # String {0}
                Concatenate Strings(w53, " ", w6, " ", "doesn't fit to the norm level") -> w14
              }
              frame True {
                Concatenate Strings("✅ ", w6, " is OK:", "\r", "In relation to the reference volume steam generator.") -> w14
              }
            }
            w13 = $"Error Cluster input"
            w15 = s1
          }
          frame "Level Electrode S2 Threshold" {
            Floating Point String To Number(default (0 DBL)=0, string=w10, use system decimal point (T)=TRUE) -> (number=w54)
            In Range And Coerce[IncludeHighLimit=True](lower limit=500, upper limit=2000, x=w54) -> (In Range?=w55)
            case (w55) {
              frame False, Default {
                w56 = "❌"  # String {0}
                Concatenate Strings(w56, " ", w6, " ", "is out of range! Valid range [500, 2000]") -> w14
              }
              frame True {
                w14 = "✅: Valid range [500, 2000] "
              }
            }
            w13 = $"Error Cluster input"
            w15 = s1
            w16 = s2
          }
          frame "Level Electrode S2 Current  Value" {
            Floating Point String To Number(default (0 DBL)=0, string=w10, use system decimal point (T)=TRUE) -> (number=w57)
            In Range And Coerce(lower limit=0, upper limit=3000, x=w57) -> (In Range?=w58)
            case (w58) {
              frame False, Default {
                w59 = "❌"  # String {0}
                Concatenate Strings(w59, " ", w6, " ", "is out of range!") -> w14
              }
              frame True {
                w14 = "✅ "
              }
            }
            w13 = $"Error Cluster input"
            w15 = s1
            w16 = s2
          }
          frame "CalcCheck Volume Steam Generator" {
            Floating Point String To Number(default (0 DBL)=0, string=w10, use system decimal point (T)=TRUE) -> (number=w60)
            Is Greater(x=w60, y=s2) -> w61
            Divide(x=s2, y=w60) -> w62
            Is Less(x=w62, y=1.08) -> w63
            Logical Or(w63, w61) -> w64
            case (w64) {
              frame True {
                w65 = "❌"  # String {0}
                Concatenate Strings(w65, " ", "Too much calc in the steam generator!") -> w14
              }
              frame False {
                w14 = "✅"
              }
            }
            w13 = $"Error Cluster input"
            w15 = s1
            w16 = s2
          }
        }
      }
      frame "E62" {
        case (w6) {
          frame "False", Default {
            w13 = $"Error Cluster input"
            w14 = "✅"
            w15 = s1
            w16 = s2
          }
          frame "Ball Valve Motor M7", "Care Pump XS M18", "CleanJet Pump XS M6", "Gas blower Hot Air1 M8", "Gas blower Hot Air2 M10", "Gas blower Steam M9", "Gas valve Hot Air 1 Y12", "Gas valve Hot Air 2 Y13", "Gas valve Steam Y11", "Hot Air Bottom Flame Current", "Hot Air Bottom Heat Request", "Hot Air Top Flame Current", "Hot Air Top Heat Request", "Magnetron Cooling Fan bottom", "Magnetron Cooling Fan top", "Magnetron Safety Chain bottom", "Magnetron Safety Chain top", "Microwave Anode current bottom", "Microwave Anode current top", "Microwave Heating Voltage bottom", "Microwave Heating Voltage top", "Microwave High Voltage actual bottom", "Microwave High Voltage actual top", "Microwave Target bottom", "Microwave Target top", "Motor Floor M22", "Motor TableFloor M16", "SC Pump XS M4", "Steam Flame Current", "Steam Heat Request" {
            w66 = " Information not required for this device type"  # String {0}
            Concatenate Strings("[ℹ]", w66) -> w14
            w13 = $"Error Cluster input"
            w15 = s1
            w16 = s2
          }
          frame "Conductivity Mixbox", "Contact Cleaning Flap S25", "Status Cartridge 1", "Status Cartridge 2", "Status Cartridge 3", "Status Cartridge 4" {
            case ($"Auto Dose") {
              frame "False", Default {
                w14 = "✅ "
              }
              frame "AutoDose_not_available" {
                w67 = " Information not required for this device type"  # String {0}
                Concatenate Strings("[ℹ]", w67) -> w14
              }
            }
            w13 = $"Error Cluster input"
            w15 = s1
            w16 = s2
          }
          frame "Reference Volume Steam Generator" {
            Floating Point String To Number(default (0 DBL)=0, string=w10, use system decimal point (T)=TRUE) -> (number=w15)
            Multiply(7.5, 1.1) -> w68
            Multiply(7.5, 0.9) -> w69
            In Range And Coerce(lower limit=w69, upper limit=w68, x=w15) -> (In Range?=w70)
            # E62_Volume_Steam_Generator_Norm = 7.5
            case (w70) {
              frame False, Default {
                Number To Fractional String(number=7.5, precision (6)=1, use system decimal point (T)=TRUE) -> (F-format string=w71)
                w72 = "❌"  # String {0}
                Concatenate Strings(w72, " ", w6, " ", "is out of range !", "\r", "Nominal volume: ", w71, " L") -> w14
              }
              frame True {
                Number To Fractional String(number=7.5, precision (6)=1, use system decimal point (T)=TRUE) -> (F-format string=w73)
                Concatenate Strings("✅", " Nominal volume: ", w73) -> w14
              }
            }
            w13 = $"Error Cluster input"
            w16 = s2
          }
          frame "Actual Filling Volume Steam Generator" {
            Floating Point String To Number(default (0 DBL)=0, string=w10, use system decimal point (T)=TRUE) -> (number=w16)
            Multiply(s1, 0.2) -> w74
            Add(w74, s1) -> w75
            Subtract(x=s1, y=w74) -> w76
            In Range And Coerce(lower limit=w76, upper limit=w75, x=w16) -> (In Range?=w77)
            case (w77) {
              frame False, Default {
                w78 = "❌"  # String {0}
                Concatenate Strings(w78, " ", w6, " ", "doesn't fit to the norm level") -> w14
              }
              frame True {
                Concatenate Strings("✅ ", w6, " is OK:", "\r", "In relation to the reference volume steam generator.") -> w14
              }
            }
            w13 = $"Error Cluster input"
            w15 = s1
          }
          frame "Level Electrode S2 Threshold" {
            Floating Point String To Number(default (0 DBL)=0, string=w10, use system decimal point (T)=TRUE) -> (number=w79)
            In Range And Coerce[IncludeHighLimit=True](lower limit=500, upper limit=2000, x=w79) -> (In Range?=w80)
            case (w80) {
              frame False, Default {
                w81 = "❌"  # String {0}
                Concatenate Strings(w81, " ", w6, " ", "is out of range! Valid range [500, 2000]") -> w14
              }
              frame True {
                w14 = "✅: Valid range [500, 2000] "
              }
            }
            w13 = $"Error Cluster input"
            w15 = s1
            w16 = s2
          }
          frame "Level Electrode S2 Current  Value" {
            Floating Point String To Number(default (0 DBL)=0, string=w10, use system decimal point (T)=TRUE) -> (number=w82)
            In Range And Coerce(lower limit=0, upper limit=3000, x=w82) -> (In Range?=w83)
            case (w83) {
              frame False, Default {
                w84 = "❌"  # String {0}
                Concatenate Strings(w84, " ", w6, " ", "is out of range!") -> w14
              }
              frame True {
                w14 = "✅ "
              }
            }
            w13 = $"Error Cluster input"
            w15 = s1
            w16 = s2
          }
          frame "CalcCheck Volume Steam Generator" {
            Floating Point String To Number(default (0 DBL)=0, string=w10, use system decimal point (T)=TRUE) -> (number=w85)
            Is Greater(x=w85, y=s2) -> w86
            Divide(x=s2, y=w85) -> w87
            Is Less(x=w87, y=1.08) -> w88
            Logical Or(w88, w86) -> w89
            case (w89) {
              frame True {
                w90 = "❌"  # String {0}
                Concatenate Strings(w90, " ", "Too much calc in the steam generator!") -> w14
              }
              frame False {
                w14 = "✅"
              }
            }
            w13 = $"Error Cluster input"
            w15 = s1
            w16 = s2
          }
        }
      }
      frame "E61T" {
        case (w6) {
          frame "False", Default {
            w13 = $"Error Cluster input"
            w14 = "✅"
            w15 = s1
            w16 = s2
          }
          frame "Ball Valve Motor M7", "Care Pump XS M18", "CleanJet Pump XS M6", "Gas blower Hot Air1 M8", "Gas blower Hot Air2 M10", "Gas blower Steam M9", "Gas valve Hot Air 1 Y12", "Gas valve Hot Air 2 Y13", "Gas valve Steam Y11", "Hot Air Bottom Flame Current", "Hot Air Bottom Heat Request", "Hot Air Top Flame Current", "Hot Air Top Heat Request", "Motor Floor M22", "Motor TableFloor M16", "SC Pump XS M4", "Steam Flame Current", "Steam Heat Request" {
            w91 = " Information not required for this device type"  # String {0}
            Concatenate Strings("[ℹ]", w91) -> w14
            w13 = $"Error Cluster input"
            w15 = s1
            w16 = s2
          }
          frame "Conductivity Mixbox", "Contact Cleaning Flap S25", "Status Cartridge 1", "Status Cartridge 2", "Status Cartridge 3", "Status Cartridge 4" {
            case ($"Auto Dose") {
              frame "False", Default {
                w14 = "✅ "
              }
              frame "AutoDose_not_available" {
                w92 = " Information not required for this device type"  # String {0}
                Concatenate Strings("[ℹ]", w92) -> w14
              }
            }
            w13 = $"Error Cluster input"
            w15 = s1
            w16 = s2
          }
          frame "Reference Volume Steam Generator" {
            Floating Point String To Number(default (0 DBL)=0, string=w10, use system decimal point (T)=TRUE) -> (number=w15)
            Multiply(3.9, 1.1) -> w93
            Multiply(3.9, 0.9) -> w94
            In Range And Coerce(lower limit=w94, upper limit=w93, x=w15) -> (In Range?=w95)
            # E61_Volume_Steam_Generator_Norm = 3.9
            case (w95) {
              frame False, Default {
                Number To Fractional String(number=3.9, precision (6)=1, use system decimal point (T)=TRUE) -> (F-format string=w96)
                w97 = "❌"  # String {0}
                Concatenate Strings(w97, " ", w6, " ", "is out of range !", "\r", "Nominal volume: ", w96, " L") -> w14
              }
              frame True {
                Number To Fractional String(number=3.9, precision (6)=1, use system decimal point (T)=TRUE) -> (F-format string=w98)
                Concatenate Strings("✅", " Nominal volume: ", w98, " L") -> w14
              }
            }
            w13 = $"Error Cluster input"
            w16 = s2
          }
          frame "Actual Filling Volume Steam Generator" {
            Floating Point String To Number(default (0 DBL)=0, string=w10, use system decimal point (T)=TRUE) -> (number=w16)
            Multiply(s1, 0.2) -> w99
            Add(w99, s1) -> w100
            Subtract(x=s1, y=w99) -> w101
            In Range And Coerce(lower limit=w101, upper limit=w100, x=w16) -> (In Range?=w102)
            case (w102) {
              frame False, Default {
                w103 = "❌"  # String {0}
                Concatenate Strings(w103, " ", w6, " ", "doesn't fit to the norm level") -> w14
              }
              frame True {
                Concatenate Strings("✅ ", w6, " is OK:", "\r", "In relation to the reference volume steam generator.") -> w14
              }
            }
            w13 = $"Error Cluster input"
            w15 = s1
          }
          frame "Level Electrode S2 Threshold" {
            Floating Point String To Number(default (0 DBL)=0, string=w10, use system decimal point (T)=TRUE) -> (number=w104)
            In Range And Coerce[IncludeHighLimit=True](lower limit=500, upper limit=2000, x=w104) -> (In Range?=w105)
            case (w105) {
              frame False, Default {
                w106 = "❌"  # String {0}
                Concatenate Strings(w106, " ", w6, " ", "is out of range! Valid range [500, 2000]") -> w14
              }
              frame True {
                w14 = "✅: Valid range [500, 2000]"
              }
            }
            w13 = $"Error Cluster input"
            w15 = s1
            w16 = s2
          }
          frame "Level Electrode S2 Current  Value" {
            Floating Point String To Number(default (0 DBL)=0, string=w10, use system decimal point (T)=TRUE) -> (number=w107)
            In Range And Coerce(lower limit=0, upper limit=3000, x=w107) -> (In Range?=w108)
            case (w108) {
              frame False, Default {
                w109 = "❌"  # String {0}
                Concatenate Strings(w109, " ", w6, " ", "is out of range!") -> w14
              }
              frame True {
                w14 = "✅ "
              }
            }
            w13 = $"Error Cluster input"
            w15 = s1
            w16 = s2
          }
          frame "CalcCheck Volume Steam Generator" {
            Floating Point String To Number(default (0 DBL)=0, string=w10, use system decimal point (T)=TRUE) -> (number=w110)
            Is Greater(x=w110, y=s2) -> w111
            Divide(x=s2, y=w110) -> w112
            Is Less(x=w112, y=1.08) -> w113
            Logical Or(w113, w111) -> w114
            case (w114) {
              frame True {
                w115 = "❌"  # String {0}
                Concatenate Strings(w115, " ", "Too much calc in the steam generator!") -> w14
              }
              frame False {
                w14 = "✅"
              }
            }
            w13 = $"Error Cluster input"
            w15 = s1
            w16 = s2
          }
        }
      }
      frame "G61" {
        case (w6) {
          frame "False", Default {
            w13 = $"Error Cluster input"
            w14 = "✅"
            w15 = s1
            w16 = s2
          }
          frame "Reference Volume Steam Generator" {
            Floating Point String To Number(default (0 DBL)=0, string=w10, use system decimal point (T)=TRUE) -> (number=w15)
            Multiply(4.4, 1.1) -> w116
            Multiply(4.4, 0.9) -> w117
            In Range And Coerce(lower limit=w117, upper limit=w116, x=w15) -> (In Range?=w118)
            # G61_Volume_Steam_Generator_Norm = 4.5
            case (w118) {
              frame False, Default {
                Number To Fractional String(number=4.4, precision (6)=1, use system decimal point (T)=TRUE) -> (F-format string=w119)
                w120 = "❌"  # String {0}
                Concatenate Strings(w120, " ", w6, " ", "is out of range !", "\r", "Nominal volume: ", w119, " L") -> w14
              }
              frame True {
                Number To Fractional String(number=4.4, precision (6)=1, use system decimal point (T)=TRUE) -> (F-format string=w121)
                Concatenate Strings("✅", " Nominal volume: ", w121, " L") -> w14
              }
            }
            w13 = $"Error Cluster input"
            w16 = s2
          }
          frame "Actual Filling Volume Steam Generator" {
            Floating Point String To Number(default (0 DBL)=0, string=w10, use system decimal point (T)=TRUE) -> (number=w16)
            Multiply(s1, 0.2) -> w122
            Add(w122, s1) -> w123
            Subtract(x=s1, y=w122) -> w124
            In Range And Coerce(lower limit=w124, upper limit=w123, x=w16) -> (In Range?=w125)
            case (w125) {
              frame False, Default {
                w126 = "❌"  # String {0}
                Concatenate Strings(w126, " ", w6, " ", "doesn't fit to the norm level") -> w14
              }
              frame True {
                Concatenate Strings("✅ ", w6, " is OK:", "\r", "In relation to the reference volume steam generator.") -> w14
              }
            }
            w13 = $"Error Cluster input"
            w15 = s1
          }
          frame "Level Electrode S2 Threshold" {
            Floating Point String To Number(default (0 DBL)=0, string=w10, use system decimal point (T)=TRUE) -> (number=w127)
            In Range And Coerce[IncludeHighLimit=True](lower limit=500, upper limit=2000, x=w127) -> (In Range?=w128)
            case (w128) {
              frame False, Default {
                w129 = "❌"  # String {0}
                Concatenate Strings(w129, " ", w6, " ", "is out of range! Valid range [500, 2000]") -> w14
              }
              frame True {
                w14 = "✅: Valid range [500, 2000]"
              }
            }
            w13 = $"Error Cluster input"
            w15 = s1
            w16 = s2
          }
          frame "Level Electrode S2 Current  Value" {
            Floating Point String To Number(default (0 DBL)=0, string=w10, use system decimal point (T)=TRUE) -> (number=w130)
            In Range And Coerce(lower limit=0, upper limit=3000, x=w130) -> (In Range?=w131)
            case (w131) {
              frame False, Default {
                w132 = "❌"  # String {0}
                Concatenate Strings(w132, " ", w6, " ", "is out of range!") -> w14
              }
              frame True {
                w14 = "✅ "
              }
            }
            w13 = $"Error Cluster input"
            w15 = s1
            w16 = s2
          }
          frame "CalcCheck Volume Steam Generator" {
            Floating Point String To Number(default (0 DBL)=0, string=w10, use system decimal point (T)=TRUE) -> (number=w133)
            Is Greater(x=w133, y=s2) -> w134
            Divide(x=s2, y=w133) -> w135
            Is Less(x=w135, y=1.08) -> w136
            Logical Or(w136, w134) -> w137
            case (w137) {
              frame True {
                w138 = "❌"  # String {0}
                Concatenate Strings(w138, " ", "Too much calc in the steam generator!") -> w14
              }
              frame False {
                w14 = "✅"
              }
            }
            w13 = $"Error Cluster input"
            w15 = s1
            w16 = s2
          }
          frame "Ball Valve Motor M7", "Care Pump XS M18", "CleanJet Pump XS M6", "Gas blower Hot Air2 M10", "Gas valve Hot Air 2 Y13", "Hot Air Bottom Flame Current", "Hot Air Bottom Heat Request", "Magnetron Cooling Fan bottom", "Magnetron Cooling Fan top", "Magnetron Safety Chain bottom", "Magnetron Safety Chain top", "Microwave Anode current bottom", "Microwave Anode current top", "Microwave Heating Voltage bottom", "Microwave Heating Voltage top", "Microwave High Voltage actual bottom", "Microwave High Voltage actual top", "Microwave Target bottom", "Microwave Target top", "Motor Floor M22", "Motor TableFloor M16", "SC Pump XS M4" {
            w139 = " Information not required for this device type"  # String {0}
            Concatenate Strings("[ℹ]", w139) -> w14
            w13 = $"Error Cluster input"
            w15 = s1
            w16 = s2
          }
          frame "Conductivity Mixbox", "Contact Cleaning Flap S25", "Status Cartridge 1", "Status Cartridge 2", "Status Cartridge 3", "Status Cartridge 4" {
            case ($"Auto Dose") {
              frame "False", Default {
                w14 = "✅ "
              }
              frame "AutoDose_not_available" {
                w140 = " Information not required for this device type"  # String {0}
                Concatenate Strings("[ℹ]", w140) -> w14
              }
            }
            w13 = $"Error Cluster input"
            w15 = s1
            w16 = s2
          }
        }
      }
      frame "G62" {
        case (w6) {
          frame "False", Default {
            w13 = $"Error Cluster input"
            w14 = "✅"
            w15 = s1
            w16 = s2
          }
          frame "Reference Volume Steam Generator" {
            Floating Point String To Number(default (0 DBL)=0, string=w10, use system decimal point (T)=TRUE) -> (number=w15)
            Multiply(7.5, 1.1) -> w141
            Multiply(7.5, 0.9) -> w142
            In Range And Coerce(lower limit=w142, upper limit=w141, x=w15) -> (In Range?=w143)
            # G62_Volume_Steam_Generator_Norm = 7.6
            case (w143) {
              frame False, Default {
                Number To Fractional String(number=7.5, precision (6)=1, use system decimal point (T)=TRUE) -> (F-format string=w144)
                w145 = "❌"  # String {0}
                Concatenate Strings(w145, " ", w6, " ", "is out of range !", "\r", "Nominal volume: ", w144, " L") -> w14
              }
              frame True {
                Number To Fractional String(number=7.5, precision (6)=1, use system decimal point (T)=TRUE) -> (F-format string=w146)
                Concatenate Strings("✅", " Nominal volume: ", w146, " L") -> w14
              }
            }
            w13 = $"Error Cluster input"
            w16 = s2
          }
          frame "Actual Filling Volume Steam Generator" {
            Floating Point String To Number(default (0 DBL)=0, string=w10, use system decimal point (T)=TRUE) -> (number=w16)
            Multiply(s1, 0.2) -> w147
            Add(w147, s1) -> w148
            Subtract(x=s1, y=w147) -> w149
            In Range And Coerce(lower limit=w149, upper limit=w148, x=w16) -> (In Range?=w150)
            case (w150) {
              frame False, Default {
                w151 = "❌"  # String {0}
                Concatenate Strings(w151, " ", w6, " ", "doesn't fit to the norm level") -> w14
              }
              frame True {
                Concatenate Strings("✅ ", w6, " is OK:", "\r", "In relation to the reference volume steam generator.") -> w14
              }
            }
            w13 = $"Error Cluster input"
            w15 = s1
          }
          frame "Level Electrode S2 Threshold" {
            Floating Point String To Number(default (0 DBL)=0, string=w10, use system decimal point (T)=TRUE) -> (number=w152)
            In Range And Coerce[IncludeHighLimit=True](lower limit=500, upper limit=2000, x=w152) -> (In Range?=w153)
            case (w153) {
              frame False, Default {
                w154 = "❌"  # String {0}
                Concatenate Strings(w154, " ", w6, " ", "is out of range! Valid range [500, 2000]") -> w14
              }
              frame True {
                w14 = "✅: Valid range [500, 2000]"
              }
            }
            w13 = $"Error Cluster input"
            w15 = s1
            w16 = s2
          }
          frame "Level Electrode S2 Current  Value" {
            Floating Point String To Number(default (0 DBL)=0, string=w10, use system decimal point (T)=TRUE) -> (number=w155)
            In Range And Coerce(lower limit=0, upper limit=3000, x=w155) -> (In Range?=w156)
            case (w156) {
              frame False, Default {
                w157 = "❌"  # String {0}
                Concatenate Strings(w157, " ", w6, " ", "is out of range!") -> w14
              }
              frame True {
                w14 = "✅ "
              }
            }
            w13 = $"Error Cluster input"
            w15 = s1
            w16 = s2
          }
          frame "CalcCheck Volume Steam Generator" {
            Floating Point String To Number(default (0 DBL)=0, string=w10, use system decimal point (T)=TRUE) -> (number=w158)
            Is Greater(x=w158, y=s2) -> w159
            Divide(x=s2, y=w158) -> w160
            Is Less(x=w160, y=1.08) -> w161
            Logical Or(w161, w159) -> w162
            case (w162) {
              frame True {
                w163 = "❌"  # String {0}
                Concatenate Strings(w163, " ", "Too much calc in the steam generator!") -> w14
              }
              frame False {
                w14 = "✅"
              }
            }
            w13 = $"Error Cluster input"
            w15 = s1
            w16 = s2
          }
          frame "Ball Valve Motor M7", "Care Pump XS M18", "CleanJet Pump XS M6", "Gas blower Hot Air2 M10", "Gas valve Hot Air 2 Y13", "Hot Air Bottom Flame Current", "Hot Air Bottom Heat Request", "Magnetron Cooling Fan bottom", "Magnetron Cooling Fan top", "Magnetron Safety Chain bottom", "Magnetron Safety Chain top", "Microwave Anode current bottom", "Microwave Anode current top", "Microwave Heating Voltage bottom", "Microwave Heating Voltage top", "Microwave High Voltage actual bottom", "Microwave High Voltage actual top", "Microwave Target bottom", "Microwave Target top", "Motor Floor M22", "Motor TableFloor M16", "SC Pump XS M4" {
            w164 = " Information not required for this device type"  # String {0}
            Concatenate Strings("[ℹ]", w164) -> w14
            w13 = $"Error Cluster input"
            w15 = s1
            w16 = s2
          }
          frame "Conductivity Mixbox", "Contact Cleaning Flap S25", "Status Cartridge 1", "Status Cartridge 2", "Status Cartridge 3", "Status Cartridge 4" {
            case ($"Auto Dose") {
              frame "False", Default {
                w14 = "✅ "
              }
              frame "AutoDose_not_available" {
                w165 = " Information not required for this device type"  # String {0}
                Concatenate Strings("[ℹ]", w165) -> w14
              }
            }
            w13 = $"Error Cluster input"
            w15 = s1
            w16 = s2
          }
        }
      }
      frame "E101" {
        case (w6) {
          frame "False", Default {
            w13 = $"Error Cluster input"
            w14 = "✅"
            w15 = s1
            w16 = s2
          }
          frame "Ball Valve Motor M7", "Care Pump XS M18", "CleanJet Pump XS M6", "Gas blower Hot Air1 M8", "Gas blower Hot Air2 M10", "Gas blower Steam M9", "Gas valve Hot Air 1 Y12", "Gas valve Hot Air 2 Y13", "Gas valve Steam Y11", "Hot Air Bottom Flame Current", "Hot Air Bottom Heat Request", "Hot Air Top Flame Current", "Hot Air Top Heat Request", "Magnetron Cooling Fan bottom", "Magnetron Cooling Fan top", "Magnetron Safety Chain bottom", "Magnetron Safety Chain top", "Microwave Anode current bottom", "Microwave Anode current top", "Microwave Heating Voltage bottom", "Microwave Heating Voltage top", "Microwave High Voltage actual bottom", "Microwave High Voltage actual top", "Microwave Target bottom", "Microwave Target top", "Motor Floor M22", "SC Pump XS M4", "Steam Flame Current", "Steam Heat Request" {
            w166 = " Information not required for this device type"  # String {0}
            Concatenate Strings("[ℹ]", w166) -> w14
            w13 = $"Error Cluster input"
            w15 = s1
            w16 = s2
          }
          frame "Conductivity Mixbox", "Contact Cleaning Flap S25", "Status Cartridge 1", "Status Cartridge 2", "Status Cartridge 3", "Status Cartridge 4" {
            case ($"Auto Dose") {
              frame "False", Default {
                w14 = "✅ "
              }
              frame "AutoDose_not_available" {
                w167 = " Information not required for this device type"  # String {0}
                Concatenate Strings("[ℹ]", w167) -> w14
              }
            }
            w13 = $"Error Cluster input"
            w15 = s1
            w16 = s2
          }
          frame "Reference Volume Steam Generator" {
            Floating Point String To Number(default (0 DBL)=0, string=w10, use system decimal point (T)=TRUE) -> (number=w15)
            Multiply(4, 1.1) -> w168
            Multiply(4, 0.9) -> w169
            In Range And Coerce(lower limit=w169, upper limit=w168, x=w15) -> (In Range?=w170)
            # E101_Volume_Steam_Generator_Norm = 3.8
            case (w170) {
              frame False, Default {
                Number To Fractional String(number=4, precision (6)=1, use system decimal point (T)=TRUE) -> (F-format string=w171)
                w172 = "❌"  # String {0}
                Concatenate Strings(w172, " ", w6, " ", "is out of range !", "\r", "Nominal volume: ", w171, " L") -> w14
              }
              frame True {
                Number To Fractional String(number=4, precision (6)=1, use system decimal point (T)=TRUE) -> (F-format string=w173)
                Concatenate Strings("✅", " Nominal volume: ", w173, " L") -> w14
              }
            }
            w13 = $"Error Cluster input"
            w16 = s2
          }
          frame "Actual Filling Volume Steam Generator" {
            Floating Point String To Number(default (0 DBL)=0, string=w10, use system decimal point (T)=TRUE) -> (number=w16)
            Multiply(s1, 0.2) -> w174
            Add(w174, s1) -> w175
            Subtract(x=s1, y=w174) -> w176
            In Range And Coerce(lower limit=w176, upper limit=w175, x=w16) -> (In Range?=w177)
            case (w177) {
              frame False, Default {
                w178 = "❌"  # String {0}
                Concatenate Strings(w178, " ", w6, " ", "doesn't fit to the norm level") -> w14
              }
              frame True {
                Concatenate Strings("✅ ", w6, " is OK:", "\r", "In relation to the reference volume steam generator.") -> w14
              }
            }
            w13 = $"Error Cluster input"
            w15 = s1
          }
          frame "Level Electrode S2 Threshold" {
            Floating Point String To Number(default (0 DBL)=0, string=w10, use system decimal point (T)=TRUE) -> (number=w179)
            In Range And Coerce[IncludeHighLimit=True](lower limit=500, upper limit=2000, x=w179) -> (In Range?=w180)
            case (w180) {
              frame False, Default {
                w181 = "❌"  # String {0}
                Concatenate Strings(w181, " ", w6, " ", "is out of range! Valid range [500, 2000]") -> w14
              }
              frame True {
                w14 = "✅: Valid range [500, 2000]  "
              }
            }
            w13 = $"Error Cluster input"
            w15 = s1
            w16 = s2
          }
          frame "Level Electrode S2 Current  Value" {
            Floating Point String To Number(default (0 DBL)=0, string=w10, use system decimal point (T)=TRUE) -> (number=w182)
            In Range And Coerce(lower limit=0, upper limit=3000, x=w182) -> (In Range?=w183)
            case (w183) {
              frame False, Default {
                w184 = "❌"  # String {0}
                Concatenate Strings(w184, " ", w6, " ", "is out of range!") -> w14
              }
              frame True {
                w14 = "✅ "
              }
            }
            w13 = $"Error Cluster input"
            w15 = s1
            w16 = s2
          }
          frame "CalcCheck Volume Steam Generator" {
            Floating Point String To Number(default (0 DBL)=0, string=w10, use system decimal point (T)=TRUE) -> (number=w185)
            Is Greater(x=w185, y=s2) -> w186
            Divide(x=s2, y=w185) -> w187
            Is Less(x=w187, y=1.08) -> w188
            Logical Or(w188, w186) -> w189
            case (w189) {
              frame True {
                w190 = "❌"  # String {0}
                Concatenate Strings(w190, " ", "Too much calc in the steam generator!") -> w14
              }
              frame False {
                w14 = "✅"
              }
            }
            w13 = $"Error Cluster input"
            w15 = s1
            w16 = s2
          }
        }
      }
      frame "E102" {
        case (w6) {
          frame "False", Default {
            w13 = $"Error Cluster input"
            w14 = "✅"
            w15 = s1
            w16 = s2
          }
          frame "Ball Valve Motor M7", "Care Pump XS M18", "CleanJet Pump XS M6", "Gas blower Hot Air1 M8", "Gas blower Hot Air2 M10", "Gas blower Steam M9", "Gas valve Hot Air 1 Y12", "Gas valve Hot Air 2 Y13", "Gas valve Steam Y11", "Hot Air Bottom Flame Current", "Hot Air Bottom Heat Request", "Hot Air Top Flame Current", "Hot Air Top Heat Request", "Magnetron Cooling Fan bottom", "Magnetron Cooling Fan top", "Magnetron Safety Chain bottom", "Magnetron Safety Chain top", "Microwave Anode current bottom", "Microwave Anode current top", "Microwave Heating Voltage bottom", "Microwave Heating Voltage top", "Microwave High Voltage actual bottom", "Microwave High Voltage actual top", "Microwave Target bottom", "Microwave Target top", "Motor Floor M22", "SC Pump XS M4", "Steam Flame Current", "Steam Heat Request" {
            w191 = " Information not required for this device type"  # String {0}
            Concatenate Strings("[ℹ]", w191) -> w14
            w13 = $"Error Cluster input"
            w15 = s1
            w16 = s2
          }
          frame "Conductivity Mixbox", "Contact Cleaning Flap S25", "Status Cartridge 1", "Status Cartridge 2", "Status Cartridge 3", "Status Cartridge 4" {
            case ($"Auto Dose") {
              frame "False", Default {
                w14 = "✅ "
              }
              frame "AutoDose_not_available" {
                w192 = " Information not required for this device type"  # String {0}
                Concatenate Strings("[ℹ]", w192) -> w14
              }
            }
            w13 = $"Error Cluster input"
            w15 = s1
            w16 = s2
          }
          frame "Reference Volume Steam Generator" {
            Floating Point String To Number(default (0 DBL)=0, string=w10, use system decimal point (T)=TRUE) -> (number=w15)
            Multiply(9.4, 1.1) -> w193
            Multiply(9.4, 0.9) -> w194
            In Range And Coerce(lower limit=w194, upper limit=w193, x=w15) -> (In Range?=w195)
            # E102_Volume_Steam_Generator_Norm = 9.5
            case (w195) {
              frame False, Default {
                Number To Fractional String(number=9.4, precision (6)=1, use system decimal point (T)=TRUE) -> (F-format string=w196)
                w197 = "❌"  # String {0}
                Concatenate Strings(w197, " ", w6, " ", "is out of range !", "\r", "Nominal volume: ", w196, " L") -> w14
              }
              frame True {
                Number To Fractional String(number=9.4, precision (6)=1, use system decimal point (T)=TRUE) -> (F-format string=w198)
                Concatenate Strings("✅", " Nominal volume: ", w198, " L") -> w14
              }
            }
            w13 = $"Error Cluster input"
            w16 = s2
          }
          frame "Actual Filling Volume Steam Generator" {
            Floating Point String To Number(default (0 DBL)=0, string=w10, use system decimal point (T)=TRUE) -> (number=w16)
            Multiply(s1, 0.2) -> w199
            Add(w199, s1) -> w200
            Subtract(x=s1, y=w199) -> w201
            In Range And Coerce(lower limit=w201, upper limit=w200, x=w16) -> (In Range?=w202)
            case (w202) {
              frame False, Default {
                w203 = "❌"  # String {0}
                Concatenate Strings(w203, " ", w6, " ", "doesn't fit to the norm level") -> w14
              }
              frame True {
                Concatenate Strings("✅ ", w6, " is OK:", "\r", "In relation to the reference volume steam generator.") -> w14
              }
            }
            w13 = $"Error Cluster input"
            w15 = s1
          }
          frame "Level Electrode S2 Threshold" {
            Floating Point String To Number(default (0 DBL)=0, string=w10, use system decimal point (T)=TRUE) -> (number=w204)
            In Range And Coerce[IncludeHighLimit=True](lower limit=500, upper limit=2000, x=w204) -> (In Range?=w205)
            case (w205) {
              frame False, Default {
                w206 = "❌"  # String {0}
                Concatenate Strings(w206, " ", w6, " ", "is out of range! Valid range [500, 2000] ") -> w14
              }
              frame True {
                w14 = "✅: Valid range [500, 2000]"
              }
            }
            w13 = $"Error Cluster input"
            w15 = s1
            w16 = s2
          }
          frame "Level Electrode S2 Current  Value" {
            Floating Point String To Number(default (0 DBL)=0, string=w10, use system decimal point (T)=TRUE) -> (number=w207)
            In Range And Coerce(lower limit=0, upper limit=3000, x=w207) -> (In Range?=w208)
            case (w208) {
              frame False, Default {
                w209 = "❌"  # String {0}
                Concatenate Strings(w209, " ", w6, " ", "is out of range!") -> w14
              }
              frame True {
                w14 = "✅ "
              }
            }
            w13 = $"Error Cluster input"
            w15 = s1
            w16 = s2
          }
          frame "CalcCheck Volume Steam Generator" {
            Floating Point String To Number(default (0 DBL)=0, string=w10, use system decimal point (T)=TRUE) -> (number=w210)
            Is Greater(x=w210, y=s2) -> w211
            Divide(x=s2, y=w210) -> w212
            Is Less(x=w212, y=1.08) -> w213
            Logical Or(w213, w211) -> w214
            case (w214) {
              frame True {
                w215 = "❌"  # String {0}
                Concatenate Strings(w215, " ", "Too much calc in the steam generator!") -> w14
              }
              frame False {
                w14 = "✅"
              }
            }
            w13 = $"Error Cluster input"
            w15 = s1
            w16 = s2
          }
        }
      }
      frame "G101" {
        case (w6) {
          frame "False", Default {
            w13 = $"Error Cluster input"
            w14 = "✅"
            w15 = s1
            w16 = s2
          }
          frame "Ball Valve Motor M7", "Care Pump XS M18", "CleanJet Pump XS M6", "Gas blower Hot Air2 M10", "Gas valve Hot Air 2 Y13", "Hot Air Bottom Flame Current", "Hot Air Bottom Heat Request", "Magnetron Cooling Fan bottom", "Magnetron Cooling Fan top", "Magnetron Safety Chain bottom", "Magnetron Safety Chain top", "Microwave Anode current bottom", "Microwave Anode current top", "Microwave Heating Voltage bottom", "Microwave Heating Voltage top", "Microwave High Voltage actual bottom", "Microwave High Voltage actual top", "Microwave Target bottom", "Microwave Target top", "Motor Floor M22", "SC Pump XS M4" {
            w216 = " Information not required for this device type"  # String {0}
            Concatenate Strings("[ℹ]", w216) -> w14
            w13 = $"Error Cluster input"
            w15 = s1
            w16 = s2
          }
          frame "Conductivity Mixbox", "Contact Cleaning Flap S25", "Status Cartridge 1", "Status Cartridge 2", "Status Cartridge 3", "Status Cartridge 4" {
            case ($"Auto Dose") {
              frame "False", Default {
                w14 = "✅ "
              }
              frame "AutoDose_not_available" {
                w217 = " Information not required for this device type"  # String {0}
                Concatenate Strings("[ℹ]", w217) -> w14
              }
            }
            w13 = $"Error Cluster input"
            w15 = s1
            w16 = s2
          }
          frame "Reference Volume Steam Generator" {
            Floating Point String To Number(default (0 DBL)=0, string=w10, use system decimal point (T)=TRUE) -> (number=w15)
            Multiply(8, 1.1) -> w218
            Multiply(8, 0.9) -> w219
            In Range And Coerce(lower limit=w219, upper limit=w218, x=w15) -> (In Range?=w220)
            # G101_Volume_Steam_Generator_Norm = 8.4
            case (w220) {
              frame False, Default {
                Number To Fractional String(number=8, precision (6)=1, use system decimal point (T)=TRUE) -> (F-format string=w221)
                w222 = "❌"  # String {0}
                Concatenate Strings(w222, " ", w6, " ", "is out of range !", "\r", "Nominal volume: ", w221, " L") -> w14
              }
              frame True {
                Number To Fractional String(number=8, precision (6)=1, use system decimal point (T)=TRUE) -> (F-format string=w223)
                Concatenate Strings("✅", " Nominal volume: ", w223, " L") -> w14
              }
            }
            w13 = $"Error Cluster input"
            w16 = s2
          }
          frame "Actual Filling Volume Steam Generator" {
            Floating Point String To Number(default (0 DBL)=0, string=w10, use system decimal point (T)=TRUE) -> (number=w16)
            Multiply(s1, 0.2) -> w224
            Add(w224, s1) -> w225
            Subtract(x=s1, y=w224) -> w226
            In Range And Coerce(lower limit=w226, upper limit=w225, x=w16) -> (In Range?=w227)
            case (w227) {
              frame False, Default {
                w228 = "❌"  # String {0}
                Concatenate Strings(w228, " ", w6, " ", "doesn't fit to the norm level") -> w14
              }
              frame True {
                Concatenate Strings("✅ ", w6, " is OK:", "\r", "In relation to the reference volume steam generator.") -> w14
              }
            }
            w13 = $"Error Cluster input"
            w15 = s1
          }
          frame "Level Electrode S2 Threshold" {
            Floating Point String To Number(default (0 DBL)=0, string=w10, use system decimal point (T)=TRUE) -> (number=w229)
            In Range And Coerce[IncludeHighLimit=True](lower limit=500, upper limit=2000, x=w229) -> (In Range?=w230)
            case (w230) {
              frame False, Default {
                w231 = "❌"  # String {0}
                Concatenate Strings(w231, " ", w6, " ", "is out of range! Valid range [500, 2000]") -> w14
              }
              frame True {
                w14 = "✅: Valid range [500, 2000]  "
              }
            }
            w13 = $"Error Cluster input"
            w15 = s1
            w16 = s2
          }
          frame "Level Electrode S2 Current  Value" {
            Floating Point String To Number(default (0 DBL)=0, string=w10, use system decimal point (T)=TRUE) -> (number=w232)
            In Range And Coerce(lower limit=0, upper limit=3000, x=w232) -> (In Range?=w233)
            case (w233) {
              frame False, Default {
                w234 = "❌"  # String {0}
                Concatenate Strings(w234, " ", w6, " ", "is out of range!") -> w14
              }
              frame True {
                w14 = "✅ "
              }
            }
            w13 = $"Error Cluster input"
            w15 = s1
            w16 = s2
          }
          frame "CalcCheck Volume Steam Generator" {
            Floating Point String To Number(default (0 DBL)=0, string=w10, use system decimal point (T)=TRUE) -> (number=w235)
            Is Greater(x=w235, y=s2) -> w236
            Divide(x=s2, y=w235) -> w237
            Is Less(x=w237, y=1.08) -> w238
            Logical Or(w238, w236) -> w239
            case (w239) {
              frame True {
                w240 = "❌"  # String {0}
                Concatenate Strings(w240, " ", "Too much calc in the steam generator!") -> w14
              }
              frame False {
                w14 = "✅"
              }
            }
            w13 = $"Error Cluster input"
            w15 = s1
            w16 = s2
          }
        }
      }
      frame "G102" {
        case (w6) {
          frame "False", Default {
            w13 = $"Error Cluster input"
            w14 = "✅"
            w15 = s1
            w16 = s2
          }
          frame "Ball Valve Motor M7", "Care Pump XS M18", "CleanJet Pump XS M6", "Gas blower Hot Air2 M10", "Gas valve Hot Air 2 Y13", "Hot Air Bottom Flame Current", "Hot Air Bottom Heat Request", "Magnetron Cooling Fan bottom", "Magnetron Cooling Fan top", "Magnetron Safety Chain bottom", "Magnetron Safety Chain top", "Microwave Anode current bottom", "Microwave Anode current top", "Microwave Heating Voltage bottom", "Microwave Heating Voltage top", "Microwave High Voltage actual bottom", "Microwave High Voltage actual top", "Microwave Target bottom", "Microwave Target top", "Motor Floor M22", "SC Pump XS M4" {
            w241 = " Information not required for this device type"  # String {0}
            Concatenate Strings("[ℹ]", w241) -> w14
            w13 = $"Error Cluster input"
            w15 = s1
            w16 = s2
          }
          frame "Conductivity Mixbox", "Contact Cleaning Flap S25", "Status Cartridge 1", "Status Cartridge 2", "Status Cartridge 3", "Status Cartridge 4" {
            case ($"Auto Dose") {
              frame "False", Default {
                w14 = "✅ "
              }
              frame "AutoDose_not_available" {
                w242 = " Information not required for this device type"  # String {0}
                Concatenate Strings("[ℹ]", w242) -> w14
              }
            }
            w13 = $"Error Cluster input"
            w15 = s1
            w16 = s2
          }
          frame "Reference Volume Steam Generator" {
            Floating Point String To Number(default (0 DBL)=0, string=w10, use system decimal point (T)=TRUE) -> (number=w15)
            Multiply(11, 1.1) -> w243
            Multiply(11, 0.9) -> w244
            In Range And Coerce(lower limit=w244, upper limit=w243, x=w15) -> (In Range?=w245)
            # G102_Volume_Steam_Generator_Norm = 11.2
            case (w245) {
              frame False, Default {
                Number To Fractional String(number=11, precision (6)=1, use system decimal point (T)=TRUE) -> (F-format string=w246)
                w247 = "❌"  # String {0}
                Concatenate Strings(w247, " ", w6, " ", "is out of range !", "\r", "Nominal volume: ", w246, " L") -> w14
              }
              frame True {
                Number To Fractional String(number=11, precision (6)=1, use system decimal point (T)=TRUE) -> (F-format string=w248)
                Concatenate Strings("✅", " Nominal volume: ", w248, " L") -> w14
              }
            }
            w13 = $"Error Cluster input"
            w16 = s2
          }
          frame "Actual Filling Volume Steam Generator" {
            Floating Point String To Number(default (0 DBL)=0, string=w10, use system decimal point (T)=TRUE) -> (number=w16)
            Multiply(s1, 0.2) -> w249
            Add(w249, s1) -> w250
            Subtract(x=s1, y=w249) -> w251
            In Range And Coerce(lower limit=w251, upper limit=w250, x=w16) -> (In Range?=w252)
            case (w252) {
              frame False, Default {
                w253 = "❌"  # String {0}
                Concatenate Strings(w253, " ", w6, " ", "doesn't fit to the norm level") -> w14
              }
              frame True {
                Concatenate Strings("✅ ", w6, " is OK:", "\r", "In relation to the reference volume steam generator.") -> w14
              }
            }
            w13 = $"Error Cluster input"
            w15 = s1
          }
          frame "Level Electrode S2 Threshold" {
            Floating Point String To Number(default (0 DBL)=0, string=w10, use system decimal point (T)=TRUE) -> (number=w254)
            In Range And Coerce[IncludeHighLimit=True](lower limit=500, upper limit=2000, x=w254) -> (In Range?=w255)
            case (w255) {
              frame False, Default {
                w256 = "❌"  # String {0}
                Concatenate Strings(w256, " ", w6, " ", "is out of range! Valid range [500, 2000]") -> w14
              }
              frame True {
                w14 = "✅: Valid range [500, 2000]"
              }
            }
            w13 = $"Error Cluster input"
            w15 = s1
            w16 = s2
          }
          frame "Level Electrode S2 Current  Value" {
            Floating Point String To Number(default (0 DBL)=0, string=w10, use system decimal point (T)=TRUE) -> (number=w257)
            In Range And Coerce(lower limit=0, upper limit=3000, x=w257) -> (In Range?=w258)
            case (w258) {
              frame False, Default {
                w259 = "❌"  # String {0}
                Concatenate Strings(w259, " ", w6, " ", "is out of range!") -> w14
              }
              frame True {
                w14 = "✅ "
              }
            }
            w13 = $"Error Cluster input"
            w15 = s1
            w16 = s2
          }
          frame "CalcCheck Volume Steam Generator" {
            Floating Point String To Number(default (0 DBL)=0, string=w10, use system decimal point (T)=TRUE) -> (number=w260)
            Is Greater(x=w260, y=s2) -> w261
            Divide(x=s2, y=w260) -> w262
            Is Less(x=w262, y=1.08) -> w263
            Logical Or(w263, w261) -> w264
            case (w264) {
              frame True {
                w265 = "❌"  # String {0}
                Concatenate Strings(w265, " ", "Too much calc in the steam generator!") -> w14
              }
              frame False {
                w14 = "✅"
              }
            }
            w13 = $"Error Cluster input"
            w15 = s1
            w16 = s2
          }
        }
      }
      frame "E201" {
        case (w6) {
          frame "False", Default {
            w13 = $"Error Cluster input"
            w14 = "✅"
            w15 = s1
            w16 = s2
          }
          frame "Ball Valve Motor M7", "Care Pump XS M18", "CleanJet Pump XS M6", "Conductivity Mixbox", "Contact Cleaning Flap S25", "Gas blower Hot Air1 M8", "Gas blower Hot Air2 M10", "Gas blower Steam M9", "Gas valve Hot Air 1 Y12", "Gas valve Hot Air 2 Y13", "Gas valve Steam Y11", "Hot Air Bottom Flame Current", "Hot Air Bottom Heat Request", "Hot Air Top Flame Current", "Hot Air Top Heat Request", "Magnetron Cooling Fan bottom", "Magnetron Cooling Fan top", "Magnetron Safety Chain bottom", "Magnetron Safety Chain top", "Microwave Anode current bottom", "Microwave Anode current top", "Microwave Heating Voltage bottom", "Microwave Heating Voltage top", "Microwave High Voltage actual bottom", "Microwave High Voltage actual top", "Microwave Target bottom", "Microwave Target top", "SC Pump XS M4", "Status Cartridge 1", "Status Cartridge 2", "Status Cartridge 3", "Status Cartridge 4", "Steam Flame Current", "Steam Heat Request" {
            w266 = " Information not required for this device type"  # String {0}
            Concatenate Strings("[ℹ]", w266) -> w14
            w13 = $"Error Cluster input"
            w15 = s1
            w16 = s2
          }
          frame "Reference Volume Steam Generator" {
            Floating Point String To Number(default (0 DBL)=0, string=w10, use system decimal point (T)=TRUE) -> (number=w15)
            Multiply(9.3, 1.1) -> w267
            Multiply(9.3, 0.9) -> w268
            In Range And Coerce(lower limit=w268, upper limit=w267, x=w15) -> (In Range?=w269)
            # E201_Volume_Steam_Generator_Norm = 9.3
            case (w269) {
              frame False, Default {
                Number To Fractional String(number=9.3, precision (6)=1, use system decimal point (T)=TRUE) -> (F-format string=w270)
                w271 = "❌"  # String {0}
                Concatenate Strings(w271, " ", w6, " ", "is out of range !", "\r", "Nominal volume: ", w270, " L") -> w14
              }
              frame True {
                Number To Fractional String(number=9.3, precision (6)=1, use system decimal point (T)=TRUE) -> (F-format string=w272)
                Concatenate Strings("✅", " Nominal volume: ", w272, " L") -> w14
              }
            }
            w13 = $"Error Cluster input"
            w16 = s2
          }
          frame "Actual Filling Volume Steam Generator" {
            Floating Point String To Number(default (0 DBL)=0, string=w10, use system decimal point (T)=TRUE) -> (number=w16)
            Multiply(s1, 0.2) -> w273
            Add(w273, s1) -> w274
            Subtract(x=s1, y=w273) -> w275
            In Range And Coerce(lower limit=w275, upper limit=w274, x=w16) -> (In Range?=w276)
            case (w276) {
              frame False, Default {
                w277 = "❌"  # String {0}
                Concatenate Strings(w277, " ", w6, " ", "doesn't fit to the norm level") -> w14
              }
              frame True {
                Concatenate Strings("✅ ", w6, " is OK:", "\r", "In relation to the reference volume steam generator.") -> w14
              }
            }
            w13 = $"Error Cluster input"
            w15 = s1
          }
          frame "Level Electrode S2 Threshold" {
            Floating Point String To Number(default (0 DBL)=0, string=w10, use system decimal point (T)=TRUE) -> (number=w278)
            In Range And Coerce[IncludeHighLimit=True](lower limit=500, upper limit=2000, x=w278) -> (In Range?=w279)
            case (w279) {
              frame False, Default {
                w280 = "❌"  # String {0}
                Concatenate Strings(w280, " ", w6, " ", "is out of range! Valid range [500, 2000]") -> w14
              }
              frame True {
                w14 = "✅: Valid range [500, 2000]"
              }
            }
            w13 = $"Error Cluster input"
            w15 = s1
            w16 = s2
          }
          frame "Level Electrode S2 Current  Value" {
            Floating Point String To Number(default (0 DBL)=0, string=w10, use system decimal point (T)=TRUE) -> (number=w281)
            In Range And Coerce(lower limit=0, upper limit=3000, x=w281) -> (In Range?=w282)
            case (w282) {
              frame False, Default {
                w283 = "❌"  # String {0}
                Concatenate Strings(w283, " ", w6, " ", "is out of range!") -> w14
              }
              frame True {
                w14 = "✅ "
              }
            }
            w13 = $"Error Cluster input"
            w15 = s1
            w16 = s2
          }
          frame "CalcCheck Volume Steam Generator" {
            Floating Point String To Number(default (0 DBL)=0, string=w10, use system decimal point (T)=TRUE) -> (number=w284)
            Is Greater(x=w284, y=s2) -> w285
            Divide(x=s2, y=w284) -> w286
            Is Less(x=w286, y=1.08) -> w287
            Logical Or(w287, w285) -> w288
            case (w288) {
              frame True {
                w289 = "❌"  # String {0}
                Concatenate Strings(w289, " ", "Too much calc in the steam generator!") -> w14
              }
              frame False {
                w14 = "✅"
              }
            }
            w13 = $"Error Cluster input"
            w15 = s1
            w16 = s2
          }
        }
      }
      frame "E202" {
        case (w6) {
          frame "False", Default {
            w13 = $"Error Cluster input"
            w14 = "✅"
            w15 = s1
            w16 = s2
          }
          frame "Ball Valve Motor M7", "Care Pump XS M18", "CleanJet Pump XS M6", "Conductivity Mixbox", "Contact Cleaning Flap S25", "Gas blower Hot Air1 M8", "Gas blower Hot Air2 M10", "Gas blower Steam M9", "Gas valve Hot Air 1 Y12", "Gas valve Hot Air 2 Y13", "Gas valve Steam Y11", "Hot Air Bottom Flame Current", "Hot Air Bottom Heat Request", "Hot Air Top Flame Current", "Hot Air Top Heat Request", "Magnetron Cooling Fan bottom", "Magnetron Cooling Fan top", "Magnetron Safety Chain bottom", "Magnetron Safety Chain top", "Microwave Anode current bottom", "Microwave Anode current top", "Microwave Heating Voltage bottom", "Microwave Heating Voltage top", "Microwave High Voltage actual bottom", "Microwave High Voltage actual top", "Microwave Target bottom", "Microwave Target top", "SC Pump XS M4", "Status Cartridge 1", "Status Cartridge 2", "Status Cartridge 3", "Status Cartridge 4", "Steam Flame Current", "Steam Heat Request" {
            w290 = " Information not required for this device type"  # String {0}
            Concatenate Strings("[ℹ]", w290) -> w14
            w13 = $"Error Cluster input"
            w15 = s1
            w16 = s2
          }
          frame "Reference Volume Steam Generator" {
            Floating Point String To Number(default (0 DBL)=0, string=w10, use system decimal point (T)=TRUE) -> (number=w15)
            Multiply(13.3, 1.1) -> w291
            Multiply(13.3, 0.9) -> w292
            In Range And Coerce(lower limit=w292, upper limit=w291, x=w15) -> (In Range?=w293)
            # E202_Volume_Steam_Generator_Norm = 13.4
            case (w293) {
              frame False, Default {
                Number To Fractional String(number=13.3, precision (6)=1, use system decimal point (T)=TRUE) -> (F-format string=w294)
                w295 = "❌"  # String {0}
                Concatenate Strings(w295, " ", w6, " ", "is out of range !", "\r", "Nominal volume: ", w294, " L") -> w14
              }
              frame True {
                Number To Fractional String(number=13.3, precision (6)=1, use system decimal point (T)=TRUE) -> (F-format string=w296)
                Concatenate Strings("✅", " Nominal volume: ", w296, " L") -> w14
              }
            }
            w13 = $"Error Cluster input"
            w16 = s2
          }
          frame "Actual Filling Volume Steam Generator" {
            Floating Point String To Number(default (0 DBL)=0, string=w10, use system decimal point (T)=TRUE) -> (number=w16)
            Multiply(s1, 0.2) -> w297
            Add(w297, s1) -> w298
            Subtract(x=s1, y=w297) -> w299
            In Range And Coerce(lower limit=w299, upper limit=w298, x=w16) -> (In Range?=w300)
            case (w300) {
              frame False, Default {
                w301 = "❌"  # String {0}
                Concatenate Strings(w301, " ", w6, " ", "doesn't fit to the norm level") -> w14
              }
              frame True {
                Concatenate Strings("✅ ", w6, " is OK:", "\r", "In relation to the reference volume steam generator.") -> w14
              }
            }
            w13 = $"Error Cluster input"
            w15 = s1
          }
          frame "Level Electrode S2 Threshold" {
            Floating Point String To Number(default (0 DBL)=0, string=w10, use system decimal point (T)=TRUE) -> (number=w302)
            In Range And Coerce[IncludeHighLimit=True](lower limit=500, upper limit=2000, x=w302) -> (In Range?=w303)
            case (w303) {
              frame False, Default {
                w304 = "❌"  # String {0}
                Concatenate Strings(w304, " ", w6, " ", "is out of range! Valid range [500, 2000]") -> w14
              }
              frame True {
                w14 = "✅: Valid range [500, 2000]"
              }
            }
            w13 = $"Error Cluster input"
            w15 = s1
            w16 = s2
          }
          frame "Level Electrode S2 Current  Value" {
            Floating Point String To Number(default (0 DBL)=0, string=w10, use system decimal point (T)=TRUE) -> (number=w305)
            In Range And Coerce(lower limit=0, upper limit=3000, x=w305) -> (In Range?=w306)
            case (w306) {
              frame False, Default {
                w307 = "❌"  # String {0}
                Concatenate Strings(w307, " ", w6, " ", "is out of range!") -> w14
              }
              frame True {
                w14 = "✅ "
              }
            }
            w13 = $"Error Cluster input"
            w15 = s1
            w16 = s2
          }
          frame "CalcCheck Volume Steam Generator" {
            Floating Point String To Number(default (0 DBL)=0, string=w10, use system decimal point (T)=TRUE) -> (number=w308)
            Is Greater(x=w308, y=s2) -> w309
            Divide(x=s2, y=w308) -> w310
            Is Less(x=w310, y=1.08) -> w311
            Logical Or(w311, w309) -> w312
            case (w312) {
              frame True {
                w313 = "❌"  # String {0}
                Concatenate Strings(w313, " ", "Too much calc in the steam generator!") -> w14
              }
              frame False {
                w14 = "✅"
              }
            }
            w13 = $"Error Cluster input"
            w15 = s1
            w16 = s2
          }
        }
      }
      frame "G201" {
        case (w6) {
          frame "False", Default {
            w13 = $"Error Cluster input"
            w14 = "✅"
            w15 = s1
            w16 = s2
          }
          frame "Ball Valve Motor M7", "Care Pump XS M18", "CleanJet Pump XS M6", "Conductivity Mixbox", "Contact Cleaning Flap S25", "Magnetron Cooling Fan bottom", "Magnetron Cooling Fan top", "Magnetron Safety Chain bottom", "Magnetron Safety Chain top", "Microwave Anode current bottom", "Microwave Anode current top", "Microwave Heating Voltage bottom", "Microwave Heating Voltage top", "Microwave High Voltage actual bottom", "Microwave High Voltage actual top", "Microwave Target bottom", "Microwave Target top", "SC Pump XS M4", "Status Cartridge 1", "Status Cartridge 2", "Status Cartridge 3", "Status Cartridge 4" {
            w314 = " Information not required for this device type"  # String {0}
            Concatenate Strings("[ℹ]", w314) -> w14
            w13 = $"Error Cluster input"
            w15 = s1
            w16 = s2
          }
          frame "Reference Volume Steam Generator" {
            Floating Point String To Number(default (0 DBL)=0, string=w10, use system decimal point (T)=TRUE) -> (number=w15)
            Multiply(9, 1.1) -> w315
            Multiply(9, 0.9) -> w316
            In Range And Coerce(lower limit=w316, upper limit=w315, x=w15) -> (In Range?=w317)
            # G201_Volume_Steam_Generator_Norm = 9.1
            case (w317) {
              frame False, Default {
                Number To Fractional String(number=9, precision (6)=1, use system decimal point (T)=TRUE) -> (F-format string=w318)
                w319 = "❌"  # String {0}
                Concatenate Strings(w319, " ", w6, " ", "is out of range !", "\r", "Nominal volume: ", w318, " L") -> w14
              }
              frame True {
                Number To Fractional String(number=9, precision (6)=1, use system decimal point (T)=TRUE) -> (F-format string=w320)
                Concatenate Strings("✅", " Nominal volume: ", w320, " L") -> w14
              }
            }
            w13 = $"Error Cluster input"
            w16 = s2
          }
          frame "Actual Filling Volume Steam Generator" {
            Floating Point String To Number(default (0 DBL)=0, string=w10, use system decimal point (T)=TRUE) -> (number=w16)
            Multiply(s1, 0.2) -> w321
            Add(w321, s1) -> w322
            Subtract(x=s1, y=w321) -> w323
            In Range And Coerce(lower limit=w323, upper limit=w322, x=w16) -> (In Range?=w324)
            case (w324) {
              frame False, Default {
                w325 = "❌"  # String {0}
                Concatenate Strings(w325, " ", w6, " ", "doesn't fit to the norm level") -> w14
              }
              frame True {
                Concatenate Strings("✅ ", w6, " is OK:", "\r", "In relation to the reference volume steam generator.") -> w14
              }
            }
            w13 = $"Error Cluster input"
            w15 = s1
          }
          frame "Level Electrode S2 Threshold" {
            Floating Point String To Number(default (0 DBL)=0, string=w10, use system decimal point (T)=TRUE) -> (number=w326)
            In Range And Coerce(lower limit=500, upper limit=2000, x=w326) -> (In Range?=w327)
            case (w327) {
              frame False, Default {
                w328 = "❌"  # String {0}
                Concatenate Strings(w328, " ", w6, " ", "is out of range! Valid range [500, 2000] ") -> w14
              }
              frame True {
                w14 = "✅: Valid range [500, 2000] "
              }
            }
            w13 = $"Error Cluster input"
            w15 = s1
            w16 = s2
          }
          frame "Level Electrode S2 Current  Value" {
            Floating Point String To Number(default (0 DBL)=0, string=w10, use system decimal point (T)=TRUE) -> (number=w329)
            In Range And Coerce(lower limit=0, upper limit=3000, x=w329) -> (In Range?=w330)
            case (w330) {
              frame False, Default {
                w331 = "❌"  # String {0}
                Concatenate Strings(w331, " ", w6, " ", "is out of range!") -> w14
              }
              frame True {
                w14 = "✅ "
              }
            }
            w13 = $"Error Cluster input"
            w15 = s1
            w16 = s2
          }
          frame "CalcCheck Volume Steam Generator" {
            Floating Point String To Number(default (0 DBL)=0, string=w10, use system decimal point (T)=TRUE) -> (number=w332)
            Is Greater(x=w332, y=s2) -> w333
            Divide(x=s2, y=w332) -> w334
            Is Less(x=w334, y=1.08) -> w335
            Logical Or(w335, w333) -> w336
            case (w336) {
              frame True {
                w337 = "❌"  # String {0}
                Concatenate Strings(w337, " ", "Too much calc in the steam generator!") -> w14
              }
              frame False {
                w14 = "✅"
              }
            }
            w13 = $"Error Cluster input"
            w15 = s1
            w16 = s2
          }
        }
      }
      frame "G202" {
        case (w6) {
          frame "False", Default {
            w13 = $"Error Cluster input"
            w14 = "✅"
            w15 = s1
            w16 = s2
          }
          frame "Ball Valve Motor M7", "Care Pump XS M18", "CleanJet Pump XS M6", "Conductivity Mixbox", "Contact Cleaning Flap S25", "Magnetron Cooling Fan bottom", "Magnetron Cooling Fan top", "Magnetron Safety Chain bottom", "Magnetron Safety Chain top", "Microwave Anode current bottom", "Microwave Anode current top", "Microwave Heating Voltage bottom", "Microwave Heating Voltage top", "Microwave High Voltage actual bottom", "Microwave High Voltage actual top", "Microwave Target bottom", "Microwave Target top", "SC Pump XS M4", "Status Cartridge 1", "Status Cartridge 2", "Status Cartridge 3", "Status Cartridge 4" {
            w338 = " Information not required for this device type"  # String {0}
            Concatenate Strings("[ℹ]", w338) -> w14
            w13 = $"Error Cluster input"
            w15 = s1
            w16 = s2
          }
          frame "Reference Volume Steam Generator" {
            # G202_Volume_Steam_Generator_Norm = 13.5
            Floating Point String To Number(default (0 DBL)=0, string=w10, use system decimal point (T)=TRUE) -> (number=w15)
            Multiply(13, 1.1) -> w339
            Multiply(13, 0.9) -> w340
            In Range And Coerce(lower limit=w340, upper limit=w339, x=w15) -> (In Range?=w341)
            case (w341) {
              frame False, Default {
                Number To Fractional String(number=13, precision (6)=1, use system decimal point (T)=TRUE) -> (F-format string=w342)
                w343 = "❌"  # String {0}
                Concatenate Strings(w343, " ", w6, " ", "is out of range !", "\r", "Nominal volume: ", w342) -> w14
              }
              frame True {
                Number To Fractional String(number=13, precision (6)=1, use system decimal point (T)=TRUE) -> (F-format string=w344)
                Concatenate Strings("✅", " Nominal volume: ", w344) -> w14
              }
            }
            w13 = $"Error Cluster input"
            w16 = s2
          }
          frame "Actual Filling Volume Steam Generator" {
            Floating Point String To Number(default (0 DBL)=0, string=w10, use system decimal point (T)=TRUE) -> (number=w16)
            Multiply(s1, 0.2) -> w345
            Add(w345, s1) -> w346
            Subtract(x=s1, y=w345) -> w347
            In Range And Coerce(lower limit=w347, upper limit=w346, x=w16) -> (In Range?=w348)
            case (w348) {
              frame False, Default {
                w349 = "❌"  # String {0}
                Concatenate Strings(w349, " ", w6, " ", "doesn't fit to the norm level", " L") -> w14
              }
              frame True {
                Concatenate Strings("✅ ", w6, " is OK:", "\r", "In relation to the reference volume steam generator.") -> w14
              }
            }
            w13 = $"Error Cluster input"
            w15 = s1
          }
          frame "Level Electrode S2 Threshold" {
            Floating Point String To Number(default (0 DBL)=0, string=w10, use system decimal point (T)=TRUE) -> (number=w350)
            In Range And Coerce(lower limit=500, upper limit=2000, x=w350) -> (In Range?=w351)
            case (w351) {
              frame False, Default {
                w352 = "❌"  # String {0}
                Concatenate Strings(w352, " ", w6, " ", "is out of range! Valid range [500, 2000]") -> w14
              }
              frame True {
                w14 = "✅: Valid range [500, 2000]"
              }
            }
            w13 = $"Error Cluster input"
            w15 = s1
            w16 = s2
          }
          frame "Level Electrode S2 Current  Value" {
            Floating Point String To Number(default (0 DBL)=0, string=w10, use system decimal point (T)=TRUE) -> (number=w353)
            In Range And Coerce(lower limit=0, upper limit=3000, x=w353) -> (In Range?=w354)
            case (w354) {
              frame False, Default {
                w355 = "❌"  # String {0}
                Concatenate Strings(w355, " ", w6, " ", "is out of range!") -> w14
              }
              frame True {
                w14 = "✅"
              }
            }
            w13 = $"Error Cluster input"
            w15 = s1
            w16 = s2
          }
          frame "CalcCheck Volume Steam Generator" {
            Floating Point String To Number(default (0 DBL)=0, string=w10, use system decimal point (T)=TRUE) -> (number=w356)
            Is Greater(x=w356, y=s2) -> w357
            Divide(x=s2, y=w356) -> w358
            Is Less(x=w358, y=1.08) -> w359
            Logical Or(w359, w357) -> w360
            case (w360) {
              frame True {
                w361 = "❌"  # String {0}
                Concatenate Strings(w361, " ", "Too much calc in the steam generator!") -> w14
              }
              frame False {
                w14 = "✅ "
              }
            }
            w13 = $"Error Cluster input"
            w15 = s1
            w16 = s2
          }
        }
      }
    }
    call "Change_Parameter_Solenoid_Valve.gviweb"(Value=w10, Parameter Name=w6, Comment in=w14, Error input=w13) -> (Comment out=w362, Output=w363)
    Property Node(instance in=T1 {all zero or empty}, "Parameter Name"=w6, "Status"=w10, "Dimension"=w12, "Comment"=w362) -> (instance out=w364)
    append w364 to w2
    next s1 = w15
    next s2 = w16
  }
  $Output_Error <- w363
  $"Diagnostic Water iCS Switch Output" <- w2
