vi "Interpret_Histogram_CPU_IO_Temperature.gviweb"   [G Web Development Software 22.3.0]
inputs:
  "Histogramm Entrys": string[]
  "Error Cluster input": error
outputs:
  "Signal": f64[]
  "Error Output": error
uses:
  NI::G Core::Strings::Search and Replace Pattern.gvi
diagram:
  for {
    w1 = each element of $"Histogramm Entrys"
    Match Pattern(regular expression="Time=", string=w1) -> (after substring=w3)
    Match Pattern(regular expression="dim=", string=w3) -> (before substring=w4)
    call "Search and Replace Pattern.gvi"(string=w4, pattern="\"", replace all=TRUE) -> (result string=w5)
    Floating Point String To Number(default (0 DBL)=0, string=w5, use system decimal point (T)=TRUE) -> (number=w6)
    append w6 to w2
  }
  $"Error Output" <- $"Error Cluster input"
  $Signal <- w2
