vi "Interpret_SystemLogger.gviweb"   [G Web Development Software 22.3.0]
inputs:
  "SystemLogger Entrys": string[]
  "Error Cluster input": error
  "Startup Date and Time": string
outputs:
  "Error Cluster output": error
  "System Logger output": T1[]
  "Output": string
types:
  T1 = cluster{"Parameter Name": string, "Value": string, "Value relative": string, "Dimension": string, "Comment": string}
uses:
  NI::G Core::Strings::Search and Replace Pattern.gvi
  NI::G Core::Strings::Trim Whitespace.gvi
  WebApp::Change_to_validate_Date.gvi
diagram:
  # 2024.10.21.22.22.54
  # 2024.11.05_11.10.12
  s1 = ""  # shift register
  for {
    w1 = each element of $"SystemLogger Entrys"
    Match Pattern(regular expression="Value=", string=w1) -> (after substring=w3, before substring=w4)
    Match Pattern(regular expression="Value_-_rel=", string=w3) -> (after substring=w5, before substring=w6, match substring=w7)
    # w8: Value
    case (w7) {
      frame "Value_-_rel=" {
        Match Pattern(regular expression="dim=", string=w5) -> (after substring=w12, before substring=w13)
        call "Search and Replace Pattern.gvi"(String=w12, Muster="\"", Alle ersetzen=TRUE) -> (Ergebnis-String=w14)
        call "Trim Whitespace.gvi"(string=w14) -> (trimmed string=w9)
        call "Search and Replace Pattern.gvi"(String=w6, Muster="\"", Alle ersetzen=TRUE) -> (Ergebnis-String=w15)
        call "Trim Whitespace.gvi"(string=w15) -> (trimmed string=w8)
        call "Search and Replace Pattern.gvi"(String=w13, Muster="\"", Alle ersetzen=TRUE) -> (Ergebnis-String=w16)
        call "Trim Whitespace.gvi"(string=w16) -> (trimmed string=w11)
        w10 = $"Error Cluster input"
      }
      frame "False", Default {
        Match Pattern(regular expression="dim=", string=w3) -> (after substring=w17, before substring=w18)
        call "Search and Replace Pattern.gvi"(String=w17, Muster="\"", Alle ersetzen=TRUE) -> (Ergebnis-String=w9)
        call "Search and Replace Pattern.gvi"(String=w18, Muster="\"", Alle ersetzen=TRUE) -> (Ergebnis-String=w8)
        w10 = $"Error Cluster input"
        w11 = "N.A"
      }
    }
    call "Search and Replace Pattern.gvi"(String=w4, Muster="_", Ersetzungs-String=" ", Alle ersetzen=TRUE) -> (Ergebnis-String=w19)
    # w11: Value rel
    call "Trim Whitespace.gvi"(string=w19) -> (trimmed string=w20)
    case (w20) {
      frame "False", Default {
        w21 = w20
        w22 = w10
        w23 = w8
        w24 = s1
      }
      frame "QSPI Writes" {
        w21 = w20
        w22 = w10
        w23 = w8
        w24 = w11
      }
      frame "Last calibration", "Last emergency run", "Second Last calibration" {
        call "Change_to_validate_Date.gvi"(Date_Time_String input=w8, Error Cluster input=w10) -> (Validate date and time=w23, Error Cluster output=w22)
        w21 = w20
        w24 = s1
      }
    }
    call "Trim Whitespace.gvi"(string=w23) -> (trimmed string=w25)
    Is Empty String Or Path(string/path=w25) -> w26
    case (w26) {
      frame False, Default {
        case (w21) {
          frame "False", Default {
            Is Equal(x=w8, y="undef") -> w30
            case (w30) {
              frame False, Default {
                w28 = w22
                w27 = "✅"
              }
              frame True {
                w31 = "[ℹ]"  # String {0}
                Concatenate Strings(w31, " ", w21, " ", "is not available!") -> w27
                w28 = w22
              }
            }
          }
          frame "Number Calibrations" {
            Decimal String To Number(default (0 I32)=0, string=w8) -> (number=w32)
            Is Greater Than 0(x=w32) -> w33
            case (w33) {
              frame True {
                w27 = "✅"
              }
              frame False {
                w34 = "❌"  # String {0}
                Concatenate Strings(w34, " Device is not Calibrated!") -> w27
              }
            }
            w28 = w22
          }
          frame "Last calibration" {
            Floating Point String To Number(default (0 DBL)=0, string=$"Startup Date and Time") -> (number=w35)
            Floating Point String To Number(default (0 DBL)=0, string=w8) -> (number=w36)
            Is Less Or Equal(x=w35, y=w36) -> w37
            case (w37) {
              frame False {
                Is Not Equal(x=w8, y="undef") -> w38
                case (w38) {
                  frame False, Default {
                    w39 = "❌"  # String {0}
                    Concatenate Strings(w39, "  Device is not Calibrated!") -> w27
                    w28 = w22
                  }
                  frame True {
                    call "Change_to_validate_Date.gvi"(Date_Time_String input=$"Startup Date and Time", Error Cluster input=w22) -> (Validate date and time=w40, Error Cluster output=w28)
                    w41 = "⚠️"  # String {0}
                    Concatenate Strings(w41, " ", w21, " ", "of the unit was before the installation !", "\r", "Installation Date: ", w40) -> w27
                  }
                }
              }
              frame True {
                Is Not Equal(x=w8, y="undef") -> w42
                case (w42) {
                  frame False, Default {
                    w43 = "❌"  # String {0}
                    Concatenate Strings(w43, "  Device is not Calibrated!") -> w27
                    w28 = w22
                  }
                  frame True {
                    w28 = w22
                    w27 = "✅"
                  }
                }
              }
            }
          }
          frame "Last Dry calibration" {
            Is Equal(x=w8, y="true") -> w44
            case (w44) {
              frame False {
                w27 = "✅"
              }
              frame True {
                Concatenate Strings("⚠️", " ", "The last calibration was a dry calibration!") -> w27
              }
            }
            w28 = w22
          }
          frame "Second Last Dry calibration" {
            Is Equal(x=w8, y="true") -> w45
            case (w45) {
              frame False {
                w27 = "✅"
              }
              frame True {
                Concatenate Strings("⚠️", " ", "The second last calibration was a dry calibration!") -> w27
              }
            }
            w28 = w22
          }
        }
        w29 = w24
      }
      frame True {
        case (w20) {
          frame "QSPI Frequency" {
            Is Empty String Or Path(string/path=w24) -> w46
            case (w46) {
              frame True {
                w47 = " Information not required for this device type"  # String {0}
                Concatenate Strings("[ℹ]", w47) -> w27
              }
              frame False {
                Is Empty String Or Path(string/path=w11) -> w48
                case (w48) {
                  frame False, Default {
                    w27 = "✅"
                  }
                  frame True {
                    w49 = "❌ "  # String {0}
                    Concatenate Strings(w49, w20, " is missing!") -> w27
                  }
                }
              }
            }
            w28 = w22
            w29 = w24
          }
          frame "False", Default {
            w50 = " Information not required for this device type"  # String {0}
            Concatenate Strings("[ℹ]", w50) -> w27
            w28 = w22
            w29 = w24
          }
        }
      }
    }
    Property Node(instance in=T1 {all zero or empty}, "Parameter Name"=w21, "Value"=w25, "Value relative"=w11, "Dimension"=w9, "Comment"=w27) -> (instance out=w51)
    append w51 to w2
    next s1 = w29
  }
  $Output <- s1
  $"Error Cluster output" <- w28
  $"System Logger output" <- w2
