vi "Interpret_System_OnOff_History.gviweb"   [G Web Development Software 22.3.0]
inputs:
  "System OnOff History Entrys": string[]
  "Device Type": string = "Device"
  "Error Cluster input": error
outputs:
  "System OnOff History output": T1[]
  "Error Output": error
types:
  T1 = cluster{"Parameter Name": string, "OnOffEvent": string, "Reason": string, "Time": string}
uses:
  NI::G Core::Strings::Trim Whitespace.gvi
  NI::G Core::Strings::Search and Replace Pattern.gvi
  WebApp::Reason_OnOffEvent.gviweb
  WebApp::Change_to_validate_Date.gvi
diagram:
  for {
    w1 = each element of $"System OnOff History Entrys"
    Match Pattern(regular expression="OnOffEvent=", string=w1) -> (after substring=w3, before substring=w4)
    call "Trim Whitespace.gvi"(string=w4) -> (trimmed string=w5)
    Match Pattern(regular expression="Reason=", string=w3) -> (after substring=w6, before substring=w7, match substring=w8)
    case (w8) {
      frame "False", Default {
        call "Trim Whitespace.gvi"(string=w3) -> (trimmed string=w13)
        Match Pattern(regular expression="Time=", string=w13) -> (after substring=w14, before substring=w15)
        call "Search and Replace Pattern.gvi"(String=w15, Muster="\"", Alle ersetzen=TRUE) -> (Ergebnis-String=w16)
        call "Trim Whitespace.gvi"(string=w16) -> (trimmed string=w10)
        call "Search and Replace Pattern.gvi"(String=w14, Muster="\"", Alle ersetzen=TRUE) -> (Ergebnis-String=w9)
        w11 = ""
        w12 = $"Error Cluster input"
      }
      frame "Reason=" {
        call "Search and Replace Pattern.gvi"(String=w7, Muster="\"", Alle ersetzen=TRUE) -> (Ergebnis-String=w17)
        call "Trim Whitespace.gvi"(string=w17) -> (trimmed string=w10)
        call "Search and Replace Pattern.gvi"(String=w6, Muster="\"", Alle ersetzen=TRUE) -> (Ergebnis-String=w18)
        call "Trim Whitespace.gvi"(string=w18) -> (trimmed string=w19)
        Match Pattern(regular expression="Time=", string=w19) -> (after substring=w20, before substring=w21)
        call "Reason_OnOffEvent.gviweb"(Reason=w21, Error in=$"Error Cluster input") -> (Reason Output=w11, Error out=w12)
        call "Search and Replace Pattern.gvi"(String=w20, Muster="\"", Alle ersetzen=TRUE) -> (Ergebnis-String=w9)
      }
    }
    call "Change_to_validate_Date.gvi"(Date_Time_String input=w9, Error Cluster input=w12) -> (Validate date and time=w22, Error Cluster output=w23)
    Property Node(instance in=T1 {all zero or empty}, "Parameter Name"=w5, "OnOffEvent"=w10, "Reason"=w11, "Time"=w22) -> (instance out=w24)
    append w24 to w2
  }
  Reverse 1D Array(array=w2) -> (reversed array=w25)
  s1 = 0  # shift register
  for {
    w26 = each element of w25
    Property Node(instance in=w26) -> ("OnOffEvent"=w28, "Reason"=w29, instance out=w30)
    case (w28) {
      frame "False", Default {
        w31 = 0
        w32 = w30
      }
      frame "Startup" {
        Increment(x=s1) -> w31
        Is Greater Or Equal(x=w31, y=2) -> w33
        case (w33) {
          frame False, Default {
            w34 = w29
          }
          frame True {
            w35 = "⚠️ No shutdown detected. Possible reasons: \n- Power failure. \n- Unplugging the unit.\n- forced shutdown."
            w34 = w35
          }
        }
        Property Node(instance in=w30, "Reason"=w34) -> (instance out=w32)
      }
    }
    append w32 to w27
    next s1 = w31
  }
  $"System OnOff History output" <- w27
  $"Error Output" <- w23
