vi "Read_XML_Part.gviweb"   [G Web Development Software 22.3.0]
inputs:
  "Input XML": string
  "Start XML Part": string = "<Common_Information>"
  "End XML Part": string = "</Common_Information>"
  "Error in": error
outputs:
  "Output XML array": string[]
  "Error out": error
uses:
  NI::G Core::Strings::Trim Whitespace.gvi
diagram:
  Match Pattern(regular expression=$"Start XML Part", string=$"Input XML") -> (after substring=w1)
  Match Pattern(regular expression=$"End XML Part", string=w1) -> (before substring=w2)
  s1 = string[] []  # shift register
  s2 = w2  # shift register
  while (iteration -> i1) {
    case (i1) {
      frame 0 {
        w3 = w2
      }
      frame 1, Default {
        w3 = s2
      }
    }
    call "Trim Whitespace.gvi"(String=w3) -> (Gekürzter String=w4)
    Match Pattern(regular expression="<", string=w4) -> (after substring=w5)
    call "Trim Whitespace.gvi"(String="/>") -> (Gekürzter String=w6)
    Match Pattern(regular expression=w6, string=w5) -> (before substring=w7)
    Is Empty String Or Path(string/path=w7) -> w8
    case (w8) {
      frame False, Default {
        Insert Into Array(inArray=s1, new=w7) -> w9
        w10 = w5
        w11 = w8
      }
      frame True {
        w9 = s1
        w10 = ""
        w11 = w8
      }
    }
    next s1 = w9
    next s2 = w10
    stop if w11
  }
  $"Output XML array" <- s1
  $"Error out" <- $"Error in"
