vi "Set_Eco_State.gviweb"   [G Web Development Software 22.3.0]
inputs:
  "Error input": error
  "Comment in": string
  "Parameter Name": string
  "Control Mode": string
outputs:
  "Output": error
  "Comment out": string
diagram:
  case ($"Parameter Name") {
    frame "False", Default {
      w1 = $"Error input"
      w2 = $"Comment in"
    }
    frame "Control Temperature Dry Heat" {
      case ($"Control Mode") {
        frame "False", Default {
          w1 = $"Error input"
          w2 = $"Comment in"
        }
        frame "Eco" {
          w1 = $"Error input"
          w2 = "⚠️ Unused: Eco Mode is activated"
        }
        frame "OFF" {
          w1 = $"Error input"
          w2 = "⚠️ NOTE: PLease set the control mode!"
        }
        frame "ON" {
          String Length(string=$"Comment in") -> (length=w3)
          Is Greater Or Equal(x=w3, y=15) -> w4
          case (w4) {
            frame True {
              w2 = $"Comment in"
            }
            frame False {
              w5 = "⚠️ Control Temperatures are valid. Use this setting in case of heavy use!"
              w2 = w5
            }
          }
          w1 = $"Error input"
        }
      }
    }
    frame "Control Temperature Moist Heat" {
      case ($"Control Mode") {
        frame "False", Default {
          w1 = $"Error input"
          w2 = $"Comment in"
        }
        frame "Eco" {
          w1 = $"Error input"
          w2 = "⚠️ Unused: Eco Mode is activated"
        }
        frame "OFF" {
          w1 = $"Error input"
          w2 = "⚠️ NOTE: PLease set the control mode!"
        }
        frame "ON" {
          String Length(string=$"Comment in") -> (length=w6)
          Is Greater Or Equal(x=w6, y=15) -> w7
          case (w7) {
            frame True {
              w2 = $"Comment in"
            }
            frame False {
              w8 = "⚠️ Control Temperatures are valid. Use this setting in case of heavy use!"
              w2 = w8
            }
          }
          w1 = $"Error input"
        }
      }
    }
    frame "Control Temperature Off" {
      case ($"Control Mode") {
        frame "False", Default {
          w1 = $"Error input"
          w2 = $"Comment in"
        }
        frame "Eco" {
          w1 = $"Error input"
          w2 = "⚠️ Unused: Eco Mode is activated"
        }
        frame "OFF" {
          w1 = $"Error input"
          w2 = "⚠️ NOTE: PLease set the control mode!"
        }
        frame "ON" {
          String Length(string=$"Comment in") -> (length=w9)
          Is Greater Or Equal(x=w9, y=15) -> w10
          case (w10) {
            frame True {
              w2 = $"Comment in"
            }
            frame False {
              w11 = "⚠️ Control Temperatures are valid. Use this setting in case of heavy use!"
              w2 = w11
            }
          }
          w1 = $"Error input"
        }
      }
    }
  }
  $"Comment out" <- w2
  $Output <- w1
