vi "Sort_Common_Infomation.gviweb"   [G Web Development Software 22.3.0]
inputs:
  "Input Error": error
  "Error_Selektor": enum{"All data", "Relevant data", "Error view"} = "All data"
  "Common Information": T1[]
outputs:
  "Output Error": error
  "Output": T1[]
  "Common Information_Error": string
types:
  T1 = cluster{"Parameter Name": string, "Value": string, "Comment": string}
diagram:
  # [ℹ] Information is not implemented for this device, [ℹ] Information not required for this device type, [ℹ]  UltraVent is not implemented for this device !, [ℹ] Information is not required for this device
  case ($Error_Selektor) {
    frame "All data", Default {
      s1 = T1[] []  # shift register
      s2 = ""  # shift register
      for {
        w4 = each element of $"Common Information"
        Property Node(instance in=w4) -> ("Comment"=w5, instance out=w6)
        Match Pattern(regular expression="❌", string=w5) -> (match substring=w7)
        case (w7) {
          frame "False", Default {
            w8 = s1
            w9 = s2
          }
          frame "❌" {
            Insert Into Array(inArray=s1, new=w6) -> w8
            w9 = "- Common Information"
          }
        }
        next s1 = w8
        next s2 = w9
      }
      w1 = $"Input Error"
      w2 = $"Common Information"
      w3 = s2
    }
    frame "Error view" {
      s3 = T1[] []  # shift register
      s4 = ""  # shift register
      for {
        w10 = each element of $"Common Information"
        Property Node(instance in=w10) -> ("Comment"=w11, instance out=w12)
        Match Pattern(regular expression="❌", string=w11) -> (match substring=w13)
        case (w13) {
          frame "False", Default {
            w14 = s3
            w15 = s4
          }
          frame "❌" {
            Insert Into Array(inArray=s3, new=w12) -> w14
            w15 = "- Common Information"
          }
        }
        next s3 = w14
        next s4 = w15
      }
      w1 = $"Input Error"
      w2 = s3
      w3 = s4
    }
    frame "Relevant data" {
      s5 = T1[] []  # shift register
      s6 = ""  # shift register
      for {
        w16 = each element of $"Common Information"
        Property Node(instance in=w16) -> ("Comment"=w17, instance out=w18)
        case (w17) {
          frame "[ℹ]   UltraVent is not implemented for this device !", "[ℹ]  Information is not implemented for this device", "[ℹ]  UltraVent is not implemented for this device !", "[ℹ] Information is not implemented for this device", "[ℹ] Information is not required for this device", "[ℹ] Information not required for this device type" {
            w19 = s5
            w20 = s6
          }
          frame "False", Default {
            Match Pattern(regular expression="❌", string=w17) -> (match substring=w21)
            case (w21) {
              frame "False", Default {
                Insert Into Array(inArray=s5, new=w18) -> w19
                w20 = s6
              }
              frame "❌" {
                Insert Into Array(inArray=s5, new=w18) -> w19
                w20 = "- Common Information"
              }
            }
          }
        }
        next s5 = w19
        next s6 = w20
      }
      w1 = $"Input Error"
      w2 = s5
      w3 = s6
    }
  }
  $"Output Error" <- w1
  $"Common Information_Error" <- w3
  $Output <- w2
