vi "Sort_Diagnostic_Service_History_iVario.gviweb"   [G Web Development Software 22.3.0]
inputs:
  "Error_Selektor": enum{"All data", "Relevant data", "Error view"} = "All data"
  "Input Error": error
  "Diagnostic Service History Output": T1[]
outputs:
  "Output Error": error
  "Output": T1[]
  "Diagnostic Service History Text": string
types:
  T1 = cluster{"Parameter Name": string, "First Time": string, "Last Time": string, "Quantity": string, "Comment": string}
diagram:
  case ($Error_Selektor) {
    frame "All data", Default {
      s1 = T1[] []  # shift register
      s2 = ""  # shift register
      for {
        w4 = each element of $"Diagnostic Service History Output"
        Property Node(instance in=w4) -> ("Comment"=w5, instance out=w6)
        Match Pattern(regular expression="❌", string=w5) -> (match substring=w7)
        case (w7) {
          frame "False", Default {
            w8 = s1
            w9 = s2
          }
          frame "❌" {
            Insert Into Array(inArray=s1, new=w6) -> w8
            w9 = "- Diagnostic Service History"
          }
        }
        next s1 = w8
        next s2 = w9
      }
      w1 = $"Input Error"
      w2 = $"Diagnostic Service History Output"
      w3 = s2
    }
    frame "Error view" {
      s3 = T1[] []  # shift register
      s4 = ""  # shift register
      for {
        w10 = each element of $"Diagnostic Service History Output"
        Property Node(instance in=w10) -> ("Comment"=w11, instance out=w12)
        Match Pattern(regular expression="❌", string=w11) -> (match substring=w13)
        case (w13) {
          frame "False", Default {
            w14 = s3
            w15 = s4
          }
          frame "❌" {
            Insert Into Array(inArray=s3, new=w12) -> w14
            w15 = "- Diagnostic Service History"
          }
        }
        next s3 = w14
        next s4 = w15
      }
      w1 = $"Input Error"
      w2 = s3
      w3 = s4
    }
    frame "Relevant data" {
      s5 = T1[] []  # shift register
      s6 = ""  # shift register
      for {
        w16 = each element of $"Diagnostic Service History Output"
        Property Node(instance in=w16) -> ("Comment"=w17, instance out=w18)
        case (w17) {
          frame "[ℹ] Information is missing for this device type", "[ℹ] Information is not implemented for this device", "[ℹ] Information is not necessary", "[ℹ] Information not required for this device type" {
            w19 = s5
            w20 = s6
          }
          frame "False", Default {
            Match Pattern(regular expression="❌", string=w17) -> (match substring=w21)
            case (w21) {
              frame "False", Default {
                Insert Into Array(inArray=s5, new=w18) -> w19
                w20 = s6
              }
              frame "❌" {
                Insert Into Array(inArray=s5, new=w18) -> w19
                w20 = "- Diagnostic Service History"
              }
            }
          }
        }
        next s5 = w19
        next s6 = w20
      }
      w1 = $"Input Error"
      w2 = s5
      w3 = s6
    }
  }
  $"Output Error" <- w1
  $"Diagnostic Service History Text" <- w3
  $Output <- w2
