vi "Sort_Service_History_event.gviweb"   [G Web Development Software 22.3.0]
inputs:
  "Diagnostic Service History input": T1[]
  "Event": bool
  "Error Cluster input": error
outputs:
  "Error Output": error
  "Diagnostic Service History output": T1[]
types:
  T1 = cluster{"Parameter Name": string, "First Time": string, "Last Time": string, "Quantity": string, "Comment": string}
diagram:
  for {
    w1 = each element of $"Diagnostic Service History input"
    Property Node(instance in=w1) -> ("Last Time"=w3, "Parameter Name"=w4, instance out=w5)
    Property Node(instance in=w5, "Parameter Name"=w3, "Last Time"=w4) -> (instance out=w6)
    append w6 to w2
  }
  Sort 1D Array(array=w2) -> (sorted array=w7)
  case ($Event) {
    frame True {
      w8 = w7
    }
    frame False {
      Reverse 1D Array(array=w7) -> (reversed array=w8)
    }
  }
  for {
    w9 = each element of w8
    Property Node(instance in=w9) -> ("Last Time"=w11, "Parameter Name"=w12, instance out=w13)
    Property Node(instance in=w13, "Parameter Name"=w11, "Last Time"=w12) -> (instance out=w14)
    append w14 to w10
  }
  $"Diagnostic Service History output" <- w10
  $"Error Output" <- $"Error Cluster input"
