vi "Sort_Total_Running_Time.gviweb"   [G Web Development Software 22.3.0]
inputs:
  "Error_Selektor": T1 = "Default View"
  "Input Error": error
  "Diagnostic Running Time Modes": T2[]
outputs:
  "Output": T2[]
  "Output Error": error
types:
  T1 = enum{"Default View", "Only Error", "Only Required"}
  T2 = cluster{"Parameter Name": string, "Count": string, "Duration": string, "Dimension": string, "Comment": string}
diagram:
  # [ℹ] Information is not implemented for this device, [ℹ] Information not required for this device type, [ℹ] Information is missing for this device type
  case ($Error_Selektor) {
    frame "Default View", Default {
      w1 = $"Input Error"
      w2 = $"Diagnostic Running Time Modes"
    }
    frame "Only Error" {
      s1 = T2[] []  # shift register
      for {
        w3 = each element of $"Diagnostic Running Time Modes"
        Property Node(instance in=w3) -> ("Comment"=w4, instance out=w5)
        Match Pattern(regular expression="❌", string=w4) -> (match substring=w6)
        case (w6) {
          frame "False", Default {
            w7 = s1
          }
          frame "❌" {
            Insert Into Array(inArray=s1, new=w5) -> w7
          }
        }
        next s1 = w7
      }
      w1 = $"Input Error"
      w2 = s1
    }
    frame "Only Required" {
      s2 = T2[] []  # shift register
      for {
        w8 = each element of $"Diagnostic Running Time Modes"
        Property Node(instance in=w8) -> ("Comment"=w9, instance out=w10)
        case (w9) {
          frame "[ℹ] Information is missing for this device type", "[ℹ] Information is not implemented for this device", "[ℹ] Information not required for this device type" {
            w11 = s2
          }
          frame "False", Default {
            Insert Into Array(inArray=s2, new=w10) -> w11
          }
        }
        next s2 = w11
      }
      w1 = $"Input Error"
      w2 = s2
    }
  }
  $Output <- w2
  $"Output Error" <- w1
