vi "Test.gvi"   [G Web Development Software 22.3.0]
inputs:
  "XML content": string
  "First Check": string = "Pan"
  "Second Check": string = "Pan"
  "Error input": error[]
outputs:
  "Error output": error[]
  "Check State": bool
diagram:
  Match Pattern(regular expression=$"First Check", string=$"XML content") -> (match substring=w1)
  Is Equal(x=w1, y=$"First Check") -> w2
  case (w2) {
    frame False, Default {
      Match Pattern(regular expression=$"Second Check", string=$"XML content") -> (match substring=w5)
      Is Equal(x=w5, y=$"Second Check") -> w6
      case (w6) {
        frame False, Default {
          w3 = FALSE
        }
        frame True {
          w3 = w6
        }
      }
      w4 = $"Error input"
    }
    frame True {
      w3 = w2
      w4 = $"Error input"
    }
  }
  $"Error output" <- w4
  $"Check State" <- w3
