vi "index.gviweb"   [G Web Development Software 22.3.0]
# Press “Analyse” and select a service report xml file
panel controls:
  "Analyse": bool  # Press the button “Analyse” and select a service report xml file.
  "Page 1": i32
  "Page selector": enum{"Page 1", "Page 2", "Page 3", "Page 4"} = "Page 1"
  "Page 2": i32
  "Page 3": i32
  "Page 4": i32
  "Device": enum{"iCombi Pro/iHexagon", "iVario"} = "iCombi Pro/iHexagon"
  "ivario": i32
  "Info_Plot": bool
  "Sort table ivario": bool
  "Sort table iCombi": bool
  "Page content": bool
  "Changed Component": string[]
  "Error_Selektor": enum{"All data", "Relevant data", "Error view"} = "Relevant data"
  "Sort table iCombi_2": bool
  "Diagnostic Running Times Comp_2": T6[]
  "Next page": bool
  "Previous page": bool
  "Changed Component iVario": string[]
  "iVario 2": i32 = 2
  "Page selector iVario": enum{"Page 1", "Page 2"} = "Page 1"
  "System OnOff History iVario_3": T13[]
  "System OnOff History iVario_2": T13[]
  "Component Replacement History iVario_2": T12[]
  "Service report XML File Content iVario:_2": string
  "Engine Link_2": string = "https://portal.rational-online.com/fs4p/media/service/3_dokumentationen/ivario_pro___ivario/tm_ivario_pro___ivario/en_108/80.52.260_iVario-iVarioPro_ET_en-GB.pdf"
  "Engine Link": string = "https://portal.rational-online.com/fs4p/media/service/3_dokumentationen/icombi_pro___icombi_classik/tm_icombi_pro___icombi_classic/en_gb/80.51.321_ET_en-GB.pdf"
  "Battery Link_2": string = "How to use it.html"
panel indicators:
  "Device:": string
  "Board Information:": cluster{"Board": string, "Information": string}[]
  "common": T1[]
  "URL-Grafik": string
  "Basic_Settings": T2[]
  "Diagnostic RT Calibration": T3[]
  "Checkbox": bool
  "Diagnostic_Water_iCS_Switch": T4[]
  "Diagnostic-Service-History": T5[]
  "Diagnostic Running Times Comp": T6[]
  "Diagnostic Running Times Modes": T6[]
  "System Logger Output": T7[]
  "Histogram cpu pcb Temperature profile Celsius": f64[]
  "skala histogram CPU": string
  "Histogram IO Temperature profile Celsius": f64[]
  "skala histogram IO": string
  "Histogram LED hinge side Temperature profile Celsius": f64[]
  "skala Histogram LED hinge": string
  "Histogram LED handle side Temperature profile Celsius": f64[]
  "Skala Histogram LED handle": string
  "Histogram pump pcb Temperature profile Celsius": f64[]
  "skala Histogram pump pcb": string
  "Histogram gas box Temperature profile Celsius": f64[]
  "Skala Histogram Gas box": string
  "Histogram fan 1 RPM profile 1 min": f64[]
  "skala Histogram fan 1 rpm": string
  "Histogram fan 1 power profile W": f64[]
  "Skala Histogram fan power": string
  "Histogram fan 1 Temperature_profile Celsius": f64[]
  "Skala Histogram fan1 temp": string
  "Histogram fan 1 Voltage max_V_1phase_3phase": f64[]
  "Skala Histogram fan1 max Volt": string
  "Histogram fan 1 Voltage min_V_1phase_3phase": f64[]
  "Skala Histogram fan1 minVolt": string
  "Histogram fan 2 RPM profile 1 min": f64[]
  "skala Histogram fan 2 rpm": string
  "Histogram fan 2 power profile W": f64[]
  "Skala Histogram fan2 power": string
  "Histogram fan 2 Temperature_profile Celsius": f64[]
  "Skala Histogram fan2 temp": string
  "Histogram fan 2 Voltage max_V_1phase_3phase": f64[]
  "Histogram fan 2 Voltage min_V_1phase_3phase": f64[]
  "Skala Histogram fan2 minVolt": string
  "Skala Histogram fan2 maxVolt": string
  "Histogram fan 3 RPM profile 1 min": f64[]
  "skala Histogram fan 3 rpm": string
  "Histogram fan 3 power profile W": f64[]
  "Skala Histogram fan3 power": string
  "Histogram fan 3 Temperature_profile Celsius": f64[]
  "Skala Histogram fan3 temp": string
  "Histogram fan 3 Voltage max_V_1phase_3phase": f64[]
  "Histogram fan 3 Voltage min_V_1phase_3phase": f64[]
  "Skala Histogram fan3 minVolt": string
  "Skala Histogram fan3 maxVolt": string
  "Histogram MMI CPU Load Percent": f64[]
  "Skala Histogram MMI CPU": string
  "Histogram MMI RAM Load Percent": f64[]
  "Skala Histogram MMI Load": string
  "Histogram Basis CPU Load Percent": f64[]
  "Skala Histogram Basis MMI CPU": string
  "Histogram Basis RAM Load Percent": f64[]
  "Skala Histogram Basis MMI Load": string
  "Histogram Magnetron Top Temperatur profile Celsius": f64[]
  "skala Magnetron top": string
  "Histogram Magnetron bottom Temperature profile Celsius": f64[]
  "skala Magnetron bottom": string
  "Histogram Power Supply Top Temperature profile Celsius": f64[]
  "skala Power Supply top": string
  "Histogram Power Supply bottom Temperature profile Celsius": f64[]
  "skala histogram Power Supply bottom": string
  "Boards_Information:": cluster{"Board": string, "Information": string}[]
  "Device :": string
  "common Information ivario": T1[]
  "Basic Informations": T2[]
  "Diagnostic_RT_Data_Sensors_Heating": T8[]
  "Diagnostic_RT_Data_Sensors": T9[]
  "Diagnostic_RT_Data_Sensors_mouvement": T10[]
  "Diagnostic_RT_Data_Sensors_Pressure": T4[]
  "Diagnostic-Service-History_iVario": T5[]
  "Total Running Time:": T6[]
  "Diagnostic Running Times Components:": T6[]
  "String": string
  "Total Running Time :": T6[]
  "Measured_temperature IO °C [Min/Max]:": f64[]
  "wrong unit type": bool
  "Software-Service-History_iCP": T11[]
  "Software-Service-History_iVario": T11[]
  "Component Replacement History": T12[]
  "add BMK to common information": bool
  "Tabs with errors": string
  "Common Information_Error": string
  "Basic_Settings_Error": string
  "Diagnostic Real Time Data Sensors": string
  "Diagnostic RT Calibration_Text": string
  "Diagnostic Water iCS Switch Text": string
  "Diagnostic Service History Text": string
  "Diagnostic RunningTimes mode": string
  "Diagnostic Running Time Components": string
  "System Logger_Text": string
  "Service report XML File Content:": string
  "System OnOff History": T13[]
  "System OnOff History iVario": T13[]
  "Component Replacement History iVario": T12[]
  "add BMK to common information iVario": bool
  "Service report XML File Content iVario:": string
  "Basic_Settings_Error_iVario": string
  "Common Information_Error_iVario": string
  "Diagnostic RT Data Sensors Heating": string
  "Diagnostic_RT_Data_Sensors_Pressure_error": string
  "Diagnostic Service History Error iVario": string
  "Diagnostic RT Data sensors movement": string
  "Diagnostic Running Time Components_iVario": string
  "URL Image": string
  "iCombi Pro device": bool
types:
  T1 = cluster{"Parameter Name": string, "Value": string, "Comment": string}
  T2 = cluster{"Parameter Name": string, "Value": string, "Dimension": string, "Comment": string}
  T3 = cluster{"Parameter Name": string, "Combi": string, "Dry": string, "Wet": string, "Dimension": string, "Comment": string}
  T4 = cluster{"Parameter Name": string, "Status": string, "Dimension": string, "Comment": string}
  T5 = cluster{"Parameter Name": string, "First Time": string, "Last Time": string, "Quantity": string, "Comment": string}
  T6 = cluster{"Parameter Name": string, "Count": string, "Duration": string, "Dimension": string, "Comment": string}
  T7 = cluster{"Parameter Name": string, "Value": string, "Value relative": string, "Dimension": string, "Comment": string}
  T8 = cluster{"Parameter Name": string, "Actual": string, "Dimension": string, "Comment": string}
  T9 = cluster{"Parameter Name": string, "Actual": string, "Dimension": string, "Limit": string, "maximum": string, "Timestamp": string, "Comment": string}
  T10 = cluster{"Parameter Name": string, "Command": string, "Down_Switch": string, "Status": string, "Up_Switch": string, "Dimension": string, "Comment": string}
  T11 = cluster{"Parameter Name": string, "Update Date": string, "Version Name": string}
  T12 = cluster{"Replacement number": string, "BMK": string, "Component name": string, "Replace time": string, "Serial number": string, "Service note": string, "Type": string}
  T13 = cluster{"Parameter Name": string, "OnOffEvent": string, "Reason": string, "Time": string}
  T14 = cluster{"Parameter Name": string, "Combi": string, "Dry": string}
  T15 = cluster{"Parameter Name": string, "Status": string, "Dimension": string, "comment": string}
  T16 = cluster{"Boards": string, "Informations": string}
  T17 = cluster{"Parameter Name": string, "Actual": string, "Dimension": string, "Limit": string, "maximum": string, "Time_stamp": string, "Comment": string}
  T18 = cluster{"Parameter Name": string, "Actual": string, "Dimension": string, "comment": string}
  T19 = cluster{"Parameter Name": string, "Command": string, "Down_Switch": string, "Status": string, "Up_Switch": string, "dim": string, "Comment": string}
uses:
  NI::HTTP::GET.gvi
  Uppy::Function.gvi
  FileTasks::Read File Text.gvi
  NI::G Core::Error::Clear Error Cluster.gvi
  Library::Check_XML_Device.gviweb
  WebApp::Sort_Service_History_event.gviweb
  WebApp::Read_XML_Part.gviweb
  WebApp::Exlude_WA_Entrys.gviweb
  WebApp::Interpret_Common_Information.gviweb
  WebApp::Sort_Common_Infomation.gviweb
  WebApp::Interpret_Common_Information_iVario.gviweb
  WebApp::Sort_Common_Infomation_iVario.gviweb
  WebApp::Interpret_Basic_Settings.gviweb
  WebApp::Sort_Basic_Settings.gviweb
  WebApp::Exclude_iVario_Entry.gviweb
  WebApp::Interpret_Basic_Settings_iVario.gviweb
  WebApp::Sort_Basic_Settings_iVario.gviweb
  WebApp::Interpret_Diagnostic_RT_Data_Sensors.gviweb
  WebApp::Sort_Diagnostic_Real_Time_Data_Sensors.gviweb
  WebApp::Interpret_Diagnostic_RT_Data_Sensors_Heating.gviweb
  WebApp::Sort_Diagnostic_RT_Data_Sensors_Heating.gviweb
  WebApp::Interpret_Diagnostic_RT_Data_Sensors_Movement.gviweb
  WebApp::Sort_Diagnostic_RT_Data_Sensors_Movement.gviweb
  WebApp::Interpret_Diagnostic_RT_Data_Sensors_Pressure.gviweb
  WebApp::Sort_Diagnostic_RT_Data_Sensors_Pressure.gviweb
  WebApp::Interpret_Diagnostic_RT_Calibration.gviweb
  WebApp::Sort_Diagnostic_RT_Calibration.gviweb
  WebApp::Interpret_Diagnostic_Water_iCS_Switch.gviweb
  WebApp::Sort_Diagnostic_Water_iCs_Switch.gviweb
  WebApp::Diagnostic_Service_History.gviweb
  WebApp::Sort_Diagnostic_Service_History.gviweb
  WebApp::Interpret_Software_Version_History.gviweb
  WebApp::Interpret_System_OnOff_History.gviweb
  WebApp::Interpret_Component_Replacement_History.gviweb
  WebApp::Sort_Service_History_MSGs_Default.gviweb
  WebApp::Sort_Diagnostic_Service_History_iVario.gviweb
  WebApp::Interpret_Diagnostic_RunningTimes_Comp.gviweb
  WebApp::Sort_RunningTimes_Components.gviweb
  WebApp::Sort_RunningTimes_iVario.gviweb
  WebApp::Interpret_SystemLogger.gviweb
  WebApp::Sort_System_Logger.gviweb
  WebApp::Interpret_Histogram_CPU_IO_Temperature.gviweb
  NI::G Core::Strings::Trim Whitespace.gvi
  NI::G Core::Strings::Search and Replace Pattern.gvi
  WebApp::Interpret_Diagnostic_RunningTimes_Modes.gviweb
  WebApp::Sort_Diagnostic_RunningTimes_Modes.gviweb
diagram:
  # "": Auto Dose available
  # "": Unit-Type
  w1 = "Init"  # State
  s1 = w1  # shift register
  s2 = ""  # shift register
  s3 = string[] []  # shift register
  s4 = ""  # shift register
  s5 = ""  # shift register
  s6 = ""  # shift register
  s7 = ""  # shift register
  s8 = 0  # shift register
  while {
    case (s1) {
      frame "Init", Default {
        $"skala Histogram pump pcb" <- "skala_120.jpg"
        $"skala histogram IO" <- "skala_120.jpg"
        $"skala histogram CPU" <- "skala_120.jpg"
        $"skala Histogram LED hinge" <- "skala_120.jpg"
        $"Skala Histogram fan1 temp" <- "skala_fan_temp.jpg"
        w11 = "Read Ini File"  # State
        $"Skala Histogram LED handle" <- "skala_120.jpg"
        $"Skala Histogram fan2 temp" <- "skala_fan_temp.jpg"
        $"Skala Histogram Gas box" <- "skala_120.jpg"
        $"Skala Histogram fan3 temp" <- "skala_fan_temp.jpg"
        $"Skala Histogram fan2 power" <- "skala_fan_Puis.jpg"
        $"Skala Histogram fan power" <- "skala_fan_Puis.jpg"
        $"Device:" <- "No_Picture.jpg"
        $"Skala Histogram fan3 power" <- "skala_fan_Puis.jpg"
        $"URL-Grafik" <- "Rational_Logo.png"
        $"Skala Histogram fan3 minVolt" <- "skala_fan_voltage.jpg"
        $"Skala Histogram fan1 minVolt" <- "skala_fan_voltage.jpg"
        $"skala Histogram fan 3 rpm" <- "skala_fan_RPM.jpg"
        $"Skala Histogram Basis MMI Load" <- "skala_MMI.jpg"
        $"skala Magnetron top" <- "skala_120.jpg"
        $"Skala Histogram fan1 max Volt" <- "skala_fan_voltage.jpg"
        $"skala Histogram fan 1 rpm" <- "skala_fan_RPM.jpg"
        $"skala Power Supply top" <- "skala_120.jpg"
        $"Skala Histogram Basis MMI CPU" <- "skala_MMI.jpg"
        $"Skala Histogram fan2 minVolt" <- "skala_fan_voltage.jpg"
        $"skala Histogram fan 2 rpm" <- "skala_fan_RPM.jpg"
        $"skala Magnetron bottom" <- "skala_120.jpg"
        $"Skala Histogram MMI CPU" <- "skala_MMI.jpg"
        $"Skala Histogram fan2 maxVolt" <- "skala_fan_voltage.jpg"
        $"skala histogram Power Supply bottom" <- "skala_120.jpg"
        $"Skala Histogram MMI Load" <- "skala_MMI.jpg"
        $"Skala Histogram fan3 maxVolt" <- "skala_fan_voltage.jpg"
        Property Node(instance in=reference to "Tabs with errors", "Visible"=TRUE, error in=no error) -> (error out=w12, instance out=w13)
        Close Reference(error in=w12, reference=w13) -> (error out=w14)
        Property Node(instance in=reference to "Previous page", "Visible"=FALSE, error in=w14) -> (error out=w15, instance out=w16)
        Property Node(instance in=reference to "Next page", "Visible"=TRUE, error in=w15) -> (error out=w17, instance out=w18)
        Close Reference(error in=w17, reference=w18) -> (error out=w19)
        Close Reference(error in=w19, reference=w16) -> (error out=w20)
        Property Node(instance in=reference to "iVario 2", "Visible"=FALSE, error in=w20) -> (error out=w21, instance out=w22)
        Close Reference(error in=w21, reference=w22) -> (error out=w23)
        Property Node(instance in=reference to "Device", "Value"="iCombi Pro/iHexagon", error in=w23) -> (error out=w24, instance out=w25)
        Close Reference(error in=w24, reference=w25) -> (error out=w26)
        Property Node(instance in=reference to "String", "Visible"=FALSE, error in=w26) -> (error out=w27, instance out=w28)
        Close Reference(error in=w27, reference=w28) -> (error out=w29)
        Property Node(instance in=reference to "Page 1", "Visible"=TRUE, error in=w29) -> (error out=w30, instance out=w31)
        Property Node(instance in=reference to "Page 2", "Visible"=FALSE, error in=w30) -> (error out=w32, instance out=w33)
        Property Node(instance in=reference to "Page 3", "Visible"=FALSE, error in=w32) -> (error out=w34, instance out=w35)
        Property Node(instance in=reference to "Page 4", "Visible"=FALSE, error in=w34) -> (error out=w36, instance out=w37)
        Property Node(instance in=reference to "ivario", "Visible"=FALSE, error in=w36) -> (error out=w38, instance out=w39)
        Property Node(instance in=reference to "Page content", "Visible"=TRUE, error in=w38) -> (error out=w40, instance out=w41)
        Close Reference(error in=w40, reference=w31) -> (error out=w42)
        Close Reference(error in=w42, reference=w33) -> (error out=w43)
        Close Reference(error in=w43, reference=w35) -> (error out=w44)
        Close Reference(error in=w44, reference=w37) -> (error out=w45)
        Close Reference(error in=w45, reference=w39) -> (error out=w46)
        Close Reference(error in=w46, reference=w41) -> (error out=w2)
        w3 = w11
        w4 = s2
        w5 = s3
        w6 = s4
        w7 = s5
        w8 = s6
        w9 = s7
        w10 = s8
      }
      frame "Reset all" {
        case ($"wrong unit type") {
          frame True { }
          frame False {
            $"Device :" <- "No_Picture.jpg"
            $"Device:" <- "No_Picture.jpg"
            $common <- T1[] []
            $"common Information ivario" <- T1[] []
          }
        }
        $"Total Running Time :" <- T6[] []
        $"Software-Service-History_iCP" <- T14[] []
        $"Diagnostic Running Times Modes" <- T6[] []
        $"Software-Service-History_iVario" <- T14[] []
        $"System OnOff History iVario" <- T13[] []
        $"Total Running Time:" <- T6[] []
        $"System OnOff History" <- T13[] []
        $"System Logger Output" <- T7[] []
        $"Tabs with errors" <- ""
        $Checkbox <- FALSE
        $"Diagnostic Running Times Components:" <- T6[] []
        $"Diagnostic RT Calibration" <- T3[] []
        $"Histogram Basis RAM Load Percent" <- f64[] []
        w47 = "Wait For Interaction"  # State
        $"Diagnostic Running Times Comp" <- T6[] []
        $"Histogram Basis CPU Load Percent" <- f64[] []
        $Diagnostic_RT_Data_Sensors_Pressure <- T15[] []
        $"Histogram MMI RAM Load Percent" <- f64[] []
        $"Diagnostic-Service-History" <- T5[] []
        $"Basic Informations" <- T2[] []
        $"Histogram MMI CPU Load Percent" <- f64[] []
        $"Boards_Information:" <- T16[] []
        case ($Device) {
          frame "iCombi Pro/iHexagon", Default {
            for (N = 4) (iteration -> i1) {
              case (i1) {
                frame 0, Default {
                  Property Node(instance in=reference to "Page 1", "Value"=i1, "Visible"=TRUE, error in=no error) -> (error out=w49, instance out=w50)
                  Close Reference(error in=w49, reference=w50) -> (error out=w48)
                }
                frame 1 {
                  Property Node(instance in=reference to "Page 2", "Value"=i1, "Visible"=FALSE, error in=no error) -> (error out=w51, instance out=w52)
                  Close Reference(error in=w51, reference=w52) -> (error out=w48)
                }
                frame 2 {
                  Property Node(instance in=reference to "Page 3", "Value"=i1, "Visible"=FALSE, error in=no error) -> (error out=w53, instance out=w54)
                  Close Reference(error in=w53, reference=w54) -> (error out=w48)
                }
                frame 3 {
                  Property Node(instance in=reference to "Page 4", "Value"=i1, "Visible"=FALSE, error in=no error) -> (error out=w55, instance out=w56)
                  Close Reference(error in=w55, reference=w56) -> (error out=w48)
                }
              }
            }
          }
          frame "iVario" {
            Property Node(instance in=reference to "ivario", "Value"=0, error in=no error) -> (error out=w57, instance out=w58)
            Close Reference(error in=w57, reference=w58) -> (error out=w59)
            Property Node(instance in=reference to "iVario 2", "Visible"=FALSE, error in=w59) -> (error out=w60, instance out=w61)
            Close Reference(error in=w60, reference=w61) -> (error out=w48)
          }
        }
        Property Node(instance in=reference to "Previous page", "Visible"=FALSE, error in=w48) -> (error out=w62, instance out=w63)
        Property Node(instance in=reference to "Next page", "Visible"=TRUE, error in=w62) -> (error out=w64, instance out=w65)
        Close Reference(error in=w64, reference=w65) -> (error out=w66)
        Close Reference(error in=w66, reference=w63) -> (error out=w67)
        Property Node(instance in=reference to "Service report XML File Content:", "Value"="", error in=w67) -> (error out=w68, instance out=w69)
        Property Node(instance in=reference to "Service report XML File Content iVario:", "Value"="", error in=w68) -> (error out=w70, instance out=w71)
        Close Reference(error in=w70, reference=w69) -> (error out=w72)
        Close Reference(error in=w72, reference=w71) -> (error out=w2)
        $Diagnostic_Water_iCS_Switch <- T4[] []
        $Basic_Settings <- T2[] []
        $"Histogram fan 3 power profile W" <- f64[] []
        $"Board Information:" <- T16[] []
        $Diagnostic_RT_Data_Sensors <- T17[] []
        $"Diagnostic-Service-History_iVario" <- T5[] []
        $Diagnostic_RT_Data_Sensors_Heating <- T18[] []
        $"add BMK to common information iVario" <- FALSE
        $Diagnostic_RT_Data_Sensors_mouvement <- T19[] []
        $"add BMK to common information" <- FALSE
        $"Histogram fan 1 Voltage min_V_1phase_3phase" <- f64[] []
        $"Histogram fan 1 Voltage max_V_1phase_3phase" <- f64[] []
        $"Histogram fan 3 RPM profile 1 min" <- f64[] []
        $"Histogram fan 1 Temperature_profile Celsius" <- f64[] []
        $"Histogram fan 2 RPM profile 1 min" <- f64[] []
        $"Histogram fan 3 Voltage min_V_1phase_3phase" <- f64[] []
        $"Histogram fan 2 power profile W" <- f64[] []
        $"Histogram fan 1 power profile W" <- f64[] []
        $"Histogram fan 3 power profile W" <- f64[] []
        $common <- T1[] []
        $"Histogram gas box Temperature profile Celsius" <- f64[] []
        $"Histogram fan 3 Temperature_profile Celsius" <- f64[] []
        $"common Information ivario" <- T1[] []
        $"Histogram fan 1 RPM profile 1 min" <- f64[] []
        $"Histogram fan 2 Temperature_profile Celsius" <- f64[] []
        $"Histogram pump pcb Temperature profile Celsius" <- f64[] []
        $"Histogram cpu pcb Temperature profile Celsius" <- f64[] []
        $"Histogram fan 2 Voltage max_V_1phase_3phase" <- f64[] []
        $"Histogram LED handle side Temperature profile Celsius" <- f64[] []
        $"Component Replacement History" <- T12[] []
        $"Histogram IO Temperature profile Celsius" <- f64[] []
        $"Component Replacement History iVario" <- T12[] []
        $"Histogram LED hinge side Temperature profile Celsius" <- f64[] []
        w3 = w47
        w4 = s2
        w5 = s3
        w6 = s4
        w7 = s5
        w8 = s6
        w9 = s7
        w10 = s8
      }
      frame "Change Page" {
        case ($"Page selector") {
          frame "Page 1", Default {
            Property Node(instance in=reference to "Page 2", "Visible"=FALSE, error in=no error) -> (error out=w80, instance out=w74)
            Property Node(instance in=reference to "Page 1", "Visible"=TRUE, error in=w80) -> (error out=w81, instance out=w75)
            Property Node(instance in=reference to "Page 3", "Visible"=FALSE, error in=w81) -> (error out=w82, instance out=w76)
            Property Node(instance in=reference to "Page 4", "Visible"=FALSE, error in=w82) -> (instance out=w77)
            Property Node(instance in=reference to "Previous page", "Visible"=FALSE) -> (error out=w83, instance out=w78)
            Property Node(instance in=reference to "Next page", "Visible"=TRUE, error in=w83) -> (error out=w73, instance out=w79)
          }
          frame "Page 2" {
            Property Node(instance in=reference to "Page 2", "Visible"=TRUE, error in=no error) -> (error out=w84, instance out=w74)
            Property Node(instance in=reference to "Page 1", "Visible"=FALSE, error in=w84) -> (error out=w85, instance out=w75)
            Property Node(instance in=reference to "Page 3", "Visible"=FALSE, error in=w85) -> (error out=w86, instance out=w76)
            Property Node(instance in=reference to "Page 4", "Visible"=FALSE, error in=w86) -> (error out=w87, instance out=w77)
            Property Node(instance in=reference to "Previous page", "Visible"=TRUE, error in=w87) -> (error out=w88, instance out=w78)
            Property Node(instance in=reference to "Next page", "Visible"=TRUE, error in=w88) -> (error out=w73, instance out=w79)
          }
          frame "Page 3" {
            Property Node(instance in=reference to "Page 2", "Visible"=FALSE, error in=no error) -> (error out=w89, instance out=w74)
            Property Node(instance in=reference to "Page 1", "Visible"=FALSE, error in=w89) -> (error out=w90, instance out=w75)
            Property Node(instance in=reference to "Page 3", "Visible"=TRUE, error in=w90) -> (error out=w91, instance out=w76)
            Property Node(instance in=reference to "Page 4", "Visible"=FALSE, error in=w91) -> (error out=w92, instance out=w77)
            Property Node(instance in=reference to "Previous page", "Visible"=TRUE, error in=w92) -> (error out=w93, instance out=w78)
            Property Node(instance in=reference to "Next page", "Visible"=TRUE, error in=w93) -> (error out=w73, instance out=w79)
          }
          frame "Page 4" {
            Property Node(instance in=reference to "Page 2", "Visible"=FALSE, error in=no error) -> (error out=w94, instance out=w74)
            Property Node(instance in=reference to "Page 1", "Visible"=FALSE, error in=w94) -> (error out=w95, instance out=w75)
            Property Node(instance in=reference to "Page 3", "Visible"=FALSE, error in=w95) -> (error out=w96, instance out=w76)
            Property Node(instance in=reference to "Page 4", "Visible"=TRUE, error in=w96) -> (error out=w97, instance out=w77)
            Property Node(instance in=reference to "Previous page", "Visible"=TRUE, error in=w97) -> (error out=w98, instance out=w78)
            Property Node(instance in=reference to "Next page", "Visible"=FALSE, error in=w98) -> (error out=w73, instance out=w79)
          }
        }
        Close Reference(error in=w73, reference=w74) -> (error out=w99)
        Close Reference(error in=w99, reference=w75) -> (error out=w100)
        Close Reference(error in=w100, reference=w76) -> (error out=w101)
        Close Reference(error in=w101, reference=w77) -> (error out=w102)
        Close Reference(error in=w102, reference=w78) -> (error out=w103)
        Close Reference(error in=w103, reference=w79) -> (error out=w104)
        Property Node(instance in=reference to "Page selector iVario", "Visible"=FALSE, error in=w104) -> (error out=w105, instance out=w106)
        Close Reference(error in=w105, reference=w106) -> (error out=w2)
        w107 = "Wait For Interaction"  # State
        w3 = w107
        w4 = s2
        w5 = s3
        w6 = s4
        w7 = s5
        w8 = s6
        w9 = s7
        w10 = s8
      }
      frame "Change Device" {
        w108 = "Reset all"  # State
        $"Service report XML File Content:" <- ""
        $Error_Selektor <- "Relevant data"
        $"Service report XML File Content iVario:" <- ""
        $"Tabs with errors" <- ""
        case ($Device) {
          frame "iCombi Pro/iHexagon", Default {
            Property Node(instance in=reference to "Page content", "Visible"=TRUE, error in=no error) -> (error out=w119, instance out=w116)
            Property Node(instance in=reference to "Page selector", "Visible"=TRUE, "Value"="Page 1", error in=w119) -> (error out=w120, instance out=w115)
            Property Node(instance in=reference to "ivario", "Visible"=FALSE, error in=w120) -> (error out=w121, instance out=w114)
            Property Node(instance in=reference to "Page 2", "Visible"=FALSE, error in=w121) -> (error out=w122, instance out=w110)
            Property Node(instance in=reference to "Page 1", "Visible"=TRUE, error in=w122) -> (error out=w123, instance out=w111)
            Property Node(instance in=reference to "Page 3", "Visible"=FALSE, error in=w123) -> (error out=w124, instance out=w112)
            Property Node(instance in=reference to "Page 4", "Visible"=FALSE, error in=w124) -> (error out=w125, instance out=w113)
            Property Node(instance in=reference to "Page selector iVario", "Visible"=FALSE, error in=w125) -> (error out=w126, instance out=w117)
            Property Node(instance in=reference to "iVario 2", "Visible"=FALSE, "Value"=0, error in=w126) -> (error out=w109, instance out=w118)
          }
          frame "iVario" {
            Property Node(instance in=reference to "Page content", "Visible"=TRUE, error in=no error) -> (error out=w127, instance out=w116)
            Property Node(instance in=reference to "Page selector", "Visible"=FALSE, error in=w127) -> (error out=w128, instance out=w115)
            Property Node(instance in=reference to "ivario", "Visible"=TRUE, error in=w128) -> (error out=w129, instance out=w114)
            Property Node(instance in=reference to "Page 2", "Visible"=FALSE, error in=w129) -> (error out=w130, instance out=w110)
            Property Node(instance in=reference to "Page 1", "Visible"=FALSE, error in=w130) -> (error out=w131, instance out=w111)
            Property Node(instance in=reference to "Page 3", "Visible"=FALSE, error in=w131) -> (error out=w132, instance out=w112)
            Property Node(instance in=reference to "Page 4", "Visible"=FALSE, error in=w132) -> (error out=w133, instance out=w113)
            Property Node(instance in=reference to "Page selector iVario", "Visible"=TRUE, error in=w133) -> (error out=w134, instance out=w117)
            Property Node(instance in=reference to "iVario 2", "Visible"=FALSE, "Value"=0, error in=w134) -> (error out=w109, instance out=w118)
          }
        }
        Close Reference(error in=w109, reference=w110) -> (error out=w135)
        Close Reference(error in=w135, reference=w111) -> (error out=w136)
        Close Reference(error in=w136, reference=w112) -> (error out=w137)
        Close Reference(error in=w137, reference=w113) -> (error out=w138)
        Close Reference(error in=w138, reference=w114) -> (error out=w139)
        Close Reference(error in=w139, reference=w117) -> (error out=w140)
        Close Reference(error in=w140, reference=w115) -> (error out=w141)
        Close Reference(error in=w141, reference=w116) -> (error out=w142)
        Close Reference(error in=w142, reference=w118) -> (error out=w143)
        Property Node(instance in=reference to "Next page", "Visible"=TRUE, error in=w143) -> (error out=w144, instance out=w145)
        Close Reference(error in=w144, reference=w145) -> (error out=w146)
        Property Node(instance in=reference to "Previous page", "Visible"=FALSE, error in=w146) -> (error out=w147, instance out=w148)
        Close Reference(error in=w147, reference=w148) -> (error out=w2)
        w3 = w108
        w4 = s2
        w5 = s3
        w6 = s4
        w7 = s5
        w8 = s6
        w9 = s7
        w10 = s8
      }
      frame "Read Ini File" {
        w149 = "Wait For Interaction"  # State
        call "GET.gvi"(url="Config_XML_Datainterpreter.ini", error in=no error) -> (body=w150, error out=w151)
        call "Function.gvi"(string in=w150, Error Cluster Constant=w151) -> (Output=w5, Output_error=w2)
        w3 = w149
        w4 = s2
        w6 = s4
        w7 = s5
        w8 = s6
        w9 = s7
        w10 = s8
      }
      frame "Read XML File" {
        call "Read File Text.gvi"(allowed file types=[".xml"], error in=no error) -> (file content=w152, file name=w153, error out=w154)
        case (w154) {
          frame Error, Default {
            w155 = "Wait For Interaction"  # State
            call "Clear Error Cluster.gvi"(error in=w154) -> (error out=w2)
            w3 = w155
            w4 = ""
          }
          frame No Error {
            call "Clear Error Cluster.gvi"(error in=w154) -> (error out=w156)
            case ($Device) {
              frame "iVario" {
                call "Check_XML_Device.gviweb"(XML Name=w153, Error Input=w156, XML Content=w152, First Check="Pan", Second Check="Potentiometer", Sous-Fix="RAT") -> (Error Output=w157, XML fine ?=w158)
                case (w158) {
                  frame False, Default {
                    $"wrong unit type" <- FALSE
                    w159 = "Reset all"  # State
                    call "Check_XML_Device.gviweb"(XML Name=w153, Error Input=w157, XML Content=w152, First Check="Histogram", Second Check="CalibN1", Sous-Fix="RAG") -> (Error Output=w2, XML fine ?=w160)
                    case (w160) {
                      frame False, Default {
                        w161 = "The service report is invalid, please check the XML file you have opened"
                        One Button Dialog(message=w161)
                      }
                      frame True {
                        w162 = "Please select iCombi as device and reload the selected Service Report XML file !"
                        One Button Dialog(message=w162)
                      }
                    }
                    w3 = w159
                  }
                  frame True {
                    w163 = "Common Information iVario"  # State
                    w3 = w163
                    w2 = w157
                  }
                }
              }
              frame "iCombi Pro/iHexagon", Default {
                call "Check_XML_Device.gviweb"(XML Name=w153, Error Input=w156, XML Content=w152, First Check="Histogram", Second Check="CalibN1", Sous-Fix="RAG") -> (Error Output=w164, XML fine ?=w165)
                case (w165) {
                  frame False, Default {
                    $"wrong unit type" <- FALSE
                    w166 = "Reset all"  # State
                    call "Check_XML_Device.gviweb"(XML Name=w153, Error Input=w164, XML Content=w152, First Check="Pan", Second Check="Potentiometer", Sous-Fix="RAT") -> (Error Output=w2, XML fine ?=w167)
                    case (w167) {
                      frame False, Default {
                        w168 = "The service report is invalid, please check the XML file you have opened"
                        One Button Dialog(message=w168)
                      }
                      frame True {
                        w169 = "Please select iVario as device and reload the selected Service Report XML file !"
                        One Button Dialog(message=w169)
                      }
                    }
                    w3 = w166
                  }
                  frame True {
                    w170 = "Common Information"  # State
                    w3 = w170
                    w2 = w164
                  }
                }
              }
            }
            $"Service report XML File Content:" <- w152
            $"Service report XML File Content iVario:" <- w152
            w4 = w152
          }
        }
        w5 = s3
        w6 = s4
        w7 = s5
        w8 = s6
        w9 = s7
        w10 = s8
      }
      frame "Wait For Interaction" {
        event {
          on "Analyse" Value changed {
            w171 = "Read XML File"  # State
            w2 = no error
            w3 = w171
            w10 = default
          }
          on "Error_Selektor" Value changed {
            case ($Device) {
              frame "iVario" {
                case ($"iCombi Pro device") {
                  frame True {
                    w3 = "Wait For Interaction"
                  }
                  frame False {
                    w3 = "Common Information iVario"
                  }
                }
              }
              frame "iCombi Pro/iHexagon", Default {
                case ($"iCombi Pro device") {
                  frame False, Default {
                    w3 = "Wait For Interaction"
                  }
                  frame True {
                    w172 = "Common Information"  # State
                    w3 = w172
                  }
                }
              }
            }
            w2 = no error
            w10 = default
          }
          on "Page selector" Value changed {
            w173 = "Change Page"  # State
            w2 = no error
            w3 = w173
            w10 = default
          }
          on "Device" Value changed {
            w174 = "Change Device"  # State
            w2 = no error
            w3 = w174
            w10 = default
          }
          on "Info_Plot" Value changed {
            w175 = "Wait For Interaction"  # State
            Event Data() -> ("New Value"=w176)
            case (w176) {
              frame False, Default {
                Property Node(instance in=reference to "String", "Visible"=FALSE, error in=no error) -> (error out=w177, instance out=w178)
              }
              frame True {
                Property Node(instance in=reference to "String", "Visible"=TRUE, error in=no error) -> (error out=w177, instance out=w178)
                w179 = "Press the drop down menu under \"Plot\" \nand change the graph settings as desired."
                $String <- w179
              }
            }
            Close Reference(error in=w177, reference=w178) -> (error out=w2)
            w3 = w175
            w10 = default
          }
          on "Page content" Value changed {
            w180 = "Wait For Interaction"  # State
            case ($Device) {
              frame "iVario" {
                w182 = """Page contents:

Page 1: 
- Common Information.
- Basic Settings.
- Diagnostic RT Data Sensors Heating.
- Diagnostic RT Data Sensors Movement.
- Diagnostic RT Data Sensors Pressure.
- Diagnostic Service History.
- Diagnostic RunningTimes.
- Software Version History.

Page 2: 
- System OnOff History.
- Component Replacement History.
- Service Report Content.
"""
                w181 = w182
              }
              frame "iCombi Pro/iHexagon", Default {
                w183 = """Page contents:

Page 1: 
- Common Information.
- Basic Settings.
- Diagnostic Real Time Data Sensors.
- Diagnostic RT Calibration.
- Diagnostic Water iCS Switch.
- Diagnostic Service History.
- Diagnostic RunningTimes Components.
- Software Version History.

Page 2: 
- Histogram temperature CPU & IO.
- Diagnostic RunningTimes Modes.
- System Logger, Histogram temperature LEDs.
- Histogram temperature pump pcb & Gas box.
- Histogram temperature pump pcb & Histogram Fan 1 RPM & Power.
- Component Replacement History.

Page 3: 
- Histogram Fan1 Temp.&Voltages.
- Histogram Fan 2 RPM & Power.
- Histogram Fan2 Temp.&Voltages.
- Histogram Fan 3 RPM & Power.
- Histogram Fan3 Temp.&Voltages.
- Histogram MMI.
- System OnOff History.
     
Page 4: 
- Histogram Basis CPU & RAM Load, 
- Histogram Magnetron Temperature (iHexagon) & Power.
- Histogram Power Supply Temperature (iHexagon).
- Service report XML File Content."""
                w181 = w183
              }
            }
            One Button Dialog(message=w181)
            w2 = default
            w3 = w180
            w10 = default
          }
          on "Sort table ivario" Value changed {
            w184 = "Wait For Interaction"  # State
            Event Data() -> ("Old Value"=w185)
            Not(x=w185) -> w186
            call "Sort_Service_History_event.gviweb"(Diagnostic Service History input=$"Diagnostic-Service-History_iVario", Event=w186, Error Cluster input=no error) -> (Diagnostic Service History output=w187, Error Output=w2)
            $"Diagnostic-Service-History_iVario" <- w187
            w3 = w184
            w10 = default
          }
          on "Sort table iCombi" Value changed {
            w188 = "Wait For Interaction"  # State
            Event Data() -> ("Old Value"=w189)
            Not(x=w189) -> w190
            call "Sort_Service_History_event.gviweb"(Diagnostic Service History input=$"Diagnostic-Service-History", Event=w190, Error Cluster input=no error) -> (Diagnostic Service History output=w191, Error Output=w2)
            $"Diagnostic-Service-History" <- w191
            w3 = w188
            w10 = default
          }
          on "Next page" Value changed {
            Event Data() -> ("New Value"=w192)
            case ($Device) {
              frame "iCombi Pro/iHexagon", Default {
                w193 = "Change Page"  # State
                case (w192) {
                  frame False, Default {
                    w10 = s8
                    w2 = no error
                  }
                  frame True {
                    Increment(x=s8) -> w194
                    Is Less Or Equal(x=w194, y=3) -> w195
                    case (w195) {
                      frame False, Default {
                        w10 = 3
                        w2 = no error
                      }
                      frame True {
                        Property Node(instance in=reference to "Page selector", "Value"=w194, error in=no error) -> (error out=w196, instance out=w197)
                        Close Reference(error in=w196, reference=w197) -> (error out=w2)
                        w10 = w194
                      }
                    }
                  }
                }
                w3 = w193
              }
              frame "iVario" {
                case (w192) {
                  frame False, Default {
                    w10 = s8
                    w2 = no error
                  }
                  frame True {
                    Increment(x=s8) -> w198
                    Is Less Or Equal(x=w198, y=1) -> w199
                    case (w199) {
                      frame False, Default {
                        w10 = 1
                        w2 = no error
                      }
                      frame True {
                        Property Node(instance in=reference to "Page selector iVario", "Value"=w198, error in=no error) -> (error out=w200, instance out=w201)
                        Close Reference(error in=w200, reference=w201) -> (error out=w2)
                        w10 = w198
                      }
                    }
                  }
                }
                w3 = "Change Page iVario"
              }
            }
          }
          on "Previous page" Value changed {
            Event Data() -> ("New Value"=w202)
            case ($Device) {
              frame "iVario" {
                case (w202) {
                  frame False, Default {
                    w10 = s8
                    w2 = no error
                  }
                  frame True {
                    Decrement(x=s8) -> w203
                    Is Less Or Equal(x=w203, y=3) -> w204
                    case (w204) {
                      frame False, Default {
                        w10 = 3
                        w2 = no error
                      }
                      frame True {
                        Property Node(instance in=reference to "Page selector iVario", "Value"=w203, error in=no error) -> (error out=w205, instance out=w206)
                        Close Reference(error in=w205, reference=w206) -> (error out=w2)
                        w10 = w203
                      }
                    }
                  }
                }
                w3 = "Change Page iVario"
              }
              frame "iCombi Pro/iHexagon", Default {
                w207 = "Change Page"  # State
                case (w202) {
                  frame False, Default {
                    w10 = s8
                    w2 = no error
                  }
                  frame True {
                    Decrement(x=s8) -> w208
                    Is Less Or Equal(x=w208, y=3) -> w209
                    case (w209) {
                      frame False, Default {
                        w10 = 3
                        w2 = no error
                      }
                      frame True {
                        Property Node(instance in=reference to "Page selector", "Value"=w208, error in=no error) -> (error out=w210, instance out=w211)
                        Close Reference(error in=w210, reference=w211) -> (error out=w2)
                        w10 = w208
                      }
                    }
                  }
                }
                w3 = w207
              }
            }
          }
          on "Page selector iVario" Value changed {
            w2 = default
            w3 = "Change Page iVario"
            w10 = default
          }
        }
        $"add BMK to common information" <- FALSE
        w4 = s2
        w5 = s3
        w6 = s4
        w7 = s5
        w8 = s6
        w9 = s7
      }
      frame "Common Information" {
        call "Read_XML_Part.gviweb"(Input XML=s2, Start XML Part="<Common_Information>", End XML Part="</Common_Information>", Error in=no error) -> (Output XML array=w212, Error out=w213)
        call "Exlude_WA_Entrys.gviweb"(Input XML array=w212, Error in=w213) -> (Without_WA_Entrys=w214, Output Error=w215)
        call "Interpret_Common_Information.gviweb"(Common Information Entrys=w214, Language Entrys=s3, BMKs=$"Changed Component", Error Cluster Constant=w215) -> (Startup Date and Time=w8, Device:=w216, common=w217, Boards Informations:=w218, Output Error=w219, Auto Dose=w9, Unit-type=w6)
        case (w216) {
          frame "No_Analyse.png" {
            $"wrong unit type" <- TRUE
            w220 = "Reset all"  # State
            $"Page selector" <- "Page 1"
            $"Page 1" <- 0
            w3 = w220
          }
          frame "False", Default {
            case ($"add BMK to common information") {
              frame True {
                w221 = "Update Tab View"  # State
                w3 = w221
              }
              frame False {
                w222 = "Basic Settings"  # State
                w3 = w222
              }
            }
          }
        }
        $"Device:" <- w216
        $"Board Information:" <- w218
        call "Sort_Common_Infomation.gviweb"(Error_Selektor=$Error_Selektor, Common Information=w217, Input Error=w219) -> (Output=w223, Common Information_Error=w224, Output Error=w2)
        $common <- w223
        $"Common Information_Error" <- w224
        w4 = s2
        w5 = s3
        w7 = s5
        w10 = s8
      }
      frame "Common Information iVario" {
        call "Read_XML_Part.gviweb"(Input XML=s2, Start XML Part="<Common_Information>", End XML Part="</Common_Information>", Error in=no error) -> (Output XML array=w225, Error out=w226)
        call "Exlude_WA_Entrys.gviweb"(Input XML array=w225, Error in=w226) -> (Without_WA_Entrys=w227, Output Error=w228)
        call "Interpret_Common_Information_iVario.gviweb"(Common Information Entrys=w227, Language Entrys=s3, BMKs=$"Changed Component iVario", Error Cluster Constant=w228) -> (Device:=w229, common=w230, Boards Informations:=w231, Output Error=w232, Unit-type=w6)
        case (w229) {
          frame "False", Default {
            case ($"add BMK to common information iVario") {
              frame True {
                w3 = "Update Tab View"
              }
              frame False {
                w233 = "Basic Settings iVario"  # State
                w3 = w233
              }
            }
          }
          frame "No_Analyse.png" {
            $"wrong unit type" <- TRUE
            w234 = "Reset all"  # State
            w3 = w234
          }
        }
        $"Device :" <- w229
        $"Boards_Information:" <- w231
        call "Sort_Common_Infomation_iVario.gviweb"(Error_Selektor=$Error_Selektor, Common Information=w230, Input Error=w232) -> (Output=w235, Common Information_Error=w236, Output Error=w2)
        $"common Information ivario" <- w235
        $"Common Information_Error_iVario" <- w236
        w4 = s2
        w5 = s3
        w7 = s5
        w8 = s6
        w9 = s7
        w10 = s8
      }
      frame "Basic Settings" {
        w237 = "Diagnostic RT Data Sensors"  # State
        call "Read_XML_Part.gviweb"(Input XML=s2, Start XML Part="<Basic_Settings>", End XML Part="</Basic_Settings>", Error in=no error) -> (Output XML array=w238, Error out=w239)
        call "Exlude_WA_Entrys.gviweb"(Input XML array=w238, Error in=w239) -> (Without_WA_Entrys=w240, Output Error=w241)
        call "Interpret_Basic_Settings.gviweb"(Basic Settings Entrys=w240, Config File infos=s3, Device Type=s4, Error input=w241) -> (Basic Informations=w242, Output Error=w243)
        call "Sort_Basic_Settings.gviweb"(Error_Selektor=$Error_Selektor, Basic Settings=w242, Input Error=w243) -> (Output Basic Settings=w244, Basic_Settings_Error=w245, Output Error=w2)
        $Basic_Settings <- w244
        $"add BMK to common information" <- FALSE
        $Basic_Settings_Error <- w245
        w3 = w237
        w4 = s2
        w5 = s3
        w6 = s4
        w7 = s5
        w8 = s6
        w9 = s7
        w10 = s8
      }
      frame "Basic Settings iVario" {
        w246 = "Diagnostic RT Data Sensors Heating iVario"  # State
        call "Read_XML_Part.gviweb"(Input XML=s2, Start XML Part="<Basic_Settings>", End XML Part="</Basic_Settings>", Error in=no error) -> (Output XML array=w247, Error out=w248)
        call "Exlude_WA_Entrys.gviweb"(Input XML array=w247, Error in=w248) -> (Without_WA_Entrys=w249, Output Error=w250)
        call "Exclude_iVario_Entry.gviweb"(Input XML array=w249, Excluded_Entry="Power_State_WA82", Error in=w250) -> (Without_WA_Entrys=w251, Output Error=w252)
        call "Interpret_Basic_Settings_iVario.gviweb"(Basic Settings Entrys=w251, Device Type=s4, Error input=w252) -> (Basic Informations=w253, Output Error=w254)
        call "Sort_Basic_Settings_iVario.gviweb"(Error_Selektor=$Error_Selektor, Basic Settings=w253, Input Error=w254) -> (Output Basic Settings=w255, Basic_Settings_Error=w256, Output Error=w2)
        $"Basic Informations" <- w255
        $Basic_Settings_Error_iVario <- w256
        $"add BMK to common information iVario" <- FALSE
        w3 = w246
        w4 = s2
        w5 = s3
        w6 = s4
        w7 = s5
        w8 = s6
        w9 = s7
        w10 = s8
      }
      frame "Change Page iVario" {
        case ($"Page selector iVario") {
          frame "Page 2" {
            Property Node(instance in=reference to "ivario", "Visible"=FALSE, error in=no error) -> (error out=w262, instance out=w259)
            Property Node(instance in=reference to "iVario 2", "Visible"=TRUE, error in=w262) -> (error out=w263, instance out=w258)
            Property Node(instance in=reference to "Next page", "Visible"=FALSE, error in=w263) -> (error out=w264, instance out=w261)
            Property Node(instance in=reference to "Previous page", "Visible"=TRUE, error in=w264) -> (error out=w257, instance out=w260)
          }
          frame "Page 1", Default {
            Property Node(instance in=reference to "ivario", "Visible"=TRUE, error in=no error) -> (error out=w265, instance out=w259)
            Property Node(instance in=reference to "iVario 2", "Visible"=FALSE, error in=w265) -> (error out=w266, instance out=w258)
            Property Node(instance in=reference to "Next page", "Visible"=TRUE, error in=w266) -> (error out=w267, instance out=w261)
            Property Node(instance in=reference to "Previous page", "Visible"=FALSE, error in=w267) -> (error out=w257, instance out=w260)
          }
        }
        Close Reference(error in=w257, reference=w259) -> (error out=w268)
        Close Reference(error in=w268, reference=w258) -> (error out=w269)
        Property Node(instance in=reference to "Page selector", "Visible"=FALSE, error in=w269) -> (error out=w270, instance out=w271)
        Close Reference(error in=w270, reference=w271) -> (error out=w272)
        Close Reference(error in=w272, reference=w261) -> (error out=w273)
        Close Reference(error in=w273, reference=w260) -> (error out=w2)
        w274 = "Wait For Interaction"  # State
        w3 = w274
        w4 = s2
        w5 = s3
        w6 = s4
        w7 = s5
        w8 = s6
        w9 = s7
        w10 = s8
      }
      frame "Diagnostic RT Data Sensors" {
        w275 = "DIagnostic RT Calibration"  # State
        call "Read_XML_Part.gviweb"(Input XML=s2, Start XML Part="<Diagnostic_RT_Data_Sensors>", End XML Part="</Diagnostic_RT_Data_Sensors>", Error in=no error) -> (Output XML array=w276, Error out=w277)
        call "Exlude_WA_Entrys.gviweb"(Input XML array=w276, Error in=w277) -> (Without_WA_Entrys=w278, Output Error=w279)
        # s7: Auto Dose Available
        call "Interpret_Diagnostic_RT_Data_Sensors.gviweb"(Diagnostic Settings Entrys=w278, Config File infos=s3, Device Type=s4, Error input=w279, Auto Dose=s7) -> (Diagnostic_RT_Data_Sensors=w280, Output Error=w281)
        call "Sort_Diagnostic_Real_Time_Data_Sensors.gviweb"(Error_Selektor=$Error_Selektor, Diagnostic_RT_Data_Sensors=w280, Input Error=w281) -> (Output=w282, Diagnostic Real Time Data Sensors=w283, Output Error=w2)
        $Diagnostic_RT_Data_Sensors <- w282
        $"Diagnostic Real Time Data Sensors" <- w283
        w3 = w275
        w4 = s2
        w5 = s3
        w6 = s4
        w7 = s5
        w8 = s6
        w9 = s7
        w10 = s8
      }
      frame "Diagnostic RT Data Sensors Heating iVario" {
        w284 = "Diagnostic RT Data Sensors Movement iVario"  # State
        call "Read_XML_Part.gviweb"(Input XML=s2, Start XML Part="<Diagnostic_RT_Data_Sensors_Heating>", End XML Part="</Diagnostic_RT_Data_Sensors_Heating>", Error in=no error) -> (Output XML array=w285, Error out=w286)
        Array Size(array=w285) -> (size(s)=w287)
        Is Greater Than 0(x=w287) -> w288
        case (w288) {
          frame False, Default {
            call "Read_XML_Part.gviweb"(Input XML=s2, Start XML Part="<Diagnostic_RT_Data_Sensors_(Heating)>", End XML Part="</Diagnostic_RT_Data_Sensors_(Heating)>", Error in=w286) -> (Output XML array=w290, Error out=w289)
          }
          frame True {
            w289 = w286
            w290 = w285
          }
        }
        call "Exlude_WA_Entrys.gviweb"(Input XML array=w290, Error in=w289) -> (Without_WA_Entrys=w291, Output Error=w292)
        call "Interpret_Diagnostic_RT_Data_Sensors_Heating.gviweb"(Diagnostic Settings Entrys=w291, Device Type=s4, Error input=w292) -> (Output=w293, Output Error=w294)
        call "Sort_Diagnostic_RT_Data_Sensors_Heating.gviweb"(Error_Selektor=$Error_Selektor, Diagnostic Water iCS Switch Output=w293, Input Error=w294) -> (Output=w295, Diagnostic Water iCS Switch=w296, Output Error=w2)
        $Diagnostic_RT_Data_Sensors_Heating <- w295
        $"Diagnostic RT Data Sensors Heating" <- w296
        w3 = w284
        w4 = s2
        w5 = s3
        w6 = s4
        w7 = s5
        w8 = s6
        w9 = s7
        w10 = s8
      }
      frame "Diagnostic RT Data Sensors Movement iVario" {
        w297 = "Diagnostic RT Data Sensors Pressure"  # State
        call "Read_XML_Part.gviweb"(Input XML=s2, Start XML Part="<Diagnostic_RT_Data_Sensors_Movement>", End XML Part="</Diagnostic_RT_Data_Sensors_Movement>", Error in=no error) -> (Output XML array=w298, Error out=w299)
        Array Size(array=w298) -> (size(s)=w300)
        Is Greater Than 0(x=w300) -> w301
        case (w301) {
          frame False, Default {
            call "Read_XML_Part.gviweb"(Input XML=s2, Start XML Part="<Diagnostic_RT_Data_Sensors_(Movement)>", End XML Part="</Diagnostic_RT_Data_Sensors_(Movement)>", Error in=w299) -> (Output XML array=w303, Error out=w302)
          }
          frame True {
            w302 = w299
            w303 = w298
          }
        }
        call "Exlude_WA_Entrys.gviweb"(Input XML array=w303, Error in=w302) -> (Without_WA_Entrys=w304, Output Error=w305)
        call "Interpret_Diagnostic_RT_Data_Sensors_Movement.gviweb"(Diagnostic Settings mouvement Entrys=w304, Device Type=s4, Error input=w305) -> (Output mouvement=w306, Output Error=w307)
        call "Sort_Diagnostic_RT_Data_Sensors_Movement.gviweb"(Error_Selektor=$Error_Selektor, Output mouvement=w306, Input Error=w307) -> (Output=w308, Diagnostic RT Data sensors movement text=w309, Output Error=w2)
        $Diagnostic_RT_Data_Sensors_mouvement <- w308
        $"Diagnostic RT Data sensors movement" <- w309
        w3 = w297
        w4 = s2
        w5 = s3
        w6 = s4
        w7 = s5
        w8 = s6
        w9 = s7
        w10 = s8
      }
      frame "Diagnostic RT Data Sensors Pressure" {
        w310 = "Diagnostic Service History iVario"  # State
        call "Read_XML_Part.gviweb"(Input XML=s2, Start XML Part="<Diagnostic_RT_Data_Sensors_Pressure>", End XML Part="</Diagnostic_RT_Data_Sensors_Pressure>", Error in=no error) -> (Output XML array=w311, Error out=w312)
        Array Size(array=w311) -> (size(s)=w313)
        Is Greater Than 0(x=w313) -> w314
        case (w314) {
          frame False, Default {
            call "Read_XML_Part.gviweb"(Input XML=s2, Start XML Part="<Diagnostic_RT_Data_Sensors_(Pressure)>", End XML Part="</Diagnostic_RT_Data_Sensors_(Pressure)>", Error in=w312) -> (Output XML array=w316, Error out=w315)
          }
          frame True {
            w315 = w312
            w316 = w311
          }
        }
        call "Exlude_WA_Entrys.gviweb"(Input XML array=w316, Error in=w315) -> (Without_WA_Entrys=w317, Output Error=w318)
        call "Interpret_Diagnostic_RT_Data_Sensors_Pressure.gviweb"(Pressure Entrys=w317, Device Type=s4, Error input=w318) -> (Output Pressure=w319, Output Error=w320)
        call "Sort_Diagnostic_RT_Data_Sensors_Pressure.gviweb"(Error_Selektor=$Error_Selektor, Diagnostic Water iCS Switch Output=w319, Input Error=w320) -> (Output=w321, Diagnostic Water iCS Switch=w322, Output Error=w2)
        $Diagnostic_RT_Data_Sensors_Pressure <- w321
        $Diagnostic_RT_Data_Sensors_Pressure_error <- w322
        w3 = w310
        w4 = s2
        w5 = s3
        w6 = s4
        w7 = s5
        w8 = s6
        w9 = s7
        w10 = s8
      }
      frame "DIagnostic RT Calibration" {
        w323 = "Diagnostic Water iCS Switch"  # State
        call "Read_XML_Part.gviweb"(Input XML=s2, Start XML Part="<Diagnostic_RT_Calibration>", End XML Part="</Diagnostic_RT_Calibration>", Error in=no error) -> (Output XML array=w324, Error out=w325)
        call "Exlude_WA_Entrys.gviweb"(Input XML array=w324, Error in=w325) -> (Without_WA_Entrys=w326, Output Error=w327)
        call "Interpret_Diagnostic_RT_Calibration.gviweb"(Diagnostic RT Calibration Entrys=w326, Error Cluster Constant=w327) -> (Diagnostic RT Calibration=w328, Calibrated=w329, Output Error=w330)
        $Checkbox <- w329
        call "Sort_Diagnostic_RT_Calibration.gviweb"(Error_Selektor=$Error_Selektor, Diagnostic RT Calibration=w328, Input Error=w330) -> (Output=w331, Diagnostic Real Time Data Sensors=w332, Output Error=w2)
        $"Diagnostic RT Calibration" <- w331
        $"Diagnostic RT Calibration_Text" <- w332
        w3 = w323
        w4 = s2
        w5 = s3
        w6 = s4
        w7 = s5
        w8 = s6
        w9 = s7
        w10 = s8
      }
      frame "Diagnostic Water iCS Switch" {
        w333 = "Diagnostic Service History"  # State
        call "Read_XML_Part.gviweb"(Input XML=s2, Start XML Part="<Diagnostic_Water_iCS_Switch>", End XML Part="</Diagnostic_Water_iCS_Switch>", Error in=no error) -> (Output XML array=w334, Error out=w335)
        call "Exlude_WA_Entrys.gviweb"(Input XML array=w334, Error in=w335) -> (Without_WA_Entrys=w336, Output Error=w337)
        call "Interpret_Diagnostic_Water_iCS_Switch.gviweb"(Diagnostic Water iCS Switch Entrys=w336, Device Type=s4, Error Cluster input=w337, Auto Dose=s7) -> (Diagnostic Water iCS Switch Output=w338, Output_Error=w339)
        call "Sort_Diagnostic_Water_iCs_Switch.gviweb"(Error_Selektor=$Error_Selektor, Diagnostic Water iCS Switch Output=w338, Input Error=w339) -> (Output=w340, Diagnostic Water iCS Switch=w341, Output Error=w2)
        $Diagnostic_Water_iCS_Switch <- w340
        $"Diagnostic Water iCS Switch Text" <- w341
        w3 = w333
        w4 = s2
        w5 = s3
        w6 = s4
        w7 = s5
        w8 = s6
        w9 = s7
        w10 = s8
      }
      frame "Diagnostic Service History" {
        w342 = "Diagnostic Running Times Modes"  # State
        call "Read_XML_Part.gviweb"(Input XML=s2, Start XML Part="<Diagnostic-Service-History>", End XML Part="</Diagnostic-Service-History>", Error in=no error) -> (Output XML array=w343, Error out=w344)
        call "Exlude_WA_Entrys.gviweb"(Input XML array=w343, Error in=w344) -> (Without_WA_Entrys=w345, Output Error=w346)
        call "Diagnostic_Service_History.gviweb"(Diagnostic Service History Entrys=w345, Device Type=s2, Error Cluster input=w346) -> (Diagnostic Service History Output=w347, Error Output=w348)
        call "Sort_Diagnostic_Service_History.gviweb"(Error_Selektor=$Error_Selektor, Diagnostic Service History Output=w347, Input Error=w348) -> (Output=w349, Diagnostic Service History Text=w350, Output Error=w2)
        $"Diagnostic-Service-History" <- w349
        $"Diagnostic Service History Text" <- w350
        w3 = w342
        w4 = s2
        w5 = s3
        w6 = s4
        w7 = s5
        w8 = s6
        w9 = s7
        w10 = s8
      }
      frame "Software Version History" {
        w351 = "Component Replacement History iCombi"  # State
        call "Read_XML_Part.gviweb"(Input XML=s2, Start XML Part="<Software-Version-History>", End XML Part="</Software-Version-History>", Error in=no error) -> (Output XML array=w352, Error out=w353)
        call "Exlude_WA_Entrys.gviweb"(Input XML array=w352, Error in=w353) -> (Without_WA_Entrys=w354, Output Error=w355)
        call "Interpret_Software_Version_History.gviweb"(Diagnostic Service History Entrys=w354, Error Cluster input=w355) -> (Software Version History=w356, Error Output=w2)
        $"Software-Service-History_iCP" <- w356
        w3 = w351
        w4 = s2
        w5 = s3
        w6 = s4
        w7 = s5
        w8 = s6
        w9 = s7
        w10 = s8
      }
      frame "System OnOff History" {
        w357 = "Common Information"  # State
        call "Read_XML_Part.gviweb"(Input XML=s2, Start XML Part="<System-OnOff-History>", End XML Part="</System-OnOff-History>", Error in=no error) -> (Output XML array=w358, Error out=w359)
        call "Exlude_WA_Entrys.gviweb"(Input XML array=w358, Error in=w359) -> (Without_WA_Entrys=w360, Output Error=w361)
        call "Interpret_System_OnOff_History.gviweb"(System OnOff History Entrys=w360, Error Cluster input=w361) -> (System OnOff History output=w362, Error Output=w2)
        $"System OnOff History" <- w362
        w3 = w357
        w4 = s2
        w5 = s3
        w6 = s4
        w7 = s5
        w8 = s6
        w9 = s7
        w10 = s8
      }
      frame "System OnOff History iVario" {
        w363 = "Common Information iVario"  # State
        call "Read_XML_Part.gviweb"(Input XML=s2, Start XML Part="<System-OnOff-History>", End XML Part="</System-OnOff-History>", Error in=no error) -> (Output XML array=w364, Error out=w365)
        call "Exlude_WA_Entrys.gviweb"(Input XML array=w364, Error in=w365) -> (Without_WA_Entrys=w366, Output Error=w367)
        call "Interpret_System_OnOff_History.gviweb"(System OnOff History Entrys=w366, Error Cluster input=w367) -> (System OnOff History output=w368, Error Output=w2)
        $"System OnOff History iVario" <- w368
        w3 = w363
        w4 = s2
        w5 = s3
        w6 = s4
        w7 = s5
        w8 = s6
        w9 = s7
        w10 = s8
      }
      frame "Component Replacement History iCombi" {
        w369 = "System OnOff History"  # State
        $"iCombi Pro device" <- TRUE
        $"add BMK to common information" <- TRUE
        call "Read_XML_Part.gviweb"(Input XML=s2, Start XML Part="<Component-Replacement-History>", End XML Part="</Component-Replacement-History>", Error in=no error) -> (Output XML array=w370, Error out=w371)
        call "Exlude_WA_Entrys.gviweb"(Input XML array=w370, Error in=w371) -> (Without_WA_Entrys=w372, Output Error=w373)
        call "Interpret_Component_Replacement_History.gviweb"(Component Replacement History Entrys=w372, Error Cluster input=w373) -> (Component Replacement History=w374, Changed Component=w375, Error Output=w2)
        $"Component Replacement History" <- w374
        $"Changed Component" <- w375
        w3 = w369
        w4 = s2
        w5 = s3
        w6 = s4
        w7 = s5
        w8 = s6
        w9 = s7
        w10 = s8
      }
      frame "Component Replacement History iVario" {
        $"iCombi Pro device" <- FALSE
        w376 = "System OnOff History iVario"  # State
        $"add BMK to common information iVario" <- TRUE
        call "Read_XML_Part.gviweb"(Input XML=s2, Start XML Part="<Component-Replacement-History>", End XML Part="</Component-Replacement-History>", Error in=no error) -> (Output XML array=w377, Error out=w378)
        call "Exlude_WA_Entrys.gviweb"(Input XML array=w377, Error in=w378) -> (Without_WA_Entrys=w379, Output Error=w380)
        call "Interpret_Component_Replacement_History.gviweb"(Component Replacement History Entrys=w379, Error Cluster input=w380) -> (Component Replacement History=w381, Changed Component=w382, Error Output=w2)
        $"Component Replacement History iVario" <- w381
        $"Changed Component iVario" <- w382
        w3 = w376
        w4 = s2
        w5 = s3
        w6 = s4
        w7 = s5
        w8 = s6
        w9 = s7
        w10 = s8
      }
      frame "Software Version History iVario" {
        w383 = "Component Replacement History iVario"  # State
        call "Read_XML_Part.gviweb"(Input XML=s2, Start XML Part="<Software-Version-History>", End XML Part="</Software-Version-History>", Error in=no error) -> (Output XML array=w384, Error out=w385)
        call "Exlude_WA_Entrys.gviweb"(Input XML array=w384, Error in=w385) -> (Without_WA_Entrys=w386, Output Error=w387)
        call "Interpret_Software_Version_History.gviweb"(Diagnostic Service History Entrys=w386, Error Cluster input=w387) -> (Software Version History=w388, Error Output=w2)
        $"Software-Service-History_iVario" <- w388
        w3 = w383
        w4 = s2
        w5 = s3
        w6 = s4
        w7 = s5
        w8 = s6
        w9 = s7
        w10 = s8
      }
      frame "Diagnostic Service History iVario" {
        w389 = "Diagnostic Running Times Modes iVario "  # State
        call "Read_XML_Part.gviweb"(Input XML=s2, Start XML Part="<Diagnostic-Service-History>", End XML Part="</Diagnostic-Service-History>", Error in=no error) -> (Output XML array=w390, Error out=w391)
        call "Exlude_WA_Entrys.gviweb"(Input XML array=w390, Error in=w391) -> (Without_WA_Entrys=w392, Output Error=w393)
        call "Diagnostic_Service_History.gviweb"(Diagnostic Service History Entrys=w392, Device Type=s4, Error Cluster input=w393) -> (Diagnostic Service History Output=w394, Error Output=w395)
        call "Sort_Service_History_MSGs_Default.gviweb"(Diagnostic Service History input=w394, Error Cluster input=w395) -> (Diagnostic Service History output=w396, Error Output=w397)
        call "Sort_Diagnostic_Service_History_iVario.gviweb"(Error_Selektor=$Error_Selektor, Diagnostic Service History Output=w396, Input Error=w397) -> (Output=w398, Diagnostic Service History Text=w399, Output Error=w2)
        $"Diagnostic-Service-History_iVario" <- w398
        $"Diagnostic Service History Error iVario" <- w399
        w3 = w389
        w4 = s2
        w5 = s3
        w6 = s4
        w7 = s5
        w8 = s6
        w9 = s7
        w10 = s8
      }
      frame "Diagnostic Running Times Comp" {
        w400 = "System Logger"  # State
        call "Read_XML_Part.gviweb"(Input XML=s2, Start XML Part="<Diagnostic-RunningTimes-Comp>", End XML Part="</Diagnostic-RunningTimes-Comp>", Error in=no error) -> (Output XML array=w401, Error out=w402)
        call "Exlude_WA_Entrys.gviweb"(Input XML array=w401, Error in=w402) -> (Without_WA_Entrys=w403, Output Error=w404)
        call "Interpret_Diagnostic_RunningTimes_Comp.gviweb"(Diagnostic Service History Entrys=w403, Total running time=s5, Error Cluster input=w404) -> (Running Time Component Output=w405, Error Cluster output=w406)
        call "Sort_RunningTimes_Components.gviweb"(Error_Selektor=$Error_Selektor, Running Time Component Output=w405, Input Error=w406) -> (Output=w407, Diagnostic Running Time Components=w408, Output Error=w2)
        $"Diagnostic Running Times Comp" <- w407
        $"Diagnostic Running Time Components" <- w408
        w3 = w400
        w4 = s2
        w5 = s3
        w6 = s4
        w7 = s5
        w8 = s6
        w9 = s7
        w10 = s8
      }
      frame "Diagnostic Running Times Component iVario " {
        w409 = "Software Version History iVario"  # State
        call "Read_XML_Part.gviweb"(Input XML=s2, Start XML Part="<Diagnostic-RunningTimes-Comp>", End XML Part="</Diagnostic-RunningTimes-Comp>", Error in=no error) -> (Output XML array=w410, Error out=w411)
        call "Exlude_WA_Entrys.gviweb"(Input XML array=w410, Error in=w411) -> (Without_WA_Entrys=w412, Output Error=w413)
        call "Interpret_Diagnostic_RunningTimes_Comp.gviweb"(Diagnostic Service History Entrys=w412, Total running time=s5, Error Cluster input=w413) -> (Running Time Component Output=w414, Error Cluster output=w415)
        call "Sort_RunningTimes_iVario.gviweb"(Error_Selektor=$Error_Selektor, Running Time Component Output=w414, Input Error=w415) -> (Output=w416, Diagnostic Running Time Components=w417, Output Error=w2)
        $"Diagnostic Running Times Components:" <- w416
        $"Diagnostic Running Time Components_iVario" <- w417
        w3 = w409
        w4 = s2
        w5 = s3
        w6 = s4
        w7 = s5
        w8 = s6
        w9 = s7
        w10 = s8
      }
      frame "System Logger" {
        w418 = "Histogram temperature CPU"  # State
        call "Read_XML_Part.gviweb"(Input XML=s2, Start XML Part="<SystemLogger>", End XML Part="</SystemLogger>", Error in=no error) -> (Output XML array=w419, Error out=w420)
        call "Exlude_WA_Entrys.gviweb"(Input XML array=w419, Error in=w420) -> (Without_WA_Entrys=w421, Output Error=w422)
        call "Interpret_SystemLogger.gviweb"(SystemLogger Entrys=w421, Startup Date and Time=s6, Error Cluster input=w422) -> (System Logger output=w423, Error Cluster output=w424)
        call "Sort_System_Logger.gviweb"(Error_Selektor=$Error_Selektor, System Logger=w423, Input Error=w424) -> (Output=w425, System Logger_2=w426, Output Error=w2)
        $"System Logger Output" <- w425
        $"System Logger_Text" <- w426
        w3 = w418
        w4 = s2
        w5 = s3
        w6 = s4
        w7 = s5
        w8 = s6
        w9 = s7
        w10 = s8
      }
      frame "Histogram temperature CPU" {
        w427 = "Histogram temperature IO"  # State
        call "Read_XML_Part.gviweb"(Input XML=s2, Start XML Part="<Histogram_cpu_pcb_-_Temperature_profile_Celsius>", End XML Part="</Histogram_cpu_pcb_-_Temperature_profile_Celsius>", Error in=no error) -> (Output XML array=w428, Error out=w429)
        call "Exlude_WA_Entrys.gviweb"(Input XML array=w428, Error in=w429) -> (Without_WA_Entrys=w430, Output Error=w431)
        call "Interpret_Histogram_CPU_IO_Temperature.gviweb"(Histogramm Entrys=w430, Error Cluster input=w431) -> (Signal=w432, Error Output=w2)
        $"Histogram cpu pcb Temperature profile Celsius" <- w432
        w3 = w427
        w4 = s2
        w5 = s3
        w6 = s4
        w7 = s5
        w8 = s6
        w9 = s7
        w10 = s8
      }
      frame "Histogram temperature IO" {
        w433 = "Histogram temperature LED hinge"  # State
        call "Read_XML_Part.gviweb"(Input XML=s2, Start XML Part="<Histogram_IO_pcb_-_Temperature_profile_Celsius>", End XML Part="</Histogram_IO_pcb_-_Temperature_profile_Celsius>", Error in=no error) -> (Output XML array=w434, Error out=w435)
        call "Exlude_WA_Entrys.gviweb"(Input XML array=w434, Error in=w435) -> (Without_WA_Entrys=w436, Output Error=w437)
        call "Interpret_Histogram_CPU_IO_Temperature.gviweb"(Histogramm Entrys=w436, Error Cluster input=w437) -> (Signal=w438, Error Output=w2)
        Array Subset(array=w438, index0=16, length0=2) -> w439
        $"Measured_temperature IO °C [Min/Max]:" <- w439
        Array Subset(array=w438, length0=16) -> w440
        $"Histogram IO Temperature profile Celsius" <- w440
        w3 = w433
        w4 = s2
        w5 = s3
        w6 = s4
        w7 = s5
        w8 = s6
        w9 = s7
        w10 = s8
      }
      frame "Histogram temperature LED hinge" {
        w441 = "Histogram temperature LED handle"  # State
        call "Read_XML_Part.gviweb"(Input XML=s2, Start XML Part="<Histogram_LED_hinge_side_-_Temperature_profile_Celsius>", End XML Part="</Histogram_LED_hinge_side_-_Temperature_profile_Celsius>", Error in=no error) -> (Output XML array=w442, Error out=w443)
        call "Exlude_WA_Entrys.gviweb"(Input XML array=w442, Error in=w443) -> (Without_WA_Entrys=w444, Output Error=w445)
        call "Interpret_Histogram_CPU_IO_Temperature.gviweb"(Histogramm Entrys=w444, Error Cluster input=w445) -> (Signal=w446, Error Output=w2)
        $"Histogram LED hinge side Temperature profile Celsius" <- w446
        w3 = w441
        w4 = s2
        w5 = s3
        w6 = s4
        w7 = s5
        w8 = s6
        w9 = s7
        w10 = s8
      }
      frame "Histogram temperature LED handle" {
        w447 = "Histogram temperature pump pcb"  # State
        call "Read_XML_Part.gviweb"(Input XML=s2, Start XML Part="<Histogram_LED_handle_side_-_Temperature_profile_Celsius>", End XML Part="</Histogram_LED_handle_side_-_Temperature_profile_Celsius>", Error in=no error) -> (Output XML array=w448, Error out=w449)
        call "Exlude_WA_Entrys.gviweb"(Input XML array=w448, Error in=w449) -> (Without_WA_Entrys=w450, Output Error=w451)
        call "Interpret_Histogram_CPU_IO_Temperature.gviweb"(Histogramm Entrys=w450, Error Cluster input=w451) -> (Signal=w452, Error Output=w2)
        $"Histogram LED handle side Temperature profile Celsius" <- w452
        w3 = w447
        w4 = s2
        w5 = s3
        w6 = s4
        w7 = s5
        w8 = s6
        w9 = s7
        w10 = s8
      }
      frame "Histogram temperature pump pcb" {
        w453 = "Histogram temperature Gas Box"  # State
        call "Read_XML_Part.gviweb"(Input XML=s2, Start XML Part="<Histogram_pump_pcb_-_Temperature_profile_Celsius>", End XML Part="</Histogram_pump_pcb_-_Temperature_profile_Celsius>", Error in=no error) -> (Output XML array=w454, Error out=w455)
        call "Exlude_WA_Entrys.gviweb"(Input XML array=w454, Error in=w455) -> (Without_WA_Entrys=w456, Output Error=w457)
        call "Interpret_Histogram_CPU_IO_Temperature.gviweb"(Histogramm Entrys=w456, Error Cluster input=w457) -> (Signal=w458, Error Output=w2)
        $"Histogram pump pcb Temperature profile Celsius" <- w458
        w3 = w453
        w4 = s2
        w5 = s3
        w6 = s4
        w7 = s5
        w8 = s6
        w9 = s7
        w10 = s8
      }
      frame "Histogram temperature Gas Box" {
        w459 = "Histogram Fan 1 RPM"  # State
        call "Read_XML_Part.gviweb"(Input XML=s2, Start XML Part="<Histogram_gas_box_-_Temperature_profile_Celsius>", End XML Part="</Histogram_gas_box_-_Temperature_profile_Celsius>", Error in=no error) -> (Output XML array=w460, Error out=w461)
        call "Exlude_WA_Entrys.gviweb"(Input XML array=w460, Error in=w461) -> (Without_WA_Entrys=w462, Output Error=w463)
        call "Interpret_Histogram_CPU_IO_Temperature.gviweb"(Histogramm Entrys=w462, Error Cluster input=w463) -> (Signal=w464, Error Output=w2)
        $"Histogram gas box Temperature profile Celsius" <- w464
        w3 = w459
        w4 = s2
        w5 = s3
        w6 = s4
        w7 = s5
        w8 = s6
        w9 = s7
        w10 = s8
      }
      frame "Histogram Fan 1 RPM" {
        w465 = "Histogram Fan 1 Power"  # State
        call "Read_XML_Part.gviweb"(Input XML=s2, Start XML Part="<Histogram_fan_1_-_RPM_profile_1_min>", End XML Part="</Histogram_fan_1_-_RPM_profile_1_min>", Error in=no error) -> (Output XML array=w466, Error out=w467)
        call "Exlude_WA_Entrys.gviweb"(Input XML array=w466, Error in=w467) -> (Without_WA_Entrys=w468, Output Error=w469)
        call "Interpret_Histogram_CPU_IO_Temperature.gviweb"(Histogramm Entrys=w468, Error Cluster input=w469) -> (Signal=w470, Error Output=w2)
        $"Histogram fan 1 RPM profile 1 min" <- w470
        w3 = w465
        w4 = s2
        w5 = s3
        w6 = s4
        w7 = s5
        w8 = s6
        w9 = s7
        w10 = s8
      }
      frame "Update Tab View" {
        call "Trim Whitespace.gvi"(string=$"Common Information_Error") -> (trimmed string=w471)
        call "Trim Whitespace.gvi"(string=$Basic_Settings_Error) -> (trimmed string=w472)
        call "Trim Whitespace.gvi"(string=$"Diagnostic Real Time Data Sensors") -> (trimmed string=w473)
        call "Trim Whitespace.gvi"(string=$"Diagnostic RT Calibration_Text") -> (trimmed string=w474)
        call "Trim Whitespace.gvi"(string=$"Diagnostic Water iCS Switch Text") -> (trimmed string=w475)
        call "Trim Whitespace.gvi"(string=$"Diagnostic Service History Text") -> (trimmed string=w476)
        call "Trim Whitespace.gvi"(string=$"Diagnostic Running Time Components") -> (trimmed string=w477)
        call "Trim Whitespace.gvi"(string=$"Diagnostic RunningTimes mode") -> (trimmed string=w478)
        call "Trim Whitespace.gvi"(string=$"System Logger_Text") -> (trimmed string=w479)
        call "Trim Whitespace.gvi"(string=$"Common Information_Error_iVario") -> (trimmed string=w480)
        call "Trim Whitespace.gvi"(string=$Basic_Settings_Error_iVario) -> (trimmed string=w481)
        call "Trim Whitespace.gvi"(string=$"Diagnostic RT Data Sensors Heating") -> (trimmed string=w482)
        call "Trim Whitespace.gvi"(string=$"Diagnostic RT Data sensors movement") -> (trimmed string=w483)
        call "Trim Whitespace.gvi"(string=$Diagnostic_RT_Data_Sensors_Pressure_error) -> (trimmed string=w484)
        call "Trim Whitespace.gvi"(string=$"Diagnostic Service History Error iVario") -> (trimmed string=w485)
        call "Trim Whitespace.gvi"(string=$"Diagnostic Running Time Components_iVario") -> (trimmed string=w486)
        Concatenate Strings("ℹ (Tab with errors):", ";", w471, ";", w472, ";", w473, ";", w474, ";", w475, ";", w476, ";", w477, ";", w478, ";", w479, ";", w480, ";", w481, ";", w482, ";", w483, ";", w484, ";", w485, ";", w486) -> w487
        call "Trim Whitespace.gvi"(string=w487) -> (trimmed string=w488)
        call "Search and Replace Pattern.gvi"(string=w488, pattern=";;", replace string=";", replace all=TRUE) -> (result string=w489)
        call "Search and Replace Pattern.gvi"(string=w489, pattern=";", replace string="\r\n", replace all=TRUE) -> (result string=w490)
        Is Empty String Or Path(string/path=w490) -> w491
        case (w491) {
          frame False {
            w492 = w490
          }
          frame True {
            w492 = "No errors were found !"
          }
        }
        $"Tabs with errors" <- w492
        w493 = "Wait For Interaction"  # State
        Property Node(instance in=reference to "Tabs with errors", "Visible"=TRUE, error in=no error) -> (error out=w494, instance out=w495)
        Close Reference(error in=w494, reference=w495) -> (error out=w2)
        w3 = w493
        w4 = s2
        w5 = s3
        w6 = s4
        w7 = s5
        w8 = s6
        w9 = s7
        w10 = s8
      }
      frame "Histogram Fan 1 Power" {
        w496 = "Histogram Fan 1 Temperature"  # State
        call "Read_XML_Part.gviweb"(Input XML=s2, Start XML Part="<Histogram_fan_1_-_power_profile_W>", End XML Part="</Histogram_fan_1_-_power_profile_W>", Error in=no error) -> (Output XML array=w497, Error out=w498)
        call "Exlude_WA_Entrys.gviweb"(Input XML array=w497, Error in=w498) -> (Without_WA_Entrys=w499, Output Error=w500)
        call "Interpret_Histogram_CPU_IO_Temperature.gviweb"(Histogramm Entrys=w499, Error Cluster input=w500) -> (Signal=w501, Error Output=w2)
        $"Histogram fan 1 power profile W" <- w501
        w3 = w496
        w4 = s2
        w5 = s3
        w6 = s4
        w7 = s5
        w8 = s6
        w9 = s7
        w10 = s8
      }
      frame "Histogram Fan 1 Temperature" {
        w502 = "Histogram Fan 1 Voltage min"  # State
        call "Read_XML_Part.gviweb"(Input XML=s2, Start XML Part="<Histogram_fan_1_-_Temperature_profile_Celsius>", End XML Part="</Histogram_fan_1_-_Temperature_profile_Celsius>", Error in=no error) -> (Output XML array=w503, Error out=w504)
        call "Exlude_WA_Entrys.gviweb"(Input XML array=w503, Error in=w504) -> (Without_WA_Entrys=w505, Output Error=w506)
        call "Interpret_Histogram_CPU_IO_Temperature.gviweb"(Histogramm Entrys=w505, Error Cluster input=w506) -> (Signal=w507, Error Output=w2)
        $"Histogram fan 1 Temperature_profile Celsius" <- w507
        w3 = w502
        w4 = s2
        w5 = s3
        w6 = s4
        w7 = s5
        w8 = s6
        w9 = s7
        w10 = s8
      }
      frame "Histogram Fan 1 Voltage min" {
        w508 = "Histogram Fan 1 Voltage max"  # State
        call "Read_XML_Part.gviweb"(Input XML=s2, Start XML Part="<Histogram_fan_1_-_Voltage_min_V_-_1phase_3phase>", End XML Part="</Histogram_fan_1_-_Voltage_min_V_-_1phase_3phase>", Error in=no error) -> (Output XML array=w509, Error out=w510)
        call "Exlude_WA_Entrys.gviweb"(Input XML array=w509, Error in=w510) -> (Without_WA_Entrys=w511, Output Error=w512)
        call "Interpret_Histogram_CPU_IO_Temperature.gviweb"(Histogramm Entrys=w511, Error Cluster input=w512) -> (Signal=w513, Error Output=w2)
        $"Histogram fan 1 Voltage min_V_1phase_3phase" <- w513
        w3 = w508
        w4 = s2
        w5 = s3
        w6 = s4
        w7 = s5
        w8 = s6
        w9 = s7
        w10 = s8
      }
      frame "Histogram Fan 1 Voltage max" {
        w514 = "Histogram Fan 2 RPM"  # State
        call "Read_XML_Part.gviweb"(Input XML=s2, Start XML Part="<Histogram_fan_1_-_Voltage_min_V_-_1phase_3phase>", End XML Part="</Histogram_fan_1_-_Voltage_min_V_-_1phase_3phase>", Error in=no error) -> (Output XML array=w515, Error out=w516)
        call "Exlude_WA_Entrys.gviweb"(Input XML array=w515, Error in=w516) -> (Without_WA_Entrys=w517, Output Error=w518)
        call "Interpret_Histogram_CPU_IO_Temperature.gviweb"(Histogramm Entrys=w517, Error Cluster input=w518) -> (Signal=w519, Error Output=w2)
        $"Histogram fan 1 Voltage max_V_1phase_3phase" <- w519
        w3 = w514
        w4 = s2
        w5 = s3
        w6 = s4
        w7 = s5
        w8 = s6
        w9 = s7
        w10 = s8
      }
      frame "Histogram Fan 2 RPM" {
        w520 = "Histogram Fan 2 Power"  # State
        call "Read_XML_Part.gviweb"(Input XML=s2, Start XML Part="<Histogram_fan_2_-_RPM_profile_1_min>", End XML Part="</Histogram_fan_2_-_RPM_profile_1_min>", Error in=no error) -> (Output XML array=w521, Error out=w522)
        call "Exlude_WA_Entrys.gviweb"(Input XML array=w521, Error in=w522) -> (Without_WA_Entrys=w523, Output Error=w524)
        call "Interpret_Histogram_CPU_IO_Temperature.gviweb"(Histogramm Entrys=w523, Error Cluster input=w524) -> (Signal=w525, Error Output=w2)
        $"Histogram fan 2 RPM profile 1 min" <- w525
        w3 = w520
        w4 = s2
        w5 = s3
        w6 = s4
        w7 = s5
        w8 = s6
        w9 = s7
        w10 = s8
      }
      frame "Histogram Fan 2 Power" {
        w526 = "Histogram Fan 2 Temperature"  # State
        call "Read_XML_Part.gviweb"(Input XML=s2, Start XML Part="<Histogram_fan_2_-_power_profile_W>", End XML Part="</Histogram_fan_2_-_power_profile_W>", Error in=no error) -> (Output XML array=w527, Error out=w528)
        call "Exlude_WA_Entrys.gviweb"(Input XML array=w527, Error in=w528) -> (Without_WA_Entrys=w529, Output Error=w530)
        call "Interpret_Histogram_CPU_IO_Temperature.gviweb"(Histogramm Entrys=w529, Error Cluster input=w530) -> (Signal=w531, Error Output=w2)
        $"Histogram fan 2 power profile W" <- w531
        w3 = w526
        w4 = s2
        w5 = s3
        w6 = s4
        w7 = s5
        w8 = s6
        w9 = s7
        w10 = s8
      }
      frame "Histogram Fan 2 Temperature" {
        w532 = "Histogram Fan 2 Voltage min"  # State
        call "Read_XML_Part.gviweb"(Input XML=s2, Start XML Part="<Histogram_fan_2_-_Temperature_profile_Celsius>", End XML Part="</Histogram_fan_2_-_Temperature_profile_Celsius>", Error in=no error) -> (Output XML array=w533, Error out=w534)
        call "Exlude_WA_Entrys.gviweb"(Input XML array=w533, Error in=w534) -> (Without_WA_Entrys=w535, Output Error=w536)
        call "Interpret_Histogram_CPU_IO_Temperature.gviweb"(Histogramm Entrys=w535, Error Cluster input=w536) -> (Signal=w537, Error Output=w2)
        $"Histogram fan 2 Temperature_profile Celsius" <- w537
        w3 = w532
        w4 = s2
        w5 = s3
        w6 = s4
        w7 = s5
        w8 = s6
        w9 = s7
        w10 = s8
      }
      frame "Histogram Fan 2 Voltage min" {
        w538 = "Histogram Fan 2 Voltage max"  # State
        call "Read_XML_Part.gviweb"(Input XML=s2, Start XML Part="<Histogram_fan_2_-_Voltage_min_V_-_1phase_3phase>", End XML Part="</Histogram_fan_2_-_Voltage_min_V_-_1phase_3phase>", Error in=no error) -> (Output XML array=w539, Error out=w540)
        call "Exlude_WA_Entrys.gviweb"(Input XML array=w539, Error in=w540) -> (Without_WA_Entrys=w541, Output Error=w542)
        call "Interpret_Histogram_CPU_IO_Temperature.gviweb"(Histogramm Entrys=w541, Error Cluster input=w542) -> (Signal=w543, Error Output=w2)
        $"Histogram fan 2 Voltage min_V_1phase_3phase" <- w543
        w3 = w538
        w4 = s2
        w5 = s3
        w6 = s4
        w7 = s5
        w8 = s6
        w9 = s7
        w10 = s8
      }
      frame "Histogram Fan 2 Voltage max" {
        w544 = "Histogram Fan 3 RPM"  # State
        call "Read_XML_Part.gviweb"(Input XML=s2, Start XML Part="<Histogram_fan_2_-_Voltage_max_V_-_1phase_3phase>", End XML Part="</Histogram_fan_2_-_Voltage_max_V_-_1phase_3phase>", Error in=no error) -> (Output XML array=w545, Error out=w546)
        call "Exlude_WA_Entrys.gviweb"(Input XML array=w545, Error in=w546) -> (Without_WA_Entrys=w547, Output Error=w548)
        call "Interpret_Histogram_CPU_IO_Temperature.gviweb"(Histogramm Entrys=w547, Error Cluster input=w548) -> (Signal=w549, Error Output=w2)
        $"Histogram fan 2 Voltage max_V_1phase_3phase" <- w549
        w3 = w544
        w4 = s2
        w5 = s3
        w6 = s4
        w7 = s5
        w8 = s6
        w9 = s7
        w10 = s8
      }
      frame "Histogram Fan 3 RPM" {
        w550 = "Histogram Fan 3 Power"  # State
        call "Read_XML_Part.gviweb"(Input XML=s2, Start XML Part="<Histogram_fan_3_-_RPM_profile_1_min>", End XML Part="</Histogram_fan_3_-_RPM_profile_1_min>", Error in=no error) -> (Output XML array=w551, Error out=w552)
        call "Exlude_WA_Entrys.gviweb"(Input XML array=w551, Error in=w552) -> (Without_WA_Entrys=w553, Output Error=w554)
        call "Interpret_Histogram_CPU_IO_Temperature.gviweb"(Histogramm Entrys=w553, Error Cluster input=w554) -> (Signal=w555, Error Output=w2)
        $"Histogram fan 3 RPM profile 1 min" <- w555
        w3 = w550
        w4 = s2
        w5 = s3
        w6 = s4
        w7 = s5
        w8 = s6
        w9 = s7
        w10 = s8
      }
      frame "Histogram Fan 3 Power" {
        w556 = "Histogram Fan 3 Temperature"  # State
        call "Read_XML_Part.gviweb"(Input XML=s2, Start XML Part="<Histogram_fan_3_-_power_profile_W>", End XML Part="</Histogram_fan_3_-_power_profile_W>", Error in=no error) -> (Output XML array=w557, Error out=w558)
        call "Exlude_WA_Entrys.gviweb"(Input XML array=w557, Error in=w558) -> (Without_WA_Entrys=w559, Output Error=w560)
        call "Interpret_Histogram_CPU_IO_Temperature.gviweb"(Histogramm Entrys=w559, Error Cluster input=w560) -> (Signal=w561, Error Output=w2)
        $"Histogram fan 3 power profile W" <- w561
        w3 = w556
        w4 = s2
        w5 = s3
        w6 = s4
        w7 = s5
        w8 = s6
        w9 = s7
        w10 = s8
      }
      frame "Histogram Fan 3 Temperature" {
        w562 = "Histogram Fan 3 Voltage min"  # State
        call "Read_XML_Part.gviweb"(Input XML=s2, Start XML Part="<Histogram_fan_3_-_Temperature_profile_Celsius>", End XML Part="</Histogram_fan_3_-_Temperature_profile_Celsius>", Error in=no error) -> (Output XML array=w563, Error out=w564)
        call "Exlude_WA_Entrys.gviweb"(Input XML array=w563, Error in=w564) -> (Without_WA_Entrys=w565, Output Error=w566)
        call "Interpret_Histogram_CPU_IO_Temperature.gviweb"(Histogramm Entrys=w565, Error Cluster input=w566) -> (Signal=w567, Error Output=w2)
        $"Histogram fan 3 Temperature_profile Celsius" <- w567
        w3 = w562
        w4 = s2
        w5 = s3
        w6 = s4
        w7 = s5
        w8 = s6
        w9 = s7
        w10 = s8
      }
      frame "Histogram Fan 3 Voltage min" {
        w568 = "Histogram Fan 3 Voltage max"  # State
        call "Read_XML_Part.gviweb"(Input XML=s2, Start XML Part="<Histogram_fan_3_-_Voltage_min_V_-_1phase_3phase>", End XML Part="</Histogram_fan_3_-_Voltage_min_V_-_1phase_3phase>", Error in=no error) -> (Output XML array=w569, Error out=w570)
        call "Exlude_WA_Entrys.gviweb"(Input XML array=w569, Error in=w570) -> (Without_WA_Entrys=w571, Output Error=w572)
        call "Interpret_Histogram_CPU_IO_Temperature.gviweb"(Histogramm Entrys=w571, Error Cluster input=w572) -> (Signal=w573, Error Output=w2)
        $"Histogram fan 3 Voltage min_V_1phase_3phase" <- w573
        w3 = w568
        w4 = s2
        w5 = s3
        w6 = s4
        w7 = s5
        w8 = s6
        w9 = s7
        w10 = s8
      }
      frame "Histogram Fan 3 Voltage max" {
        w574 = "Histogram MMI CPU Load"  # State
        call "Read_XML_Part.gviweb"(Input XML=s2, Start XML Part="<Histogram_fan_3_-_Voltage_max_V_-_1phase_3phase>", End XML Part="</Histogram_fan_3_-_Voltage_max_V_-_1phase_3phase>", Error in=no error) -> (Output XML array=w575, Error out=w576)
        call "Exlude_WA_Entrys.gviweb"(Input XML array=w575, Error in=w576) -> (Without_WA_Entrys=w577, Output Error=w578)
        call "Interpret_Histogram_CPU_IO_Temperature.gviweb"(Histogramm Entrys=w577, Error Cluster input=w578) -> (Signal=w579, Error Output=w2)
        $"Histogram fan 3 Voltage max_V_1phase_3phase" <- w579
        w3 = w574
        w4 = s2
        w5 = s3
        w6 = s4
        w7 = s5
        w8 = s6
        w9 = s7
        w10 = s8
      }
      frame "Histogram MMI CPU Load" {
        w580 = "Histogram MMI RAM Load"  # State
        call "Read_XML_Part.gviweb"(Input XML=s2, Start XML Part="<Histogram_-_MMI_CPU_Load_Percent>", End XML Part="</Histogram_-_MMI_CPU_Load_Percent>", Error in=no error) -> (Output XML array=w581, Error out=w582)
        call "Exlude_WA_Entrys.gviweb"(Input XML array=w581, Error in=w582) -> (Without_WA_Entrys=w583, Output Error=w584)
        call "Interpret_Histogram_CPU_IO_Temperature.gviweb"(Histogramm Entrys=w583, Error Cluster input=w584) -> (Signal=w585, Error Output=w2)
        $"Histogram MMI CPU Load Percent" <- w585
        w3 = w580
        w4 = s2
        w5 = s3
        w6 = s4
        w7 = s5
        w8 = s6
        w9 = s7
        w10 = s8
      }
      frame "Histogram MMI RAM Load" {
        w586 = "Histogram Basis CPU Load"  # State
        call "Read_XML_Part.gviweb"(Input XML=s2, Start XML Part="<Histogram_-_MMI_RAM_Load_Percent>", End XML Part="</Histogram_-_MMI_RAM_Load_Percent>", Error in=no error) -> (Output XML array=w587, Error out=w588)
        call "Exlude_WA_Entrys.gviweb"(Input XML array=w587, Error in=w588) -> (Without_WA_Entrys=w589, Output Error=w590)
        call "Interpret_Histogram_CPU_IO_Temperature.gviweb"(Histogramm Entrys=w589, Error Cluster input=w590) -> (Signal=w591, Error Output=w2)
        $"Histogram MMI RAM Load Percent" <- w591
        w3 = w586
        w4 = s2
        w5 = s3
        w6 = s4
        w7 = s5
        w8 = s6
        w9 = s7
        w10 = s8
      }
      frame "Histogram Basis CPU Load" {
        w592 = "Histogram Basis RAM Load"  # State
        call "Read_XML_Part.gviweb"(Input XML=s2, Start XML Part="<Histogram_-_Basis_CPU_Load_Percent>", End XML Part="</Histogram_-_Basis_CPU_Load_Percent>", Error in=no error) -> (Output XML array=w593, Error out=w594)
        call "Exlude_WA_Entrys.gviweb"(Input XML array=w593, Error in=w594) -> (Without_WA_Entrys=w595, Output Error=w596)
        call "Interpret_Histogram_CPU_IO_Temperature.gviweb"(Histogramm Entrys=w595, Error Cluster input=w596) -> (Signal=w597, Error Output=w2)
        $"Histogram Basis CPU Load Percent" <- w597
        w3 = w592
        w4 = s2
        w5 = s3
        w6 = s4
        w7 = s5
        w8 = s6
        w9 = s7
        w10 = s8
      }
      frame "Histogram Basis RAM Load" {
        w598 = "Histogram Magnetron Top Temperature"  # State
        call "Read_XML_Part.gviweb"(Input XML=s2, Start XML Part="<Histogram_-_Basis_RAM_Load_Percent>", End XML Part="</Histogram_-_Basis_RAM_Load_Percent>", Error in=no error) -> (Output XML array=w599, Error out=w600)
        call "Exlude_WA_Entrys.gviweb"(Input XML array=w599, Error in=w600) -> (Without_WA_Entrys=w601, Output Error=w602)
        call "Interpret_Histogram_CPU_IO_Temperature.gviweb"(Histogramm Entrys=w601, Error Cluster input=w602) -> (Signal=w603, Error Output=w2)
        $"Histogram Basis RAM Load Percent" <- w603
        w3 = w598
        w4 = s2
        w5 = s3
        w6 = s4
        w7 = s5
        w8 = s6
        w9 = s7
        w10 = s8
      }
      frame "Histogram Magnetron Top Temperature" {
        w604 = "Histogram Magnetron bottomTemperature"  # State
        call "Read_XML_Part.gviweb"(Input XML=s2, Start XML Part="<Histogram_Magnetron_Top_Temperature_profile_Celsius>", End XML Part="</Histogram_Magnetron_Top_Temperature_profile_Celsius>", Error in=no error) -> (Output XML array=w605, Error out=w606)
        call "Exlude_WA_Entrys.gviweb"(Input XML array=w605, Error in=w606) -> (Without_WA_Entrys=w607, Output Error=w608)
        call "Interpret_Histogram_CPU_IO_Temperature.gviweb"(Histogramm Entrys=w607, Error Cluster input=w608) -> (Signal=w609, Error Output=w2)
        $"Histogram Magnetron Top Temperatur profile Celsius" <- w609
        w3 = w604
        w4 = s2
        w5 = s3
        w6 = s4
        w7 = s5
        w8 = s6
        w9 = s7
        w10 = s8
      }
      frame "Histogram Magnetron bottomTemperature" {
        w610 = "Histogram Power Supply Top Temperature"  # State
        call "Read_XML_Part.gviweb"(Input XML=s2, Start XML Part="<Histogram_Magnetron_bottom_Temperature_profile_Celsius>", End XML Part="</Histogram_Magnetron_bottom_Temperature_profile_Celsius>", Error in=no error) -> (Output XML array=w611, Error out=w612)
        call "Exlude_WA_Entrys.gviweb"(Input XML array=w611, Error in=w612) -> (Without_WA_Entrys=w613, Output Error=w614)
        call "Interpret_Histogram_CPU_IO_Temperature.gviweb"(Histogramm Entrys=w613, Error Cluster input=w614) -> (Signal=w615, Error Output=w2)
        $"Histogram Magnetron bottom Temperature profile Celsius" <- w615
        w3 = w610
        w4 = s2
        w5 = s3
        w6 = s4
        w7 = s5
        w8 = s6
        w9 = s7
        w10 = s8
      }
      frame "Histogram Power Supply Top Temperature" {
        w616 = "Histogram Power Supply bottom Temperature"  # State
        w617 = "</Histogram_Microwave_Power_Supply_Top_Temperature_profile_Celsius>"
        # New part name
        w618 = "<Histogram_Microwave_Power_Supply_Top_Temperature_profile_Celsius>"
        # old part name
        call "Read_XML_Part.gviweb"(Input XML=s2, Start XML Part="<Histogram_Power_Supply_Top_Temperature_profile_Celsius>", End XML Part="</Histogram_Power_Supply_Top_Temperature_profile_Celsius>", Error in=no error) -> (Output XML array=w619, Error out=w620)
        Is Empty Array(array=w619) -> w621
        case (w621) {
          frame False, Default {
            w622 = w620
            w623 = w619
          }
          frame True {
            call "Read_XML_Part.gviweb"(Input XML=s2, Start XML Part=w618, End XML Part=w617, Error in=w620) -> (Output XML array=w623, Error out=w622)
          }
        }
        call "Exlude_WA_Entrys.gviweb"(Input XML array=w623, Error in=w622) -> (Without_WA_Entrys=w624, Output Error=w625)
        call "Interpret_Histogram_CPU_IO_Temperature.gviweb"(Histogramm Entrys=w624, Error Cluster input=w625) -> (Signal=w626, Error Output=w2)
        $"Histogram Power Supply Top Temperature profile Celsius" <- w626
        w3 = w616
        w4 = s2
        w5 = s3
        w6 = s4
        w7 = s5
        w8 = s6
        w9 = s7
        w10 = s8
      }
      frame "Histogram Power Supply bottom Temperature" {
        w627 = "Software Version History"  # State
        w628 = "</Histogram_Microwave_Power_Supply_bottom_Temperature_profile_Celsius>"
        w629 = "<Histogram_Microwave_Power_Supply_bottom_Temperature_profile_Celsius>"
        w630 = "</Histogram_Power_Supply_bottom_Temperature_profile_Celsius>"
        w631 = "<Histogram_Power_Supply_bottom_Temperature_profile_Celsius>"
        call "Read_XML_Part.gviweb"(Input XML=s2, Start XML Part=w631, End XML Part=w630, Error in=no error) -> (Output XML array=w632, Error out=w633)
        Is Empty Array(array=w632) -> w634
        case (w634) {
          frame False, Default {
            w635 = w633
            w636 = w632
          }
          frame True {
            call "Read_XML_Part.gviweb"(Input XML=s2, Start XML Part=w629, End XML Part=w628, Error in=w633) -> (Output XML array=w636, Error out=w635)
          }
        }
        call "Exlude_WA_Entrys.gviweb"(Input XML array=w636, Error in=w635) -> (Without_WA_Entrys=w637, Output Error=w638)
        call "Interpret_Histogram_CPU_IO_Temperature.gviweb"(Histogramm Entrys=w637, Error Cluster input=w638) -> (Signal=w639, Error Output=w2)
        $"Histogram Power Supply bottom Temperature profile Celsius" <- w639
        w3 = w627
        w4 = s2
        w5 = s3
        w6 = s4
        w7 = s5
        w8 = s6
        w9 = s7
        w10 = s8
      }
      frame "Diagnostic Running Times Modes" {
        w640 = "Diagnostic Running Times Comp"  # State
        call "Read_XML_Part.gviweb"(Input XML=s2, Start XML Part="<Diagnostic-RunningTimes-Modes>", End XML Part="</Diagnostic-RunningTimes-Modes>", Error in=no error) -> (Output XML array=w641, Error out=w642)
        call "Exlude_WA_Entrys.gviweb"(Input XML array=w641, Error in=w642) -> (Without_WA_Entrys=w643, Output Error=w644)
        call "Interpret_Diagnostic_RunningTimes_Modes.gviweb"(Diagnostic Service History Entrys=w643, Error Cluster input=w644) -> (Diagnostic Running Time Modes Output=w645, Total running time=w7, Only Total running Time:=w646, Error Cluster output=w647)
        call "Sort_Diagnostic_RunningTimes_Modes.gviweb"(Error_Selektor=$Error_Selektor, Diagnostic Running Time Modes=w645, Input Error=w647) -> (Output=w648, Diagnostic Running Time Components=w649, Output Error=w2)
        $"Diagnostic Running Times Modes" <- w648
        $"Diagnostic RunningTimes mode" <- w649
        $"Total Running Time :" <- w646
        w3 = w640
        w4 = s2
        w5 = s3
        w6 = s4
        w8 = s6
        w9 = s7
        w10 = s8
      }
      frame "Diagnostic Running Times Modes iVario " {
        w650 = "Diagnostic Running Times Component iVario "  # State
        call "Read_XML_Part.gviweb"(Input XML=s2, Start XML Part="<Diagnostic-RunningTimes-Modes>", End XML Part="</Diagnostic-RunningTimes-Modes>", Error in=no error) -> (Output XML array=w651, Error out=w652)
        call "Exlude_WA_Entrys.gviweb"(Input XML array=w651, Error in=w652) -> (Without_WA_Entrys=w653, Output Error=w654)
        call "Interpret_Diagnostic_RunningTimes_Modes.gviweb"(Diagnostic Service History Entrys=w653, Error Cluster input=w654) -> (Total running time=w7, Only Total running Time:=w655, Error Cluster output=w2)
        $"Total Running Time:" <- w655
        w3 = w650
        w4 = s2
        w5 = s3
        w6 = s4
        w8 = s6
        w9 = s7
        w10 = s8
      }
    }
    next s1 = w3
    next s2 = w4
    next s3 = w5
    next s4 = w6
    next s5 = w7
    next s6 = w8
    next s7 = w9
    next s8 = w10
    stop if FALSE
  }
