vi "Check_XML_Device.gviweb"   [G Web Development Software 22.3.0]
inputs:
  "Error Input": error
  "XML Content": string
  "First Check": string = "Pan"
  "Second Check": string
  "Sous-Fix": string = "Pan"
  "XML Name": string = "Pan"
outputs:
  "Error Output": error
  "XML fine ?": bool
diagram:
  Match Pattern(regular expression=$"Sous-Fix", string=$"XML Name") -> (match substring=w1)
  Is Equal(x=w1, y=$"Sous-Fix") -> w2
  case (w2) {
    frame True {
      w3 = TRUE
    }
    frame False {
      Match Pattern(regular expression=$"First Check", string=$"XML Content") -> (match substring=w4)
      Is Equal(x=w4, y=$"First Check") -> w5
      case (w5) {
        frame False, Default {
          Match Pattern(regular expression=$"Second Check", string=$"XML Content") -> (match substring=w6)
          Is Equal(x=w6, y=$"Second Check") -> w7
          case (w7) {
            frame False, Default {
              w3 = FALSE
            }
            frame True {
              w3 = w7
            }
          }
        }
        frame True {
          w3 = w5
        }
      }
    }
  }
  $"XML fine ?" <- w3
  $"Error Output" <- $"Error Input"
